# Grasshopper definition Adaptive comfort.gh (Grasshopper 1.0.8)
# Copyright: 2017
# plug-ins: Heteroptera, Pufferfish, MetaHopper, Wallacei, Kangaroo2 Components

number_slider = Slider(3, range=0..10)
number_slider_2 = Slider(4.8, range=0..10)
number_slider_3 = Slider(11, range=3..15)

# ----
# EPW FILE
# General input
epw_file_path_barcelona = Panel("https://climate.onebuilding.org/WMO_Region_1_Africa/EGY_Egypt/QH_Al_Qahirah_Cairo/EGY_QH_Cairo.Intl.AP.623660_TMYx.zip")
epw_filepath = Data(epw_file_path_barcelona)

rectangle = Rectangle(Plane=PlaneXY(0, 0, 0), XSize=Slider(15, range=0..100), YSize=Slider(10, range=0..10), Radius=0)  # -> Rectangle, Length
isotrim = Isotrim(Surface=rectangle.Rectangle)
division = Division(A=number_slider_3, B=5)

# ----
# Weather file
epw_filepath_2 = Data(epw_filepath)
# Room Related
downloadepw = LBDownloadWeather(weather_URL=epw_filepath_2)  # -> epw_file, stat_file, ddy_file; plug-in component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

number_slider_4 = Slider(2, range=0..10)

pt = Point(Point(-2.722291582, 0.2658342869, 0))
northarrow = Ladybug_North(centerPt=pt, scale=Slider(0.1, range=0..0.1))  # -> northSign; plug-in component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

hb_building_programs = HBBuildingPrograms({"LargeOffice", "MediumOffice", "SmallOffice", "MidriseApartment", "HighriseApartment", "Retail", "StripMall", "PrimarySchool", "SecondarySchool", "SmallHotel", "LargeHotel", "Hospital", "Outpatient", "Laboratory", "Warehouse", "SuperMarket", "FullServiceRestaurant", "QuickServiceRestaurant", "Courthouse", "LargeDataCenterHighITE", "LargeDataCenterLowITE", "SmallDataCenterHighITE", "SmallDataCenterLowITE"}, selected="LargeOffice")

# ----
# Set Up ROOM or ZONE
number_slider_5 = Slider(5, range=3..10)
number_slider_6 = Slider(3, range=0..10)
domain_box = DomainBox(Base=PlaneXY(0, 0, 0), X=number_slider_3, Y=number_slider_5, Z=number_slider_6)
roomsolid = HBRoomFromSolid(geo=flatten(domain_box), program=hb_building_programs, conditioned=True)  # -> out, rooms; plug-in component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

deconstruct_brep = DeconstructBrep(Brep=domain_box)  # -> Faces, Edges, Vertices
list_item = ListItem(List=deconstruct_brep.Faces, Index=Slider(4, range=0..6), Wrap=True)
curve = Curve(list_item)
explode = Explode(Curve=curve, Recursive=True)  # -> Segments, Vertices
division_2 = Division(A=number_slider_5, B=5)
center = Center(Geometry=domain_box)  # -> Center, Dimension
division_3 = Division(A=number_slider_6, B=2)
removeduplicatepts = RemoveDuplicatePts(Points=explode.Vertices, Tolerance=0.01)
center_box = CenterBox(Base=center.Center, X=division_2, Y=division, Z=division_3)
xy_plane = XYPlane(Origin=removeduplicatepts)
scale_nu = ScaleNU(Geometry=domain_box, Plane=xy_plane, ScaleX=Slider(0.5, range=0..1), ScaleY=Slider(0.5, range=0..1), ScaleZ=1)  # -> Geometry, Transform
solid_difference = SolidDifference(BrepsA=scale_nu.Geometry, BrepsB=center_box)
roomsolid_2 = HBRoomFromSolid(geo=flatten(center_box), program=hb_building_programs, conditioned=True)  # -> out, rooms; plug-in component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
boolean_toggle = BooleanToggle(True)
roomsolid_3 = HBRoomFromSolid(geo=flatten(solid_difference), program=hb_building_programs, conditioned=True)  # -> out, rooms; plug-in component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
face = HBFace()  # -> out, faces; plug-in component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
importstat = LBImportSTAT(stat_file=downloadepw.stat_file)  # -> location, ashrae_zone, koppen_zone, clear_dir_norm_rad, clear_diff_horiz_rad, ann_heat_dday_996, ann_heat_dday_990, ann_cool_dday_004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; plug-in component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
vizquick = HBVisualizeQuick(hb_objs=flatten([roomsolid_3.rooms, roomsolid_2.rooms]))  # -> geo; plug-in component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
intsolid = HBIntersectSolids(rooms=flatten([roomsolid_3.rooms, roomsolid_2.rooms]), run=boolean_toggle)  # -> int_rooms; plug-in component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

# ----
# Opening Parameters
horizontal_spacing_between = Slider(2, range=0..10)
window_height = Slider(2, range=0..10)
sill_height = Slider(0.5, range=-0.5..2)
vertical_spacing_between = Slider(0, range=0..10)

importepw = LBImportEPW(epw_file=downloadepw.epw_file)  # -> location, dry_bulb_temperature, dew_point_temperature, relative_humidity, wind_speed, wind_direction, direct_normal_rad, diffuse_horizontal_rad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; disabled; plug-in component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
number_slider_7 = Slider(3, range=0..10)  # disabled
windprofile = LBWindProfile(met_wind_vel=importepw.wind_speed, met_wind_dir=importepw.wind_direction, profile_height=number_slider_7)  # -> out, wind_speeds, wind_vectors, anchor_pts, mesh_arrows, profile_curve, speed_axis, height_axis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; disabled; plug-in component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
windspeed = LBWindSpeed(met_wind_vel=importepw.wind_speed)  # -> out, air_speed; disabled; plug-in component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
xdata = LBDeconstructData(data=windspeed.air_speed)  # -> header, values; disabled; plug-in component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
data = Data()  # disabled
bounds = Bounds(Numbers=xdata.values)  # disabled
deconstruct_domain = DeconstructDomain(Domain=bounds)  # -> Start, End; disabled

# ----
# plane to analyze
deconstruct_brep_2 = DeconstructBrep(Brep=domain_box)  # -> Faces, Edges, Vertices
center_2 = Center(Geometry=deconstruct_brep_2.Faces)  # -> Center, Dimension
deconstruct = Deconstruct(Point=center_2.Center)  # -> XComponent, YComponent, ZComponent
smaller_than = SmallerThan(FirstNumber=deconstruct.ZComponent, SecondNumber=Slider(0.02, range=0..0.1))  # -> SmallerThan, OrEqualTo
cull_pattern = CullPattern(List=deconstruct_brep_2.Faces, CullPattern=smaller_than.SmallerThan)

solveadj = HBSolveAdjacency(rooms=flatten(intsolid), adiabatic=boolean_toggle, run=boolean_toggle)  # -> out, adj_rooms; plug-in component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
vizquick_2 = HBVisualizeQuick(hb_objs=flatten(solveadj.adj_rooms))  # -> geo; plug-in component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
unit_z = UnitZ(Factor=Slider(1, range=0..1))
move = Move(Geometry=cull_pattern, Motion=unit_z)  # -> Geometry, Transform

# ----
# Period
number_slider_8 = Slider(1, range=1..12)
number_slider_9 = Slider(1, range=1..31)

# ----
# Comfort param
lb_activities_met_list = LBActivitiesMetList({"Seated", "Standing", "supine"}, selected="Seated")
panel = Panel("0.65")
solarbodypar = LBSolarBodyParameters(posture=lb_activities_met_list, sharp="45")  # -> sol_body_par; plug-in component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

analysisperiod = LBAnalysisPeriod(
    start_month=number_slider_8,
    start_day=number_slider_9,
    start_hour=Slider(8, range=0..23),
    end_month=Slider(12, range=1..12),
    end_day=number_slider_9,
    end_hour=Slider(17, range=0..23))  # -> period, hoys, dates; plug-in component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
adaptpar = LBAdaptiveComfortParameters(
    ashrae_or_en="False",
    neutral_offset=Slider(3, range=0..10),
    avgm_or_runmean="False",
    discr_or_cont_vel="False",
    cold_prevail_limit="15",
    conditioning="0")  # -> adapt_par; plug-in component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
set_group_properties = SetGroupProperties(Color=ColourSwatch(SwatchColor=RGB(216, 255, 184)))

# ---- group: ARE YOU SURE ?
toggle = BooleanToggle(False)

# ----
# Adpative thermal comfort
number_slider_10 = Slider(0.2, range=0..3)
legendpar = LBLegendParameters(min=Slider(25, range=0..100), max=Slider(35, range=0..100))  # -> leg_par; plug-in component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
data_2 = Data(Tree({0;0;0}: [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], {0;1;0}: [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], {0;2;0}: [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], {0;3;0}: [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], {0;4;0}: [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], {0;5;0}: [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]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))
data_3 = Data(Tree({0;0;0}: [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], {0;1;0}: [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], {0;2;0}: [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], {0;3;0}: [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], {0;4;0}: [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], {0;5;0}: [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]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))

# ----
# Floor plane set to 1 meter high
data_4 = Data(flatten(Tree({0;0;0}: [], {1;0}: ["C:\Users\Aly Mahmoud\simulation\unnamed\adaptive_comfort_map\initial_results/conditions"], {2;0}: ["C:\Users\Aly Mahmoud\simulation\unnamed\adaptive_comfort_map\results/temperature"], {3;0}: ["C:\Users\Aly Mahmoud\simulation\unnamed\adaptive_comfort_map\results/condition"], {4;0}: ["C:\Users\Aly Mahmoud\simulation\unnamed\adaptive_comfort_map\results/condition_intensity"], {5;0;0}: [79.01854714, 77.74343122, 77.2797527, 77.2797527, 77.04791345, 76.89335394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], {6;0;0}: [0, 0, 0, 0, 0, 0, 0, 0, 0, 0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], {7;0;0}: [20.98145286, 22.25656878, 22.7202473, 22.7202473, 22.95208655, 23.10664606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])))  # disabled
list_item_2 = ListItem(List=data_4, Index=0, Wrap=True)  # -> Item, Item1, Item2, Item3, Item4, Item5, Item6, Item7; disabled
boolean_toggle_2 = BooleanToggle(True)  # disabled
mesh = Mesh(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)  # disabled
thermalmtx = HBReadThermalMatrix(comf_result=list_item_2.Item2, load=boolean_toggle_2)  # -> comf_mtx; disabled; plug-in component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
face_normals = FaceNormals(Mesh=mesh)  # -> Centers, Normals; disabled
number_slider_11 = Slider(2, range=0..10)  # disabled
vizthermalmap = HBVisualizeThermalMap(comf_mtx=thermalmtx, mesh=flatten(mesh))  # -> out, mesh, legend, title, colors, values; disabled; plug-in component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
number_slider_12 = Slider(0.1, range=0..0.1)  # disabled
round_to_decimal_place = RoundToDecimalPlace(NumberX=vizthermalmap.values, DecimalPlace=number_slider_11, RoundType=0)  # -> Rounded, Difference; disabled
swatch = ColourSwatch(SwatchColor=RGB(0, 0, 0))  # disabled
tag = TextTag3D(
    Location=face_normals.Centers,
    Text=round_to_decimal_place.Rounded,
    Size=number_slider_12,
    Colour=swatch,
    Justification=7)  # disabled

boolean_toggle_3 = BooleanToggle(True)  # disabled

# ----
# Facade as a shader
number_slider_13 = Slider(0, range=0..5)
viznorm = HBVisualizeNormals(hb_objs=roomsolid.rooms)  # -> points, vectors; plug-in component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
number_slider_14 = Slider(1.23, range=0..1.5)
list_item_3 = ListItem(List=deconstruct_brep_2.Faces, Index=number_slider_13, Wrap=True)  # -> Item, Item1, Item2, Item3
list_item_4 = ListItem(List=viznorm.vectors, Index=number_slider_13, Wrap=True)  # -> Item, Item1, Item2, Item3

merge = Merge(Data1=list_item_3.Item, Data2=list_item_3.Item1, Data3=list_item_3.Item2, Data4=list_item_3.Item3)
merge_2 = Merge(Data1=list_item_4.Item, Data2=list_item_4.Item1, Data3=list_item_4.Item2, Data4=list_item_4.Item3)

ratio_to_the_elevation = Slider(0.55, range=0..1)
hb_construction_types = HBConstructionTypes({"SteelFramed", "WoodFramed", "Mass", "Metal Building"}, selected="SteelFramed")

# ----
# Windows
facparam = HBFacadeParameters(north=ratio_to_the_elevation, east=ratio_to_the_elevation, south=ratio_to_the_elevation, west=ratio_to_the_elevation)  # -> fac_par; plug-in component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
aperturesbyratio = HBAperturesByRatio(
    hb_objs=flatten(solveadj.adj_rooms),
    ratio=facparam,
    subdivide=Slider(3, range=0..10),
    win_height=window_height,
    sill_height=sill_height,
    horiz_separ=horizontal_spacing_between,
    vert_separ=vertical_spacing_between)  # -> out, hb_objs; plug-in component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

decnstrobj = HBDeconstructObject(hb_obj=aperturesbyratio.hb_objs)  # -> flatten(faces), flatten(apertures), doors, shades; plug-in component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
vizquick_3 = HBVisualizeQuick(hb_objs=flatten(decnstrobj.faces))  # -> geo; plug-in component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
vizquick_4 = HBVisualizeQuick(hb_objs=flatten(decnstrobj.apertures))  # -> geo; plug-in component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
aperture = HBAperture(geo=vizquick_4)  # -> out, apertures; plug-in component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
face_2 = HBFace(geo=vizquick_3, bc="adiabatic")  # -> out, faces; plug-in component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

vizquick_5 = HBVisualizeQuick(hb_objs=flatten(aperturesbyratio.hb_objs))  # -> geo; plug-in component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

amplitude = Amplitude(Vector=merge_2, Amplitude=number_slider_14)
move_2 = Move(Geometry=merge, Motion=amplitude)  # -> Geometry, Transform

number_slider_15 = Slider(4, range=2..10)

cluster = Cluster(S=move_2.Geometry, U=number_slider_15, V=number_slider_15, S_2=move_2.Geometry, B=number_slider_15)  # -> sm, lg

srf = Surface(cluster.sm)

srf_2 = Surface(cluster.lg)

shade = HBShade(geo=flatten(srf_2))  # -> out, shades; plug-in component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

area = Area(Geometry=flatten(srf_2))  # -> Area, Centroid

# ----
# Model
model = HBModel(rooms=flatten(aperturesbyratio.hb_objs), shades=flatten(shade.shades), apertures=flatten(aperture.apertures))  # -> out, model; plug-in component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
vizall = HBVisualizeAll(hb_objs=flatten(model.model))  # -> geo; plug-in component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
vizwiref = HBVisualizeWireframe(hb_objs=flatten(model.model))  # -> geo; plug-in component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

hb_face_attributes = HBFaceAttributes({"Display Name": "display_name", "Simulation Name (Identifier)": "identifier", "Boundary Condition": "boundary_condition", "Has Parent": "has_parent", "Parent": "parent", "Azimuth": "azimuth", "Altitude": "altitude", "Area": "area", "Perimeter": "perimeter", "Face Type": "type", "Aperture Is Operable": "is_operable", "Door Is Glass": "is_glass"}, selected="Boundary Condition")
# Faces labels
lablefaces = HBLabelFaces(hb_objs=flatten(model.model), attribute=hb_face_attributes)  # -> label_text, base_pts, labels, wire_frame; plug-in component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

# ----
# Visualize
vizbytype = HBVisualizeByType(hb_objs=model.model)  # -> walls, interior_walls, roofs, ceilings, exterior_floors, interior_floors, air_walls, apertures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; plug-in component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
data_5 = Data(vizbytype.outdoor_shades)
mesh_edges = MeshEdges(Mesh=data_5)  # -> NakedEdges, InteriorEdges, NonManifoldEdges
data_6 = Data(mesh_edges.NakedEdges)
mesh_2 = Mesh(data_5)

# ----
# Sensor Grid
number_slider_16 = Slider(0.5, range=0..10)
genpts = LBGeneratePointGrid(geometry=move.Geometry, grid_size=number_slider_16)  # -> points, vectors, face_areas, mesh; plug-in component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
points = Data(genpts.points)

rebuild_mesh = RebuildMesh(
    Mesh=genpts.mesh,
    RebuildNormals=False,
    CullUnused=False,
    UnifyNormals=False,
    FlipNormals=True,
    IdenticalCombine=False,
    WeldVertices=0)

sensorgrid = HBSensorGrid(positions=points, mesh=rebuild_mesh)  # -> grid; plug-in component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
assigngridsviews = HBAssignGridsAndViews(model=model.model, grids=flatten(sensorgrid))  # -> model; plug-in component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

# ----
# Analysis parameters:
# 
# HB room - Indoor analysis:
# Apreture testing location : South
# period: Annual
# Wind speed: 0.2
# human body parameters: Seated - facing side way to the window
adaptivemap = HBAdaptiveComfortMap(
    model=assigngridsviews,
    epw=downloadepw.epw_file,
    ddy=downloadepw.ddy_file,
    run_period=analysisperiod.period,
    air_speed=number_slider_10,
    comfort_par=adaptpar,
    solar_body_par=solarbodypar,
    run=toggle)  # -> out, env_conds, op_temp, condition, deg_neut, TCP, HSP, CSP; plug-in component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

# ----
# Cold sensation percentage
heatmap = LBSpatialHeatmap(values=adaptivemap.CSP, mesh=rebuild_mesh)  # -> mesh, legend, title, colors, legend_par, vis_set; plug-in component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
# Thermal comfort percentage
heatmap_2 = LBSpatialHeatmap(values=adaptivemap.HSP, mesh=rebuild_mesh)  # -> mesh, legend, title, colors, legend_par, vis_set; plug-in component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
# HSP Heat sensation percentage %
heatmap_3 = LBSpatialHeatmap(values=adaptivemap.TCP, mesh=rebuild_mesh)  # -> mesh, legend, title, colors, legend_par, vis_set; plug-in component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

envmtx = HBReadEnvironmentMatrix(env_conds=adaptivemap.env_conds, load=Toggle(True))  # -> comf_mtx; plug-in component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
thermalmtx_2 = HBReadThermalMatrix(comf_result=adaptivemap.condition, load=Toggle(True))  # -> comf_mtx; plug-in component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
average = Average(Input=adaptivemap.HSP)
average_2 = Average(Input=adaptivemap.TCP)
vizthermalmap_2 = HBVisualizeThermalMap(comf_mtx=envmtx, mesh=flatten(rebuild_mesh), legend_par=legendpar)  # -> out, mesh, legend, title, colors, values; plug-in component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
average_3 = Average(Input=vizthermalmap_2.values)

round_to_decimal_place_2 = RoundToDecimalPlace(NumberX=average_3, DecimalPlace=Slider(1, range=0..10), RoundType=0)  # -> Rounded, Difference
tag_2 = TextTag3D(
    Location=points,
    Text=round_to_decimal_place_2.Rounded,
    Size=Slider(0.1, range=0..0.1),
    Colour=ColourSwatch(SwatchColor=RGB(0, 0, 0)),
    Justification=7)

# ----
# Wallacei
wallacei_x = WallaceiX(
    Genes=[number_slider_5, number_slider_3, number_slider_14, number_slider_15],
    Objectives=[round_to_decimal_place_2.Rounded, average, average_2],
    Phenotype=[vizwiref, vizthermalmap_2.mesh],
    allFitness="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",
    allFrontIdx="0|0;0|1;0|4;0|6;0|7;0|8;0|9;0|12;0|13;0|14;0|15;0|16;0|17;0|18;0|19;0|20;0|21;0|22;0|23;0|24;0|25;0|26;0|27;0|29;0|30;0|31;0|33;0|38;0|39;0|43;0|44;0|46;0|48;0|49",
    allGenomes="5|4|0.7|8_8|8|0.53|10_4|11|0.04|4_5|15|1.02|7_5|10|1.06|8_10|4|0.24|5_9|5|1.19|4_9|14|0.83|8_8|3|1.49|8_9|4|0.77|6_5|15|1.04|5_6|11|1.02|6_5|7|0.79|3_5|11|0.59|3_10|4|1.46|6_7|4|0.18|4_4|7|0.82|4_10|14|1.19|4_4|5|0.64|10_6|12|1.42|3_6|7|0.09|6_6|8|0.56|2_7|13|1.28|8_4|3|1.33|4_9|9|0.45|3_4|7|0.71|5_7|7|0.1|3_5|8|1.13|3_4|13|1.49|5_10|11|1.28|8_10|9|1.03|3_3|3|0.2|3_5|5|0.12|9_6|13|1.49|3_9|11|1.37|2_5|5|1.12|3_4|11|0.95|4_3|10|0.36|4_7|10|0.27|7_8|7|0.52|6_4|15|1.31|2_5|13|1.05|4_9|13|0.71|4_8|13|0.57|8_9|9|0.12|5_6|14|0.07|8_10|13|0.46|9_8|8|0.66|6_5|8|1.32|5_5|11|1.23|4",
    curFrontIdx="0|0;0|1;0|4;0|6;0|7;0|8;0|9;0|12;0|13;0|14;0|15;0|16;0|17;0|18;0|19;0|20;0|21;0|22;0|23;0|24;0|25;0|26;0|27;0|29;0|30;0|31;0|33;0|38;0|39;0|43;0|44;0|46;0|48;0|49",
    curFrontIdxSave="0|0;0|1;0|4;0|6;0|7;0|8;0|9;0|12;0|13;0|14;0|15;0|16;0|17;0|18;0|19;0|20;0|21;0|22;0|23;0|24;0|25;0|26;0|27;0|29;0|30;0|31;0|33;0|38;0|39;0|43;0|44;0|46;0|48;0|49",
    popGen="50,1",
    total="3117485",
    wlcDone=True)  # -> WallaceiGenomes, FitnessValues, Data, Phenotypes
number_slider_17 = Slider(20, range=0..100)
distribute_to_grid = DistributeToGrid(
    FitnessValues=wallacei_x.FitnessValues,
    WallaceiPhenotypes=wallacei_x.Phenotypes,
    SizeOfTheGridInTheXDirection=number_slider_17,
    SizeOfTheGridInTheYDirection=number_slider_17,
    OutputOptions=0)  # -> DistributedFitnessValues, DistributedData, DistributedGeometries, DistributedMeshes, DistributedNumbers, GridLocations
tag_3 = TextTag3D(
    Text=distribute_to_grid.DistributedFitnessValues,
    Size=Slider(0.1, range=0..0.1),
    Colour=ColourSwatch(SwatchColor=RGB(0, 0, 0)),
    Justification=7)

# ----
# floor plane on the ground
data_7 = Data(flatten(Tree({0}: ["C:\Users\Aly Mahmoud\simulation\unnamed\adaptive_comfort_map\initial_results/conditions", "C:\Users\Aly Mahmoud\simulation\unnamed\adaptive_comfort_map\results/temperature", "C:\Users\Aly Mahmoud\simulation\unnamed\adaptive_comfort_map\results/condition", "C:\Users\Aly Mahmoud\simulation\unnamed\adaptive_comfort_map\results/condition_intensity"], {0;0}: [47.58208955, 47.88059701, 47.97014925, 47.91044776, 47.73134328, 47.82089552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])))  # disabled
list_item_5 = ListItem(List=data_7, Index=0, Wrap=True)  # -> Item, Item1, Item2, Item3, Item4, Item5, Item6, Item7; disabled
boolean_toggle_4 = BooleanToggle(True)  # disabled
mesh_3 = Mesh(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)  # disabled
thermalmtx_3 = HBReadThermalMatrix(comf_result=list_item_5.Item2, load=boolean_toggle_4)  # -> comf_mtx; disabled; plug-in component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
face_normals_2 = FaceNormals(Mesh=mesh_3)  # -> Centers, Normals; disabled
number_slider_18 = Slider(2, range=0..10)  # disabled
number_slider_19 = Slider(0.1, range=0..0.1)  # disabled
swatch_2 = ColourSwatch(SwatchColor=RGB(0, 0, 0))  # disabled

envmtx_2 = HBReadEnvironmentMatrix(env_conds=list_item_5.Item, load=boolean_toggle_3)  # -> comf_mtx; disabled; plug-in component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

vizthermalmap_3 = HBVisualizeThermalMap(comf_mtx=envmtx_2, mesh=flatten(mesh_3))  # -> out, mesh, legend, title, colors, values; disabled; plug-in component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
round_to_decimal_place_3 = RoundToDecimalPlace(NumberX=vizthermalmap_3.values, DecimalPlace=number_slider_18, RoundType=0)  # -> Rounded, Difference; disabled
tag_4 = TextTag3D(
    Location=face_normals_2.Centers,
    Text=round_to_decimal_place_3.Rounded,
    Size=number_slider_19,
    Colour=swatch_2,
    Justification=7)  # disabled

# ==== cluster Cluster
S = ClusterInput()
U = ClusterInput()
V = ClusterInput()
S_2 = ClusterInput()
B = ClusterInput()
sframes = SurfaceFrames(Surface=S, UCount=U, VCount=V)  # -> Frames, Parameters
panel = Panel("""0
-1""")
division = Division(A=2.8, B=B)
cull_i = CullIndex(List=sframes.Frames, Indices=panel, Wrap=True)
cull_i_2 = CullIndex(List=flatten(cull_i), Indices=panel, Wrap=True)  # -> flatten(List)
panel_2 = Panel("""0
1""")
cull = CullPattern(List=cull_i_2, CullPattern=panel_2)
cir = Circle(Plane=cull, Radius=division)
srfsplit = SurfaceSplit(Surface=S_2, Curves=cir)
# Skin
srf_sl = SrfSmallLarge(srf_list=srfsplit)  # -> smallest, largest
sm = ClusterOutput(srf_sl.smallest)
lg = ClusterOutput(srf_sl.largest)

# ==== cluster SrfSmallLarge
srf_list = ClusterInput()
edges = BrepEdges(Brep=srf_list)  # -> Naked, Interior, NonManifold
len = Length(Curve=edges.Naked)
ma = MassAddition(Input=len)  # -> Result, PartialResults
pshift = ShiftPaths(Data=ma.Result, Offset=-1)
sort = SortList(Keys=pshift, ValuesA=srf_list)  # -> Keys, ValuesA
item = ListItem(List=reverse(sort.ValuesA), Index=0, Wrap=True)
cull_index = CullIndex(List=sort.ValuesA, Indices="-1", Wrap=True)
largest = ClusterOutput(item)
smallest = ClusterOutput(cull_index)
