# Grasshopper definition Encoding images merge with simulation.gh (Grasshopper 1.0.8)
# plug-ins: Heteroptera, Pufferfish, LunchBox, MetaHopper, Wallacei, Kangaroo2 Components

# ----
# List Generation
# Red Channel
# R channel Image
# Only R values
# Filter Points
# G channel Image
# Green Channel
# Only G values
# Blue Channel
# B channel Image
# Only B values
mersh_vectors = MershVectors()
dist_facade_skin = DistFacadeSkin()
max_heigth_room_z = MaxHeigthRoomZ()
max_width_x = MaxWidthX()
facade_window_srf = FacadeWindowSrf()
r_color_domain = RColorDomain()
skin_typology_srf = SkinTypologySrf()
g_color_domain = GColorDomain()
back_room_wall_srf = BackRoomWallSrf()
b_color_domain = BColorDomain()
deconstruct = Deconstruct(Point=mersh_vectors)  # -> XComponent, YComponent, ZComponent
smaller_than = SmallerThan(FirstNumber=deconstruct.XComponent, SecondNumber=max_width_x)  # -> SmallerThan, OrEqualTo
larger_than = LargerThan(FirstNumber=deconstruct.ZComponent, SecondNumber="0")  # -> LargerThan, OrEqualTo
smaller_than_2 = SmallerThan(FirstNumber=deconstruct.ZComponent, SecondNumber=max_heigth_room_z)  # -> SmallerThan, OrEqualTo
larger_than_2 = LargerThan(FirstNumber=deconstruct.XComponent, SecondNumber="0")  # -> LargerThan, OrEqualTo
gate_and = GateAnd(A=larger_than.OrEqualTo, B=smaller_than_2.OrEqualTo, C=larger_than_2.OrEqualTo, D=smaller_than.OrEqualTo)
cull_pattern = CullPattern(List=mersh_vectors, CullPattern=gate_and)
deconstruct_2 = Deconstruct(Point=cull_pattern)  # -> XComponent, YComponent, ZComponent
deconstruct_3 = Deconstruct(Point=cull_pattern)  # -> XComponent, YComponent, ZComponent
equality = Equality(FirstNumber=deconstruct_2.ZComponent, SecondNumber="0")  # -> Equality, Inequality
equality_2 = Equality(FirstNumber=deconstruct_3.XComponent, SecondNumber="0")  # -> Equality, Inequality
cull_pattern_2 = CullPattern(List=cull_pattern, CullPattern=equality.Equality)
cull_pattern_3 = CullPattern(List=cull_pattern, CullPattern=equality_2.Equality)
list_length = ListLength(List=cull_pattern_2)
list_length_2 = ListLength(List=cull_pattern_3)
data = Data(dist_facade_skin)
mesh_surface = MeshSurface(Surface=back_room_wall_srf, UCount=list_length, VCount=list_length_2, Overhang=True, Equalize=False)
mesh_surface_2 = MeshSurface(Surface=skin_typology_srf, UCount=list_length, VCount=list_length_2, Overhang=True, Equalize=False)
mesh_surface_3 = MeshSurface(Surface=facade_window_srf, UCount=list_length, VCount=list_length_2, Overhang=True, Equalize=False)
list_length_3 = ListLength(List=mersh_vectors)
mesh_join = MeshJoin(Meshes=mesh_surface_2)
mesh_join_2 = MeshJoin(Meshes=mesh_surface)
mesh_join_3 = MeshJoin(Meshes=mesh_surface_3)
deconstruct_mesh = DeconstructMesh(Mesh=mesh_join)  # -> Vertices, Faces, Colours, Normals
deconstruct_mesh_2 = DeconstructMesh(Mesh=mesh_join_2)  # -> Vertices, Faces, Colours, Normals
deconstruct_mesh_3 = DeconstructMesh(Mesh=mesh_join_3)  # -> Vertices, Faces, Colours, Normals
deconstruct_4 = Deconstruct(Point=deconstruct_mesh.Vertices)  # -> XComponent, YComponent, ZComponent
deconstruct_5 = Deconstruct(Point=deconstruct_mesh_2.Vertices)  # -> XComponent, YComponent, ZComponent
deconstruct_6 = Deconstruct(Point=deconstruct_mesh_3.Vertices)  # -> XComponent, YComponent, ZComponent
duplicate_data = DuplicateData(Data="0,0,0", Number=list_length_3, Order=True)
duplicate_data_2 = DuplicateData(Data="0", Number=list_length_3, Order=True)
round = Round(Number=deconstruct_4.YComponent)  # -> Nearest, Floor, Ceiling
round_2 = Round(Number=deconstruct_5.YComponent)  # -> Nearest, Floor, Ceiling
round_3 = Round(Number=deconstruct_6.YComponent)  # -> Nearest, Floor, Ceiling
bounds = Bounds(Numbers=round.Nearest)
construct_point = ConstructPoint(XCoordinate=deconstruct_4.XComponent, YCoordinate=data, ZCoordinate=deconstruct_4.ZComponent)
construct_point_2 = ConstructPoint(XCoordinate=deconstruct_6.XComponent, YCoordinate=data, ZCoordinate=deconstruct_6.ZComponent)
construct_point_3 = ConstructPoint(XCoordinate=deconstruct_5.XComponent, YCoordinate=data, ZCoordinate=deconstruct_5.ZComponent)
bounds_2 = Bounds(Numbers=round_2.Nearest)
bounds_3 = Bounds(Numbers=round_3.Nearest)
control_wire_display = ControlWireDisplay(WireDisplay="1")
remap_numbers = RemapNumbers(Value=deconstruct_4.YComponent, Source=bounds, Target=g_color_domain)  # -> Mapped, Clipped
remap_numbers_2 = RemapNumbers(Value=deconstruct_5.YComponent, Source=bounds_2, Target=b_color_domain)  # -> Mapped, Clipped
remap_numbers_3 = RemapNumbers(Value=deconstruct_6.YComponent, Source=bounds_3, Target=r_color_domain)  # -> Mapped, Clipped
round_4 = Round(Number=remap_numbers.Mapped)  # -> Nearest, Floor, Ceiling
round_5 = Round(Number=remap_numbers_3.Mapped)  # -> Nearest, Floor, Ceiling
round_6 = Round(Number=remap_numbers_2.Mapped)  # -> Nearest, Floor, Ceiling
create_rtree = CreateRTree(InputGeometry=flatten(mersh_vectors))
create_rtree_2 = CreateRTree(InputGeometry=flatten(mersh_vectors))
concatenate = Concatenate(Fragment_B="0", A=round_4.Nearest, B="0", JoinSeparator=",")
create_rtree_3 = CreateRTree(InputGeometry=flatten(mersh_vectors))
concatenate_2 = Concatenate(FragmentB=round_5.Nearest, FragmentA="0,0", JoinSeparator=",")
concatenate_3 = Concatenate(FragmentB="0,0", FragmentA=round_6.Nearest, JoinSeparator=",")
rtree_closest_point = RTreeClosestPoint(SearchPoints=flatten(construct_point_2), RTree=create_rtree)  # -> ClosestPoint, ClosestIndex
rtree_closest_point_2 = RTreeClosestPoint(SearchPoints=flatten(construct_point), RTree=create_rtree_2)  # -> ClosestPoint, ClosestIndex
rtree_closest_point_3 = RTreeClosestPoint(SearchPoints=flatten(construct_point_3), RTree=create_rtree_3)  # -> ClosestPoint, ClosestIndex
replace_items = ReplaceItems(List=duplicate_data, Item=concatenate_2, Indices=rtree_closest_point.ClosestIndex, Wrap=False)
replace_items_2 = ReplaceItems(List=duplicate_data_2, Item=round_5.Nearest, Indices=rtree_closest_point.ClosestIndex, Wrap=False)
replace_items_3 = ReplaceItems(List=duplicate_data, Item=concatenate, Indices=rtree_closest_point_2.ClosestIndex, Wrap=False)
replace_items_4 = ReplaceItems(List=duplicate_data_2, Item=round_4.Nearest, Indices=rtree_closest_point_2.ClosestIndex, Wrap=False)
replace_items_5 = ReplaceItems(List=duplicate_data, Item=concatenate_3, Indices=rtree_closest_point_3.ClosestIndex, Wrap=False)
replace_items_6 = ReplaceItems(List=duplicate_data_2, Item=remap_numbers_2.Mapped, Indices=rtree_closest_point_3.ClosestIndex, Wrap=False)
g_channel_values = GChannelValues(replace_items_4)
r_channel_values = RChannelValues(replace_items_2)
g_channel_image = GChannelImage(replace_items_3)
r_channel_image = RChannelImage(replace_items)
b_channel_values = BChannelValues(replace_items_6)
b_channel_image = BChannelImage(replace_items_5)
concatenate_4 = Concatenate(R=replace_items_2, G=replace_items_4, B=replace_items_6, JoinSeparator=",")
encoded_image = EncodedImage(concatenate_4)

number_slider = Slider(13, range=3..15)

# ----
# General input
epw_file_path_barcelona = Panel("https://climate.onebuilding.org/WMO_Region_1_Africa/EGY_Egypt/QH_Al_Qahirah_Cairo/EGY_QH_Cairo.Intl.AP.623660_TMYx.zip")
epw_filepath = Data(epw_file_path_barcelona)

multiplication = Multiplication(A=number_slider, B=0.1)

# ----
# Weather file
epw_filepath_2 = Data(epw_filepath)
# Room Related
downloadepw = LBDownloadWeather(weather_URL=epw_filepath_2)  # -> epw_file, stat_file, ddy_file; plug-in component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

pt = Point(Point(-2.722291582, 0.2658342869, 0))
northarrow = Ladybug_North(centerPt=pt, scale=Slider(0.1, range=0..0.1))  # -> northSign; plug-in component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

hb_building_programs = HBBuildingPrograms({"LargeOffice", "MediumOffice", "SmallOffice", "MidriseApartment", "HighriseApartment", "Retail", "StripMall", "PrimarySchool", "SecondarySchool", "SmallHotel", "LargeHotel", "Hospital", "Outpatient", "Laboratory", "Warehouse", "SuperMarket", "FullServiceRestaurant", "QuickServiceRestaurant", "Courthouse", "LargeDataCenterHighITE", "LargeDataCenterLowITE", "SmallDataCenterHighITE", "SmallDataCenterLowITE"}, selected="LargeOffice")

# ----
# Set Up ROOM or ZONE
number_slider_2 = Slider(3, range=0..10)
number_slider_3 = Slider(5, range=3..10)
domain_box = DomainBox(Base=PlaneXY(0, 0, 0), X=number_slider, Y=number_slider_3, Z=number_slider_2)
roomsolid = HBRoomFromSolid(geo=flatten(domain_box), program=hb_building_programs, conditioned=True)  # -> out, rooms; plug-in component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

multiplication_2 = Multiplication(A=number_slider_3, B=0.1)
multiplication_3 = Multiplication(A=number_slider_2, B=0.1)

deconstruct_brep = DeconstructBrep(Brep=domain_box)  # -> Faces, Edges, Vertices
list_item = ListItem(List=deconstruct_brep.Faces, Index=Slider(4, range=0..6), Wrap=True)
curve = Curve(list_item)
explode = Explode(Curve=curve, Recursive=True)  # -> Segments, Vertices
center = Center(Geometry=domain_box)  # -> Center, Dimension
division = Division(A=number_slider, B=5)
division_2 = Division(A=number_slider_3, B=5)
division_3 = Division(A=number_slider_2, B=2)
removeduplicatepts = RemoveDuplicatePts(Points=explode.Vertices, Tolerance=0.01)
center_box = CenterBox(Base=center.Center, X=division_2, Y=division, Z=division_3)
xy_plane = XYPlane(Origin=removeduplicatepts)
scale_nu = ScaleNU(Geometry=domain_box, Plane=xy_plane, ScaleX=Slider(0.5, range=0..1), ScaleY=Slider(0.5, range=0..1), ScaleZ=1)  # -> Geometry, Transform
solid_difference = SolidDifference(BrepsA=scale_nu.Geometry, BrepsB=center_box)
roomsolid_2 = HBRoomFromSolid(geo=flatten(solid_difference), program=hb_building_programs, conditioned=True)  # -> out, rooms; plug-in component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
roomsolid_3 = HBRoomFromSolid(geo=flatten(center_box), program=hb_building_programs, conditioned=True)  # -> out, rooms; plug-in component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
boolean_toggle = BooleanToggle(True)
intsolid = HBIntersectSolids(rooms=flatten([roomsolid_2.rooms, roomsolid_3.rooms]), run=boolean_toggle)  # -> int_rooms; plug-in component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
vizquick = HBVisualizeQuick(hb_objs=flatten([roomsolid_2.rooms, roomsolid_3.rooms]))  # -> geo; plug-in component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
solveadj = HBSolveAdjacency(rooms=flatten(intsolid), adiabatic=boolean_toggle, run=boolean_toggle)  # -> out, adj_rooms; plug-in component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
vizquick_2 = HBVisualizeQuick(hb_objs=flatten(solveadj.adj_rooms))  # -> geo; plug-in component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

face = HBFace()  # -> out, faces; plug-in component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
# Skins Typologies
height = Panel("3")

# ----
# Clusters
encoded_image_v_1 = EncodedImageV1()  # -> output_b_channel, list_of_red_values, list_of_green_values, list_of_blue_values; disabled
encoded_image_v_2 = EncodedImageV2()  # -> colored_mesh, red_values, green_values, blue_values; disabled
encoded_image_v_3 = EncodedImageV3_2(
    max_heigth_room_z=0,
    max_width_x=0,
    r_color_domain=Domain(0, 1),
    g_color_domain=Domain(0, 1),
    b_color_domain=Domain(0, 1))  # -> encoded_image, r_channel_image, r_channel_values, g_channel_image, faces, g_channel_values, b_channel_image, b_channel_values; disabled

skin_resolution = Slider(35, range=0..100)  # disabled
value_list = ValueList({"Red Channel": 0, "Green Channel": 1, "Blue Channel": 2}, selected="Red Channel")  # disabled

# ----
# Opening Parameters
horizontal_spacing_between = Slider(2, range=0..10)
window_height = Slider(2, range=0..10)
sill_height = Slider(0.5, range=-0.5..2)
vertical_spacing_between = Slider(0, range=0..10)

# ----
# plane to analyze
deconstruct_brep_2 = DeconstructBrep(Brep=domain_box)  # -> Faces, Edges, Vertices
center_2 = Center(Geometry=deconstruct_brep_2.Faces)  # -> Center, Dimension
deconstruct_7 = Deconstruct(Point=center_2.Center)  # -> XComponent, YComponent, ZComponent
smaller_than_3 = SmallerThan(FirstNumber=deconstruct_7.ZComponent, SecondNumber=Slider(0.02, range=0..0.1))  # -> SmallerThan, OrEqualTo
cull_pattern_4 = CullPattern(List=deconstruct_brep_2.Faces, CullPattern=smaller_than_3.SmallerThan)

importstat = LBImportSTAT(stat_file=downloadepw.stat_file)  # -> location, ashrae_zone, koppen_zone, clear_dir_norm_rad, clear_diff_horiz_rad, ann_heat_dday_996, ann_heat_dday_990, ann_cool_dday_004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; plug-in component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
importepw = LBImportEPW(epw_file=downloadepw.epw_file)  # -> location, dry_bulb_temperature, dew_point_temperature, relative_humidity, wind_speed, wind_direction, direct_normal_rad, diffuse_horizontal_rad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; disabled; plug-in component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
number_slider_4 = Slider(3, range=0..10)  # disabled
windprofile = LBWindProfile(met_wind_vel=importepw.wind_speed, met_wind_dir=importepw.wind_direction, profile_height=number_slider_4)  # -> out, wind_speeds, wind_vectors, anchor_pts, mesh_arrows, profile_curve, speed_axis, height_axis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; disabled; plug-in component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
windspeed = LBWindSpeed(met_wind_vel=importepw.wind_speed)  # -> out, air_speed; disabled; plug-in component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
xdata = LBDeconstructData(data=windspeed.air_speed)  # -> header, values; disabled; plug-in component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
data_2 = Data()  # disabled
bounds_4 = Bounds(Numbers=xdata.values)  # disabled
deconstruct_domain = DeconstructDomain(Domain=bounds_4)  # -> Start, End; disabled

bounding_rectangle = BoundingRectangle(Geometry=vizquick_2, Plane=PlaneXY(0, 0, 0), Axis=0, Slide=0, Union=True)  # -> Bounding, DimensionX, DimensionY
brep_brep = BrepBrep(BrepA=vizquick_2, BrepB=bounding_rectangle.Bounding)  # -> Curves, Points
unit_z = UnitZ(Factor=Slider(1, range=0..1))
move = Move(Geometry=cull_pattern_4, Motion=unit_z)  # -> Geometry, Transform

# ----
# Period
number_slider_5 = Slider(1, range=1..12)
number_slider_6 = Slider(1, range=1..31)

# ----
# Comfort param
lb_activities_met_list = LBActivitiesMetList({"Seated", "Standing", "supine"}, selected="Seated")
panel = Panel("0.65")
solarbodypar = LBSolarBodyParameters(posture=lb_activities_met_list, sharp="45")  # -> sol_body_par; plug-in component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

analysisperiod = LBAnalysisPeriod(
    start_month=number_slider_5,
    start_day=number_slider_6,
    start_hour=Slider(8, range=0..23),
    end_month=Slider(12, range=1..12),
    end_day=number_slider_6,
    end_hour=Slider(17, range=0..23))  # -> period, hoys, dates; plug-in component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
adaptpar = LBAdaptiveComfortParameters(
    ashrae_or_en="False",
    neutral_offset=Slider(3, range=0..10),
    avgm_or_runmean="False",
    discr_or_cont_vel="False",
    cold_prevail_limit="15",
    conditioning="0")  # -> adapt_par; plug-in component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
set_group_properties = SetGroupProperties(Color=ColourSwatch(SwatchColor=RGB(216, 255, 184)))

# ---- group: ARE YOU SURE ?
toggle = BooleanToggle(False)

# ----
# Adpative thermal comfort
number_slider_7 = Slider(0.2, range=0..3)
legendpar = LBLegendParameters(min=Slider(25, range=0..100), max=Slider(35, range=0..100))  # -> leg_par; plug-in component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

data_3 = Data(flatten(Tree({0;0;0}: [], {1;0}: ["C:\Users\Aly Mahmoud\simulation\unnamed\adaptive_comfort_map\initial_results/conditions"], {2;0}: ["C:\Users\Aly Mahmoud\simulation\unnamed\adaptive_comfort_map\results/temperature"], {3;0}: ["C:\Users\Aly Mahmoud\simulation\unnamed\adaptive_comfort_map\results/condition"], {4;0}: ["C:\Users\Aly Mahmoud\simulation\unnamed\adaptive_comfort_map\results/condition_intensity"], {5;0;0}: [79.01854714, 77.74343122, 77.2797527, 77.2797527, 77.04791345, 76.89335394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], {6;0;0}: [0, 0, 0, 0, 0, 0, 0, 0, 0, 0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], {7;0;0}: [20.98145286, 22.25656878, 22.7202473, 22.7202473, 22.95208655, 23.10664606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])))  # disabled
list_item_2 = ListItem(List=data_3, Index=0, Wrap=True)  # -> Item, Item1, Item2, Item3, Item4, Item5, Item6, Item7; disabled
boolean_toggle_2 = BooleanToggle(True)  # disabled
mesh = Mesh(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)  # disabled
thermalmtx = HBReadThermalMatrix(comf_result=list_item_2.Item2, load=boolean_toggle_2)  # -> comf_mtx; disabled; plug-in component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
face_normals = FaceNormals(Mesh=mesh)  # -> Centers, Normals; disabled
number_slider_8 = Slider(2, range=0..10)  # disabled
vizthermalmap = HBVisualizeThermalMap(comf_mtx=thermalmtx, mesh=flatten(mesh))  # -> out, mesh, legend, title, colors, values; disabled; plug-in component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
number_slider_9 = Slider(0.1, range=0..0.1)  # disabled
round_to_decimal_place = RoundToDecimalPlace(NumberX=vizthermalmap.values, DecimalPlace=number_slider_8, RoundType=0)  # -> Rounded, Difference; disabled
swatch = ColourSwatch(SwatchColor=RGB(0, 0, 0))  # disabled
# Visualize
tag = TextTag3D(Location=face_normals.Centers, Text=round_to_decimal_place.Rounded, Size=number_slider_9, Colour=swatch, Justification=7)  # disabled

boolean_toggle_3 = BooleanToggle(True)  # disabled

# ----
# Inputs: Skins
# Facade as a shader
number_slider_10 = Slider(0, range=0..5)
viznorm = HBVisualizeNormals(hb_objs=roomsolid.rooms)  # -> points, vectors; plug-in component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
number_slider_11 = Slider(0.85, range=0..1.5)
list_item_3 = ListItem(List=deconstruct_brep_2.Faces, Index=number_slider_10, Wrap=True)  # -> Item, Item1, Item2, Item3
list_item_4 = ListItem(List=viznorm.vectors, Index=number_slider_10, Wrap=True)  # -> Item, Item1, Item2, Item3
amplitude = Amplitude(Vector=list_item_4.Item, Amplitude=number_slider_11)
amplitude_2 = Amplitude(Vector=list_item_4.Item2, Amplitude=number_slider_11)
amplitude_3 = Amplitude(Vector=list_item_4.Item1, Amplitude=number_slider_11)
amplitude_4 = Amplitude(Vector=list_item_4.Item3, Amplitude=number_slider_11)
move_2 = Move(Geometry=list_item_3.Item, Motion=amplitude)  # -> Geometry, Transform
move_3 = Move(Geometry=list_item_3.Item1, Motion=amplitude_3)  # -> Geometry, Transform
move_4 = Move(Geometry=list_item_3.Item2, Motion=amplitude_2)  # -> Geometry, Transform
move_5 = Move(Geometry=list_item_3.Item3, Motion=amplitude_4)  # -> Geometry, Transform

# ----
# Encoded Image Boundaries
panel_2 = Panel("-8")
dom = ConstructDomain(DomainStart=panel_2, DomainEnd="8")
rectangle = Rectangle(Plane=move_2.Geometry, XSize=dom, YSize=dom, Radius=0)  # -> Rectangle, Length

# ----
# SKIN TYPOLOGY
no_of_vertical_divisions = Slider(100, range=10..100)
no_of_panels = Slider(9, range=6..15)
cluster = Cluster_2(srf=move_2.Geometry, V=no_of_panels, N=no_of_vertical_divisions)  # -> no_of_panels, geometry
cluster_2 = Cluster(srf=move_3.Geometry, V=no_of_panels, N=no_of_vertical_divisions)  # -> no_of_panels, geometry
cluster_3 = Cluster_3(srf=move_4.Geometry, V=no_of_panels, N=no_of_vertical_divisions)  # -> no_of_panels, geometry; disabled
cluster_4 = Cluster_4(srf=move_5.Geometry, V=no_of_panels, N=no_of_vertical_divisions)  # -> no_of_panels, geometry
merge = Merge(Data1=cluster.geometry, Data2=cluster_2.geometry, Data3=cluster_3.geometry, Data4=cluster_4.geometry)

srf = Surface(merge)
shade = HBShade(geo=flatten(srf))  # -> out, shades; plug-in component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
area = Area(Geometry=flatten(srf))  # -> Area, Centroid

# ----
# Inputs: Encoded Image
resolution = Panel("256")
image_location = Slider(5, range=0..10)

# ----
# Encoded Image Resolution
mesh_plane = MeshPlane(Boundary=rectangle.Rectangle, WidthCount=resolution, HeightCount=resolution)  # -> Mesh, Area

mesh_encoded_image = Mesh(mesh_plane.Mesh)

ratio_to_the_elevation = Slider(0.55, range=0..1)
hb_construction_types = HBConstructionTypes({"SteelFramed", "WoodFramed", "Mass", "Metal Building"}, selected="SteelFramed")

# ----
# Windows
facparam = HBFacadeParameters(north=ratio_to_the_elevation, east=ratio_to_the_elevation, south=ratio_to_the_elevation, west=ratio_to_the_elevation)  # -> fac_par; plug-in component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
aperturesbyratio = HBAperturesByRatio(
    hb_objs=flatten(solveadj.adj_rooms),
    ratio=facparam,
    subdivide=Slider(3, range=0..10),
    win_height=window_height,
    sill_height=sill_height,
    horiz_separ=horizontal_spacing_between,
    vert_separ=vertical_spacing_between)  # -> out, hb_objs; plug-in component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

decnstrobj = HBDeconstructObject(hb_obj=aperturesbyratio.hb_objs)  # -> flatten(faces), flatten(apertures), doors, shades; plug-in component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
vizquick_3 = HBVisualizeQuick(hb_objs=flatten(decnstrobj.faces))  # -> geo; plug-in component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
vizquick_4 = HBVisualizeQuick(hb_objs=flatten(decnstrobj.apertures))  # -> geo; plug-in component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
aperture = HBAperture(geo=vizquick_4)  # -> out, apertures; plug-in component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
face_2 = HBFace(geo=vizquick_3, bc="adiabatic")  # -> out, faces; plug-in component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

vizquick_5 = HBVisualizeQuick(hb_objs=flatten(aperturesbyratio.hb_objs))  # -> geo; plug-in component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
center_3 = Center(Geometry=vizquick_4)  # -> Center, Dimension
deconstruct_vector = DeconstructVector(Vector=center_3.Center)  # -> XComponent, YComponent, ZComponent
equality_3 = Equality(FirstNumber=deconstruct_vector.XComponent, SecondNumber=number_slider)  # -> Equality, Inequality
equality_4 = Equality(FirstNumber=deconstruct_vector.YComponent, SecondNumber=number_slider_3)  # -> Equality, Inequality
cull_pattern_5 = CullPattern(List=vizquick_4, CullPattern=invert(deconstruct_vector.YComponent))

# ----
# Encoded Image
deconstruct_mesh_4 = DeconstructMesh(Mesh=mesh_encoded_image)  # -> Vertices, Faces, Colours, Normals
encoded_image_v_3_2 = EncodedImageV3(
    mersh_vectors=deconstruct_mesh_4.Vertices,
    dist_facade_skin=image_location,
    max_heigth_room_z=height,
    max_width_x=number_slider,
    facade_window_srf=cull_pattern_5,
    r_color_domain="255 to 30",
    skin_typology_srf=cluster.geometry,
    g_color_domain="70 to 255",
    back_room_wall_srf=move_4.Geometry,
    b_color_domain="255 to 30")  # -> encoded_image, r_channel_image, r_channel_values, g_channel_image, faces, g_channel_values, b_channel_image, b_channel_values
construct_mesh = ConstructMesh(Vertices=deconstruct_mesh_4.Vertices, Faces=deconstruct_mesh_4.Faces, Colours=encoded_image_v_3_2.encoded_image)

cull_pattern_6 = CullPattern(List=vizquick_4, CullPattern=equality_3.Equality)

# ----
# Encoded Image
# Inputs: Encoded Image
# Encoded Image Boundaries
# Encoded Image Resolution
# Clusters
resolution_2 = Panel("256")
image_location_2 = Slider(5, range=0..10)
encoded_image_v_1_2 = EncodedImageV1()  # -> output_b_channel, list_of_red_values, list_of_green_values, list_of_blue_values; disabled
encoded_image_v_2_2 = EncodedImageV2()  # -> colored_mesh, red_values, green_values, blue_values; disabled
skin_resolution_2 = Slider(35, range=0..100)  # disabled
value_list_2 = ValueList({"Red Channel": 0, "Green Channel": 1, "Blue Channel": 2}, selected="Red Channel")  # disabled
dom_2 = ConstructDomain(DomainStart="-8", DomainEnd="8")
rectangle_2 = Rectangle(Plane=move_3.Geometry, XSize=dom_2, YSize=dom_2, Radius=0)  # -> Rectangle, Length
encoded_image_v_3_3 = EncodedImageV3_2(
    max_heigth_room_z=0,
    max_width_x=0,
    r_color_domain=Domain(0, 1),
    g_color_domain=Domain(0, 1),
    b_color_domain=Domain(0, 1))  # -> encoded_image, r_channel_image, r_channel_values, g_channel_image, faces, g_channel_values, b_channel_image, b_channel_values; disabled
mesh_plane_2 = MeshPlane(Boundary=rectangle_2.Rectangle, WidthCount=resolution_2, HeightCount=resolution_2)  # -> Mesh, Area
mesh_encoded_image_2 = Mesh(mesh_plane_2.Mesh)
deconstruct_mesh_5 = DeconstructMesh(Mesh=mesh_encoded_image_2)  # -> Vertices, Faces, Colours, Normals
encoded_image_v_3_4 = EncodedImageV3_3(
    mersh_vectors=deconstruct_mesh_5.Vertices,
    dist_facade_skin=image_location_2,
    max_heigth_room_z=height,
    max_width_x=number_slider,
    facade_window_srf=cull_pattern_6,
    r_color_domain="255 to 30",
    skin_typology_srf=cluster_2.geometry,
    g_color_domain="70 to 255",
    back_room_wall_srf=move_5.Geometry,
    b_color_domain="255 to 30")  # -> encoded_image, r_channel_image, r_channel_values, g_channel_image, faces, g_channel_values, b_channel_image, b_channel_values
construct_mesh_2 = ConstructMesh(Vertices=deconstruct_mesh_5.Vertices, Faces=deconstruct_mesh_5.Faces, Colours=encoded_image_v_3_4.encoded_image)

cull_pattern_7 = CullPattern(List=vizquick_4, CullPattern=invert(deconstruct_vector.XComponent))
cull_pattern_8 = CullPattern(List=vizquick_4, CullPattern=equality_4.Equality)

# ----
# Encoded Image
# Inputs: Encoded Image
# Encoded Image Boundaries
# Encoded Image Resolution
# Clusters
image_location_3 = Slider(5, range=0..10)
resolution_3 = Panel("256")
encoded_image_v_1_3 = EncodedImageV1()  # -> output_b_channel, list_of_red_values, list_of_green_values, list_of_blue_values; disabled
encoded_image_v_2_3 = EncodedImageV2()  # -> colored_mesh, red_values, green_values, blue_values; disabled
skin_resolution_3 = Slider(35, range=0..100)  # disabled
value_list_3 = ValueList({"Red Channel": 0, "Green Channel": 1, "Blue Channel": 2}, selected="Red Channel")  # disabled
dom_3 = ConstructDomain(DomainStart="-8", DomainEnd="8")
rectangle_3 = Rectangle(Plane=move_4.Geometry, XSize=dom_3, YSize=dom_3, Radius=0)  # -> Rectangle, Length
encoded_image_v_3_5 = EncodedImageV3_2(
    max_heigth_room_z=0,
    max_width_x=0,
    r_color_domain=Domain(0, 1),
    g_color_domain=Domain(0, 1),
    b_color_domain=Domain(0, 1))  # -> encoded_image, r_channel_image, r_channel_values, g_channel_image, faces, g_channel_values, b_channel_image, b_channel_values; disabled
mesh_plane_3 = MeshPlane(Boundary=rectangle_3.Rectangle, WidthCount=resolution_3, HeightCount=resolution_3)  # -> Mesh, Area
mesh_encoded_image_3 = Mesh(mesh_plane_3.Mesh)
deconstruct_mesh_6 = DeconstructMesh(Mesh=mesh_encoded_image_3)  # -> Vertices, Faces, Colours, Normals
encoded_image_v_3_6 = EncodedImageV3(
    mersh_vectors=deconstruct_mesh_6.Vertices,
    dist_facade_skin=image_location_3,
    max_heigth_room_z=height,
    max_width_x=number_slider,
    facade_window_srf=cull_pattern_8,
    r_color_domain="255 to 30",
    skin_typology_srf=cluster_3.geometry,
    g_color_domain="70 to 255",
    back_room_wall_srf=move_2.Geometry,
    b_color_domain="255 to 30")  # -> encoded_image, r_channel_image, r_channel_values, g_channel_image, faces, g_channel_values, b_channel_image, b_channel_values
construct_mesh_3 = ConstructMesh(Vertices=deconstruct_mesh_6.Vertices, Faces=deconstruct_mesh_6.Faces, Colours=encoded_image_v_3_6.encoded_image)

# ----
# Model
model = HBModel(rooms=flatten(aperturesbyratio.hb_objs), shades=flatten(shade.shades), apertures=flatten(aperture.apertures))  # -> out, model; plug-in component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
vizall = HBVisualizeAll(hb_objs=flatten(model.model))  # -> geo; plug-in component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
vizwiref = HBVisualizeWireframe(hb_objs=flatten(model.model))  # -> geo; plug-in component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

hb_face_attributes = HBFaceAttributes({"Display Name": "display_name", "Simulation Name (Identifier)": "identifier", "Boundary Condition": "boundary_condition", "Has Parent": "has_parent", "Parent": "parent", "Azimuth": "azimuth", "Altitude": "altitude", "Area": "area", "Perimeter": "perimeter", "Face Type": "type", "Aperture Is Operable": "is_operable", "Door Is Glass": "is_glass"}, selected="Boundary Condition")
# Faces labels
lablefaces = HBLabelFaces(hb_objs=flatten(model.model), attribute=hb_face_attributes)  # -> label_text, base_pts, labels, wire_frame; plug-in component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

# ----
# Visualize
vizbytype = HBVisualizeByType(hb_objs=model.model)  # -> walls, interior_walls, roofs, ceilings, exterior_floors, interior_floors, air_walls, apertures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; plug-in component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
data_4 = Data(vizbytype.outdoor_shades)
mesh_edges = MeshEdges(Mesh=data_4)  # -> NakedEdges, InteriorEdges, NonManifoldEdges
data_5 = Data(mesh_edges.NakedEdges)
mesh_2 = Mesh(data_4)

# ----
# Encoded Image
# Inputs: Encoded Image
# Encoded Image Boundaries
# Encoded Image Resolution
# Clusters
resolution_4 = Panel("256")
image_location_4 = Slider(5, range=0..10)
encoded_image_v_1_4 = EncodedImageV1()  # -> output_b_channel, list_of_red_values, list_of_green_values, list_of_blue_values; disabled
encoded_image_v_2_4 = EncodedImageV2()  # -> colored_mesh, red_values, green_values, blue_values; disabled
skin_resolution_4 = Slider(35, range=0..100)  # disabled
value_list_4 = ValueList({"Red Channel": 0, "Green Channel": 1, "Blue Channel": 2}, selected="Red Channel")  # disabled
dom_4 = ConstructDomain(DomainStart="-8", DomainEnd="8")
rectangle_4 = Rectangle(Plane=move_5.Geometry, XSize=dom_4, YSize=dom_4, Radius=0)  # -> Rectangle, Length
encoded_image_v_3_7 = EncodedImageV3_2(
    max_heigth_room_z=0,
    max_width_x=0,
    r_color_domain=Domain(0, 1),
    g_color_domain=Domain(0, 1),
    b_color_domain=Domain(0, 1))  # -> encoded_image, r_channel_image, r_channel_values, g_channel_image, faces, g_channel_values, b_channel_image, b_channel_values; disabled
mesh_plane_4 = MeshPlane(Boundary=rectangle_4.Rectangle, WidthCount=resolution_4, HeightCount=resolution_4)  # -> Mesh, Area
mesh_encoded_image_4 = Mesh(mesh_plane_4.Mesh)
deconstruct_mesh_7 = DeconstructMesh(Mesh=mesh_encoded_image_4)  # -> Vertices, Faces, Colours, Normals
encoded_image_v_3_8 = EncodedImageV3_3(
    mersh_vectors=deconstruct_mesh_7.Vertices,
    dist_facade_skin=image_location_4,
    max_heigth_room_z=height,
    max_width_x=number_slider,
    facade_window_srf=cull_pattern_7,
    r_color_domain="255 to 30",
    skin_typology_srf=cluster_4.geometry,
    g_color_domain="70 to 255",
    back_room_wall_srf=move_3.Geometry,
    b_color_domain="255 to 30")  # -> encoded_image, r_channel_image, r_channel_values, g_channel_image, faces, g_channel_values, b_channel_image, b_channel_values
construct_mesh_4 = ConstructMesh(Vertices=deconstruct_mesh_7.Vertices, Faces=deconstruct_mesh_7.Faces, Colours=encoded_image_v_3_8.encoded_image)

# ----
# Sensor Grid
number_slider_12 = Slider(0.5, range=0..10)
genpts = LBGeneratePointGrid(geometry=move.Geometry, grid_size=number_slider_12)  # -> points, vectors, face_areas, mesh; plug-in component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
points = Data(genpts.points)

rebuild_mesh = RebuildMesh(
    Mesh=genpts.mesh,
    RebuildNormals=False,
    CullUnused=False,
    UnifyNormals=False,
    FlipNormals=True,
    IdenticalCombine=False,
    WeldVertices=0)

sensorgrid = HBSensorGrid(positions=points, mesh=rebuild_mesh)  # -> grid; plug-in component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
assigngridsviews = HBAssignGridsAndViews(model=model.model, grids=flatten(sensorgrid))  # -> model; plug-in component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

# ----
# Analysis parameters:
# 
# HB room - Indoor analysis:
# Apreture testing location : South
# period: Annual
# Wind speed: 0.2
# human body parameters: Seated - facing side way to the window
adaptivemap = HBAdaptiveComfortMap(
    model=assigngridsviews,
    epw=downloadepw.epw_file,
    ddy=downloadepw.ddy_file,
    run_period=analysisperiod.period,
    air_speed=number_slider_7,
    comfort_par=adaptpar,
    solar_body_par=solarbodypar,
    run=toggle)  # -> out, env_conds, op_temp, condition, deg_neut, TCP, HSP, CSP; plug-in component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

heatmap = LBSpatialHeatmap(values=adaptivemap.CSP, mesh=rebuild_mesh)  # -> mesh, legend, title, colors, legend_par, vis_set; plug-in component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
heatmap_2 = LBSpatialHeatmap(values=adaptivemap.HSP, mesh=rebuild_mesh)  # -> mesh, legend, title, colors, legend_par, vis_set; plug-in component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
heatmap_3 = LBSpatialHeatmap(values=adaptivemap.TCP, mesh=rebuild_mesh)  # -> mesh, legend, title, colors, legend_par, vis_set; plug-in component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

envmtx = HBReadEnvironmentMatrix(env_conds=adaptivemap.env_conds, load=Toggle(True))  # -> comf_mtx; plug-in component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
thermalmtx_2 = HBReadThermalMatrix(comf_result=adaptivemap.condition, load=Toggle(True))  # -> comf_mtx; plug-in component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
vizthermalmap_2 = HBVisualizeThermalMap(comf_mtx=envmtx, mesh=flatten(rebuild_mesh), legend_par=legendpar)  # -> out, mesh, legend, title, colors, values; plug-in component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
average = Average(Input=adaptivemap.HSP)
average_2 = Average(Input=adaptivemap.TCP)
average_3 = Average(Input=vizthermalmap_2.values)

round_to_decimal_place_2 = RoundToDecimalPlace(NumberX=average_3, DecimalPlace=Slider(1, range=0..10), RoundType=0)  # -> Rounded, Difference
tag_2 = TextTag3D(
    Location=points,
    Text=round_to_decimal_place_2.Rounded,
    Size=Slider(0.1, range=0..0.1),
    Colour=ColourSwatch(SwatchColor=RGB(0, 0, 0)),
    Justification=7)

wallacei_x = WallaceiX(
    Genes=[number_slider, number_slider_3, number_slider_11, no_of_panels, no_of_vertical_divisions],
    Objectives=[average_3, average_2, average],
    Phenotype=[vizthermalmap_2.mesh, brep_brep.Curves],
    allFitness="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",
    allFrontIdx="0|0;0|1;0|4;0|6;0|7;0|8;0|9;0|12;0|13;0|14;0|15;0|16;0|17;0|18;0|19;0|20;0|21;0|22;0|23;0|24;0|25;0|26;0|27;0|29;0|30;0|31;0|33;0|38;0|39;0|43;0|44;0|46;0|48;0|49",
    allGenomes="5|4|0.7|8_8|8|0.53|10_4|11|0.04|4_5|15|1.02|7_5|10|1.06|8_10|4|0.24|5_9|5|1.19|4_9|14|0.83|8_8|3|1.49|8_9|4|0.77|6_5|15|1.04|5_6|11|1.02|6_5|7|0.79|3_5|11|0.59|3_10|4|1.46|6_7|4|0.18|4_4|7|0.82|4_10|14|1.19|4_4|5|0.64|10_6|12|1.42|3_6|7|0.09|6_6|8|0.56|2_7|13|1.28|8_4|3|1.33|4_9|9|0.45|3_4|7|0.71|5_7|7|0.1|3_5|8|1.13|3_4|13|1.49|5_10|11|1.28|8_10|9|1.03|3_3|3|0.2|3_5|5|0.12|9_6|13|1.49|3_9|11|1.37|2_5|5|1.12|3_4|11|0.95|4_3|10|0.36|4_7|10|0.27|7_8|7|0.52|6_4|15|1.31|2_5|13|1.05|4_9|13|0.71|4_8|13|0.57|8_9|9|0.12|5_6|14|0.07|8_10|13|0.46|9_8|8|0.66|6_5|8|1.32|5_5|11|1.23|4",
    curFrontIdx="0|0;0|1;0|4;0|6;0|7;0|8;0|9;0|12;0|13;0|14;0|15;0|16;0|17;0|18;0|19;0|20;0|21;0|22;0|23;0|24;0|25;0|26;0|27;0|29;0|30;0|31;0|33;0|38;0|39;0|43;0|44;0|46;0|48;0|49",
    curFrontIdxSave="0|0;0|1;0|4;0|6;0|7;0|8;0|9;0|12;0|13;0|14;0|15;0|16;0|17;0|18;0|19;0|20;0|21;0|22;0|23;0|24;0|25;0|26;0|27;0|29;0|30;0|31;0|33;0|38;0|39;0|43;0|44;0|46;0|48;0|49",
    popGen="50,1",
    total="3117485",
    wlcDone=True)  # -> WallaceiGenomes, FitnessValues, Data, Phenotypes
number_slider_13 = Slider(20, range=0..100)
distribute_to_grid = DistributeToGrid(
    FitnessValues=wallacei_x.FitnessValues,
    WallaceiPhenotypes=wallacei_x.Phenotypes,
    SizeOfTheGridInTheXDirection=number_slider_13,
    SizeOfTheGridInTheYDirection=number_slider_13,
    OutputOptions=0)  # -> DistributedFitnessValues, DistributedData, DistributedGeometries, DistributedMeshes, DistributedNumbers, GridLocations
tag_3 = TextTag3D(
    Text=distribute_to_grid.DistributedFitnessValues,
    Size=Slider(0.1, range=0..0.1),
    Colour=ColourSwatch(SwatchColor=RGB(0, 0, 0)),
    Justification=7)

data_6 = Data(flatten(Tree({0}: ["C:\Users\Aly Mahmoud\simulation\unnamed\adaptive_comfort_map\initial_results/conditions", "C:\Users\Aly Mahmoud\simulation\unnamed\adaptive_comfort_map\results/temperature", "C:\Users\Aly Mahmoud\simulation\unnamed\adaptive_comfort_map\results/condition", "C:\Users\Aly Mahmoud\simulation\unnamed\adaptive_comfort_map\results/condition_intensity"], {0;0}: [47.58208955, 47.88059701, 47.97014925, 47.91044776, 47.73134328, 47.82089552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])))  # disabled
list_item_5 = ListItem(List=data_6, Index=0, Wrap=True)  # -> Item, Item1, Item2, Item3, Item4, Item5, Item6, Item7; disabled
boolean_toggle_4 = BooleanToggle(True)  # disabled
mesh_3 = Mesh(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)  # disabled
thermalmtx_3 = HBReadThermalMatrix(comf_result=list_item_5.Item2, load=boolean_toggle_4)  # -> comf_mtx; disabled; plug-in component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
face_normals_2 = FaceNormals(Mesh=mesh_3)  # -> Centers, Normals; disabled
number_slider_14 = Slider(2, range=0..10)  # disabled
number_slider_15 = Slider(0.1, range=0..0.1)  # disabled
swatch_2 = ColourSwatch(SwatchColor=RGB(0, 0, 0))  # disabled

envmtx_2 = HBReadEnvironmentMatrix(env_conds=list_item_5.Item, load=boolean_toggle_3)  # -> comf_mtx; disabled; plug-in component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

vizthermalmap_3 = HBVisualizeThermalMap(comf_mtx=envmtx_2, mesh=flatten(mesh_3))  # -> out, mesh, legend, title, colors, values; disabled; plug-in component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
round_to_decimal_place_3 = RoundToDecimalPlace(NumberX=vizthermalmap_3.values, DecimalPlace=number_slider_14, RoundType=0)  # -> Rounded, Difference; disabled
tag_4 = TextTag3D(
    Location=face_normals_2.Centers,
    Text=round_to_decimal_place_3.Rounded,
    Size=number_slider_15,
    Colour=swatch_2,
    Justification=7)  # disabled

# ==== cluster EncodedImageV1
back_surface_of_room = ClusterInput()
mjoin = MeshJoin(Meshes=back_surface_of_room)
mesh = ClusterInput()
mesh_2 = Mesh(back_surface_of_room)
mesh_3 = Mesh(mesh)
center = Center(Geometry=mjoin, forall=False)  # -> Center, Dimension
center_2 = Center(Geometry=mesh, forall=False)  # -> Center, Dimension
deconstruct_mesh = DeconstructMesh(Mesh=mesh)  # -> Vertices, Faces, Colours, Normals

# ----
# Vector for Projection
vector_2pt = Vector2Pt(PointA=center_2.Center, PointB=center.Center, Unitize=False)  # -> Vector, Length

# ----
# Points
project_point = ProjectPoint(Point=deconstruct_mesh.Vertices, Direction=vector_2pt.Vector, Geometry=back_surface_of_room)  # -> Point, Index
deconstruct = Deconstruct(Point=project_point.Point)  # -> XComponent, YComponent, ZComponent

vdis = VectorDisplay(Anchor=center_2.Center, Vector=vector_2pt.Vector)
absolute = Absolute(Value=deconstruct.YComponent)
control_wire_display = ControlWireDisplay(WireDisplay="1")

# ----
# Point domain in Y
bounds = Bounds(Numbers=absolute)
deconstruct_domain = DeconstructDomain(Domain=bounds)  # -> Start, End

channel = ClusterInput()

# ----
# Checks if flat
subtraction = Subtraction(A=deconstruct_domain.Start, B=deconstruct_domain.End)
equality_within_tolerance = EqualityWithinTolerance(FirstNumber=subtraction, SecondNumber="0,00", Tolerance=0.01)  # -> Equality, Inequality

# ----
# Condition:
# Geometry of Surface
condition_flat = Panel("0")
condition_not_flat = Data(deconstruct_domain.End)
stream_filter = StreamFilter(Gate=equality_within_tolerance.Equality, Stream0=condition_not_flat, Stream1=condition_flat)

construct_domain = ConstructDomain(DomainStart=deconstruct_domain.Start, DomainEnd=stream_filter)

# ----
# Red Channel
panel = Panel("0")
equality = Equality(FirstNumber=channel, SecondNumber=panel)  # -> Equality, Inequality
stream_filter_2 = StreamFilter(Gate=equality.Equality, Stream0="0 to 0", Stream1="255 to 30")
remap_numbers = RemapNumbers(Value=absolute, Source=construct_domain, Target=stream_filter_2)  # -> Mapped, Clipped

# ----
# Blue Channel
panel_2 = Panel("2")
equality_2 = Equality(FirstNumber=channel, SecondNumber=panel_2)  # -> Equality, Inequality
stream_filter_3 = StreamFilter(Gate=equality_2.Equality, Stream0="0 to 0", Stream1="255 to 30")
remap_numbers_2 = RemapNumbers(Value=absolute, Source=construct_domain, Target=stream_filter_3)  # -> Mapped, Clipped

# ----
# Green Channel
panel_3 = Panel("1")
equality_3 = Equality(FirstNumber=channel, SecondNumber=panel_3)  # -> Equality, Inequality
stream_filter_4 = StreamFilter(Gate=equality_3.Equality, Stream0="0 to 0", Stream1="60 to 255")
remap_numbers_3 = RemapNumbers(Value=absolute, Source=construct_domain, Target=stream_filter_4)  # -> Mapped, Clipped

colour_rgb = ColourRGB(Alpha=255, Red=remap_numbers.Mapped, Green=remap_numbers_3.Mapped, Blue=remap_numbers_2.Mapped)

# ----
# Replace <null> cells
# with 0,0,1 (black)
null_item = NullItem(Item=colour_rgb)  # -> NullFlags, InvalidFlags, Description
list_length = ListLength(List=colour_rgb)
series = Series(Start=0, Step=1, Count=list_length)
cull_pattern = CullPattern(List=series, CullPattern=null_item.InvalidFlags)

replace_items = ReplaceItems(List=remap_numbers_2.Mapped, Item="1", Indices=cull_pattern, Wrap=False)
replace_items_2 = ReplaceItems(List=remap_numbers.Mapped, Item="1", Indices=cull_pattern, Wrap=False)
replace_items_3 = ReplaceItems(List=remap_numbers_3.Mapped, Item="1", Indices=cull_pattern, Wrap=False)
list_of_red_values = ClusterOutput(replace_items_2)
list_of_blue_values = ClusterOutput(replace_items)
list_of_green_values = ClusterOutput(replace_items_3)
b_channel = Panel("0,0,1")
r_channel = Panel("1,0,0")
g_channel = Panel("0,1,0")
stream_filter_5 = StreamFilter(Gate=channel, Stream0=r_channel, Stream1=g_channel, Stream2=b_channel)

# ----
# Create List colors
replace_items_4 = ReplaceItems(List=colour_rgb, Item=stream_filter_5, Indices=cull_pattern, Wrap=False)

panel_4 = Panel(replace_items_4)

# ----
# Output Gradient
construct_mesh = ConstructMesh(Vertices=deconstruct_mesh.Vertices, Faces=deconstruct_mesh.Faces, Colours=replace_items_4)

output_b_channel = ClusterOutput(construct_mesh)

# ==== cluster EncodedImageV2
mesh_image = ClusterInput()
geomtery_to_encode = ClusterInput()
skin_typology_resolution = ClusterInput()
channel = ClusterInput()
direction_projection = ClusterInput()
control_wire_display = ControlWireDisplay(WireDisplay="1")
number_slider = Slider(9, range=0..10)
mesh_surface = MeshSurface(
    Surface=geomtery_to_encode,
    UCount=Slider(256, range=0..256),
    VCount=skin_typology_resolution,
    Overhang=True,
    Equalize=False)
deconstruct_mesh = DeconstructMesh(Mesh=mesh_image)  # -> Vertices, Faces, Colours, Normals
mesh_join = MeshJoin(Meshes=mesh_surface)

deconstruct_mesh_2 = DeconstructMesh(Mesh=mesh_join)  # -> Vertices, Faces, Colours, Normals
deconstruct = Deconstruct(Point=deconstruct_mesh_2.Vertices)  # -> XComponent, YComponent, ZComponent
construct_point = ConstructPoint(XCoordinate=deconstruct.XComponent, YCoordinate="-5", ZCoordinate=deconstruct.ZComponent)

# ----
# Points
mesh_ray = MeshRay(Mesh=mesh_join, Point=deconstruct_mesh.Vertices, Direction=expr("-x", direction_projection))  # -> Point, Hit; disabled

list_length = ListLength(List=deconstruct_mesh.Vertices)
create_rtree = CreateRTree(InputGeometry=flatten(deconstruct_mesh.Vertices))
series = Series(Start=0, Step="0", Count=list_length)
rtree_closest_point = RTreeClosestPoint(SearchPoints=flatten(construct_point), RTree=create_rtree)  # -> ClosestPoint, ClosestIndex
replace_items = ReplaceItems(List=series, Item=deconstruct.YComponent, Indices=rtree_closest_point.ClosestIndex, Wrap=False)

absolute = Absolute(Value=replace_items)
create_set = CreateSet(List=absolute)  # -> Set, Map
equality = Equality(FirstNumber=absolute, SecondNumber=Slider(0, range=0..100))  # -> Equality, Inequality
cull_pattern = CullPattern(List=absolute, CullPattern=equality.Inequality)
# Point domain in Y
bounds = Bounds(Numbers=cull_pattern)
deconstruct_domain = DeconstructDomain(Domain=bounds)  # -> Start, End
# Checks if flat
subtraction = Subtraction(A=deconstruct_domain.Start, B=deconstruct_domain.End)
# Red Channel
panel = Panel("0")
condition_flat = Panel("0")
# Condition:
# Geometry of Surface
condition_not_flat = Data(deconstruct_domain.End)
# Blue Channel
panel_2 = Panel("2")
# Green Channel
panel_3 = Panel("1")
equality_within_tolerance = EqualityWithinTolerance(FirstNumber=subtraction, SecondNumber="0,00", Tolerance=0.01)  # -> Equality, Inequality
equality_2 = Equality(FirstNumber=channel, SecondNumber=panel_3)  # -> Equality, Inequality
equality_3 = Equality(FirstNumber=channel, SecondNumber=panel)  # -> Equality, Inequality
equality_4 = Equality(FirstNumber=channel, SecondNumber=panel_2)  # -> Equality, Inequality
stream_filter = StreamFilter(Gate=equality_within_tolerance.Equality, Stream0=condition_not_flat, Stream1=condition_flat)
construct_domain = ConstructDomain(DomainStart=deconstruct_domain.Start, DomainEnd=stream_filter)
stream_filter_2 = StreamFilter(Gate=equality_2.Equality, Stream0="0 to 0", Stream1="1 to 255")
stream_filter_3 = StreamFilter(Gate=equality_4.Equality, Stream0="0 to 0", Stream1="255 to 30")
stream_filter_4 = StreamFilter(Gate=equality_3.Equality, Stream0="0 to 0", Stream1="255 to 30")
remap_numbers = RemapNumbers(Value=absolute, Source=construct_domain, Target=stream_filter_4)  # -> Mapped, Clipped
remap_numbers_2 = RemapNumbers(Value=absolute, Source=construct_domain, Target=stream_filter_3)  # -> Mapped, Clipped
remap_numbers_3 = RemapNumbers(Value=absolute, Source=construct_domain, Target=stream_filter_2)  # -> Mapped, Clipped
colour_rgb = ColourRGB(Alpha=255, Red=remap_numbers.Mapped, Green=remap_numbers_3.Mapped, Blue=remap_numbers_2.Mapped)
null_item = NullItem(Item=colour_rgb)  # -> NullFlags, InvalidFlags, Description
# Replace <null> cells
# with 0,0,1 (black)
list_length_2 = ListLength(List=colour_rgb)
series_2 = Series(Start=0, Step=1, Count=list_length_2)
cull_pattern_2 = CullPattern(List=series_2, CullPattern=null_item.InvalidFlags)
replace_items_2 = ReplaceItems(List=remap_numbers_2.Mapped, Item="1", Indices=cull_pattern_2, Wrap=False)
replace_items_3 = ReplaceItems(List=remap_numbers_3.Mapped, Item="1", Indices=cull_pattern_2, Wrap=False)
replace_items_4 = ReplaceItems(List=remap_numbers.Mapped, Item="1", Indices=cull_pattern_2, Wrap=False)
blue_values = ClusterOutput(replace_items_2)
red_values = ClusterOutput(replace_items_4)
green_values = ClusterOutput(replace_items_3)
b_channel = Panel("0,0,1")
r_channel = Panel("1,0,0")
g_channel = Panel("0,1,0")
stream_filter_5 = StreamFilter(Gate=channel, Stream0=r_channel, Stream1=g_channel, Stream2=b_channel)
# Create List colors
replace_items_5 = ReplaceItems(List=colour_rgb, Item=stream_filter_5, Indices=cull_pattern_2, Wrap=False)
# Output Gradient
construct_mesh = ConstructMesh(Vertices=deconstruct_mesh.Vertices, Faces=deconstruct_mesh.Faces, Colours=replace_items_5)
panel_4 = Panel(replace_items_5)
colored_mesh = ClusterOutput(construct_mesh)

# ==== cluster EncodedImageV3
mersh_vectors = ClusterInput()
dist_facade_skin = ClusterInput()
max_heigth_room_z = ClusterInput()
max_width_x = ClusterInput()

# ----
# Filter Points
deconstruct = Deconstruct(Point=mersh_vectors)  # -> XComponent, YComponent, ZComponent
smaller_than = SmallerThan(FirstNumber=deconstruct.XComponent, SecondNumber=max_width_x)  # -> SmallerThan, OrEqualTo
larger_than = LargerThan(FirstNumber=deconstruct.ZComponent, SecondNumber="0")  # -> LargerThan, OrEqualTo
smaller_than_2 = SmallerThan(FirstNumber=deconstruct.ZComponent, SecondNumber=max_heigth_room_z)  # -> SmallerThan, OrEqualTo
larger_than_2 = LargerThan(FirstNumber=deconstruct.XComponent, SecondNumber="0")  # -> LargerThan, OrEqualTo
gate_and = GateAnd(A=larger_than.OrEqualTo, B=smaller_than_2.OrEqualTo, C=larger_than_2.OrEqualTo, D=smaller_than.OrEqualTo)
cull_pattern = CullPattern(List=mersh_vectors, CullPattern=gate_and)

facade_window_srf = ClusterInput()
r_color_domain = ClusterInput()
skin_typology_srf = ClusterInput()
g_color_domain = ClusterInput()
back_room_wall_srf = ClusterInput()
b_color_domain = ClusterInput()

deconstruct_2 = Deconstruct(Point=cull_pattern)  # -> XComponent, YComponent, ZComponent
equality = Equality(FirstNumber=deconstruct_2.ZComponent, SecondNumber="0")  # -> Equality, Inequality
cull_pattern_2 = CullPattern(List=cull_pattern, CullPattern=equality.Equality)
list_length = ListLength(List=cull_pattern_2)

deconstruct_3 = Deconstruct(Point=cull_pattern)  # -> XComponent, YComponent, ZComponent
equality_2 = Equality(FirstNumber=deconstruct_3.XComponent, SecondNumber="0")  # -> Equality, Inequality
cull_pattern_3 = CullPattern(List=cull_pattern, CullPattern=equality_2.Equality)
list_length_2 = ListLength(List=cull_pattern_3)

data = Data(dist_facade_skin)

mesh_surface = MeshSurface(Surface=back_room_wall_srf, UCount=list_length, VCount=list_length_2, Overhang=True, Equalize=False)
mesh_join = MeshJoin(Meshes=mesh_surface)
deconstruct_mesh = DeconstructMesh(Mesh=mesh_join)  # -> Vertices, Faces, Colours, Normals
deconstruct_4 = Deconstruct(Point=deconstruct_mesh.Vertices)  # -> XComponent, YComponent, ZComponent
round = Round(Number=deconstruct_4.YComponent)  # -> Nearest, Floor, Ceiling
construct_point = ConstructPoint(XCoordinate=deconstruct_4.XComponent, YCoordinate=data, ZCoordinate=deconstruct_4.ZComponent)
bounds = Bounds(Numbers=round.Nearest)

mesh_surface_2 = MeshSurface(Surface=facade_window_srf, UCount=list_length, VCount=list_length_2, Overhang=True, Equalize=False)
mesh_join_2 = MeshJoin(Meshes=mesh_surface_2)
deconstruct_mesh_2 = DeconstructMesh(Mesh=mesh_join_2)  # -> Vertices, Faces, Colours, Normals
deconstruct_5 = Deconstruct(Point=deconstruct_mesh_2.Vertices)  # -> XComponent, YComponent, ZComponent
round_2 = Round(Number=deconstruct_5.YComponent)  # -> Nearest, Floor, Ceiling
construct_point_2 = ConstructPoint(XCoordinate=deconstruct_5.XComponent, YCoordinate=data, ZCoordinate=deconstruct_5.ZComponent)
bounds_2 = Bounds(Numbers=round_2.Nearest)

# ----
# List Generation
list_length_3 = ListLength(List=mersh_vectors)
duplicate_data = DuplicateData(Data="0,0,0", Number=list_length_3, Order=True)
duplicate_data_2 = DuplicateData(Data="0", Number=list_length_3, Order=True)

deconstruct_6 = Deconstruct(Point=deconstruct_mesh_2.Vertices)  # -> XComponent, YComponent, ZComponent
construct_point_3 = ConstructPoint(XCoordinate=0, YCoordinate=0, ZCoordinate=0)
control_wire_display = ControlWireDisplay(WireDisplay="1")

mesh_surface_3 = MeshSurface(Surface=flatten(skin_typology_srf), UCount=list_length_2, VCount=list_length, Overhang=True, Equalize=False)
mesh_join_3 = MeshJoin(Meshes=mesh_surface_3)
deconstruct_mesh_3 = DeconstructMesh(Mesh=mesh_join_3)  # -> Vertices, Faces, Colours, Normals

deconstruct_7 = Deconstruct(Point=deconstruct_mesh_3.Vertices)  # -> XComponent, YComponent, ZComponent

round_3 = Round(Number=deconstruct_7.YComponent)  # -> Nearest, Floor, Ceiling
bounds_3 = Bounds(Numbers=deconstruct_7.YComponent)

panel = Panel(deconstruct_7.YComponent)
construct_point_4 = ConstructPoint(XCoordinate=deconstruct_7.XComponent, YCoordinate=data, ZCoordinate=deconstruct_7.ZComponent)
panel_2 = Panel(round_3.Nearest)
faces = ClusterOutput(deconstruct_mesh_3.Faces)

remap_numbers = RemapNumbers(Value=deconstruct_4.YComponent, Source=bounds, Target=b_color_domain)  # -> Mapped, Clipped
create_rtree = CreateRTree(InputGeometry=flatten(mersh_vectors))
rtree_closest_point = RTreeClosestPoint(SearchPoints=flatten(construct_point), RTree=create_rtree)  # -> ClosestPoint, ClosestIndex

round_4 = Round(Number=remap_numbers.Mapped)  # -> Nearest, Floor, Ceiling

concatenate = Concatenate(FragmentB="0,0", FragmentA=round_4.Nearest, JoinSeparator=",")

# ----
# B channel Image
replace_items = ReplaceItems(List=duplicate_data, Item=concatenate, Indices=rtree_closest_point.ClosestIndex, Wrap=False)

# ----
# Only B values
replace_items_2 = ReplaceItems(List=duplicate_data_2, Item=round_4.Nearest, Indices=rtree_closest_point.ClosestIndex, Wrap=False)

# ----
# Blue Channel
b_channel_values = ClusterOutput(replace_items_2)
b_channel_image = ClusterOutput(replace_items)

remap_numbers_2 = RemapNumbers(Value=deconstruct_5.YComponent, Source=bounds_2, Target=r_color_domain)  # -> Mapped, Clipped
create_rtree_2 = CreateRTree(InputGeometry=flatten(mersh_vectors))
rtree_closest_point_2 = RTreeClosestPoint(SearchPoints=flatten(construct_point_2), RTree=create_rtree_2)  # -> ClosestPoint, ClosestIndex

round_5 = Round(Number=remap_numbers_2.Mapped)  # -> Nearest, Floor, Ceiling

concatenate_2 = Concatenate(FragmentB=round_5.Nearest, FragmentA="0,0", JoinSeparator=",")

# ----
# R channel Image
replace_items_3 = ReplaceItems(List=duplicate_data, Item=concatenate_2, Indices=rtree_closest_point_2.ClosestIndex, Wrap=False)

# ----
# Only R values
replace_items_4 = ReplaceItems(List=duplicate_data_2, Item=round_5.Nearest, Indices=rtree_closest_point_2.ClosestIndex, Wrap=False)

# ----
# Red Channel
r_channel_values = ClusterOutput(replace_items_4)
r_channel_image = ClusterOutput(replace_items_3)

remap_numbers_3 = RemapNumbers(Value=deconstruct_7.YComponent, Source=bounds_3, Target=g_color_domain)  # -> Mapped, Clipped
create_rtree_3 = CreateRTree(InputGeometry=flatten(mersh_vectors))
rtree_closest_point_3 = RTreeClosestPoint(SearchPoints=flatten(construct_point_4), RTree=create_rtree_3)  # -> ClosestPoint, ClosestIndex

round_6 = Round(Number=remap_numbers_3.Mapped)  # -> Nearest, Floor, Ceiling

concatenate_3 = Concatenate(Fragment_B="0", A=round_6.Nearest, B="0", JoinSeparator=",")

# ----
# G channel Image
replace_items_5 = ReplaceItems(List=duplicate_data, Item=concatenate_3, Indices=rtree_closest_point_3.ClosestIndex, Wrap=False)

# ----
# Only G values
replace_items_6 = ReplaceItems(List=duplicate_data_2, Item=round_6.Nearest, Indices=rtree_closest_point_3.ClosestIndex, Wrap=False)

# ----
# Green Channel
g_channel_image = ClusterOutput(replace_items_5)
g_channel_values = ClusterOutput(replace_items_6)

concatenate_4 = Concatenate(R=replace_items_4, G=replace_items_6, B=replace_items_2, JoinSeparator=",")
encoded_image = ClusterOutput(concatenate_4)

# ==== cluster EncodedImageV3_2
mersh_vectors = ClusterInput()
dist_facade_skin = ClusterInput()
max_heigth_room_z = ClusterInput()
max_width_x = ClusterInput()

# ----
# Filter Points
deconstruct = Deconstruct(Point=mersh_vectors)  # -> XComponent, YComponent, ZComponent
smaller_than = SmallerThan(FirstNumber=deconstruct.YComponent, SecondNumber=max_width_x)  # -> SmallerThan, OrEqualTo
larger_than = LargerThan(FirstNumber=deconstruct.ZComponent, SecondNumber="0")  # -> LargerThan, OrEqualTo
smaller_than_2 = SmallerThan(FirstNumber=deconstruct.ZComponent, SecondNumber=max_heigth_room_z)  # -> SmallerThan, OrEqualTo
larger_than_2 = LargerThan(FirstNumber=deconstruct.YComponent, SecondNumber="0")  # -> LargerThan, OrEqualTo
gate_and = GateAnd(A=larger_than.OrEqualTo, B=smaller_than_2.OrEqualTo, C=larger_than_2.OrEqualTo, D=smaller_than.OrEqualTo)
cull_pattern = CullPattern(List=mersh_vectors, CullPattern=gate_and)

facade_window_srf = ClusterInput()
r_color_domain = ClusterInput()
skin_typology_srf = ClusterInput()
g_color_domain = ClusterInput()
back_room_wall_srf = ClusterInput()
b_color_domain = ClusterInput()

deconstruct_2 = Deconstruct(Point=cull_pattern)  # -> XComponent, YComponent, ZComponent
equality = Equality(FirstNumber=deconstruct_2.ZComponent, SecondNumber="0")  # -> Equality, Inequality
cull_pattern_2 = CullPattern(List=cull_pattern, CullPattern=equality.Equality)
list_length = ListLength(List=cull_pattern_2)

deconstruct_3 = Deconstruct(Point=cull_pattern)  # -> XComponent, YComponent, ZComponent
equality_2 = Equality(FirstNumber=deconstruct_3.YComponent, SecondNumber="0")  # -> Equality, Inequality
cull_pattern_3 = CullPattern(List=cull_pattern, CullPattern=equality_2.Equality)
list_length_2 = ListLength(List=cull_pattern_3)

data = Data(dist_facade_skin)

mesh_surface = MeshSurface(Surface=back_room_wall_srf, UCount=list_length, VCount=list_length_2, Overhang=True, Equalize=False)
mesh_join = MeshJoin(Meshes=mesh_surface)
deconstruct_mesh = DeconstructMesh(Mesh=mesh_join)  # -> Vertices, Faces, Colours, Normals
deconstruct_4 = Deconstruct(Point=deconstruct_mesh.Vertices)  # -> XComponent, YComponent, ZComponent
round = Round(Number=deconstruct_4.YComponent)  # -> Nearest, Floor, Ceiling
construct_point = ConstructPoint(XCoordinate=deconstruct_4.XComponent, YCoordinate=data, ZCoordinate=deconstruct_4.ZComponent)
bounds = Bounds(Numbers=round.Nearest)

# ----
# List Generation
list_length_3 = ListLength(List=mersh_vectors)
duplicate_data = DuplicateData(Data="0,0,0", Number=list_length_3, Order=True)
duplicate_data_2 = DuplicateData(Data="0", Number=list_length_3, Order=True)

control_wire_display = ControlWireDisplay(WireDisplay="1")

mesh_surface_2 = MeshSurface(Surface=flatten(skin_typology_srf), UCount=list_length_2, VCount=list_length, Overhang=True, Equalize=False)
mesh_join_2 = MeshJoin(Meshes=mesh_surface_2)
deconstruct_mesh_2 = DeconstructMesh(Mesh=mesh_join_2)  # -> Vertices, Faces, Colours, Normals

deconstruct_5 = Deconstruct(Point=deconstruct_mesh_2.Vertices)  # -> XComponent, YComponent, ZComponent

round_2 = Round(Number=deconstruct_5.XComponent)  # -> Nearest, Floor, Ceiling
bounds_2 = Bounds(Numbers=deconstruct_5.XComponent)

panel = Panel(deconstruct_5.XComponent)
construct_point_2 = ConstructPoint(XCoordinate=data, YCoordinate=deconstruct_5.YComponent, ZCoordinate=deconstruct_5.ZComponent)
panel_2 = Panel(round_2.Nearest)
faces = ClusterOutput(deconstruct_mesh_2.Faces)

mesh_surface_3 = MeshSurface(Surface=facade_window_srf, UCount=list_length, VCount=list_length_2, Overhang=True, Equalize=False)
mesh_join_3 = MeshJoin(Meshes=mesh_surface_3)
deconstruct_mesh_3 = DeconstructMesh(Mesh=mesh_join_3)  # -> Vertices, Faces, Colours, Normals
deconstruct_6 = Deconstruct(Point=deconstruct_mesh_3.Vertices)  # -> XComponent, YComponent, ZComponent
construct_point_3 = ConstructPoint(XCoordinate=0, YCoordinate=0, ZCoordinate=0)

deconstruct_7 = Deconstruct(Point=deconstruct_mesh_3.Vertices)  # -> XComponent, YComponent, ZComponent

round_3 = Round(Number=deconstruct_7.XComponent)  # -> Nearest, Floor, Ceiling
bounds_3 = Bounds(Numbers=round_3.Nearest)

construct_point_4 = ConstructPoint(XCoordinate=data, YCoordinate=deconstruct_7.YComponent, ZCoordinate=deconstruct_7.ZComponent)

remap_numbers = RemapNumbers(Value=deconstruct_4.YComponent, Source=bounds, Target=b_color_domain)  # -> Mapped, Clipped
create_rtree = CreateRTree(InputGeometry=flatten(mersh_vectors))
rtree_closest_point = RTreeClosestPoint(SearchPoints=flatten(construct_point), RTree=create_rtree)  # -> ClosestPoint, ClosestIndex

round_4 = Round(Number=remap_numbers.Mapped)  # -> Nearest, Floor, Ceiling

concatenate = Concatenate(FragmentB="0,0", FragmentA=round_4.Nearest, JoinSeparator=",")

# ----
# B channel Image
replace_items = ReplaceItems(List=duplicate_data, Item=concatenate, Indices=rtree_closest_point.ClosestIndex, Wrap=False)

# ----
# Only B values
replace_items_2 = ReplaceItems(List=duplicate_data_2, Item=round_4.Nearest, Indices=rtree_closest_point.ClosestIndex, Wrap=False)

# ----
# Blue Channel
b_channel_values = ClusterOutput(replace_items_2)
b_channel_image = ClusterOutput(replace_items)

remap_numbers_2 = RemapNumbers(Value=deconstruct_7.XComponent, Source=bounds_3, Target=r_color_domain)  # -> Mapped, Clipped
create_rtree_2 = CreateRTree(InputGeometry=flatten(mersh_vectors))
rtree_closest_point_2 = RTreeClosestPoint(SearchPoints=flatten(construct_point_4), RTree=create_rtree_2)  # -> ClosestPoint, ClosestIndex

round_5 = Round(Number=remap_numbers_2.Mapped)  # -> Nearest, Floor, Ceiling

concatenate_2 = Concatenate(FragmentB=round_5.Nearest, FragmentA="0,0", JoinSeparator=",")

# ----
# R channel Image
replace_items_3 = ReplaceItems(List=duplicate_data, Item=concatenate_2, Indices=rtree_closest_point_2.ClosestIndex, Wrap=False)

# ----
# Only R values
replace_items_4 = ReplaceItems(List=duplicate_data_2, Item=round_5.Nearest, Indices=rtree_closest_point_2.ClosestIndex, Wrap=False)

# ----
# Red Channel
r_channel_values = ClusterOutput(replace_items_4)
r_channel_image = ClusterOutput(replace_items_3)

remap_numbers_3 = RemapNumbers(Value=deconstruct_5.XComponent, Source=bounds_2, Target=g_color_domain)  # -> Mapped, Clipped
create_rtree_3 = CreateRTree(InputGeometry=flatten(mersh_vectors))
rtree_closest_point_3 = RTreeClosestPoint(SearchPoints=flatten(construct_point_2), RTree=create_rtree_3)  # -> ClosestPoint, ClosestIndex

round_6 = Round(Number=remap_numbers_3.Mapped)  # -> Nearest, Floor, Ceiling

concatenate_3 = Concatenate(Fragment_B="0", A=round_6.Nearest, B="0", JoinSeparator=",")

# ----
# G channel Image
replace_items_5 = ReplaceItems(List=duplicate_data, Item=concatenate_3, Indices=rtree_closest_point_3.ClosestIndex, Wrap=False)

# ----
# Only G values
replace_items_6 = ReplaceItems(List=duplicate_data_2, Item=round_6.Nearest, Indices=rtree_closest_point_3.ClosestIndex, Wrap=False)

# ----
# Green Channel
g_channel_image = ClusterOutput(replace_items_5)
g_channel_values = ClusterOutput(replace_items_6)

concatenate_4 = Concatenate(R=replace_items_4, G=replace_items_6, B=replace_items_2, JoinSeparator=",")
encoded_image = ClusterOutput(concatenate_4)

# ==== cluster Cluster

length = Slider(44, range=0..100)
width = Slider(6, range=0..100)
xz = XZPlane(Origin=Point(0, 0, 0))

vertical_depth_bottom = Slider(-0.301, range=-2..0)
thickness_of_panels = Slider(0, range=0..1)
horizontal_depth_min = Slider(1.063, range=0.1..4)
horizontal_depth_maximumn = Slider(0, range=0..2)
vertical_depth_top = Slider(0.9, range=0.2..1.2)

V = ClusterInput()
N = ClusterInput()
no_of_panels = ClusterOutput(V)
multiplication = Multiplication(A=V, B=0.041)
srf = ClusterInput()
division = Division(A=width, B=V)
subtraction = Subtraction(A=division, B=vertical_depth_top)
neg = Negative(Value=subtraction)

# ----
# Facade Size
rectangle = Rectangle(Plane=xz, XSize=length, YSize=width, Radius=0)  # -> Rectangle, Length
srf_2 = Surface(srf)
divide = DivideDomain²(Domain=srf_2, UCount=Slider(1, range=0..1), VCount=V)
subsrf = Isotrim(Surface=graft(srf_2), Domain=divide)
debrep = DeconstructBrep(Brep=subsrf)  # -> Faces, Edges, Vertices
item = ListItem(List=debrep.Edges, Index=0, Wrap=True)
range = Range(Domain=Domain(0, 1), Steps=expr("x-1", N))
graph = GraphMapper(range, x0=0, x1=1, y0=0, y1=1, container_name="Sine", Equation_px=[0, 0.2374285758], Equation_py=[0, 0.6601299047])
divide_2 = DivideCurve(Curve=item, Count=N, Kinks=False)  # -> Points, Tangents, Parameters
series = Series(Start=0, Step=Slider(1, range=0..1), Count=V)
bnd = Bounds(Numbers=graph)
dom = ConstructDomain(DomainStart=multiplication, DomainEnd=horizontal_depth_maximumn)
dom_2 = ConstructDomain(DomainStart=neg, DomainEnd=vertical_depth_bottom)
remap = RemapNumbers(Value=graph, Source=bnd, Target=dom)  # -> Mapped, Clipped
shift = ShiftList(List=remap.Mapped, Shift=series, Wrap=True)
remap_2 = RemapNumbers(Value=graph, Source=bnd, Target=dom_2)  # -> Mapped, Clipped
series_2 = Series(Start=0, Step="1", Count=V)
shift_2 = ShiftList(List=remap_2.Mapped, Shift=series_2, Wrap=True)
neg_2 = Negative(Value=shift_2)
Z = UnitZ(Factor=neg_2)
item_2 = ListItem(List=debrep.Edges, Index="2", Wrap=True)

unit_y = UnitY(Factor=shift)
unit_x = UnitX(Factor=shift)

move = Move(Geometry=divide_2.Points, Motion=unit_x)  # -> Geometry, Transform
intcrv = Interpolate(Vertices=move.Geometry, Degree=3, Periodic=False, KnotStyle=1)  # -> Curve, Length, Domain
project = Project(Geometry=intcrv.Curve, Plane=srf_2)  # -> Geometry, Transform
move_2 = Move(Geometry=move.Geometry, Motion=Z)  # -> Geometry, Transform
intcrv_2 = Interpolate(Vertices=move_2.Geometry, Degree=3, Periodic=False, KnotStyle=1)  # -> Curve, Length, Domain
loft = Loft(
    Curves=[project.Geometry, intcrv.Curve],
    Options={Adjust=False, Closed=False, LoftEnds=0, LoftSimp=0, LoftType=0, Rebuild=10, Refit=0.01})
edgesrf = EdgeSurface(CurveA=intcrv_2.Curve, CurveB=item_2)
offsrf = OffsetSurface(Surface=edgesrf, Distance=thickness_of_panels, BothSides=0, CreateSolid=True)

center = Center(Geometry=edgesrf)  # -> Center, Dimension
xz_plane = XZPlane(Origin=center.Center)
mirror = Mirror(Geometry=edgesrf, Plane=xz_plane)  # -> Geometry, Transform
geometry = ClusterOutput(mirror.Geometry)

# ==== cluster Cluster_2

length = Slider(44, range=0..100)
width = Slider(6, range=0..100)
xz = XZPlane(Origin=Point(0, 0, 0))

vertical_depth_bottom = Slider(-0.301, range=-2..0)
thickness_of_panels = Slider(0, range=0..1)
horizontal_depth_min = Slider(1.063, range=0.1..4)
horizontal_depth_maximumn = Slider(0, range=0..2)
vertical_depth_top = Slider(0.9, range=0.2..1.2)

V = ClusterInput()
N = ClusterInput()
no_of_panels = ClusterOutput(V)
multiplication = Multiplication(A=V, B=0.041)
srf = ClusterInput()
division = Division(A=width, B=V)
subtraction = Subtraction(A=division, B=vertical_depth_top)
neg = Negative(Value=subtraction)

# ----
# Facade Size
rectangle = Rectangle(Plane=xz, XSize=length, YSize=width, Radius=0)  # -> Rectangle, Length
srf_2 = Surface(srf)
divide = DivideDomain²(Domain=srf_2, UCount=Slider(1, range=0..1), VCount=V)
subsrf = Isotrim(Surface=graft(srf_2), Domain=divide)
debrep = DeconstructBrep(Brep=subsrf)  # -> Faces, Edges, Vertices
item = ListItem(List=debrep.Edges, Index=0, Wrap=True)
range = Range(Domain=Domain(0, 1), Steps=expr("x-1", N))
graph = GraphMapper(range, x0=0, x1=1, y0=0, y1=1, container_name="Sine", Equation_px=[0, 0.2374285758], Equation_py=[0, 0.6601299047])
divide_2 = DivideCurve(Curve=item, Count=N, Kinks=False)  # -> Points, Tangents, Parameters
series = Series(Start=0, Step=Slider(1, range=0..1), Count=V)
bnd = Bounds(Numbers=graph)
dom = ConstructDomain(DomainStart=multiplication, DomainEnd=horizontal_depth_maximumn)
dom_2 = ConstructDomain(DomainStart=neg, DomainEnd=vertical_depth_bottom)
remap = RemapNumbers(Value=graph, Source=bnd, Target=dom)  # -> Mapped, Clipped
shift = ShiftList(List=remap.Mapped, Shift=series, Wrap=True)
remap_2 = RemapNumbers(Value=graph, Source=bnd, Target=dom_2)  # -> Mapped, Clipped
series_2 = Series(Start=0, Step="1", Count=V)
shift_2 = ShiftList(List=remap_2.Mapped, Shift=series_2, Wrap=True)
neg_2 = Negative(Value=shift_2)
Z = UnitZ(Factor=neg_2)
item_2 = ListItem(List=debrep.Edges, Index="2", Wrap=True)

unit_y = UnitY(Factor=shift)

move = Move(Geometry=divide_2.Points, Motion=unit_y)  # -> Geometry, Transform
intcrv = Interpolate(Vertices=move.Geometry, Degree=3, Periodic=False, KnotStyle=1)  # -> Curve, Length, Domain
project = Project(Geometry=intcrv.Curve, Plane=srf_2)  # -> Geometry, Transform
move_2 = Move(Geometry=move.Geometry, Motion=Z)  # -> Geometry, Transform
intcrv_2 = Interpolate(Vertices=move_2.Geometry, Degree=3, Periodic=False, KnotStyle=1)  # -> Curve, Length, Domain
loft = Loft(
    Curves=[project.Geometry, intcrv.Curve],
    Options={Adjust=False, Closed=False, LoftEnds=0, LoftSimp=0, LoftType=0, Rebuild=10, Refit=0.01})
edgesrf = EdgeSurface(CurveA=intcrv_2.Curve, CurveB=item_2)
offsrf = OffsetSurface(Surface=edgesrf, Distance=thickness_of_panels, BothSides=0, CreateSolid=True)

center = Center(Geometry=edgesrf)  # -> Center, Dimension
xz_plane = XZPlane(Origin=center.Center)
mirror = Mirror(Geometry=edgesrf, Plane=xz_plane)  # -> Geometry, Transform
geometry = ClusterOutput(mirror.Geometry)

# ==== cluster Cluster_3

length = Slider(44, range=0..100)
width = Slider(6, range=0..100)
xz = XZPlane(Origin=Point(0, 0, 0))

vertical_depth_bottom = Slider(-0.301, range=-2..0)
thickness_of_panels = Slider(0, range=0..1)
horizontal_depth_min = Slider(1.063, range=0.1..4)
horizontal_depth_maximumn = Slider(0, range=0..2)
vertical_depth_top = Slider(0.9, range=0.2..1.2)

V = ClusterInput()
N = ClusterInput()
no_of_panels = ClusterOutput(V)
multiplication = Multiplication(A=V, B=0.041)
srf = ClusterInput()
division = Division(A=width, B=V)
subtraction = Subtraction(A=division, B=vertical_depth_top)
neg = Negative(Value=subtraction)

# ----
# Facade Size
rectangle = Rectangle(Plane=xz, XSize=length, YSize=width, Radius=0)  # -> Rectangle, Length
srf_2 = Surface(srf)
divide = DivideDomain²(Domain=srf_2, UCount=Slider(1, range=0..1), VCount=V)
subsrf = Isotrim(Surface=graft(srf_2), Domain=divide)
debrep = DeconstructBrep(Brep=subsrf)  # -> Faces, Edges, Vertices
item = ListItem(List=debrep.Edges, Index=0, Wrap=True)
range = Range(Domain=Domain(0, 1), Steps=expr("x-1", N))
graph = GraphMapper(range, x0=0, x1=1, y0=0, y1=1, container_name="Sine", Equation_px=[0, 0.2374285758], Equation_py=[0, 0.6601299047])
divide_2 = DivideCurve(Curve=item, Count=N, Kinks=False)  # -> Points, Tangents, Parameters
series = Series(Start=0, Step=Slider(1, range=0..1), Count=V)
bnd = Bounds(Numbers=graph)
dom = ConstructDomain(DomainStart=multiplication, DomainEnd=horizontal_depth_maximumn)
dom_2 = ConstructDomain(DomainStart=neg, DomainEnd=vertical_depth_bottom)
remap = RemapNumbers(Value=graph, Source=bnd, Target=dom)  # -> Mapped, Clipped
shift = ShiftList(List=remap.Mapped, Shift=series, Wrap=True)
remap_2 = RemapNumbers(Value=graph, Source=bnd, Target=dom_2)  # -> Mapped, Clipped
series_2 = Series(Start=0, Step="1", Count=V)
shift_2 = ShiftList(List=remap_2.Mapped, Shift=series_2, Wrap=True)
neg_2 = Negative(Value=shift_2)
Z = UnitZ(Factor=neg_2)
item_2 = ListItem(List=debrep.Edges, Index="2", Wrap=True)

unit_y = UnitY(Factor=expr("-x", shift))

move = Move(Geometry=divide_2.Points, Motion=unit_y)  # -> Geometry, Transform
intcrv = Interpolate(Vertices=move.Geometry, Degree=3, Periodic=False, KnotStyle=1)  # -> Curve, Length, Domain
project = Project(Geometry=intcrv.Curve, Plane=srf_2)  # -> Geometry, Transform
move_2 = Move(Geometry=move.Geometry, Motion=Z)  # -> Geometry, Transform
intcrv_2 = Interpolate(Vertices=move_2.Geometry, Degree=3, Periodic=False, KnotStyle=1)  # -> Curve, Length, Domain
loft = Loft(
    Curves=[project.Geometry, intcrv.Curve],
    Options={Adjust=False, Closed=False, LoftEnds=0, LoftSimp=0, LoftType=0, Rebuild=10, Refit=0.01})
edgesrf = EdgeSurface(CurveA=intcrv_2.Curve, CurveB=item_2)
offsrf = OffsetSurface(Surface=edgesrf, Distance=thickness_of_panels, BothSides=0, CreateSolid=True)

center = Center(Geometry=edgesrf)  # -> Center, Dimension
xz_plane = XZPlane(Origin=center.Center)
mirror = Mirror(Geometry=edgesrf, Plane=xz_plane)  # -> Geometry, Transform
geometry = ClusterOutput(mirror.Geometry)

# ==== cluster Cluster_4

length = Slider(44, range=0..100)
width = Slider(6, range=0..100)
xz = XZPlane(Origin=Point(0, 0, 0))

vertical_depth_bottom = Slider(-0.301, range=-2..0)
thickness_of_panels = Slider(0, range=0..1)
horizontal_depth_min = Slider(1.063, range=0.1..4)
horizontal_depth_maximumn = Slider(0, range=0..2)
vertical_depth_top = Slider(0.9, range=0.2..1.2)

V = ClusterInput()
N = ClusterInput()
no_of_panels = ClusterOutput(V)
multiplication = Multiplication(A=V, B=0.041)
srf = ClusterInput()
division = Division(A=width, B=V)
subtraction = Subtraction(A=division, B=vertical_depth_top)
neg = Negative(Value=subtraction)

# ----
# Facade Size
rectangle = Rectangle(Plane=xz, XSize=length, YSize=width, Radius=0)  # -> Rectangle, Length
srf_2 = Surface(srf)
divide = DivideDomain²(Domain=srf_2, UCount=Slider(1, range=0..1), VCount=V)
subsrf = Isotrim(Surface=graft(srf_2), Domain=divide)
debrep = DeconstructBrep(Brep=subsrf)  # -> Faces, Edges, Vertices
item = ListItem(List=debrep.Edges, Index=0, Wrap=True)
range = Range(Domain=Domain(0, 1), Steps=expr("x-1", N))
graph = GraphMapper(range, x0=0, x1=1, y0=0, y1=1, container_name="Sine", Equation_px=[0, 0.2374285758], Equation_py=[0, 0.6601299047])
divide_2 = DivideCurve(Curve=item, Count=N, Kinks=False)  # -> Points, Tangents, Parameters
series = Series(Start=0, Step=Slider(1, range=0..1), Count=V)
bnd = Bounds(Numbers=graph)
dom = ConstructDomain(DomainStart=multiplication, DomainEnd=horizontal_depth_maximumn)
dom_2 = ConstructDomain(DomainStart=neg, DomainEnd=vertical_depth_bottom)
remap = RemapNumbers(Value=graph, Source=bnd, Target=dom)  # -> Mapped, Clipped
shift = ShiftList(List=remap.Mapped, Shift=series, Wrap=True)
remap_2 = RemapNumbers(Value=graph, Source=bnd, Target=dom_2)  # -> Mapped, Clipped
series_2 = Series(Start=0, Step="1", Count=V)
shift_2 = ShiftList(List=remap_2.Mapped, Shift=series_2, Wrap=True)
neg_2 = Negative(Value=shift_2)
Z = UnitZ(Factor=neg_2)
item_2 = ListItem(List=debrep.Edges, Index="2", Wrap=True)

unit_x = UnitX(Factor=expr("-x", shift))

move = Move(Geometry=divide_2.Points, Motion=unit_x)  # -> Geometry, Transform
intcrv = Interpolate(Vertices=move.Geometry, Degree=3, Periodic=False, KnotStyle=1)  # -> Curve, Length, Domain
project = Project(Geometry=intcrv.Curve, Plane=srf_2)  # -> Geometry, Transform
move_2 = Move(Geometry=move.Geometry, Motion=Z)  # -> Geometry, Transform
intcrv_2 = Interpolate(Vertices=move_2.Geometry, Degree=3, Periodic=False, KnotStyle=1)  # -> Curve, Length, Domain
loft = Loft(
    Curves=[project.Geometry, intcrv.Curve],
    Options={Adjust=False, Closed=False, LoftEnds=0, LoftSimp=0, LoftType=0, Rebuild=10, Refit=0.01})
edgesrf = EdgeSurface(CurveA=intcrv_2.Curve, CurveB=item_2)
offsrf = OffsetSurface(Surface=edgesrf, Distance=thickness_of_panels, BothSides=0, CreateSolid=True)

center = Center(Geometry=edgesrf)  # -> Center, Dimension
xz_plane = XZPlane(Origin=center.Center)
mirror = Mirror(Geometry=edgesrf, Plane=xz_plane)  # -> Geometry, Transform
geometry = ClusterOutput(mirror.Geometry)

# ==== cluster EncodedImageV3_3
mersh_vectors = ClusterInput()
dist_facade_skin = ClusterInput()
max_heigth_room_z = ClusterInput()
max_width_x = ClusterInput()

# ----
# Filter Points
deconstruct = Deconstruct(Point=mersh_vectors)  # -> XComponent, YComponent, ZComponent
smaller_than = SmallerThan(FirstNumber=deconstruct.YComponent, SecondNumber=max_width_x)  # -> SmallerThan, OrEqualTo
larger_than = LargerThan(FirstNumber=deconstruct.ZComponent, SecondNumber="0")  # -> LargerThan, OrEqualTo
smaller_than_2 = SmallerThan(FirstNumber=deconstruct.ZComponent, SecondNumber=max_heigth_room_z)  # -> SmallerThan, OrEqualTo
larger_than_2 = LargerThan(FirstNumber=deconstruct.YComponent, SecondNumber="0")  # -> LargerThan, OrEqualTo
gate_and = GateAnd(A=larger_than.OrEqualTo, B=smaller_than_2.OrEqualTo, C=larger_than_2.OrEqualTo, D=smaller_than.OrEqualTo)
cull_pattern = CullPattern(List=mersh_vectors, CullPattern=gate_and)

facade_window_srf = ClusterInput()
r_color_domain = ClusterInput()
skin_typology_srf = ClusterInput()
g_color_domain = ClusterInput()
back_room_wall_srf = ClusterInput()
b_color_domain = ClusterInput()

deconstruct_2 = Deconstruct(Point=cull_pattern)  # -> XComponent, YComponent, ZComponent
equality = Equality(FirstNumber=deconstruct_2.ZComponent, SecondNumber="0")  # -> Equality, Inequality
cull_pattern_2 = CullPattern(List=cull_pattern, CullPattern=equality.Equality)
list_length = ListLength(List=cull_pattern_2)

deconstruct_3 = Deconstruct(Point=cull_pattern)  # -> XComponent, YComponent, ZComponent
equality_2 = Equality(FirstNumber=deconstruct_3.YComponent, SecondNumber="0")  # -> Equality, Inequality
cull_pattern_3 = CullPattern(List=cull_pattern, CullPattern=equality_2.Equality)
list_length_2 = ListLength(List=cull_pattern_3)

data = Data(dist_facade_skin)

# ----
# List Generation
list_length_3 = ListLength(List=mersh_vectors)
duplicate_data = DuplicateData(Data="0,0,0", Number=list_length_3, Order=True)
duplicate_data_2 = DuplicateData(Data="0", Number=list_length_3, Order=True)

control_wire_display = ControlWireDisplay(WireDisplay="1")

mesh_surface = MeshSurface(Surface=flatten(skin_typology_srf), UCount=list_length_2, VCount=list_length, Overhang=True, Equalize=False)
mesh_join = MeshJoin(Meshes=mesh_surface)
deconstruct_mesh = DeconstructMesh(Mesh=mesh_join)  # -> Vertices, Faces, Colours, Normals

deconstruct_4 = Deconstruct(Point=deconstruct_mesh.Vertices)  # -> XComponent, YComponent, ZComponent

round = Round(Number=deconstruct_4.XComponent)  # -> Nearest, Floor, Ceiling
bounds = Bounds(Numbers=deconstruct_4.XComponent)

panel = Panel(deconstruct_4.XComponent)
construct_point = ConstructPoint(XCoordinate=data, YCoordinate=deconstruct_4.YComponent, ZCoordinate=deconstruct_4.ZComponent)
panel_2 = Panel(round.Nearest)
faces = ClusterOutput(deconstruct_mesh.Faces)

mesh_surface_2 = MeshSurface(Surface=back_room_wall_srf, UCount=list_length, VCount=list_length_2, Overhang=True, Equalize=False)
mesh_join_2 = MeshJoin(Meshes=mesh_surface_2)
deconstruct_mesh_2 = DeconstructMesh(Mesh=mesh_join_2)  # -> Vertices, Faces, Colours, Normals
deconstruct_5 = Deconstruct(Point=deconstruct_mesh_2.Vertices)  # -> XComponent, YComponent, ZComponent
construct_point_2 = ConstructPoint(XCoordinate=0, YCoordinate=0, ZCoordinate=0)

deconstruct_6 = Deconstruct(Point=deconstruct_mesh_2.Vertices)  # -> XComponent, YComponent, ZComponent

round_2 = Round(Number=deconstruct_6.XComponent)  # -> Nearest, Floor, Ceiling
bounds_2 = Bounds(Numbers=round_2.Nearest)

construct_point_3 = ConstructPoint(XCoordinate=data, YCoordinate=deconstruct_6.YComponent, ZCoordinate=deconstruct_6.ZComponent)

mesh_surface_3 = MeshSurface(Surface=facade_window_srf, UCount=list_length, VCount=list_length_2, Overhang=True, Equalize=False)
mesh_join_3 = MeshJoin(Meshes=mesh_surface_3)
deconstruct_mesh_3 = DeconstructMesh(Mesh=mesh_join_3)  # -> Vertices, Faces, Colours, Normals
deconstruct_7 = Deconstruct(Point=deconstruct_mesh_3.Vertices)  # -> XComponent, YComponent, ZComponent
construct_point_4 = ConstructPoint(XCoordinate=0, YCoordinate=0, ZCoordinate=0)

deconstruct_8 = Deconstruct(Point=deconstruct_mesh_3.Vertices)  # -> XComponent, YComponent, ZComponent

round_3 = Round(Number=deconstruct_8.XComponent)  # -> Nearest, Floor, Ceiling
bounds_3 = Bounds(Numbers=round_3.Nearest)

construct_point_5 = ConstructPoint(XCoordinate=data, YCoordinate=deconstruct_8.YComponent, ZCoordinate=deconstruct_8.ZComponent)

remap_numbers = RemapNumbers(Value=deconstruct_6.XComponent, Source=bounds_2, Target=b_color_domain)  # -> Mapped, Clipped
create_rtree = CreateRTree(InputGeometry=flatten(mersh_vectors))
rtree_closest_point = RTreeClosestPoint(SearchPoints=flatten(construct_point_3), RTree=create_rtree)  # -> ClosestPoint, ClosestIndex

round_4 = Round(Number=remap_numbers.Mapped)  # -> Nearest, Floor, Ceiling

concatenate = Concatenate(FragmentB="0,0", FragmentA=round_4.Nearest, JoinSeparator=",")

# ----
# B channel Image
replace_items = ReplaceItems(List=duplicate_data, Item=concatenate, Indices=rtree_closest_point.ClosestIndex, Wrap=False)

# ----
# Only B values
replace_items_2 = ReplaceItems(List=duplicate_data_2, Item=round_4.Nearest, Indices=rtree_closest_point.ClosestIndex, Wrap=False)

# ----
# Blue Channel
b_channel_values = ClusterOutput(replace_items_2)
b_channel_image = ClusterOutput(replace_items)

remap_numbers_2 = RemapNumbers(Value=deconstruct_8.XComponent, Source=bounds_3, Target=r_color_domain)  # -> Mapped, Clipped
create_rtree_2 = CreateRTree(InputGeometry=flatten(mersh_vectors))
rtree_closest_point_2 = RTreeClosestPoint(SearchPoints=flatten(construct_point_5), RTree=create_rtree_2)  # -> ClosestPoint, ClosestIndex

round_5 = Round(Number=remap_numbers_2.Mapped)  # -> Nearest, Floor, Ceiling

concatenate_2 = Concatenate(FragmentB=round_5.Nearest, FragmentA="0,0", JoinSeparator=",")

# ----
# R channel Image
replace_items_3 = ReplaceItems(List=duplicate_data, Item=concatenate_2, Indices=rtree_closest_point_2.ClosestIndex, Wrap=False)

# ----
# Only R values
replace_items_4 = ReplaceItems(List=duplicate_data_2, Item=round_5.Nearest, Indices=rtree_closest_point_2.ClosestIndex, Wrap=False)

# ----
# Red Channel
r_channel_values = ClusterOutput(replace_items_4)
r_channel_image = ClusterOutput(replace_items_3)

remap_numbers_3 = RemapNumbers(Value=deconstruct_4.XComponent, Source=bounds, Target=g_color_domain)  # -> Mapped, Clipped
create_rtree_3 = CreateRTree(InputGeometry=flatten(mersh_vectors))
rtree_closest_point_3 = RTreeClosestPoint(SearchPoints=flatten(construct_point), RTree=create_rtree_3)  # -> ClosestPoint, ClosestIndex

round_6 = Round(Number=remap_numbers_3.Mapped)  # -> Nearest, Floor, Ceiling

concatenate_3 = Concatenate(Fragment_B="0", A=round_6.Nearest, B="0", JoinSeparator=",")

# ----
# G channel Image
replace_items_5 = ReplaceItems(List=duplicate_data, Item=concatenate_3, Indices=rtree_closest_point_3.ClosestIndex, Wrap=False)

# ----
# Only G values
replace_items_6 = ReplaceItems(List=duplicate_data_2, Item=round_6.Nearest, Indices=rtree_closest_point_3.ClosestIndex, Wrap=False)

# ----
# Green Channel
g_channel_image = ClusterOutput(replace_items_5)
g_channel_values = ClusterOutput(replace_items_6)

concatenate_4 = Concatenate(R=replace_items_4, G=replace_items_6, B=replace_items_2, JoinSeparator=",")
encoded_image = ClusterOutput(concatenate_4)
