# Grasshopper definition Final Mesh_V2.gh (Grasshopper 1.0.7)
# Copyright: 2017
# plug-ins: Heteroptera, MetaHopper, Pufferfish, Wallacei, Kangaroo2 Components, NGon

# ----
# EPW FILE
epw_file_path_barcelona = Panel("https://climate.onebuilding.org/WMO_Region_1_Africa/EGY_Egypt/QH_Al_Qahirah_Cairo/EGY_QH_Cairo.Intl.AP.623660_TMYx.zip")
# General input
epw_filepath = Data(epw_file_path_barcelona)

panel = Panel("5")
panel_2 = Panel("8")
Y = Panel("6")
hb_building_programs = HBBuildingPrograms({"LargeOffice", "MediumOffice", "SmallOffice", "MidriseApartment", "HighriseApartment", "Retail", "StripMall", "PrimarySchool", "SecondarySchool", "SmallHotel", "LargeHotel", "Hospital", "Outpatient", "Laboratory", "Warehouse", "SuperMarket", "FullServiceRestaurant", "QuickServiceRestaurant", "Courthouse", "LargeDataCenterHighITE", "LargeDataCenterLowITE", "SmallDataCenterHighITE", "SmallDataCenterLowITE"}, selected="LargeOffice")
Z = Panel("3")
X = Panel("6")

# ----
# Set Up ROOM or ZONE
# FIXED
number_slider = Slider(5.9, range=0..10)
number_slider_2 = Slider(6, range=0..10)
number_slider_3 = Slider(3, range=0..10)
domain_box = DomainBox(Base=PlaneXY(0, 0, 0), X=X, Y=Y, Z=Z)
volume = Volume(Geometry=domain_box)  # -> Volume, Centroid
panel_3 = Panel(volume.Volume)
# Room Related
roomsolid = HBRoomFromSolid(geo=flatten(domain_box), program=hb_building_programs, conditioned=True)  # -> out, rooms; plug-in component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

vt = Slider(0.8, range=0..1)  # disabled
number_slider_4 = Slider(0.2, range=0..1)  # disabled
number_slider_5 = Slider(5.7, range=0.8..5.7)  # disabled
# Material Set up
panel_4 = Panel("glazing")  # disabled
windowmat = HBWindowMaterial(name=panel_4, u_factor=number_slider_5, shgc=number_slider_4, t_vis=vt)  # -> mat; disabled; plug-in component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
windowconstr = HBWindowConstruction(name=panel_4, materials=windowmat)  # -> constr; disabled; plug-in component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

panel_5 = Panel("interior_Walls_MT")  # disabled
opaquemat = HBOpaqueMaterial(name=panel_5)  # -> mat; disabled; plug-in component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
opaqueconstr = HBOpaqueConstruction(name=panel_5, materials=opaquemat)  # -> constr; disabled; plug-in component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

panel_6 = Panel("roof_MT")  # disabled
opaquemat_2 = HBOpaqueMaterial(name=panel_6)  # -> mat; disabled; plug-in component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
opaqueconstr_2 = HBOpaqueConstruction(name=panel_6, materials=opaquemat_2)  # -> constr; disabled; plug-in component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

panel_7 = Panel("Exterior_Walls_MT")  # disabled
opaquemat_3 = HBOpaqueMaterial(name=panel_7)  # -> mat; disabled; plug-in component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
opaqueconstr_3 = HBOpaqueConstruction(name=panel_7, materials=opaquemat_3)  # -> constr; disabled; plug-in component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

panel_8 = Panel("floor_MT")  # disabled
opaquemat_4 = HBOpaqueMaterial(name=panel_8)  # -> mat; disabled; plug-in component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
opaqueconstr_4 = HBOpaqueConstruction(name=panel_8, materials=opaquemat_4)  # -> constr; disabled; plug-in component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

# ----
# Weather file
epw_filepath_2 = Data(epw_filepath)
downloadepw = LBDownloadWeather(weather_URL=epw_filepath_2)  # -> epw_file, stat_file, ddy_file; plug-in component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

pt = Point(Point(-2.722291582, 0.2658342869, 0))
northarrow = Ladybug_North(centerPt=pt, scale=Slider(0.1, range=0..0.1))  # -> northSign; plug-in component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

depth_max = Slider(0.106, range=0..1)
depth_min = Slider(0.535, range=0..2)
thickness_of_panels = Slider(0.1, range=0..1)

# ---- group: Attractor Points
pt_2 = Point([Point(1.204088415, -2.498187981, 2.951122658), Point(3.560976659, 0.2601758001, 17.86178769), Point(11.00378164, -0.8219923242, 3.199216157), Point(18.19849312, -0.8996962654, 16.5091201), Point(26.57164873, 0.02883612935, 8.409179645)])
dots = DotDisplay(Point=pt_2, Colour=RGB(255, 255, 0), Size=0.3)

# ----
# plane to analyze
deconstruct_brep = DeconstructBrep(Brep=domain_box)  # -> Faces, Edges, Vertices
center = Center(Geometry=deconstruct_brep.Faces)  # -> Center, Dimension
deconstruct = Deconstruct(Point=center.Center)  # -> XComponent, YComponent, ZComponent
smaller_than = SmallerThan(FirstNumber=deconstruct.ZComponent, SecondNumber=Slider(0.02, range=0..0.1))  # -> SmallerThan, OrEqualTo
cull_pattern = CullPattern(List=deconstruct_brep.Faces, CullPattern=smaller_than.SmallerThan)

# ----
# Facade Size
no_of_panels = Slider(19, range=1..20)
length = Slider(78, range=0..100)
width = Slider(44, range=0..100)
xz = XZPlane(Origin=Point(0, 0, 0))

series = Series(Start=0, Step=1, Count=10)
construct_point = ConstructPoint(XCoordinate=series, YCoordinate=graft(series), ZCoordinate=0)  # -> flatten(Point)

point = Point(construct_point)
deconstruct_2 = Deconstruct(Point=point)  # -> XComponent, YComponent, ZComponent
list_length = ListLength(List=point)
sort_list = SortList(Keys=deconstruct_2.ZComponent, ValuesValuesA=point)  # -> Keys, ValuesValuesA
square_root = SquareRoot(Value=list_length)
partition_list = PartitionList(List=sort_list.ValuesValuesA, Size=square_root)
deconstruct_3 = Deconstruct(Point=partition_list)  # -> XComponent, YComponent, ZComponent
sort_list_2 = SortList(Keys=deconstruct_3.XComponent, ValuesValuesA=partition_list)  # -> Keys, flatten(ValuesValuesA)
point_list = PointList(Points=sort_list_2.ValuesValuesA, Size=Slider(0.11, range=0..1))

number_slider_6 = Slider(0, range=0..5)
mass_addition = MassAddition()  # -> Result, PartialResults
hb_construction_types = HBConstructionTypes({"SteelFramed", "WoodFramed", "Mass", "Metal Building"}, selected="SteelFramed")
panel_9 = Panel(mass_addition.Result)
dom = ConstructDomain(DomainStart="-4", DomainEnd="4")
settings_speed = SettingsSpeed()
debrep = DeconstructBrep(Brep=domain_box)  # -> Faces, Edges, Vertices

# ----
# Comfort param
adaptpar = LBAdaptiveComfortParameters()  # -> adapt_par; plug-in component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
solarbodypar = LBSolarBodyParameters()  # -> sol_body_par; plug-in component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

number_slider_7 = Slider(1, range=1..31)
analysisperiod = LBAnalysisPeriod(
    start_month=Slider(1, range=1..12),
    start_day=number_slider_7,
    start_hour=Slider(1, range=0..23),
    end_month=Slider(12, range=1..12),
    end_day=number_slider_7,
    end_hour=Slider(23, range=0..23))  # -> period, hoys, dates; plug-in component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
data_dam = DataDam(BufferDelay=10000000, BufferMode=0)  # -> DataDataA, DataA, DataB, DataC, DataD, DataE

item = ListItem(List=debrep.Faces, Index=Slider(0, range=0..10), Wrap=invert(True))

# ---- group: ARE YOU SURE ?
toggle = BooleanToggle(True)
toggle_2 = BooleanToggle(False)
# PMV
toggle_3 = BooleanToggle(False)

# ----
legendpar = LBLegendParameters(min="20", max="20.5")  # -> leg_par; plug-in component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
xz_plane = XZPlane(Origin=Point(0, 0, 0))

# ----
# VERTICAL SKIN
genes = GenePool(Decimals=3, Maximum=10, Minimum=0, Value=[0.042, 2.11, 6.728, 1.912, 0])
expression = Expression(x=thickness_of_panels, Expression="x/2")
neg = Negative(Value=expression)
X_2 = UnitX(Factor=neg)
X_3 = UnitX(Factor=thickness_of_panels)

# ----
# Hoz Facade System
horizontal_depth_max = Slider(0.5, range=0.5..2)
panel_depth = Slider(0.095, range=0..1)
horizontal_depth_min = Slider(0.115, range=0..1)
rectangle = Rectangle(Plane=xz, XSize=X, YSize=Z, Radius=0)  # -> Rectangle, Length
number_slider_8 = Slider(7, range=3..100)
range = Range(Domain=Domain(0, 1), Steps=expr("x-1", number_slider_8))
graph = GraphMapper(
    range,
    x0=0,
    x1=1,
    y0=0,
    y1=1,
    container_name="Sinc",
    Equation_X0=0.7256833315,
    Equation_X1=0.1845636368,
    Equation_Y0=0.03992664814,
    Equation_Y1=0.5902863741)
dom_2 = ConstructDomain(DomainStart=horizontal_depth_min, DomainEnd=horizontal_depth_max)
bnd = Bounds(Numbers=graph)
remap = RemapNumbers(Value=graph, Source=bnd, Target=dom_2)  # -> Mapped, Clipped

merge = Merge(Data1=horizontal_depth_min, Data2=horizontal_depth_max, Data3=flatten(graph))

# ----
# Opening Parameters
horizontal_spacing_between = Slider(2, range=0..10)
ratio_to_the_elevation = Slider(0.57, range=0..1)
sill_height = Slider(0.5, range=-0.5..2)
vertical_spacing_between = Slider(0, range=0..10)
# FIXED
window_height = Slider(2, range=0..10)

# ----
# Windows
facparam = HBFacadeParameters(north=0, east=0, south=ratio_to_the_elevation, west=0)  # -> fac_par; plug-in component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
aperturesbyratio = HBAperturesByRatio(
    hb_objs=flatten(roomsolid.rooms),
    ratio=facparam,
    subdivide=Slider(3, range=0..10),
    win_height=window_height,
    sill_height=sill_height,
    horiz_separ=horizontal_spacing_between,
    vert_separ=vertical_spacing_between)  # -> out, hb_objs; plug-in component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

# ----
# Skylight
ratio_to_the_elevation_2 = Slider(0.21, range=0..1)
skylightsbyratio = HBSkylightsByRatio(hb_objs=flatten(aperturesbyratio.hb_objs), ratio=ratio_to_the_elevation_2)  # -> out, hb_objs; plug-in component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
vizwiref = HBVisualizeWireframe(hb_objs=flatten(skylightsbyratio.hb_objs))  # -> geo; plug-in component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

# ----
# CIRCULAR PERFORATED SKIN
number_slider_9 = Slider(11, range=0..100)
panel_10 = Panel("""0
-1""")
panel_11 = Panel("""0
1""")

# ----
# Facade as a shader
number_slider_10 = Slider(0, range=0..5)
viznorm = HBVisualizeNormals(hb_objs=roomsolid.rooms)  # -> points, vectors; plug-in component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
number_slider_11 = Slider(1.18, range=0..2)
list_item = ListItem(List=deconstruct_brep.Faces, Index=number_slider_10, Wrap=True)
list_item_2 = ListItem(List=viznorm.vectors, Index=number_slider_10, Wrap=True)
amplitude = Amplitude(Vector=list_item_2, Amplitude=number_slider_11)
move = Move(Geometry=list_item, Motion=amplitude)  # -> Geometry, Transform

amplitude_2 = Amplitude(Vector=list_item_2, Amplitude=remap.Mapped)

explode = Explode(Curve=move.Geometry, Recursive=True)  # -> Segments, Vertices
srf = Surface(move.Geometry)
item_2 = ListItem(List=explode.Segments, Index=0, Wrap=True)  # -> Item, Item1, Item2, Item3
flip = FlipCurve(Curve=item_2.Item2)  # -> Curve, Flag
divide = DivideDomain²(Domain=srf, UCount="1", VCount=no_of_panels)
subsrf = Isotrim(Surface=srf, Domain=divide)
debrep_2 = DeconstructBrep(Brep=subsrf)  # -> Faces, simplify(Edges), flatten(Vertices)

srf_2 = Surface(srf)

curvepoint = PointOnCurve(item_2.Item, parameter=0.158)
curvepoint_2 = PointOnCurve(flip.Curve, parameter=0.858)

sdivide = DivideSurface(Surface=srf_2, UCount=Slider(20, range=0..100), VCount=Slider(20, range=0..100))  # -> Points, Normals, Parameters
flatten = FlattenTree(Tree=sdivide.Points, Path="{0}")
dist = Distance(PointA=graft(flatten), PointB=pt_2)
bnd_2 = Bounds(Numbers=flatten(dist))
remap_2 = RemapNumbers(Value=dist, Source=bnd_2, Target=Domain(0, 1))  # -> Mapped, Clipped
graph_2 = GraphMapper(
    remap_2.Mapped,
    x0=0,
    x1=1,
    y0=0,
    y1=1,
    container_name="Bezier",
    cpx=[0, 0.4592220187, 0, 1],
    cpy=[1, 0.5075471401, 0, 0])
multiplication = Multiplication(A=graph_2, B=genes)
ma = MassAddition(Input=multiplication)  # -> flatten(Result), PartialResults
bnd_3 = Bounds(Numbers=ma.Result)
remap_3 = RemapNumbers(Value=ma.Result, Source=bnd_3, Target=Domain(0, 1))  # -> Mapped, Clipped
graph_3 = GraphMapper(
    remap_3.Mapped,
    x0=0,
    x1=1,
    y0=0,
    y1=1,
    container_name="Sine",
    Equation_px=[0, 0.1356530935],
    Equation_py=[0, 0.9846509695])
multiplication_2 = Multiplication(A=graph_3, B=depth_min)
addition = Addition(A=multiplication_2, B=depth_max)
amp = Amplitude(Vector=flatten(sdivide.Normals), Amplitude=addition)
move_2 = Move(Geometry=flatten, Motion=amp)  # -> Geometry, Transform
unflatten = UnflattenTree(Tree=move_2.Geometry, Guide=sdivide.Points)
intcrv = Interpolate(Vertices=unflatten, Degree=3, Periodic=False, KnotStyle=1)  # -> Curve, Length, Domain
intcrv_2 = Interpolate(Vertices=sdivide.Points, Degree=3, Periodic=False, KnotStyle=1)  # -> Curve, Length, Domain
flip_2 = FlipCurve(Curve=intcrv_2.Curve)  # -> Curve, Flag
merge_2 = Merge(Data1=intcrv.Curve, Data2=flip_2.Curve)
connect = ConnectCurves(Curves=merge_2, Continuity="0", Close=True, Bulge=1)
boundary = BoundarySurfaces(Edges=connect)
move_3 = Move(Geometry=boundary, Motion=X_2)  # -> Geometry, Transform

surface = Surface(srf)
sframes = SurfaceFrames(Surface=surface, UCount=number_slider_9, VCount=number_slider_9)  # -> Frames, Parameters
cull_i = CullIndex(List=sframes.Frames, Indices=panel_10, Wrap=True)
flip_3 = FlipMatrix(Data=cull_i)
cull_i_2 = CullIndex(List=flip_3, Indices=panel_10, Wrap=True)  # -> flatten(List)
cull = CullPattern(List=cull_i_2, CullPattern=panel_11)
cir = Circle(Plane=cull, Radius=Slider(0.1, range=0..10))
srfsplit = SurfaceSplit(Surface=surface, Curves=cir)
srf_sl = SrfSmallLarge(srf_list=srfsplit)  # -> smallest, largest
perforaated = Surface(srf_sl.largest)

# ----
# CONSIDERED MAX ROOM SIZE 8MX8MX8M
number_slider_12 = Slider(2, range=0..10)
addition_2 = Addition(A=number_slider_11, B=number_slider_12)
amplitude_3 = Amplitude(Vector=list_item_2, Amplitude=addition_2)
move_4 = Move(Geometry=srf, Motion=amplitude_3)  # -> Geometry, Transform
dom_3 = ConstructDomain(DomainStart="-4", DomainEnd="4")
rectangle_2 = Rectangle(Plane=move_4.Geometry, XSize=dom_3, YSize=dom_3, Radius=0)  # -> Rectangle, Length

end_points = EndPoints(Curve=debrep_2.Edges)  # -> Start, End
vector_2pt = Vector2Pt(PointA=end_points.Start, PointB=end_points.End, Unitize=False)  # -> flatten(Vector), Length
deconstruct_vector = DeconstructVector(Vector=vector_2pt.Vector)  # -> XComponent, YComponent, ZComponent
equality = Equality(FirstNumber=deconstruct_vector.ZComponent, SecondNumber="0")  # -> Equality, Inequality
cull_pattern_2 = CullPattern(List=debrep_2.Edges, CullPattern=equality.Equality)  # -> flatten(List)
removeduplicatelines = RemoveDuplicateLines(Lines=cull_pattern_2, Tolerance=0.01)
list_item_3 = ListItem(List=removeduplicatelines, Index=0, Wrap=True)
flip_curve = FlipCurve(Curve=removeduplicatelines, Guide=list_item_3)  # -> Curve, Flag

ln = Line(StartPoint=curvepoint, EndPoint=curvepoint_2)
divide_2 = DivideCurve(Curve=flip_curve.Curve, Count=number_slider_8, Kinks=False)  # -> Points, Tangents, Parameters
move_5 = Move(Geometry=divide_2.Points, Motion=amplitude_2)  # -> Geometry, Transform
intcrv_t = InterpolateT(Vertices=move_5.Geometry, TangentStart=Vector(0, 0, 0), TangentEnd=Vector(0, 0, 0), KnotStyle=1)  # -> Curve, Length, Domain
project = Project(Geometry=intcrv_t.Curve, Plane=srf)  # -> Geometry, Transform
loft = Loft(
    Curves=[project.Geometry, intcrv_t.Curve],
    Options={Adjust=False, Closed=False, LoftEnds=0, LoftSimp=0, LoftType=3, Rebuild=10, Refit=0.01})  # -> flatten(Loft)
offsrf = OffsetSurface(Surface=loft, Distance=panel_depth, BothSides=0, CreateSolid=True)  # -> flatten(Offset)

offset_curve = OffsetCurve(Curve=debrep_2.Faces, Distance=expr("-x", Slider(0.06, range=0..1)), Corners=1)
surface_split = SurfaceSplit(Surface=debrep_2.Faces, Curves=offset_curve)

extr = Extrude(Base=move_3.Geometry, Direction=X_3)
preview = CustomPreview(Geometry=extr, Material=ColourSwatch(SwatchColor=RGB(169, 193, 209)))  # disabled

rectangle_3 = Rectangle(Plane=move_4.Geometry, XSize=dom, YSize=dom, Radius=0)  # -> Rectangle, Length

debrep_3 = DeconstructBrep(Brep=extr)  # -> Faces, Edges, Vertices
item_3 = ListItem(List=debrep_3.Faces, Index=Slider(1, range=0..10), Wrap=invert(True))
vertical_pattern = Mesh(item_3)

list_item_4 = ListItem(List=surface_split, Index=0, Wrap=True)  # -> flatten(Item)
mesh_plane = MeshPlane(Boundary=rectangle_3.Rectangle, WidthCount="256", HeightCount="256")  # -> Mesh, Area
mesh_brep = MeshBrep(Brep=loft, Settings=settings_speed)

shade = HBShade(geo=mesh_brep)  # -> out, shades; plug-in component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

# ----
# CONSIDERED MAX ROOM SIZE 8MX8MX8M
number_slider_13 = Slider(2, range=0..10)
addition_3 = Addition(A=number_slider_11, B=number_slider_13)
amplitude_4 = Amplitude(Vector=list_item_2, Amplitude=addition_3)
move_6 = Move(Geometry=srf, Motion=amplitude_4)  # -> Geometry, Transform
dom_4 = ConstructDomain(DomainStart="-4", DomainEnd="4")
rectangle_4 = Rectangle(Plane=move_6.Geometry, XSize=dom_4, YSize=dom_4, Radius=0)  # -> Rectangle, Length

mesh_join = MeshJoin(Meshes=flatten(mesh_brep))
debrep_4 = DeconstructBrep(Brep=offsrf)  # -> Faces, Edges, Vertices
item_4 = ListItem(List=debrep_4.Faces, Index=Slider(3, range=0..10), Wrap=invert(True))
horizontal_skin = Surface(item_4)

decnstrobj = HBDeconstructObject(hb_obj=aperturesbyratio.hb_objs)  # -> faces, apertures, doors, shades; plug-in component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
vizquick = HBVisualizeQuick(hb_objs=flatten(decnstrobj.apertures))  # -> geo; plug-in component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
aperture = HBAperture(geo=vizquick)  # -> out, apertures; plug-in component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

area = Area(Geometry=vizquick)  # -> Area, Centroid
list_item_5 = ListItem(List=decnstrobj.faces, Index=Slider(2, range=0..5), Wrap=True)
cull_index = CullIndex(List=decnstrobj.faces, Indices=number_slider_6, Wrap=True)
list_item_6 = ListItem(List=decnstrobj.faces, Index=number_slider_6, Wrap=True)
vizquick_2 = HBVisualizeQuick(hb_objs=flatten(list_item_5))  # -> geo; plug-in component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
vizquick_3 = HBVisualizeQuick(hb_objs=flatten(list_item_6))  # -> geo; plug-in component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

vizquick_4 = HBVisualizeQuick(hb_objs=flatten(cull_index))  # -> geo; plug-in component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
face = HBFace(geo=vizquick_3)  # -> out, faces; plug-in component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

face_2 = HBFace(geo=vizquick_4, bc="adiabatic")  # -> out, faces; plug-in component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

# ----
# Model
model = HBModel(faces=flatten([face.faces, face_2.faces]), shades=flatten(shade.shades), apertures=flatten(aperture.apertures))  # -> out, model; plug-in component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

# ----
# Sensor Grid
number_slider_14 = Slider(1, range=0..10)
genpts = LBGeneratePointGrid(geometry=cull_pattern, grid_size=number_slider_14)  # -> points, vectors, face_areas, mesh; plug-in component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
points = Data(genpts.points)
sensorgrid = HBSensorGrid(positions=points)  # -> grid; plug-in component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
assigngridsviews = HBAssignGridsAndViews(model=model.model, grids=flatten(sensorgrid))  # -> model; plug-in component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

vizall = HBVisualizeAll(hb_objs=flatten(model.model))  # -> geo; plug-in component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

# ----
# Visualize
vizbytype = HBVisualizeByType(hb_objs=model.model)  # -> walls, interior_walls, roofs, ceilings, exterior_floors, interior_floors, air_walls, apertures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; plug-in component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
vizwiref_2 = HBVisualizeWireframe(hb_objs=flatten(model.model))  # -> geo; plug-in component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

vizwiref_3 = HBVisualizeWireframe(hb_objs=flatten(model.model))  # -> geo; plug-in component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

# ----
# Faces labels
hb_face_attributes = HBFaceAttributes({"Display Name": "display_name", "Simulation Name (Identifier)": "identifier", "Boundary Condition": "boundary_condition", "Has Parent": "has_parent", "Parent": "parent", "Azimuth": "azimuth", "Altitude": "altitude", "Area": "area", "Perimeter": "perimeter", "Face Type": "type", "Aperture Is Operable": "is_operable", "Door Is Glass": "is_glass"}, selected="Boundary Condition")
lablefaces = HBLabelFaces(hb_objs=flatten(model.model), attribute=hb_face_attributes)  # -> label_text, base_pts, labels, wire_frame; plug-in component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

depth = Geometry(vizquick_2)
center_2 = Center(Geometry=depth)  # -> Center, Dimension
mesh_plane_2 = MeshPlane(Boundary=rectangle_2.Rectangle, WidthCount="256", HeightCount="256")  # -> Mesh, Area
number_slider_15 = Slider(7, range=0..10)
rotate = Rotate(Geometry=depth, Angle=degrees(Slider(0, range=0..360)), Plane=center_2.Center)  # -> Geometry, Transform
skin = Geometry(flatten(vertical_pattern))
facade = Geometry(vizquick_3)
value_list = ValueList({"Red Channel": 0, "Green Channel": 1, "Blue Channel": 2}, selected="Red Channel")
value_list_2 = ValueList({"Red Channel": 0, "Green Channel": 1, "Blue Channel": 2}, selected="Green Channel")
value_list_3 = ValueList({"Red Channel": 0, "Green Channel": 1, "Blue Channel": 2}, selected="Blue Channel")
extract_colors = ExtractColors(mesh=mesh_plane_2.Mesh, back_surface_of_room=facade, channel=value_list)  # -> output_b_channel, list_of_red_values, list_of_green_values, list_of_blue_values
extract_colors_2 = ExtractColors(mesh=mesh_plane_2.Mesh, back_surface_of_room=skin, channel=value_list_2)  # -> output_b_channel, list_of_red_values, list_of_green_values, list_of_blue_values
extract_colors_3 = ExtractColors(mesh=mesh_plane_2.Mesh, back_surface_of_room=rotate.Geometry, channel=value_list_3)  # -> output_b_channel, list_of_red_values, list_of_green_values, list_of_blue_values
deconstruct_mesh = DeconstructMesh(Mesh=mesh_plane_2.Mesh)  # -> Vertices, Faces, Colours, Normals
colour_rgb = ColourRGB(
    Alpha=255,
    Red=extract_colors.list_of_red_values,
    Green=extract_colors_2.list_of_green_values,
    Blue=extract_colors_3.list_of_blue_values)
panel_12 = Panel(extract_colors_3.list_of_blue_values)
construct_mesh = ConstructMesh(Vertices=deconstruct_mesh.Vertices, Faces=deconstruct_mesh.Faces, Colours=colour_rgb)
panel_13 = Panel(colour_rgb)

data_dam_2 = DataDam(
    DataDataA=assigngridsviews,
    DataA=downloadepw.epw_file,
    DataB=downloadepw.ddy_file,
    DataC=analysisperiod.period,
    DataD=adaptpar,
    DataE=toggle_3,
    BufferDelay=10000000,
    BufferMode=0)  # -> DataDataA, DataA, DataB, DataC, DataD, DataE
pmvmap = HBPMVComfortMap(
    model=data_dam_2.DataDataA,
    epw=data_dam_2.DataA,
    ddy=data_dam_2.DataB,
    run_period=data_dam_2.DataC,
    comfort_par=data_dam_2.DataD,
    run=data_dam_2.DataE)  # -> out, env_conds, temperature, condition, pmv, TCP, HSP, CSP; plug-in component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
thermalmtx = HBReadThermalMatrix(comf_result=pmvmap.pmv, load=Toggle(True))  # -> comf_mtx; plug-in component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

# ---- group: JOIN MESH
unit_x = UnitX(Factor=Slider(8, range=0..10))
move_7 = Move(Geometry=rectangle_2.Rectangle, Motion=unit_x)  # -> Geometry, Transform
yz_plane = YZPlane(Origin=Point(0, 0, 0))
area_2 = Area(Geometry=move_7.Geometry)  # -> Area, Centroid

# ----
# UTCI
utcimap = HBUTCIComfortMap(
    model=assigngridsviews,
    epw=downloadepw.epw_file,
    ddy=downloadepw.ddy_file,
    run_period=analysisperiod.period,
    comfort_par=adaptpar,
    run=toggle)  # -> report, env_conds, utci, condition, category, TCP, HSP, CSP; plug-in component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
thermalmtx_2 = HBReadThermalMatrix(comf_result=utcimap.utci, load=Toggle(True))  # -> comf_mtx; plug-in component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
xmatrix = LBDeconstructMatrix(matrix=flatten(thermalmtx_2))  # -> values; plug-in component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
number_slider_16 = Slider(157, range=0..1000)
xdata = LBDeconstructData(data=xmatrix)  # -> header, values; plug-in component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
points_2 = Data(points)
item_5 = ListItem(List=xmatrix, Index=number_slider_16, Wrap=True)
item_6 = ListItem(List=points_2, Index=number_slider_16, Wrap=True)
avr = Average(Input=xdata.values)  # -> flatten(ArithmeticMean)
pt_3 = Point(Point(93.14477679, -19.53288665, 0))
meshselector = LBMeshThresholdSelector(values=avr, mesh=genpts.mesh)  # -> report, total_value, total_area, sub_mesh, outline; plug-in component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
hourlyplot = LBHourlyPlot(data=item_5, base_pt=pt_3, y_dim=Slider(2, range=0..100))  # -> report, mesh, legend, borders, labels, title, vis_set; plug-in component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

# ----
# Visualization
data_dam_3 = DataDam(
    DataDataA=assigngridsviews,
    DataA=downloadepw.epw_file,
    DataB=downloadepw.ddy_file,
    DataC=analysisperiod.period,
    DataD=adaptpar,
    DataE=toggle_2,
    BufferDelay=10000000,
    BufferMode=0)  # -> DataDataA, DataA, DataB, DataC, DataD, DataE
# Adpative thermal comfort
adaptivemap = HBAdaptiveComfortMap(
    model=data_dam_3.DataDataA,
    epw=data_dam_3.DataA,
    ddy=data_dam_3.DataB,
    run_period=data_dam_3.DataC,
    comfort_par=data_dam_3.DataD,
    run=data_dam_3.DataE)  # -> out, env_conds, op_temp, condition, deg_neut, TCP, HSP, CSP; plug-in component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
thermalmtx_3 = HBReadThermalMatrix(comf_result=adaptivemap.TCP, load=Toggle(True))  # -> comf_mtx; plug-in component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
xmatrix_2 = LBDeconstructMatrix(matrix=flatten(thermalmtx_3))  # -> values; plug-in component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
number_slider_17 = Slider(157, range=0..1000)
xdata_2 = LBDeconstructData(data=xmatrix_2)  # -> header, values; plug-in component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
points_3 = Data(points)
item_7 = ListItem(List=xmatrix_2, Index=number_slider_17, Wrap=True)
item_8 = ListItem(List=points_3, Index=number_slider_17, Wrap=True)
avr_2 = Average(Input=xdata_2.values)  # -> flatten(ArithmeticMean)
pt_4 = Point(Point(93.14477679, -19.53288665, 0))
round_to_decimal_place = RoundToDecimalPlace(NumberX=avr_2, DecimalPlace="2", RoundType=0)  # -> Rounded, Difference
vizthermalmap = HBVisualizeThermalMap(comf_mtx=thermalmtx_2, mesh=flatten(genpts.mesh))  # -> report, mesh, legend, title, colors, values; plug-in component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
meshselector_2 = LBMeshThresholdSelector(values=avr_2, mesh=genpts.mesh)  # -> report, total_value, total_area, sub_mesh, outline; plug-in component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
hourlyplot_2 = LBHourlyPlot(data=item_7, base_pt=pt_4, y_dim=Slider(2, range=0..100))  # -> report, mesh, legend, borders, labels, title, vis_set; plug-in component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
toggle_4 = GroupToggle(ToggleActive=True, ToggleVisible=False)  # disabled
tag = TextTag3D(
    Location=points_3,
    Text=round_to_decimal_place.Rounded,
    Size=Slider(0.1, range=0..0.1),
    Colour=ColourSwatch(SwatchColor=RGB(0, 0, 0)),
    Justification=7)

round_to_decimal_place_2 = RoundToDecimalPlace(NumberX=avr, DecimalPlace="2", RoundType=0)  # -> Rounded, Difference

# ----
# Visualization
xmatrix_3 = LBDeconstructMatrix(matrix=flatten(thermalmtx))  # -> values; plug-in component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
number_slider_18 = Slider(157, range=0..1000)
xdata_3 = LBDeconstructData(data=xmatrix_3)  # -> header, values; plug-in component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
points_4 = Data(points)
item_9 = ListItem(List=xmatrix_3, Index=number_slider_18, Wrap=True)
item_10 = ListItem(List=points_4, Index=number_slider_18, Wrap=True)
avr_3 = Average(Input=xdata_3.values)  # -> flatten(ArithmeticMean)
pt_5 = Point(Point(93.14477679, -19.53288665, 0))
round_to_decimal_place_3 = RoundToDecimalPlace(NumberX=avr_3, DecimalPlace="2", RoundType=0)  # -> Rounded, Difference
vizthermalmap_2 = HBVisualizeThermalMap(comf_mtx=thermalmtx_2, mesh=flatten(genpts.mesh))  # -> report, mesh, legend, title, colors, values; plug-in component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
meshselector_3 = LBMeshThresholdSelector(values=avr_3, mesh=genpts.mesh)  # -> report, total_value, total_area, sub_mesh, outline; plug-in component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
hourlyplot_3 = LBHourlyPlot(data=item_9, base_pt=pt_5, y_dim=Slider(2, range=0..100))  # -> report, mesh, legend, borders, labels, title, vis_set; plug-in component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
toggle_5 = GroupToggle(ToggleActive=True, ToggleVisible=False)  # disabled
tag_2 = TextTag3D(
    Location=points_4,
    Text=round_to_decimal_place_3.Rounded,
    Size=Slider(0.1, range=0..0.1),
    Colour=ColourSwatch(SwatchColor=RGB(0, 0, 0)),
    Justification=7)

# ---- group: Main preview
vizthermalmap_3 = HBVisualizeThermalMap(comf_mtx=thermalmtx_2, mesh=flatten(genpts.mesh), period=analysisperiod.period)  # -> report, mesh, legend, title, colors, values; plug-in component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
toggle_6 = GroupToggle(ToggleActive=True, ToggleVisible=False)  # disabled

# ---- group: JOIN MESH (continued)
rotate_2 = Rotate(Geometry=vizthermalmap_3.mesh, Angle=1.570796327, Plane=yz_plane)  # -> Geometry, Transform
area_3 = Area(Geometry=rotate_2.Geometry)  # -> Area, Centroid
deconstruct_mesh_2 = DeconstructMesh(Mesh=rotate_2.Geometry)  # -> Vertices, Faces, Colours, Normals
move_to_point = MoveToPoint(Geometry=rotate_2.Geometry, PointA=area_3.Centroid, PointB=area_2.Centroid)  # -> Moved, Vector, Transform
mesh = Mesh(move_to_point.Moved)
deconstruct_mesh_3 = DeconstructMesh(Mesh=mesh)  # -> Vertices, Faces, Colours, Normals
point_list_2 = PointList(Points=deconstruct_mesh_3.Vertices, Size=Slider(0.5, range=0..1))
list_item_7 = ListItem(List=deconstruct_mesh_3.Vertices, Index=Slider(140, range=0..200), Wrap=True)
list_item_8 = ListItem(List=deconstruct_mesh_3.Vertices, Index=Slider(21, range=0..100), Wrap=True)
list_item_9 = ListItem(List=deconstruct_mesh_3.Vertices, Index=Slider(123, range=0..1000), Wrap=True)
list_item_10 = ListItem(List=deconstruct_mesh_3.Vertices, Index=Slider(2, range=0..10), Wrap=True)
xz_plane_2 = XZPlane(Origin=list_item_10)
_4point_surface = _4PointSurface(CornerA=list_item_10, CornerB=list_item_9, CornerC=list_item_7, CornerD=list_item_8)
rectangle_2pt = Rectangle2Pt(Plane=xz_plane_2, PointA=list_item_7, PointB=list_item_10, Radius=0)  # -> Rectangle, Length
boundary_surfaces = BoundarySurfaces(Edges=flatten([rectangle_2pt.Rectangle, move_7.Geometry]))
mesh_brep_2 = MeshBrep(
    Brep=boundary_surfaces,
    Settings={GridMaxCount=0, GridMinCount=16, JaggedSeams=False, MaxEdgeLength=0, MinEdgeLength=0.0001, MinTolerance=0, Refine=True, RefineAngle=0, RelativeTolerance=0.65, SimplePlanes=True, Tolerance=0})
colormesh = ColorMesh(Mesh=mesh_brep_2, Color=ColourSwatch(SwatchColor=RGB(0, 0, 0)))

# ---- group: FINAL MESH
mesh_2 = Mesh([construct_mesh, colormesh, mesh])

# ----
tag_3 = TextTag3D(
    Location=points_2,
    Text=round_to_decimal_place_2.Rounded,
    Size=Slider(0.1, range=0..0.1),
    Colour=ColourSwatch(SwatchColor=RGB(0, 0, 0)),
    Justification=7)

entwine = Entwine(Branch00=vizthermalmap_3.values, Branch01=merge, FlattenInputs=True)

# ----
# Iterative parameters or Different set of geometries
# Import your current geometry here !
wallacei_x = WallaceiX(
    Genes=[horizontal_depth_min, horizontal_depth_max, graph, no_of_panels],
    Objectives=round_to_decimal_place_2.Rounded,
    Data=flatten([vizthermalmap_3.values, entwine]),
    Phenotype=[vizwiref_2, vizthermalmap_3.mesh],
    allFitness="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",
    allFrontIdx="0|0;2|0;3|0;4|0;5|0;6|0;7|0;8|0",
    allGenomes="0.249|0.666|11_0.249|0.666|11_0.249|0.738|11_0.437|0.738|11_0.437|0.894|14_0.437|0.894|12_0.437|0.894|12_0.437|0.894|11_0.437|0.805|11_0.437|0.805|9",
    curFrontIdx="9|0",
    curFrontIdxSave="0|0;1|0;2|0;3|0;4|0;5|0;6|0;7|0;8|0;9|0",
    popGen="1,10",
    total="578890",
    wlcDone=True)  # -> WallaceiGenomes, FitnessValues, Data, Phenotypes
number_slider_19 = Slider(11, range=0..100)
distribute_to_grid = DistributeToGrid(
    FitnessValues=wallacei_x.FitnessValues,
    Data=wallacei_x.Data,
    WallaceiPhenotypes=wallacei_x.Phenotypes,
    SizeOfTheGridInTheXDirection=number_slider_19,
    SizeOfTheGridInTheYDirection=number_slider_19,
    SizeOfTheTexts=Slider(0.2, range=0..1),
    OutputOptions=0)  # -> DistributedFitnessValues, DistributedData, DistributedGeometries, DistributedMeshes, DistributedNumbers, GridLocations

create_set = CreateSet(List=wallacei_x.FitnessValues)  # -> Set, Map
panel_14 = Panel(create_set.Set)
geometry = Geometry(distribute_to_grid.DistributedMeshes)
geometry_2 = Geometry(distribute_to_grid.DistributedGeometries)
face_normals = FaceNormals(Mesh=distribute_to_grid.DistributedMeshes)  # -> Centers, Normals
text_tag = TextTag(Location=face_normals.Centers, Text=wallacei_x.FitnessValues)

# ==== cluster SrfSmallLarge
srf_list = ClusterInput()
edges = BrepEdges(Brep=srf_list)  # -> Naked, Interior, NonManifold
len = Length(Curve=edges.Naked)
ma = MassAddition(Input=len)  # -> Result, PartialResults
pshift = ShiftPaths(Data=ma.Result, Offset=-1)
sort = SortList(Keys=pshift, ValuesA=srf_list)  # -> Keys, ValuesA
item = ListItem(List=reverse(sort.ValuesA), Index=0, Wrap=True)
item_2 = ListItem(List=sort.ValuesA, Index=0, Wrap=True)
smallest = ClusterOutput(item_2)
largest = ClusterOutput(item)

# ==== cluster ExtractColors
back_surface_of_room = ClusterInput()
mjoin = MeshJoin(Meshes=back_surface_of_room)
mesh = ClusterInput()
mesh_2 = Mesh(back_surface_of_room)
mesh_3 = Mesh(mesh)
center = Center(Geometry=mjoin, forall=False)  # -> Center, Dimension

# ----
# Vector for Projection
mesh_area = MeshArea(Mesh=mesh)  # -> Area, Centroid
vector_2pt = Vector2Pt(PointA=mesh_area.Centroid, PointB=center.Center, Unitize=False)  # -> Vector, Length

deconstruct_mesh = DeconstructMesh(Mesh=mesh)  # -> Vertices, Faces, Colours, Normals

# ----
# Points
project_point = ProjectPoint(Point=deconstruct_mesh.Vertices, Direction=vector_2pt.Vector, Geometry=back_surface_of_room)  # -> Point, Index
deconstruct = Deconstruct(Point=project_point.Point)  # -> XComponent, YComponent, ZComponent

vdis = VectorDisplay(Anchor=mesh_area.Centroid, Vector=vector_2pt.Vector)
control_wire_display = ControlWireDisplay(WireDisplay="1")

# ----
# Point domain in Y
bounds = Bounds(Numbers=deconstruct.YComponent)
deconstruct_domain = DeconstructDomain(Domain=bounds)  # -> Start, End

channel = ClusterInput()

# ----
# Checks if flat
subtraction = Subtraction(A=deconstruct_domain.Start, B=deconstruct_domain.End)
equality_within_tolerance = EqualityWithinTolerance(FirstNumber=subtraction, SecondNumber="0,00", Tolerance=0.01)  # -> Equality, Inequality

# ----
# Condition:
# Geometry of Surface
condition_flat = Panel("0")
condition_not_flat = Data(deconstruct_domain.End)
stream_filter = StreamFilter(Gate=equality_within_tolerance.Equality, Stream0=condition_not_flat, Stream1=condition_flat)

construct_domain = ConstructDomain(DomainStart=deconstruct_domain.Start, DomainEnd=stream_filter)

# ----
# Red Channel
panel = Panel("0")
equality = Equality(FirstNumber=channel, SecondNumber=panel)  # -> Equality, Inequality
stream_filter_2 = StreamFilter(Gate=equality.Equality, Stream0="0 to 0", Stream1="255 to 20")
remap_numbers = RemapNumbers(Value=deconstruct.YComponent, Source=construct_domain, Target=stream_filter_2)  # -> Mapped, Clipped

# ----
# Blue Channel
panel_2 = Panel("2")
equality_2 = Equality(FirstNumber=channel, SecondNumber=panel_2)  # -> Equality, Inequality
stream_filter_3 = StreamFilter(Gate=equality_2.Equality, Stream0="0 to 0", Stream1="255 to 20")
remap_numbers_2 = RemapNumbers(Value=deconstruct.YComponent, Source=construct_domain, Target=stream_filter_3)  # -> Mapped, Clipped

# ----
# Green Channel
panel_3 = Panel("1")
equality_3 = Equality(FirstNumber=channel, SecondNumber=panel_3)  # -> Equality, Inequality
stream_filter_4 = StreamFilter(Gate=equality_3.Equality, Stream0="0 to 0", Stream1="255 to 20")
remap_numbers_3 = RemapNumbers(Value=deconstruct.YComponent, Source=construct_domain, Target=stream_filter_4)  # -> Mapped, Clipped

# ----
# Assign Colors
gradient = Gradient(
    LowerLimit=0,
    UpperLimit=stream_filter,
    Parameter=deconstruct.YComponent,
    stops=[0.15: RGB(0, 0, 255), 0.842: RGB(0, 0, 15)])

colour_rgb = ColourRGB(Alpha=255, Red=remap_numbers.Mapped, Green=remap_numbers_3.Mapped, Blue=remap_numbers_2.Mapped)

# ----
# Replace <null> cells
# with 0,0,1 (black)
null_item = NullItem(Item=colour_rgb)  # -> NullFlags, InvalidFlags, Description
list_length = ListLength(List=colour_rgb)
series = Series(Start=0, Step=1, Count=list_length)
cull_pattern = CullPattern(List=series, CullPattern=null_item.InvalidFlags)

replace_items = ReplaceItems(List=remap_numbers_2.Mapped, Item="1", Indices=cull_pattern, Wrap=False)
replace_items_2 = ReplaceItems(List=remap_numbers.Mapped, Item="1", Indices=cull_pattern, Wrap=False)
replace_items_3 = ReplaceItems(List=remap_numbers_3.Mapped, Item="1", Indices=cull_pattern, Wrap=False)
list_of_red_values = ClusterOutput(replace_items_2)
list_of_blue_values = ClusterOutput(replace_items)
list_of_green_values = ClusterOutput(replace_items_3)
b_channel = Panel("0,0,1")
r_channel = Panel("1,0,0")
g_channel = Panel("0,1,0")
stream_filter_5 = StreamFilter(Gate=channel, Stream0=r_channel, Stream1=g_channel, Stream2=b_channel)

# ----
# Create List colors
replace_items_4 = ReplaceItems(List=colour_rgb, Item=stream_filter_5, Indices=cull_pattern, Wrap=False)

panel_4 = Panel(replace_items_4)

# ----
# Output Gradient
construct_mesh = ConstructMesh(Vertices=deconstruct_mesh.Vertices, Faces=deconstruct_mesh.Faces, Colours=replace_items_4)

output_b_channel = ClusterOutput(construct_mesh)
