# Grasshopper definition Adaptive comfort dd.gh (Grasshopper 1.0.8)
# Copyright: 2017
# plug-ins: Heteroptera, Pufferfish, MetaHopper, Wallacei, Kangaroo2 Components

# ----
# EPW FILE
# General input
epw_file_path_barcelona = Panel("https://climate.onebuilding.org/WMO_Region_1_Africa/EGY_Egypt/QH_Al_Qahirah_Cairo/EGY_QH_Cairo.Intl.AP.623660_TMYx.zip")
epw_filepath = Data(epw_file_path_barcelona)

deconstruct_brep = DeconstructBrep()  # -> Faces, Edges, Vertices

# ----
# Weather file
epw_filepath_2 = Data(epw_filepath)
# Room Related
downloadepw = LBDownloadWeather(weather_URL=epw_filepath_2)  # -> epw_file, stat_file, ddy_file; plug-in component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

number_slider = Slider(2, range=0..10)

pt = Point(Point(-2.722291582, 0.2658342869, 0))
northarrow = Ladybug_North(centerPt=pt, scale=Slider(0.1, range=0..0.1))  # -> northSign; plug-in component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

hb_building_programs = HBBuildingPrograms({"LargeOffice", "MediumOffice", "SmallOffice", "MidriseApartment", "HighriseApartment", "Retail", "StripMall", "PrimarySchool", "SecondarySchool", "SmallHotel", "LargeHotel", "Hospital", "Outpatient", "Laboratory", "Warehouse", "SuperMarket", "FullServiceRestaurant", "QuickServiceRestaurant", "Courthouse", "LargeDataCenterHighITE", "LargeDataCenterLowITE", "SmallDataCenterHighITE", "SmallDataCenterLowITE"}, selected="LargeOffice")

# ----
# Set Up ROOM or ZONE
number_slider_2 = Slider(3, range=0..10)
number_slider_3 = Slider(4.8, range=0..10)
domain_box = DomainBox(Base=PlaneXY(0, 0, 0), X=Slider(15, range=0..100), Y=Slider(10, range=0..10), Z=number_slider_2)
roomsolid = HBRoomFromSolid(geo=flatten(domain_box), program=hb_building_programs, conditioned=True)  # -> out, rooms; plug-in component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

deconstruct_brep_2 = DeconstructBrep(Brep=domain_box)  # -> Faces, Edges, Vertices
list_item = ListItem(List=deconstruct_brep_2.Faces, Index=Slider(4, range=0..6), Wrap=True)
curve = Curve(list_item)
explode = Explode(Curve=curve, Recursive=True)  # -> Segments, Vertices
deconstruct_brep_3 = DeconstructBrep(Brep=domain_box)  # -> Faces, Edges, Vertices
center = Center(Geometry=domain_box)  # -> Center, Dimension
division = Division(A=number_slider_2, B=2)
removeduplicatepts = RemoveDuplicatePts(Points=explode.Vertices, Tolerance=0.01)
list_item_2 = ListItem(List=deconstruct_brep_3.Faces, Index=Slider(4, range=0..6), Wrap=True)
curve_2 = Curve(list_item_2)
center_box = CenterBox(Base=center.Center, X=number_slider, Y=number_slider, Z=division)
xy_plane = XYPlane(Origin=removeduplicatepts)
explode_2 = Explode(Curve=curve_2, Recursive=True)  # -> Segments, Vertices
divide_surface = DivideSurface(Surface=curve_2, UCount=10, VCount=10)  # -> flatten(Points), Normals, Parameters
scale_nu = ScaleNU(Geometry=domain_box, Plane=xy_plane, ScaleX=Slider(0.5, range=0..1), ScaleY=Slider(0.5, range=0..1), ScaleZ=1)  # -> Geometry, Transform
solid_difference = SolidDifference(BrepsA=scale_nu.Geometry, BrepsB=center_box)
divide_curve = DivideCurve(Curve=explode_2.Segments, Count=10, Kinks=False)  # -> flatten(Points), Tangents, Parameters
roomsolid_2 = HBRoomFromSolid(geo=flatten(center_box), program=hb_building_programs, conditioned=True)  # -> out, rooms; plug-in component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
pull_point = PullPoint(Point=divide_surface.Points, Geometry=curve_2, ClosestOnly=True)  # -> ClosestPoint, Distance
boolean_toggle = BooleanToggle(True)
roomsolid_3 = HBRoomFromSolid(geo=flatten(solid_difference), program=hb_building_programs, conditioned=True)  # -> out, rooms; plug-in component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
face = HBFace()  # -> out, faces; plug-in component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
larger_than = LargerThan(FirstNumber=pull_point.Distance, SecondNumber=Slider(0.5, range=0..1))  # -> LargerThan, OrEqualTo
importstat = LBImportSTAT(stat_file=downloadepw.stat_file)  # -> location, ashrae_zone, koppen_zone, clear_dir_norm_rad, clear_diff_horiz_rad, ann_heat_dday_996, ann_heat_dday_990, ann_cool_dday_004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; plug-in component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
vizquick = HBVisualizeQuick(hb_objs=flatten([roomsolid_3.rooms, roomsolid_2.rooms]))  # -> geo; plug-in component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
intsolid = HBIntersectSolids(rooms=flatten([roomsolid_3.rooms, roomsolid_2.rooms]), run=boolean_toggle)  # -> int_rooms; plug-in component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

# ----
# Opening Parameters
horizontal_spacing_between = Slider(2, range=0..10)
window_height = Slider(2, range=0..10)
sill_height = Slider(0.5, range=-0.5..2)
vertical_spacing_between = Slider(0, range=0..10)

cull_pattern = CullPattern(List=divide_surface.Points, CullPattern=larger_than.LargerThan)

importepw = LBImportEPW(epw_file=downloadepw.epw_file)  # -> location, dry_bulb_temperature, dew_point_temperature, relative_humidity, wind_speed, wind_direction, direct_normal_rad, diffuse_horizontal_rad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; disabled; plug-in component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
number_slider_4 = Slider(3, range=0..10)  # disabled
windprofile = LBWindProfile(met_wind_vel=importepw.wind_speed, met_wind_dir=importepw.wind_direction, profile_height=number_slider_4)  # -> out, wind_speeds, wind_vectors, anchor_pts, mesh_arrows, profile_curve, speed_axis, height_axis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; disabled; plug-in component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
windspeed = LBWindSpeed(met_wind_vel=importepw.wind_speed)  # -> out, air_speed; disabled; plug-in component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
xdata = LBDeconstructData(data=windspeed.air_speed)  # -> header, values; disabled; plug-in component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
data = Data()  # disabled
bounds = Bounds(Numbers=xdata.values)  # disabled
deconstruct_domain = DeconstructDomain(Domain=bounds)  # -> Start, End; disabled

gene_pool = GenePool(Decimals=2, Maximum=81, Minimum=0, Value=[69.90632836, 41.98079813, 11.62120907, 79.02, 15.86285359])

# ----
# plane to analyze
deconstruct_brep_4 = DeconstructBrep(Brep=domain_box)  # -> Faces, Edges, Vertices
center_2 = Center(Geometry=deconstruct_brep_4.Faces)  # -> Center, Dimension
deconstruct = Deconstruct(Point=center_2.Center)  # -> XComponent, YComponent, ZComponent
smaller_than = SmallerThan(FirstNumber=deconstruct.ZComponent, SecondNumber=Slider(0.02, range=0..0.1))  # -> SmallerThan, OrEqualTo
cull_pattern_2 = CullPattern(List=deconstruct_brep_4.Faces, CullPattern=smaller_than.SmallerThan)

solveadj = HBSolveAdjacency(rooms=flatten(intsolid), adiabatic=boolean_toggle, run=boolean_toggle)  # -> out, adj_rooms; plug-in component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
list_item_3 = ListItem(List=cull_pattern, Index=gene_pool, Wrap=True)
number_slider_5 = Slider(3, range=0..10)
closest_point = ClosestPoint(Point=list_item_3, Cloud=divide_curve.Points)  # -> ClosestPoint, CPIndex, Distance
vizquick_2 = HBVisualizeQuick(hb_objs=flatten(solveadj.adj_rooms))  # -> geo; plug-in component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
line = Line(StartPoint=list_item_3, EndPoint=closest_point.ClosestPoint)
unit_z = UnitZ(Factor=Slider(3, range=0..10))
removeduplicatelines = RemoveDuplicateLines(Lines=line, Tolerance=0.01)
extrude = Extrude(Base=removeduplicatelines, Direction=unit_z)
unit_z_2 = UnitZ(Factor=Slider(1, range=0..1))
move = Move(Geometry=cull_pattern_2, Motion=unit_z_2)  # -> Geometry, Transform

# ----
# Period
number_slider_6 = Slider(1, range=1..12)
number_slider_7 = Slider(1, range=1..31)

# ----
# Comfort param
lb_activities_met_list = LBActivitiesMetList({"Seated", "Standing", "supine"}, selected="Seated")
panel = Panel("0.65")
solarbodypar = LBSolarBodyParameters(posture=lb_activities_met_list, sharp="45")  # -> sol_body_par; plug-in component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

analysisperiod = LBAnalysisPeriod(
    start_month=number_slider_6,
    start_day=number_slider_7,
    start_hour=Slider(8, range=0..23),
    end_month=Slider(12, range=1..12),
    end_day=number_slider_7,
    end_hour=Slider(17, range=0..23))  # -> period, hoys, dates; plug-in component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
adaptpar = LBAdaptiveComfortParameters(
    ashrae_or_en="False",
    neutral_offset=Slider(3, range=0..10),
    avgm_or_runmean="False",
    discr_or_cont_vel="False",
    cold_prevail_limit="15",
    conditioning="0")  # -> adapt_par; plug-in component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
set_group_properties = SetGroupProperties(Color=ColourSwatch(SwatchColor=RGB(216, 255, 184)))

# ---- group: ARE YOU SURE ?
toggle = BooleanToggle(False)

# ----
# Adpative thermal comfort
number_slider_8 = Slider(2, range=0..3)
legendpar = LBLegendParameters(min=Slider(25, range=0..100), max=Slider(35, range=0..100))  # -> leg_par; plug-in component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
data_2 = Data("Grasshopper.Kernel.Types.GH_ObjectWrapper")
data_3 = Data("Grasshopper.Kernel.Types.GH_ObjectWrapper")
data_4 = Data("Grasshopper.Kernel.Types.GH_ObjectWrapper")
data_5 = Data("Grasshopper.Kernel.Types.GH_ObjectWrapper")

# ----
# Floor plane set to 1 meter high
data_6 = Data(flatten(Tree({0;0;0}: [], {1;0}: ["C:\Users\Aly Mahmoud\simulation\unnamed\adaptive_comfort_map\initial_results/conditions"], {2;0}: ["C:\Users\Aly Mahmoud\simulation\unnamed\adaptive_comfort_map\results/temperature"], {3;0}: ["C:\Users\Aly Mahmoud\simulation\unnamed\adaptive_comfort_map\results/condition"], {4;0}: ["C:\Users\Aly Mahmoud\simulation\unnamed\adaptive_comfort_map\results/condition_intensity"], {5;0;0}: [79.01854714, 77.74343122, 77.2797527, 77.2797527, 77.04791345, 76.89335394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], {6;0;0}: [0, 0, 0, 0, 0, 0, 0, 0, 0, 0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], {7;0;0}: [20.98145286, 22.25656878, 22.7202473, 22.7202473, 22.95208655, 23.10664606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])))  # disabled
list_item_4 = ListItem(List=data_6, Index=0, Wrap=True)  # -> Item, Item1, Item2, Item3, Item4, Item5, Item6, Item7; disabled
boolean_toggle_2 = BooleanToggle(True)  # disabled
mesh = Mesh(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)  # disabled
thermalmtx = HBReadThermalMatrix(comf_result=list_item_4.Item2, load=boolean_toggle_2)  # -> comf_mtx; disabled; plug-in component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
face_normals = FaceNormals(Mesh=mesh)  # -> Centers, Normals; disabled
number_slider_9 = Slider(2, range=0..10)  # disabled
vizthermalmap = HBVisualizeThermalMap(comf_mtx=thermalmtx, mesh=flatten(mesh))  # -> out, mesh, legend, title, colors, values; disabled; plug-in component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
number_slider_10 = Slider(0.1, range=0..0.1)  # disabled
round_to_decimal_place = RoundToDecimalPlace(NumberX=vizthermalmap.values, DecimalPlace=number_slider_9, RoundType=0)  # -> Rounded, Difference; disabled
swatch = ColourSwatch(SwatchColor=RGB(0, 0, 0))  # disabled
tag = TextTag3D(
    Location=face_normals.Centers,
    Text=round_to_decimal_place.Rounded,
    Size=number_slider_10,
    Colour=swatch,
    Justification=7)  # disabled

boolean_toggle_3 = BooleanToggle(True)  # disabled

# ----
# Facade as a shader
number_slider_11 = Slider(0, range=0..5)
viznorm = HBVisualizeNormals(hb_objs=roomsolid.rooms)  # -> points, vectors; plug-in component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
list_item_5 = ListItem(List=deconstruct_brep_4.Faces, Index=number_slider_11, Wrap=True)  # -> Item, Item1, Item2, Item3
list_item_6 = ListItem(List=viznorm.vectors, Index=number_slider_11, Wrap=True)  # -> Item, Item1, Item2, Item3

merge = Merge(Data1=list_item_5.Item, Data2=list_item_5.Item1, Data3=list_item_5.Item2, Data4=list_item_5.Item3)
merge_2 = Merge(Data1=list_item_6.Item, Data2=list_item_6.Item1, Data3=list_item_6.Item2, Data4=list_item_6.Item3)

ratio_to_the_elevation = Slider(0.55, range=0..1)
hb_construction_types = HBConstructionTypes({"SteelFramed", "WoodFramed", "Mass", "Metal Building"}, selected="SteelFramed")

# ----
# Windows
facparam = HBFacadeParameters(north=ratio_to_the_elevation, east=ratio_to_the_elevation, south=ratio_to_the_elevation, west=ratio_to_the_elevation)  # -> fac_par; plug-in component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
aperturesbyratio = HBAperturesByRatio(
    hb_objs=flatten(solveadj.adj_rooms),
    ratio=facparam,
    subdivide=Slider(3, range=0..10),
    win_height=window_height,
    sill_height=sill_height,
    horiz_separ=horizontal_spacing_between,
    vert_separ=vertical_spacing_between)  # -> out, hb_objs; plug-in component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

decnstrobj = HBDeconstructObject(hb_obj=aperturesbyratio.hb_objs)  # -> flatten(faces), flatten(apertures), doors, shades; plug-in component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
vizquick_3 = HBVisualizeQuick(hb_objs=flatten(decnstrobj.faces))  # -> geo; plug-in component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
vizquick_4 = HBVisualizeQuick(hb_objs=flatten(decnstrobj.apertures))  # -> geo; plug-in component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
aperture = HBAperture(geo=vizquick_4)  # -> out, apertures; plug-in component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
face_2 = HBFace(geo=vizquick_3, bc="adiabatic")  # -> out, faces; plug-in component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

vizquick_5 = HBVisualizeQuick(hb_objs=flatten(aperturesbyratio.hb_objs))  # -> geo; plug-in component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

amplitude = Amplitude(Vector=merge_2, Amplitude=Slider(1.5, range=0..2))
move_2 = Move(Geometry=merge, Motion=amplitude)  # -> Geometry, Transform

# ----
# Skin
number_slider_12 = Slider(2, range=2..10)
sframes = SurfaceFrames(Surface=move_2.Geometry, UCount=number_slider_12, VCount=number_slider_12)  # -> Frames, Parameters
panel_2 = Panel("""0
-1""")
division_2 = Division(A=2.8, B=number_slider_12)
cull_i = CullIndex(List=sframes.Frames, Indices=panel_2, Wrap=True)
cull_i_2 = CullIndex(List=flatten(cull_i), Indices=panel_2, Wrap=True)  # -> flatten(List)
panel_3 = Panel("""0
1""")
cull = CullPattern(List=cull_i_2, CullPattern=panel_3)
cir = Circle(Plane=cull, Radius=division_2)
srfsplit = SurfaceSplit(Surface=move_2.Geometry, Curves=cir)
srf_sl = SrfSmallLarge(srf_list=srfsplit)  # -> smallest, largest
srf = Surface(srf_sl.smallest)

srf_2 = Surface(srf_sl.largest)

shade = HBShade(geo=flatten(srf_2))  # -> out, shades; plug-in component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

# ----
# Model
model = HBModel(rooms=flatten(aperturesbyratio.hb_objs), shades=flatten(shade.shades), apertures=flatten(aperture.apertures))  # -> out, model; plug-in component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
vizall = HBVisualizeAll(hb_objs=flatten(model.model))  # -> geo; plug-in component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
vizwiref = HBVisualizeWireframe(hb_objs=flatten(model.model))  # -> geo; plug-in component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

hb_face_attributes = HBFaceAttributes({"Display Name": "display_name", "Simulation Name (Identifier)": "identifier", "Boundary Condition": "boundary_condition", "Has Parent": "has_parent", "Parent": "parent", "Azimuth": "azimuth", "Altitude": "altitude", "Area": "area", "Perimeter": "perimeter", "Face Type": "type", "Aperture Is Operable": "is_operable", "Door Is Glass": "is_glass"}, selected="Boundary Condition")
# Faces labels
lablefaces = HBLabelFaces(hb_objs=flatten(model.model), attribute=hb_face_attributes)  # -> label_text, base_pts, labels, wire_frame; plug-in component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

# ----
# Visualize
vizbytype = HBVisualizeByType(hb_objs=model.model)  # -> walls, interior_walls, roofs, ceilings, exterior_floors, interior_floors, air_walls, apertures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; plug-in component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
data_7 = Data(vizbytype.outdoor_shades)
mesh_edges = MeshEdges(Mesh=data_7)  # -> NakedEdges, InteriorEdges, NonManifoldEdges
data_8 = Data(mesh_edges.NakedEdges)
mesh_2 = Mesh(data_7)

# ----
# Sensor Grid
number_slider_13 = Slider(0.5, range=0..10)
genpts = LBGeneratePointGrid(geometry=move.Geometry, grid_size=number_slider_13)  # -> points, vectors, face_areas, mesh; plug-in component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
points = Data(genpts.points)

rebuild_mesh = RebuildMesh(
    Mesh=genpts.mesh,
    RebuildNormals=False,
    CullUnused=False,
    UnifyNormals=False,
    FlipNormals=True,
    IdenticalCombine=False,
    WeldVertices=0)

sensorgrid = HBSensorGrid(positions=points, mesh=rebuild_mesh)  # -> grid; plug-in component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
assigngridsviews = HBAssignGridsAndViews(model=model.model, grids=flatten(sensorgrid))  # -> model; plug-in component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

# ----
# Analysis parameters:
# 
# HB room - Indoor analysis:
# Apreture testing location : South
# period: Annual
# Wind speed: 0.2
# human body parameters: Seated - facing side way to the window
adaptivemap = HBAdaptiveComfortMap(
    model=assigngridsviews,
    epw=downloadepw.epw_file,
    ddy=downloadepw.ddy_file,
    run_period=analysisperiod.period,
    air_speed=number_slider_8,
    comfort_par=adaptpar,
    solar_body_par=solarbodypar,
    run=toggle)  # -> out, env_conds, op_temp, condition, deg_neut, TCP, HSP, CSP; plug-in component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

# ----
# Cold sensation percentage
heatmap = LBSpatialHeatmap(values=adaptivemap.CSP, mesh=rebuild_mesh)  # -> mesh, legend, title, colors, legend_par, vis_set; plug-in component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
# Thermal comfort percentage
heatmap_2 = LBSpatialHeatmap(values=adaptivemap.HSP, mesh=rebuild_mesh)  # -> mesh, legend, title, colors, legend_par, vis_set; plug-in component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
# HSP Heat sensation percentage %
heatmap_3 = LBSpatialHeatmap(values=adaptivemap.TCP, mesh=rebuild_mesh)  # -> mesh, legend, title, colors, legend_par, vis_set; plug-in component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

envmtx = HBReadEnvironmentMatrix(env_conds=adaptivemap.env_conds, load=Toggle(True))  # -> comf_mtx; plug-in component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
thermalmtx_2 = HBReadThermalMatrix(comf_result=adaptivemap.condition, load=Toggle(True))  # -> comf_mtx; plug-in component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
vizthermalmap_2 = HBVisualizeThermalMap(comf_mtx=envmtx, mesh=flatten(rebuild_mesh), legend_par=legendpar)  # -> out, mesh, legend, title, colors, values; plug-in component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
vizthermalmap_3 = HBVisualizeThermalMap(comf_mtx=data_3, mesh=flatten(rebuild_mesh), legend_par=legendpar)  # -> out, mesh, legend, title, colors, values; plug-in component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
vizthermalmap_4 = HBVisualizeThermalMap(comf_mtx=data_5, mesh=flatten(rebuild_mesh), legend_par=legendpar)  # -> out, mesh, legend, title, colors, values; plug-in component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
vizthermalmap_5 = HBVisualizeThermalMap(comf_mtx=data_4, mesh=flatten(rebuild_mesh), legend_par=legendpar)  # -> out, mesh, legend, title, colors, values; plug-in component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

round_to_decimal_place_2 = RoundToDecimalPlace(NumberX=vizthermalmap_4.values, DecimalPlace=Slider(1, range=0..10), RoundType=0)  # -> Rounded, Difference
tag_2 = TextTag3D(
    Location=points,
    Text=round_to_decimal_place_2.Rounded,
    Size=Slider(0.1, range=0..0.1),
    Colour=ColourSwatch(SwatchColor=RGB(0, 0, 0)),
    Justification=7)

# ----
# Wallacei
wallacei_x = WallaceiX(
    Genes=number_slider_12,
    Objectives=round_to_decimal_place_2.Rounded,
    Phenotype=vizwiref,
    allFitness="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",
    allFrontIdx="0|0;0|1;0|2;0|5;0|7;0|9",
    allGenomes="7_4_11_17_15_11_9_4_15_3",
    curFrontIdx="0|0;0|1;0|2;0|5;0|7;0|9",
    curFrontIdxSave="0|0;0|1;0|2;0|5;0|7;0|9",
    popGen="10,1",
    total="384953",
    wlcDone=True)  # -> WallaceiGenomes, FitnessValues, Data, Phenotypes
number_slider_14 = Slider(20, range=0..100)
distribute_to_grid = DistributeToGrid(
    FitnessValues=wallacei_x.FitnessValues,
    WallaceiPhenotypes=wallacei_x.Phenotypes,
    SizeOfTheGridInTheXDirection=number_slider_14,
    SizeOfTheGridInTheYDirection=number_slider_14,
    OutputOptions=0)  # -> DistributedFitnessValues, DistributedData, DistributedGeometries, DistributedMeshes, DistributedNumbers, GridLocations
tag_3 = TextTag3D(
    Text=distribute_to_grid.DistributedFitnessValues,
    Size=Slider(0.1, range=0..0.1),
    Colour=ColourSwatch(SwatchColor=RGB(0, 0, 0)),
    Justification=7)

# ----
# floor plane on the ground
data_9 = Data(flatten(Tree({0}: ["C:\Users\Aly Mahmoud\simulation\unnamed\adaptive_comfort_map\initial_results/conditions", "C:\Users\Aly Mahmoud\simulation\unnamed\adaptive_comfort_map\results/temperature", "C:\Users\Aly Mahmoud\simulation\unnamed\adaptive_comfort_map\results/condition", "C:\Users\Aly Mahmoud\simulation\unnamed\adaptive_comfort_map\results/condition_intensity"], {0;0}: [47.58208955, 47.88059701, 47.97014925, 47.91044776, 47.73134328, 47.82089552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])))  # disabled
list_item_7 = ListItem(List=data_9, Index=0, Wrap=True)  # -> Item, Item1, Item2, Item3, Item4, Item5, Item6, Item7; disabled
boolean_toggle_4 = BooleanToggle(True)  # disabled
mesh_3 = Mesh(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)  # disabled
thermalmtx_3 = HBReadThermalMatrix(comf_result=list_item_7.Item2, load=boolean_toggle_4)  # -> comf_mtx; disabled; plug-in component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
face_normals_2 = FaceNormals(Mesh=mesh_3)  # -> Centers, Normals; disabled
number_slider_15 = Slider(2, range=0..10)  # disabled
number_slider_16 = Slider(0.1, range=0..0.1)  # disabled
swatch_2 = ColourSwatch(SwatchColor=RGB(0, 0, 0))  # disabled

envmtx_2 = HBReadEnvironmentMatrix(env_conds=list_item_7.Item, load=boolean_toggle_3)  # -> comf_mtx; disabled; plug-in component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

vizthermalmap_6 = HBVisualizeThermalMap(comf_mtx=envmtx_2, mesh=flatten(mesh_3))  # -> out, mesh, legend, title, colors, values; disabled; plug-in component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
round_to_decimal_place_3 = RoundToDecimalPlace(NumberX=vizthermalmap_6.values, DecimalPlace=number_slider_15, RoundType=0)  # -> Rounded, Difference; disabled
tag_4 = TextTag3D(
    Location=face_normals_2.Centers,
    Text=round_to_decimal_place_3.Rounded,
    Size=number_slider_16,
    Colour=swatch_2,
    Justification=7)  # disabled

# ==== cluster SrfSmallLarge
srf_list = ClusterInput()
edges = BrepEdges(Brep=srf_list)  # -> Naked, Interior, NonManifold
len = Length(Curve=edges.Naked)
ma = MassAddition(Input=len)  # -> Result, PartialResults
pshift = ShiftPaths(Data=ma.Result, Offset=-1)
sort = SortList(Keys=pshift, ValuesA=srf_list)  # -> Keys, ValuesA
item = ListItem(List=reverse(sort.ValuesA), Index=0, Wrap=True)
cull_index = CullIndex(List=sort.ValuesA, Indices="-1", Wrap=True)
largest = ClusterOutput(item)
smallest = ClusterOutput(cull_index)
