# Grasshopper definition UTCI Template_updated with export.gh (Grasshopper 1.0.7)
# Copyright: 2017
# plug-ins: Heteroptera, MetaHopper, Pufferfish, Wallacei, LunchBox, Kangaroo2 Components

# ----
# EPW FILE
# General input
epw_file_path_barcelona = Panel("https://climate.onebuilding.org/WMO_Region_1_Africa/EGY_Egypt/QH_Al_Qahirah_Cairo/EGY_QH_Cairo.Intl.AP.623660_TMYx.zip")
epw_filepath = Data(epw_file_path_barcelona)

hb_building_programs = HBBuildingPrograms({"LargeOffice", "MediumOffice", "SmallOffice", "MidriseApartment", "HighriseApartment", "Retail", "StripMall", "PrimarySchool", "SecondarySchool", "SmallHotel", "LargeHotel", "Hospital", "Outpatient", "Laboratory", "Warehouse", "SuperMarket", "FullServiceRestaurant", "QuickServiceRestaurant", "Courthouse", "LargeDataCenterHighITE", "LargeDataCenterLowITE", "SmallDataCenterHighITE", "SmallDataCenterLowITE"}, selected="LargeOffice")

# ----
# Set Up ROOM or ZONE
number_slider = Slider(6, range=0..10)
domain_box = DomainBox(Base=PlaneXY(0, 0, 0), X=number_slider, Y=Slider(6, range=0..10), Z=Slider(3, range=0..10))
volume = Volume(Geometry=domain_box)  # -> Volume, Centroid
panel = Panel(volume.Volume)
# Room Related
roomsolid = HBRoomFromSolid(geo=flatten(domain_box), program=hb_building_programs, conditioned=True)  # -> out, rooms; plug-in component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

vt = Slider(0.8, range=0..1)
# Material Set up
panel_2 = Panel("glazing")
windowmat = HBWindowMaterial(name=panel_2, u_factor=Slider(5.7, range=0.8..5.7), shgc=Slider(0.2, range=0..1), t_vis=vt)  # -> mat; plug-in component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
windowconstr = HBWindowConstruction(name=panel_2, materials=windowmat)  # -> constr; plug-in component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

opaquemat = HBOpaqueMaterial(name="interior_Walls_MT")  # -> mat; plug-in component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
opaqueconstr = HBOpaqueConstruction(name="interior_Walls_MT", materials=opaquemat)  # -> constr; plug-in component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

opaquemat_2 = HBOpaqueMaterial(name="roof_MT")  # -> mat; plug-in component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
opaqueconstr_2 = HBOpaqueConstruction(name="roof_MT", materials=opaquemat_2)  # -> constr; plug-in component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

opaquemat_3 = HBOpaqueMaterial(name="floor_MT")  # -> mat; plug-in component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
opaqueconstr_3 = HBOpaqueConstruction(name="floor_MT", materials=opaquemat_3)  # -> constr; plug-in component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

opaquemat_4 = HBOpaqueMaterial(name="Exterior_Walls_MT")  # -> mat; plug-in component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
opaqueconstr_4 = HBOpaqueConstruction(name="Exterior_Walls_MT", materials=opaquemat_4)  # -> constr; plug-in component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

set_group_properties = SetGroupProperties(
    Group=["Grasshopper.Kernel.Types.GH_ObjectWrapper", "Grasshopper.Kernel.Types.GH_ObjectWrapper", "Grasshopper.Kernel.Types.GH_ObjectWrapper", "Grasshopper.Kernel.Types.GH_ObjectWrapper", "Grasshopper.Kernel.Types.GH_ObjectWrapper", "Grasshopper.Kernel.Types.GH_ObjectWrapper", "Grasshopper.Kernel.Types.GH_ObjectWrapper", "Grasshopper.Kernel.Types.GH_ObjectWrapper", "Grasshopper.Kernel.Types.GH_ObjectWrapper", "Grasshopper.Kernel.Types.GH_ObjectWrapper", "Grasshopper.Kernel.Types.GH_ObjectWrapper", "Grasshopper.Kernel.Types.GH_ObjectWrapper", "Grasshopper.Kernel.Types.GH_ObjectWrapper"],
    Color=ColourSwatch(SwatchColor=RGBA(120, 120, 120, 88)))

# ----
# Weather file
epw_filepath_2 = Data(epw_filepath)
downloadepw = LBDownloadWeather(weather_URL=epw_filepath_2)  # -> epw_file, stat_file, ddy_file; plug-in component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

pt = Point(Point(-2.722291582, 0.2658342869, 0))
northarrow = Ladybug_North(centerPt=pt, scale=Slider(0.1, range=0..0.1))  # -> northSign; plug-in component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

aperture = HBAperture()  # -> out, apertures; plug-in component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
face = HBFace()  # -> out, faces; plug-in component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

# ----
# plane to analyze
deconstruct_brep = DeconstructBrep(Brep=domain_box)  # -> Faces, Edges, Vertices
center = Center(Geometry=deconstruct_brep.Faces)  # -> Center, Dimension
deconstruct = Deconstruct(Point=center.Center)  # -> XComponent, YComponent, ZComponent
smaller_than = SmallerThan(FirstNumber=deconstruct.ZComponent, SecondNumber=Slider(0.02, range=0..0.1))  # -> SmallerThan, OrEqualTo
cull_pattern = CullPattern(List=deconstruct_brep.Faces, CullPattern=smaller_than.SmallerThan)

number_slider_2 = Slider(0, range=0..5)
hb_construction_types = HBConstructionTypes({"SteelFramed", "WoodFramed", "Mass", "Metal Building"}, selected="SteelFramed")

# ----
# Comfort param
adaptpar = LBAdaptiveComfortParameters()  # -> adapt_par; plug-in component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
solarbodypar = LBSolarBodyParameters()  # -> sol_body_par; plug-in component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

number_slider_3 = Slider(12, range=0..23)
number_slider_4 = Slider(13, range=0..23)
number_slider_5 = Slider(4, range=1..31)
analysisperiod = LBAnalysisPeriod(
    start_month=Slider(1, range=1..12),
    start_day=number_slider_5,
    start_hour=number_slider_3,
    end_month=Slider(12, range=1..12),
    end_day=number_slider_5,
    end_hour=number_slider_3)  # -> period, hoys, dates; plug-in component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
data_dam = DataDam(BufferDelay=10000000, BufferMode=0)  # -> DataDataA, DataA, DataB, DataC, DataD, DataE

xy_plane = XYPlane(Origin=Point(0, 0, 0))

# ---- group: ARE YOU SURE ?
toggle = BooleanToggle(True)
toggle_2 = BooleanToggle(False)  # disabled
toggle_3 = BooleanToggle(False)  # disabled

# ----
control_wire_display = ControlWireDisplay(
    WireDisplay=2,
    AllObjects_Object=[adaptivemap, pmvmap, vizthermalmap_3, toggle_8, xmatrix_3, item_5, number_slider_13, hourlyplot_3, pt_4, item_6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])
param_viewer = ParamViewer()
panel_3 = Panel("""0
1
102
103
104""")
panel_4 = Panel("""points blocked
points entering room
soild percentage
perforation percentage
distance between skin and facade""")
panel_5 = Panel("""points blocked
points entering room
soild percentage
perforation percentage
distance between skin and facade""")
series = Series(Start=0, Step=1, Count=Slider(100, range=0..105))
concatenate = Concatenate(FragmentA="cell ", FragmentB=series)
# i want this to be the first branch
insert_items = InsertItems(List=concatenate, Item=panel_5, Indices="0", Wrap=True)
panel_6 = Panel(insert_items)

# ----
# Opening Parameters
ratio_to_the_elevation = Slider(0.46, range=0..1)
horizontal_spacing_between = Slider(2, range=0..10)
window_height = Slider(2, range=0..10)
sill_height = Slider(0.5, range=-0.5..2)
vertical_spacing_between = Slider(0, range=0..10)

# ----
# Windows
facparam = HBFacadeParameters(north=0, east=0, south=ratio_to_the_elevation, west=0)  # -> fac_par; plug-in component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
aperturesbyratio = HBAperturesByRatio(
    hb_objs=flatten(roomsolid.rooms),
    ratio=facparam,
    subdivide=Slider(3, range=0..10),
    win_height=window_height,
    sill_height=sill_height,
    horiz_separ=horizontal_spacing_between,
    vert_separ=vertical_spacing_between)  # -> out, hb_objs; plug-in component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

# ----
# Skylight
ratio_to_the_elevation_2 = Slider(0.21, range=0..1)
skylightsbyratio = HBSkylightsByRatio(hb_objs=flatten(aperturesbyratio.hb_objs), ratio=ratio_to_the_elevation_2)  # -> out, hb_objs; plug-in component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
vizwiref = HBVisualizeWireframe(hb_objs=flatten(skylightsbyratio.hb_objs))  # -> geo; plug-in component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

number_slider_6 = Slider(8, range=2..16)
panel_7 = Panel("""0
-1""")
division = Division(A=2.4, B=number_slider_6)
panel_8 = Panel("""0
1""")

# ----
# Facade as a shader
number_slider_7 = Slider(0, range=0..5)
viznorm = HBVisualizeNormals(hb_objs=roomsolid.rooms)  # -> points, vectors; plug-in component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
list_item = ListItem(List=deconstruct_brep.Faces, Index=number_slider_7, Wrap=True)
list_item_2 = ListItem(List=viznorm.vectors, Index=number_slider_7, Wrap=True)
amplitude = Amplitude(Vector=list_item_2, Amplitude=Slider(0.87, range=0.5..2))
move = Move(Geometry=list_item, Motion=amplitude)  # -> Geometry, Transform
center_2 = Center(Geometry=list_item)  # -> Center, Dimension
center_3 = Center(Geometry=move.Geometry)  # -> Center, Dimension
distance = Distance(PointA=center_2.Center, PointB=center_3.Center)

curve = Curve(list_item)
curve_2 = Curve(move.Geometry)
ruled_surface = RuledSurface(CurveA=curve, CurveB=curve_2)

sframes = SurfaceFrames(Surface=move.Geometry, UCount=number_slider_6, VCount=number_slider_6)  # -> Frames, Parameters
cull_i = CullIndex(List=sframes.Frames, Indices=panel_7, Wrap=True)
flip = FlipMatrix(Data=cull_i)
cull_i_2 = CullIndex(List=flip, Indices=panel_7, Wrap=True)  # -> flatten(List)
cull = CullPattern(List=cull_i_2, CullPattern=panel_8)
cir = Circle(Plane=cull, Radius=division)
# Skin
srfsplit = SurfaceSplit(Surface=move.Geometry, Curves=cir)
srf_sl = SrfSmallLarge(srf_list=srfsplit)  # -> smallest, largest
srf = Surface(srf_sl.smallest)
area = Area(Geometry=srf)  # -> Area, Centroid
mass_addition = MassAddition(Input=area.Area)  # -> Result, PartialResults

srf_2 = Surface(srf_sl.smallest)

srf_3 = Surface(srf_sl.largest)
shade = HBShade(geo=[srf_3, ruled_surface])  # -> out, shades; plug-in component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

decnstrobj = HBDeconstructObject(hb_obj=aperturesbyratio.hb_objs)  # -> faces, apertures, doors, shades; plug-in component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
vizquick = HBVisualizeQuick(hb_objs=flatten(decnstrobj.apertures))  # -> geo; plug-in component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
aperture_2 = HBAperture(geo=vizquick)  # -> out, apertures; plug-in component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

geometry = Geometry(vizquick)
center_4 = Center(Geometry=geometry)  # -> Center, Dimension
list_item_3 = ListItem(List=center_4.Center, Index=0, Wrap=True)  # -> Item, Item1, Item2
distance_2 = Distance(PointA=list_item_3.Item, PointB=area.Centroid)
distance_3 = Distance(PointA=list_item_3.Item1, PointB=area.Centroid)
distance_4 = Distance(PointA=list_item_3.Item2, PointB=area.Centroid)

list_item_4 = ListItem(List=decnstrobj.faces, Index=number_slider_2, Wrap=True)
cull_index = CullIndex(List=decnstrobj.faces, Indices=number_slider_2, Wrap=True)
vizquick_2 = HBVisualizeQuick(hb_objs=flatten(list_item_4))  # -> geo; plug-in component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

vizquick_3 = HBVisualizeQuick(hb_objs=flatten(cull_index))  # -> geo; plug-in component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
face_2 = HBFace(geo=vizquick_2)  # -> out, faces; plug-in component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

face_3 = HBFace(geo=vizquick_3, bc="adiabatic")  # -> out, faces; plug-in component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

# ----
# Model
model = HBModel(faces=flatten([face_2.faces, face_3.faces]), shades=flatten(shade.shades), apertures=flatten(aperture_2.apertures))  # -> out, model; plug-in component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

# ----
# Sensor Grid
number_slider_8 = Slider(0.6, range=0..10)
genpts = LBGeneratePointGrid(geometry=cull_pattern, grid_size=number_slider_8)  # -> points, vectors, face_areas, mesh; plug-in component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
points = Data(genpts.points)
sensorgrid = HBSensorGrid(positions=points)  # -> grid; plug-in component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
assigngridsviews = HBAssignGridsAndViews(model=model.model, grids=flatten(sensorgrid))  # -> model; plug-in component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

vizall = HBVisualizeAll(hb_objs=flatten(model.model))  # -> geo; plug-in component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
vizwiref_2 = HBVisualizeWireframe(hb_objs=flatten(model.model))  # -> geo; plug-in component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

# ----
# Faces labels
hb_face_attributes = HBFaceAttributes({"Display Name": "display_name", "Simulation Name (Identifier)": "identifier", "Boundary Condition": "boundary_condition", "Has Parent": "has_parent", "Parent": "parent", "Azimuth": "azimuth", "Altitude": "altitude", "Area": "area", "Perimeter": "perimeter", "Face Type": "type", "Aperture Is Operable": "is_operable", "Door Is Glass": "is_glass"}, selected="Boundary Condition")
lablefaces = HBLabelFaces(hb_objs=flatten(model.model), attribute=hb_face_attributes)  # -> label_text, base_pts, labels, wire_frame; plug-in component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

# ----
# Visualize
vizbytype = HBVisualizeByType(hb_objs=model.model)  # -> walls, interior_walls, roofs, ceilings, exterior_floors, interior_floors, air_walls, apertures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; plug-in component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
vizwiref_3 = HBVisualizeWireframe(hb_objs=flatten(model.model))  # -> geo; plug-in component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

data_dam_2 = DataDam(
    DataDataA=assigngridsviews,
    DataA=downloadepw.epw_file,
    DataB=downloadepw.ddy_file,
    DataC=analysisperiod.period,
    DataD=adaptpar,
    DataE=toggle_2,
    BufferDelay=10000000,
    BufferMode=0)  # -> DataDataA, DataA, DataB, DataC, DataD, DataE; disabled
# PMV
pmvmap = HBPMVComfortMap(
    model=data_dam_2.DataDataA,
    epw=data_dam_2.DataA,
    ddy=data_dam_2.DataB,
    run_period=data_dam_2.DataC,
    comfort_par=data_dam_2.DataD,
    run=data_dam_2.DataE)  # -> out, env_conds, temperature, condition, pmv, TCP, HSP, CSP; disabled; plug-in component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
toggle_4 = BooleanToggle(True)  # disabled
thermalmtx = HBReadThermalMatrix(comf_result=pmvmap.pmv, load=toggle_4)  # -> comf_mtx; disabled; plug-in component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

srf_4 = Surface(srf_sl.largest)
importloc = LBImportLocation(epw_file=downloadepw.epw_file)  # -> location; plug-in component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
sunpath = LBSunPath(location=importloc, hoys=analysisperiod.hoys, scale=1)  # -> out, vectors, altitudes, azimuths, hoys, sun_pts, analemma, daily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; plug-in component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
grid_sensor_points = Point(genpts.points)
sun_points = Point(sunpath.sun_pts)
removeduplicatepts = RemoveDuplicatePts(Points=sun_points, Tolerance=Slider(4, range=0..5))

line = Line(StartPoint=grid_sensor_points, EndPoint=graft(removeduplicatepts))

# ----
# Entering the room through the window
surface_line = SurfaceLine(Surface=graft(srf_2), Line=flatten(line), LimitToFirst=False)  # -> Curves, Points, UVPoints, Normal

# ----
# Points Blocked by the skin
surface_line_2 = SurfaceLine(Surface=graft(srf_4), Line=line, LimitToFirst=False)  # -> Curves, flatten(Points), UVPoints, Normal

vector = Vector(line)
negative = Negative(Value=vector)
line_sdl = LineSDL(Start=surface_line.Points, Direction=negative, Length=Slider(5, range=0..5))
removeduplicatelines = RemoveDuplicateLines(Lines=flatten(line_sdl), Tolerance=Slider(0.1, range=0..5))
surface_line_3 = SurfaceLine(Surface=graft(geometry), Line=flatten(removeduplicatelines), LimitToFirst=False)  # -> Curves, flatten(Points), UVPoints, Normal

list_length = ListLength(List=flatten(surface_line_2.Points))
list_length_2 = ListLength(List=flatten(surface_line_3.Points))

panel_9 = Panel(list_length)
line_plane = LinePlane(Line=removeduplicatelines, Plane=xy_plane)  # -> Point, ParamL, ParamP

area_2 = Area(Geometry=srf_3)  # -> Area, Centroid

mass_addition_2 = MassAddition(Input=flatten([area.Area, area_2.Area]))  # -> Result, PartialResults

division_2 = Division(A=mass_addition.Result, B=mass_addition_2.Result)
multiplication = Multiplication(A=division_2, B=100)

division_3 = Division(A=area_2.Area, B=mass_addition_2.Result)
multiplication_2 = Multiplication(A=division_3, B=100)

# ----
# Objectives
distance_between_skin_and_facade = Data(distance)
perforations_percentage = Data(multiplication)
solid_percentage = Data(multiplication_2)
proints_blocked = Data(list_length)
points_entering_the_room = Data(list_length_2)

panel_10 = Panel(points_entering_the_room)

# ----
# UTCI
utcimap = HBUTCIComfortMap(
    model=assigngridsviews,
    epw=downloadepw.epw_file,
    ddy=downloadepw.ddy_file,
    run_period=analysisperiod.period,
    comfort_par=adaptpar,
    run=toggle)  # -> report, env_conds, utci, condition, category, TCP, HSP, CSP; plug-in component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
thermalmtx_2 = HBReadThermalMatrix(comf_result=utcimap.utci, load=Toggle(True))  # -> comf_mtx; plug-in component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
xmatrix = LBDeconstructMatrix(matrix=flatten(thermalmtx_2))  # -> values; plug-in component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
number_slider_9 = Slider(157, range=0..1000)
xdata = LBDeconstructData(data=xmatrix)  # -> header, values; plug-in component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
points_2 = Data(points)
item = ListItem(List=xmatrix, Index=number_slider_9, Wrap=True)
item_2 = ListItem(List=points_2, Index=number_slider_9, Wrap=True)
avr = Average(Input=xdata.values)  # -> flatten(ArithmeticMean)
pt_2 = Point(Point(93.14477679, -19.53288665, 0))
meshselector = LBMeshThresholdSelector(values=avr, mesh=genpts.mesh)  # -> report, total_value, total_area, sub_mesh, outline; plug-in component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
hourlyplot = LBHourlyPlot(data=item, base_pt=pt_2, y_dim=Slider(2, range=0..100))  # -> report, mesh, legend, borders, labels, title, vis_set; plug-in component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

# ----
# Adpative thermal comfort
# Visualization
data_dam_3 = DataDam(
    DataDataA=assigngridsviews,
    DataA=downloadepw.epw_file,
    DataB=downloadepw.ddy_file,
    DataC=analysisperiod.period,
    DataD=adaptpar,
    DataE=toggle_3,
    BufferDelay=10000000,
    BufferMode=0)  # -> DataDataA, DataA, DataB, DataC, DataD, DataE; disabled
adaptivemap = HBAdaptiveComfortMap(
    model=data_dam_3.DataDataA,
    epw=data_dam_3.DataA,
    ddy=data_dam_3.DataB,
    run_period=data_dam_3.DataC,
    comfort_par=data_dam_3.DataD,
    run=data_dam_3.DataE)  # -> out, env_conds, op_temp, condition, deg_neut, TCP, HSP, CSP; disabled; plug-in component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
toggle_5 = BooleanToggle(True)  # disabled
thermalmtx_3 = HBReadThermalMatrix(comf_result=adaptivemap.TCP, load=toggle_5)  # -> comf_mtx; disabled; plug-in component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
xmatrix_2 = LBDeconstructMatrix(matrix=flatten(thermalmtx_3))  # -> values; disabled; plug-in component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
number_slider_10 = Slider(157, range=0..1000)  # disabled
xdata_2 = LBDeconstructData(data=xmatrix_2)  # -> header, values; disabled; plug-in component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
points_3 = Data(points)  # disabled
number_slider_11 = Slider(2, range=0..100)  # disabled
item_3 = ListItem(List=xmatrix_2, Index=number_slider_10, Wrap=True)  # disabled
item_4 = ListItem(List=points_3, Index=number_slider_10, Wrap=True)  # disabled
avr_2 = Average(Input=xdata_2.values)  # -> flatten(ArithmeticMean); disabled
panel_11 = Panel("2")  # disabled
pt_3 = Point(Point(93.14477679, -19.53288665, 0))  # disabled
round_to_decimal_place = RoundToDecimalPlace(NumberX=avr_2, DecimalPlace=panel_11, RoundType=0)  # -> Rounded, Difference; disabled
number_slider_12 = Slider(0.1, range=0..0.1)  # disabled
vizthermalmap = HBVisualizeThermalMap(comf_mtx=thermalmtx_2, mesh=flatten(genpts.mesh))  # -> report, mesh, legend, title, colors, values; disabled; plug-in component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
meshselector_2 = LBMeshThresholdSelector(values=avr_2, mesh=genpts.mesh)  # -> report, total_value, total_area, sub_mesh, outline; disabled; plug-in component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
hourlyplot_2 = LBHourlyPlot(data=item_3, base_pt=pt_3, y_dim=number_slider_11)  # -> report, mesh, legend, borders, labels, title, vis_set; disabled; plug-in component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
swatch = ColourSwatch(SwatchColor=RGB(0, 0, 0))  # disabled
toggle_6 = GroupToggle(ToggleActive=True, ToggleVisible=False)  # disabled
tag = TextTag3D(Location=points_3, Text=round_to_decimal_place.Rounded, Size=number_slider_12, Colour=swatch, Justification=7)  # disabled

round_to_decimal_place_2 = RoundToDecimalPlace(NumberX=avr, DecimalPlace="2", RoundType=0)  # -> Rounded, Difference

# ---- group: Main preview
vizthermalmap_2 = HBVisualizeThermalMap(comf_mtx=thermalmtx_2, mesh=flatten(genpts.mesh))  # -> report, mesh, legend, title, colors, values; plug-in component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
toggle_7 = GroupToggle(ToggleActive=True, ToggleVisible=False)  # disabled

# ----
tag_2 = TextTag3D(
    Location=points_2,
    Text=round_to_decimal_place_2.Rounded,
    Size=Slider(0.1, range=0..0.1),
    Colour=ColourSwatch(SwatchColor=RGB(0, 0, 0)),
    Justification=7)

# ----
# Visualization
xmatrix_3 = LBDeconstructMatrix(matrix=flatten(thermalmtx))  # -> values; disabled; plug-in component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
number_slider_13 = Slider(157, range=0..1000)  # disabled
xdata_3 = LBDeconstructData(data=xmatrix_3)  # -> header, values; disabled; plug-in component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
points_4 = Data(points)  # disabled
number_slider_14 = Slider(2, range=0..100)  # disabled
item_5 = ListItem(List=xmatrix_3, Index=number_slider_13, Wrap=True)  # disabled
item_6 = ListItem(List=points_4, Index=number_slider_13, Wrap=True)  # disabled
avr_3 = Average(Input=xdata_3.values)  # -> flatten(ArithmeticMean); disabled
panel_12 = Panel("2")  # disabled
pt_4 = Point(Point(93.14477679, -19.53288665, 0))  # disabled
round_to_decimal_place_3 = RoundToDecimalPlace(NumberX=avr_3, DecimalPlace=panel_12, RoundType=0)  # -> Rounded, Difference; disabled
number_slider_15 = Slider(0.1, range=0..0.1)  # disabled
vizthermalmap_3 = HBVisualizeThermalMap(comf_mtx=thermalmtx_2, mesh=flatten(genpts.mesh))  # -> report, mesh, legend, title, colors, values; disabled; plug-in component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
meshselector_3 = LBMeshThresholdSelector(values=avr_3, mesh=genpts.mesh)  # -> report, total_value, total_area, sub_mesh, outline; disabled; plug-in component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
hourlyplot_3 = LBHourlyPlot(data=item_5, base_pt=pt_4, y_dim=number_slider_14)  # -> report, mesh, legend, borders, labels, title, vis_set; disabled; plug-in component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
swatch_2 = ColourSwatch(SwatchColor=RGB(0, 0, 0))  # disabled
toggle_8 = GroupToggle(ToggleActive=True, ToggleVisible=False)  # disabled
tag_3 = TextTag3D(Location=points_4, Text=round_to_decimal_place_3.Rounded, Size=number_slider_15, Colour=swatch_2, Justification=7)  # disabled

utci_per_grid_cell = Data(round_to_decimal_place_2.Rounded)

data = Data(vizthermalmap_2.mesh)
wallacei_x = WallaceiX(
    Genes=number_slider_6,
    Objectives=[proints_blocked, points_entering_the_room, solid_percentage, perforations_percentage, distance_between_skin_and_facade, utci_per_grid_cell],
    Phenotype=[vizwiref_2, vizthermalmap_2.mesh],
    allFitness="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",
    allFrontIdx="0|0;0|1;0|2;0|3;0|4;1|0;1|1;1|2;1|3;1|4;2|0;2|1;2|2;2|3;2|4;3|0;3|1;3|2;3|3;3|4;4|0;4|1;4|2;4|3;4|4;5|0;5|1;5|2;5|3;5|4;6|0;6|1;6|2;6|3;6|4;7|0;7|1;7|2;7|3;7|4;8|0;8|1;8|2;8|3;8|4;9|0;9|1;9|2;9|3;9|4",
    allGenomes="5_4_9_13_11_6_3_4_6_13_4_6_6_3_7_7_7_8_5_3_2_7_6_6_8_6_2_7_5_8_4_8_6_8_8_8_5_8_4_8_7_8_5_9_2_9_10_3_8_9",
    curFrontIdx="9|0;9|1;9|2;9|3;9|4",
    curFrontIdxSave="0|0;0|1;0|2;0|3;0|4;1|0;1|1;1|2;1|3;1|4;2|0;2|1;2|2;2|3;2|4;3|0;3|1;3|2;3|3;3|4;4|0;4|1;4|2;4|3;4|4;5|0;5|1;5|2;5|3;5|4;6|0;6|1;6|2;6|3;6|4;7|0;7|1;7|2;7|3;7|4;8|0;8|1;8|2;8|3;8|4;9|0;9|1;9|2;9|3;9|4",
    popGen="5,10",
    total="1871313",
    wlcDone=True)  # -> WallaceiGenomes, FitnessValues, Data, Phenotypes

# ----
# WALLACEI
# Iterative parameters or Different set of geometries
# Import your current geometry here !
wallacei_x_2 = WallaceiX(popGen="10,1", total="0", wlcDone=False)  # -> WallaceiGenomes, FitnessValues, Data, Phenotypes
number_slider_16 = Slider(20, range=0..100)
distribute_to_grid = DistributeToGrid(
    FitnessValues=wallacei_x_2.FitnessValues,
    WallaceiPhenotypes=wallacei_x_2.Phenotypes,
    SizeOfTheGridInTheXDirection=number_slider_16,
    SizeOfTheGridInTheYDirection=number_slider_16,
    OutputOptions=0)  # -> DistributedFitnessValues, DistributedData, DistributedGeometries, DistributedMeshes, DistributedNumbers, GridLocations
data_2 = Data(distribute_to_grid.DistributedMeshes)
face_normals = FaceNormals(Mesh=data_2)  # -> Centers, Normals
tag_4 = TextTag3D(
    Location=face_normals.Centers,
    Text=round_to_decimal_place_2.Rounded,
    Size=Slider(0.1, range=0..0.1),
    Colour=ColourSwatch(SwatchColor=RGB(0, 0, 0)),
    Justification=7)

param_viewer_2 = ParamViewer(wallacei_x.FitnessValues)
decode_phenotype = DecodePhenotype(WallaceiPhenotype=wallacei_x.Phenotypes)  # -> GeometriesList, MeshesList, NumbersList, TextList
path_mapper = PathMapper(wallacei_x.FitnessValues, source="{A;B}", target="{path_index}")
data_3 = Data(path_mapper)
cull_index_2 = CullIndex(List=data_3, Indices=panel_3, Wrap=True)
list_item_5 = ListItem(List=data_3, Index=panel_3, Wrap=True)
insert_items_2 = InsertItems(List=cull_index_2, Item=list_item_5, Indices="0", Wrap=True)
entwine = Entwine(Branch0X=insert_items, Branch1X=insert_items_2, FlattenInputs=False)

# ----
# Set a file path on your computer
number_slider_17 = Slider(51, range=0..100)
series_2 = Series(Start=0, Step=1, Count=number_slider_17)
concatenate_2 = Concatenate(FragmentA="Generation ", FragmentB=series_2)
# Export CSV
boolean_toggle = BooleanToggle(False)
file_path = FilePath("D:\IAAC\Third semester\Studio\Studio_G04\Dataset 01 - Sheet1.csv")
excel_write = ExcelWrite(
    WriteExcelData=boolean_toggle,
    WorkbookPath=file_path,
    WorksheetName="UTCI SKIN TRIAL 01",
    ColumnHeadings=concatenate_2,
    Data=entwine,
    ClearSheet=Toggle(False))

insert_items_3 = InsertItems(List=concatenate_2, Item=panel_4, Indices="0", Wrap=True)
panel_13 = Panel(excel_write)

# ==== cluster SrfSmallLarge
srf_list = ClusterInput()
edges = BrepEdges(Brep=srf_list)  # -> Naked, Interior, NonManifold
len = Length(Curve=edges.Naked)
ma = MassAddition(Input=len)  # -> Result, PartialResults
pshift = ShiftPaths(Data=ma.Result, Offset=-1)
sort = SortList(Keys=pshift, ValuesA=srf_list)  # -> Keys, ValuesA
item = ListItem(List=reverse(sort.ValuesA), Index=0, Wrap=True)
cull_index = CullIndex(List=sort.ValuesA, Indices="-1", Wrap=True)
largest = ClusterOutput(item)
smallest = ClusterOutput(cull_index)
