# Grasshopper definition updated one00.gh (Grasshopper 1.0.8)
# Copyright: 2017
# plug-ins: Heteroptera, MeshEdit Components, Pufferfish, Human, BitmapPlus, LunchBox, MetaHopper, Wallacei, Kangaroo2 Components

# ----
# List Generation
# Red Channel
# R channel Image
# Only R values
# Filter Points
# G channel Image
# Green Channel
# Only G values
# Blue Channel
# B channel Image
# Only B values
mersh_vectors = MershVectors()
dist_facade_skin = DistFacadeSkin()
max_heigth_room_z = MaxHeigthRoomZ()
max_width_x = MaxWidthX()
facade_window_srf = FacadeWindowSrf()
r_color_domain = RColorDomain()
skin_typology_srf = SkinTypologySrf()
g_color_domain = GColorDomain()
back_room_wall_srf = BackRoomWallSrf()
b_color_domain = BColorDomain()
deconstruct = Deconstruct(Point=mersh_vectors)  # -> XComponent, YComponent, ZComponent
smaller_than = SmallerThan(FirstNumber=deconstruct.XComponent, SecondNumber=max_width_x)  # -> SmallerThan, OrEqualTo
larger_than = LargerThan(FirstNumber=deconstruct.ZComponent, SecondNumber="0")  # -> LargerThan, OrEqualTo
smaller_than_2 = SmallerThan(FirstNumber=deconstruct.ZComponent, SecondNumber=max_heigth_room_z)  # -> SmallerThan, OrEqualTo
larger_than_2 = LargerThan(FirstNumber=deconstruct.XComponent, SecondNumber="0")  # -> LargerThan, OrEqualTo
gate_and = GateAnd(A=larger_than.OrEqualTo, B=smaller_than_2.OrEqualTo, C=larger_than_2.OrEqualTo, D=smaller_than.OrEqualTo)
cull_pattern = CullPattern(List=mersh_vectors, CullPattern=gate_and)
deconstruct_2 = Deconstruct(Point=cull_pattern)  # -> XComponent, YComponent, ZComponent
deconstruct_3 = Deconstruct(Point=cull_pattern)  # -> XComponent, YComponent, ZComponent
equality = Equality(FirstNumber=deconstruct_2.ZComponent, SecondNumber="0")  # -> Equality, Inequality
equality_2 = Equality(FirstNumber=deconstruct_3.XComponent, SecondNumber="0")  # -> Equality, Inequality
cull_pattern_2 = CullPattern(List=cull_pattern, CullPattern=equality.Equality)
cull_pattern_3 = CullPattern(List=cull_pattern, CullPattern=equality_2.Equality)
list_length = ListLength(List=cull_pattern_2)
list_length_2 = ListLength(List=cull_pattern_3)
data = Data(dist_facade_skin)
mesh_surface = MeshSurface(Surface=back_room_wall_srf, UCount=list_length, VCount=list_length_2, Overhang=True, Equalize=False)
mesh_surface_2 = MeshSurface(Surface=skin_typology_srf, UCount=list_length, VCount=list_length_2, Overhang=True, Equalize=False)
mesh_surface_3 = MeshSurface(Surface=facade_window_srf, UCount=list_length, VCount=list_length_2, Overhang=True, Equalize=False)
list_length_3 = ListLength(List=mersh_vectors)
mesh_join = MeshJoin(Meshes=mesh_surface_2)
mesh_join_2 = MeshJoin(Meshes=mesh_surface)
mesh_join_3 = MeshJoin(Meshes=mesh_surface_3)
deconstruct_mesh = DeconstructMesh(Mesh=mesh_join)  # -> Vertices, Faces, Colours, Normals
deconstruct_mesh_2 = DeconstructMesh(Mesh=mesh_join_2)  # -> Vertices, Faces, Colours, Normals
deconstruct_mesh_3 = DeconstructMesh(Mesh=mesh_join_3)  # -> Vertices, Faces, Colours, Normals
deconstruct_4 = Deconstruct(Point=deconstruct_mesh.Vertices)  # -> XComponent, YComponent, ZComponent
deconstruct_5 = Deconstruct(Point=deconstruct_mesh_2.Vertices)  # -> XComponent, YComponent, ZComponent
deconstruct_6 = Deconstruct(Point=deconstruct_mesh_3.Vertices)  # -> XComponent, YComponent, ZComponent
duplicate_data = DuplicateData(Data="0,0,0", Number=list_length_3, Order=True)
duplicate_data_2 = DuplicateData(Data="0", Number=list_length_3, Order=True)
round = Round(Number=deconstruct_4.YComponent)  # -> Nearest, Floor, Ceiling
round_2 = Round(Number=deconstruct_5.YComponent)  # -> Nearest, Floor, Ceiling
round_3 = Round(Number=deconstruct_6.YComponent)  # -> Nearest, Floor, Ceiling
bounds = Bounds(Numbers=round.Nearest)
construct_point = ConstructPoint(XCoordinate=deconstruct_4.XComponent, YCoordinate=data, ZCoordinate=deconstruct_4.ZComponent)
construct_point_2 = ConstructPoint(XCoordinate=deconstruct_6.XComponent, YCoordinate=data, ZCoordinate=deconstruct_6.ZComponent)
construct_point_3 = ConstructPoint(XCoordinate=deconstruct_5.XComponent, YCoordinate=data, ZCoordinate=deconstruct_5.ZComponent)
bounds_2 = Bounds(Numbers=round_2.Nearest)
bounds_3 = Bounds(Numbers=round_3.Nearest)
control_wire_display = ControlWireDisplay(WireDisplay="1")
remap_numbers = RemapNumbers(Value=deconstruct_4.YComponent, Source=bounds, Target=g_color_domain)  # -> Mapped, Clipped
remap_numbers_2 = RemapNumbers(Value=deconstruct_5.YComponent, Source=bounds_2, Target=b_color_domain)  # -> Mapped, Clipped
remap_numbers_3 = RemapNumbers(Value=deconstruct_6.YComponent, Source=bounds_3, Target=r_color_domain)  # -> Mapped, Clipped
round_4 = Round(Number=remap_numbers.Mapped)  # -> Nearest, Floor, Ceiling
round_5 = Round(Number=remap_numbers_3.Mapped)  # -> Nearest, Floor, Ceiling
round_6 = Round(Number=remap_numbers_2.Mapped)  # -> Nearest, Floor, Ceiling
create_rtree = CreateRTree(InputGeometry=flatten(mersh_vectors))
create_rtree_2 = CreateRTree(InputGeometry=flatten(mersh_vectors))
concatenate = Concatenate(Fragment_B="0", A=round_4.Nearest, B="0", JoinSeparator=",")
create_rtree_3 = CreateRTree(InputGeometry=flatten(mersh_vectors))
concatenate_2 = Concatenate(FragmentB=round_5.Nearest, FragmentA="0,0", JoinSeparator=",")
concatenate_3 = Concatenate(FragmentB="0,0", FragmentA=round_6.Nearest, JoinSeparator=",")
rtree_closest_point = RTreeClosestPoint(SearchPoints=flatten(construct_point_2), RTree=create_rtree)  # -> ClosestPoint, ClosestIndex
rtree_closest_point_2 = RTreeClosestPoint(SearchPoints=flatten(construct_point), RTree=create_rtree_2)  # -> ClosestPoint, ClosestIndex
rtree_closest_point_3 = RTreeClosestPoint(SearchPoints=flatten(construct_point_3), RTree=create_rtree_3)  # -> ClosestPoint, ClosestIndex
replace_items = ReplaceItems(List=duplicate_data, Item=concatenate_2, Indices=rtree_closest_point.ClosestIndex, Wrap=False)
replace_items_2 = ReplaceItems(List=duplicate_data_2, Item=round_5.Nearest, Indices=rtree_closest_point.ClosestIndex, Wrap=False)
replace_items_3 = ReplaceItems(List=duplicate_data, Item=concatenate, Indices=rtree_closest_point_2.ClosestIndex, Wrap=False)
replace_items_4 = ReplaceItems(List=duplicate_data_2, Item=round_4.Nearest, Indices=rtree_closest_point_2.ClosestIndex, Wrap=False)
replace_items_5 = ReplaceItems(List=duplicate_data, Item=concatenate_3, Indices=rtree_closest_point_3.ClosestIndex, Wrap=False)
replace_items_6 = ReplaceItems(List=duplicate_data_2, Item=remap_numbers_2.Mapped, Indices=rtree_closest_point_3.ClosestIndex, Wrap=False)
g_channel_values = GChannelValues(replace_items_4)
r_channel_values = RChannelValues(replace_items_2)
g_channel_image = GChannelImage(replace_items_3)
r_channel_image = RChannelImage(replace_items)
b_channel_values = BChannelValues(replace_items_6)
b_channel_image = BChannelImage(replace_items_5)
concatenate_4 = Concatenate(R=replace_items_2, G=replace_items_4, B=replace_items_6, JoinSeparator=",")
encoded_image = EncodedImage(concatenate_4)

number_slider = Slider(4, range=3..15)

# ----
# General input
epw_file_path_barcelona = Panel("https://climate.onebuilding.org/WMO_Region_1_Africa/EGY_Egypt/QH_Al_Qahirah_Cairo/EGY_QH_Cairo.Intl.AP.623660_TMYx.zip")
epw_filepath = Data(epw_file_path_barcelona)

multiplication = Multiplication(A=number_slider, B=0.1)

# ----
# Weather file
epw_filepath_2 = Data(epw_filepath)
# Room Related
downloadepw = LBDownloadWeather(weather_URL=epw_filepath_2)  # -> epw_file, stat_file, ddy_file; plug-in component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

pt = Point(Point(-2.722291582, 0.2658342869, 0))
northarrow = Ladybug_North(centerPt=pt, scale=Slider(0.1, range=0..0.1))  # -> northSign; plug-in component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

hb_building_programs = HBBuildingPrograms({"LargeOffice", "MediumOffice", "SmallOffice", "MidriseApartment", "HighriseApartment", "Retail", "StripMall", "PrimarySchool", "SecondarySchool", "SmallHotel", "LargeHotel", "Hospital", "Outpatient", "Laboratory", "Warehouse", "SuperMarket", "FullServiceRestaurant", "QuickServiceRestaurant", "Courthouse", "LargeDataCenterHighITE", "LargeDataCenterLowITE", "SmallDataCenterHighITE", "SmallDataCenterLowITE"}, selected="LargeOffice")

# ----
# Set Up ROOM or ZONE
number_slider_2 = Slider(3, range=0..10)
number_slider_3 = Slider(10, range=3..10)
domain_box = DomainBox(Base=PlaneXY(0, 0, 0), X=number_slider, Y=number_slider_3, Z=number_slider_2)
roomsolid = HBRoomFromSolid(geo=flatten(domain_box), program=hb_building_programs, conditioned=True)  # -> out, rooms; plug-in component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

multiplication_2 = Multiplication(A=number_slider_3, B=0.1)
multiplication_3 = Multiplication(A=number_slider_2, B=0.1)

deconstruct_brep = DeconstructBrep(Brep=domain_box)  # -> Faces, Edges, Vertices
list_item = ListItem(List=deconstruct_brep.Faces, Index=Slider(4, range=0..6), Wrap=True)
curve = Curve(list_item)
explode = Explode(Curve=curve, Recursive=True)  # -> Segments, Vertices
center = Center(Geometry=domain_box)  # -> Center, Dimension
division = Division(A=number_slider, B=5)
division_2 = Division(A=number_slider_3, B=5)
division_3 = Division(A=number_slider_2, B=2)
removeduplicatepts = RemoveDuplicatePts(Points=explode.Vertices, Tolerance=0.01)
center_box = CenterBox(Base=center.Center, X=division_2, Y=division, Z=division_3)
xy_plane = XYPlane(Origin=removeduplicatepts)
scale_nu = ScaleNU(Geometry=domain_box, Plane=xy_plane, ScaleX=Slider(0.5, range=0..1), ScaleY=Slider(0.5, range=0..1), ScaleZ=1)  # -> Geometry, Transform
solid_difference = SolidDifference(BrepsA=scale_nu.Geometry, BrepsB=center_box)
roomsolid_2 = HBRoomFromSolid(geo=flatten(solid_difference), program=hb_building_programs, conditioned=True)  # -> out, rooms; plug-in component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
roomsolid_3 = HBRoomFromSolid(geo=flatten(center_box), program=hb_building_programs, conditioned=True)  # -> out, rooms; plug-in component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
boolean_toggle = BooleanToggle(True)
intsolid = HBIntersectSolids(rooms=flatten([roomsolid_2.rooms, roomsolid_3.rooms]), run=boolean_toggle)  # -> int_rooms; plug-in component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
vizquick = HBVisualizeQuick(hb_objs=flatten([roomsolid_2.rooms, roomsolid_3.rooms]))  # -> geo; plug-in component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
solveadj = HBSolveAdjacency(rooms=flatten(intsolid), adiabatic=boolean_toggle, run=boolean_toggle)  # -> out, adj_rooms; plug-in component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
vizquick_2 = HBVisualizeQuick(hb_objs=flatten(solveadj.adj_rooms))  # -> geo; plug-in component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

face = HBFace()  # -> out, faces; plug-in component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
# Skins Typologies
height = Panel("3")

# ----
# Clusters
encoded_image_v_1 = EncodedImageV1()  # -> output_b_channel, list_of_red_values, list_of_green_values, list_of_blue_values; disabled
encoded_image_v_2 = EncodedImageV2()  # -> colored_mesh, red_values, green_values, blue_values; disabled
encoded_image_v_3 = EncodedImageV3_2(
    max_heigth_room_z=0,
    max_width_x=0,
    r_color_domain=Domain(0, 1),
    g_color_domain=Domain(0, 1),
    b_color_domain=Domain(0, 1))  # -> encoded_image, r_channel_image, r_channel_values, g_channel_image, faces, g_channel_values, b_channel_image, b_channel_values; disabled

skin_resolution = Slider(35, range=0..100)  # disabled
value_list = ValueList({"Red Channel": 0, "Green Channel": 1, "Blue Channel": 2}, selected="Red Channel")  # disabled

# ----
# Opening Parameters
horizontal_spacing_between = Slider(2, range=0..10)
window_height = Slider(2, range=0..10)
sill_height = Slider(0.5, range=-0.5..2)
vertical_spacing_between = Slider(0, range=0..10)

# ----
# plane to analyze
deconstruct_brep_2 = DeconstructBrep(Brep=domain_box)  # -> Faces, Edges, Vertices
center_2 = Center(Geometry=deconstruct_brep_2.Faces)  # -> Center, Dimension
deconstruct_7 = Deconstruct(Point=center_2.Center)  # -> XComponent, YComponent, ZComponent
smaller_than_3 = SmallerThan(FirstNumber=deconstruct_7.ZComponent, SecondNumber=Slider(0.02, range=0..0.1))  # -> SmallerThan, OrEqualTo
cull_pattern_4 = CullPattern(List=deconstruct_brep_2.Faces, CullPattern=smaller_than_3.SmallerThan)

importstat = LBImportSTAT(stat_file=downloadepw.stat_file)  # -> location, ashrae_zone, koppen_zone, clear_dir_norm_rad, clear_diff_horiz_rad, ann_heat_dday_996, ann_heat_dday_990, ann_cool_dday_004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; plug-in component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
importepw = LBImportEPW(epw_file=downloadepw.epw_file)  # -> location, dry_bulb_temperature, dew_point_temperature, relative_humidity, wind_speed, wind_direction, direct_normal_rad, diffuse_horizontal_rad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; disabled; plug-in component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
number_slider_4 = Slider(3, range=0..10)  # disabled
windprofile = LBWindProfile(met_wind_vel=importepw.wind_speed, met_wind_dir=importepw.wind_direction, profile_height=number_slider_4)  # -> out, wind_speeds, wind_vectors, anchor_pts, mesh_arrows, profile_curve, speed_axis, height_axis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; disabled; plug-in component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
windspeed = LBWindSpeed(met_wind_vel=importepw.wind_speed)  # -> out, air_speed; disabled; plug-in component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
xdata = LBDeconstructData(data=windspeed.air_speed)  # -> header, values; disabled; plug-in component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
data_2 = Data()  # disabled
bounds_4 = Bounds(Numbers=xdata.values)  # disabled
deconstruct_domain = DeconstructDomain(Domain=bounds_4)  # -> Start, End; disabled

number_slider_5 = Slider(4, range=2..10)
bounding_rectangle = BoundingRectangle(Geometry=vizquick_2, Plane=PlaneXY(0, 0, 0), Axis=0, Slide=0, Union=True)  # -> Bounding, DimensionX, DimensionY
brep_brep = BrepBrep(BrepA=vizquick_2, BrepB=bounding_rectangle.Bounding)  # -> flatten(Curves), Points
join_curves = JoinCurves(Curves=brep_brep.Curves, Preserve=False)
brep_join = BrepJoin(Breps=join_curves)  # -> Breps, Closed
unit_z = UnitZ(Factor=Slider(1, range=0..1))
move = Move(Geometry=cull_pattern_4, Motion=unit_z)  # -> Geometry, Transform

# ----
# Period
number_slider_6 = Slider(1, range=1..12)
number_slider_7 = Slider(1, range=1..31)

# ----
# Comfort param
lb_activities_met_list = LBActivitiesMetList({"Seated", "Standing", "supine"}, selected="Seated")
panel = Panel("0.65")
solarbodypar = LBSolarBodyParameters(posture=lb_activities_met_list, sharp="45")  # -> sol_body_par; plug-in component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

analysisperiod = LBAnalysisPeriod(
    start_month=number_slider_6,
    start_day=number_slider_7,
    start_hour=Slider(8, range=0..23),
    end_month=Slider(12, range=1..12),
    end_day=number_slider_7,
    end_hour=Slider(17, range=0..23))  # -> period, hoys, dates; plug-in component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
adaptpar = LBAdaptiveComfortParameters(
    ashrae_or_en="False",
    neutral_offset=Slider(3, range=0..10),
    avgm_or_runmean="False",
    discr_or_cont_vel="False",
    cold_prevail_limit="15",
    conditioning="0")  # -> adapt_par; plug-in component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
set_group_properties = SetGroupProperties(Color=ColourSwatch(SwatchColor=RGB(216, 255, 184)))

# ---- group: ARE YOU SURE ?
toggle = BooleanToggle(True)

# ----
# Adpative thermal comfort
number_slider_8 = Slider(0.2, range=0..3)
legendpar = LBLegendParameters(min=Slider(25, range=0..100), max=Slider(35, range=0..100))  # -> leg_par; plug-in component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
number_slider_9 = Slider(20, range=0..100)

data_3 = Data(flatten(Tree({0;0;0}: [], {1;0}: ["C:\Users\Aly Mahmoud\simulation\unnamed\adaptive_comfort_map\initial_results/conditions"], {2;0}: ["C:\Users\Aly Mahmoud\simulation\unnamed\adaptive_comfort_map\results/temperature"], {3;0}: ["C:\Users\Aly Mahmoud\simulation\unnamed\adaptive_comfort_map\results/condition"], {4;0}: ["C:\Users\Aly Mahmoud\simulation\unnamed\adaptive_comfort_map\results/condition_intensity"], {5;0;0}: [79.01854714, 77.74343122, 77.2797527, 77.2797527, 77.04791345, 76.89335394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], {6;0;0}: [0, 0, 0, 0, 0, 0, 0, 0, 0, 0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], {7;0;0}: [20.98145286, 22.25656878, 22.7202473, 22.7202473, 22.95208655, 23.10664606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])))  # disabled
list_item_2 = ListItem(List=data_3, Index=0, Wrap=True)  # -> Item, Item1, Item2, Item3, Item4, Item5, Item6, Item7; disabled
boolean_toggle_2 = BooleanToggle(True)  # disabled
mesh = Mesh(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)  # disabled
thermalmtx = HBReadThermalMatrix(comf_result=list_item_2.Item2, load=boolean_toggle_2)  # -> comf_mtx; disabled; plug-in component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
face_normals = FaceNormals(Mesh=mesh)  # -> Centers, Normals; disabled
number_slider_10 = Slider(2, range=0..10)  # disabled
vizthermalmap = HBVisualizeThermalMap(comf_mtx=thermalmtx, mesh=flatten(mesh))  # -> out, mesh, legend, title, colors, values; disabled; plug-in component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
number_slider_11 = Slider(0.1, range=0..0.1)  # disabled
round_to_decimal_place = RoundToDecimalPlace(NumberX=vizthermalmap.values, DecimalPlace=number_slider_10, RoundType=0)  # -> Rounded, Difference; disabled
swatch = ColourSwatch(SwatchColor=RGB(0, 0, 0))  # disabled
tag = TextTag3D(
    Location=face_normals.Centers,
    Text=round_to_decimal_place.Rounded,
    Size=number_slider_11,
    Colour=swatch,
    Justification=7)  # disabled

boolean_toggle_3 = BooleanToggle(True)  # disabled
number_slider_12 = Slider(0, range=0..20)
unit_x = UnitX(Factor="0")
unit_x_2 = UnitX(Factor="-4")
number_slider_13 = Slider(512, range=0..1000)  # disabled
relay = Relay()  # disabled
panel_2 = Panel(".5")  # disabled
scale_image = ScaleImage(Mode=0, Scale=panel_2)  # disabled
bitmap_properties = BitmapProperties(Image=scale_image)  # -> Boundary, Width, Height, HorizontalResolution, VerticalResolution, Format; disabled
build_bitmap = BuildBitmap(Width=bitmap_properties.Width, Height=bitmap_properties.Height, Colors=relay)  # disabled
panel_3 = Panel(bitmap_properties.Height)  # disabled
panel_4 = Panel(bitmap_properties.Width)  # disabled

# ----
# Inputs: Skins
# Facade as a shader
number_slider_14 = Slider(0, range=0..5)
viznorm = HBVisualizeNormals(hb_objs=roomsolid.rooms)  # -> points, vectors; plug-in component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
number_slider_15 = Slider(0.73, range=0..1.5)
list_item_3 = ListItem(List=deconstruct_brep_2.Faces, Index=number_slider_14, Wrap=True)  # -> Item, Item1, Item2, Item3
list_item_4 = ListItem(List=viznorm.vectors, Index=number_slider_14, Wrap=True)  # -> Item, Item1, Item2, Item3
amplitude = Amplitude(Vector=list_item_4.Item, Amplitude=number_slider_15)
amplitude_2 = Amplitude(Vector=list_item_4.Item2, Amplitude=number_slider_15)
amplitude_3 = Amplitude(Vector=list_item_4.Item1, Amplitude=number_slider_15)
amplitude_4 = Amplitude(Vector=list_item_4.Item3, Amplitude=number_slider_15)
move_2 = Move(Geometry=list_item_3.Item, Motion=amplitude)  # -> Geometry, Transform
move_3 = Move(Geometry=list_item_3.Item1, Motion=amplitude_3)  # -> Geometry, Transform
move_4 = Move(Geometry=list_item_3.Item2, Motion=amplitude_2)  # -> Geometry, Transform
move_5 = Move(Geometry=list_item_3.Item3, Motion=amplitude_4)  # -> Geometry, Transform

# ----
# Encoded Image Boundaries
panel_5 = Panel("-8")
dom = ConstructDomain(DomainStart=panel_5, DomainEnd="8")
rectangle = Rectangle(Plane=move_2.Geometry, XSize=dom, YSize=dom, Radius=0)  # -> Rectangle, Length

cluster = Cluster(S=move_3.Geometry, U=number_slider_5, V=number_slider_5, S_2=move_3.Geometry, B=number_slider_5)  # -> sm, lg
cluster_2 = Cluster(S=move_5.Geometry, U=number_slider_5, V=number_slider_5, S_2=move_5.Geometry, B=number_slider_5)  # -> sm, lg
cluster_3 = Cluster(S=move_2.Geometry, U=number_slider_5, V=number_slider_5, S_2=move_2.Geometry, B=number_slider_5)  # -> sm, lg
cluster_4 = Cluster(S=move_4.Geometry, U=number_slider_5, V=number_slider_5, S_2=move_4.Geometry, B=number_slider_5)  # -> sm, lg

# ----
# SKIN TYPOLOGY
merge = Merge(Data1=cluster_3.lg, Data2=cluster.lg, Data3=cluster_4.lg, Data4=cluster_2.lg)

srf = Surface(merge)
shade = HBShade(geo=flatten(srf))  # -> out, shades; plug-in component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
area = Area(Geometry=flatten(srf))  # -> Area, Centroid

# ----
# Inputs: Encoded Image
resolution = Panel("256")
image_location = Slider(5, range=0..10)

# ----
# Encoded Image Resolution
mesh_plane = MeshPlane(Boundary=rectangle.Rectangle, WidthCount=resolution, HeightCount=resolution)  # -> Mesh, Area

mesh_encoded_image = Mesh(mesh_plane.Mesh)

ratio_to_the_elevation = Slider(0.55, range=0..1)
hb_construction_types = HBConstructionTypes({"SteelFramed", "WoodFramed", "Mass", "Metal Building"}, selected="SteelFramed")

# ----
# Windows
facparam = HBFacadeParameters(north=ratio_to_the_elevation, east=ratio_to_the_elevation, south=ratio_to_the_elevation, west=ratio_to_the_elevation)  # -> fac_par; plug-in component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
aperturesbyratio = HBAperturesByRatio(
    hb_objs=flatten(solveadj.adj_rooms),
    ratio=facparam,
    subdivide=Slider(3, range=0..10),
    win_height=window_height,
    sill_height=sill_height,
    horiz_separ=horizontal_spacing_between,
    vert_separ=vertical_spacing_between)  # -> out, hb_objs; plug-in component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

decnstrobj = HBDeconstructObject(hb_obj=aperturesbyratio.hb_objs)  # -> flatten(faces), flatten(apertures), doors, shades; plug-in component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
vizquick_3 = HBVisualizeQuick(hb_objs=flatten(decnstrobj.faces))  # -> geo; plug-in component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
vizquick_4 = HBVisualizeQuick(hb_objs=flatten(decnstrobj.apertures))  # -> geo; plug-in component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
aperture = HBAperture(geo=vizquick_4)  # -> out, apertures; plug-in component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
face_2 = HBFace(geo=vizquick_3, bc="adiabatic")  # -> out, faces; plug-in component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

vizquick_5 = HBVisualizeQuick(hb_objs=flatten(aperturesbyratio.hb_objs))  # -> geo; plug-in component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
center_3 = Center(Geometry=vizquick_4)  # -> Center, Dimension
deconstruct_vector = DeconstructVector(Vector=center_3.Center)  # -> XComponent, YComponent, ZComponent
equality_3 = Equality(FirstNumber=deconstruct_vector.XComponent, SecondNumber=number_slider)  # -> Equality, Inequality
equality_4 = Equality(FirstNumber=deconstruct_vector.YComponent, SecondNumber=number_slider_3)  # -> Equality, Inequality
cull_pattern_5 = CullPattern(List=vizquick_4, CullPattern=invert(deconstruct_vector.YComponent))

# ----
# Encoded Image
deconstruct_mesh_4 = DeconstructMesh(Mesh=mesh_encoded_image)  # -> Vertices, Faces, Colours, Normals
encoded_image_v_3_2 = EncodedImageV3(
    mersh_vectors=deconstruct_mesh_4.Vertices,
    dist_facade_skin=image_location,
    max_heigth_room_z=height,
    max_width_x=number_slider,
    facade_window_srf=cull_pattern_5,
    r_color_domain="255 to 30",
    skin_typology_srf=cluster_3.lg,
    g_color_domain="70 to 255",
    back_room_wall_srf=move_4.Geometry,
    b_color_domain="255 to 30")  # -> encoded_image, r_channel_image, r_channel_values, g_channel_image, faces, g_channel_values, b_channel_image, b_channel_values
construct_mesh = ConstructMesh(Vertices=deconstruct_mesh_4.Vertices, Faces=deconstruct_mesh_4.Faces, Colours=encoded_image_v_3_2.encoded_image)

concatenate_5 = Concatenate(
    Fragment_A=encoded_image_v_3_2.r_channel_values,
    Fragment_B="0",
    A=encoded_image_v_3_2.b_channel_values,
    JoinSeparator=",")
construct_mesh_2 = ConstructMesh(Vertices=deconstruct_mesh_4.Vertices, Faces=deconstruct_mesh_4.Faces, Colours=concatenate_5)

concatenate_6 = Concatenate(Fragment_A="0", Fragment_B=encoded_image_v_3_2.g_channel_values, A="0", JoinSeparator=",")
construct_mesh_3 = ConstructMesh(Vertices=deconstruct_mesh_4.Vertices, Faces=deconstruct_mesh_4.Faces, Colours=concatenate_6)

cull_pattern_6 = CullPattern(List=vizquick_4, CullPattern=equality_3.Equality)

# ----
# Encoded Image
# Inputs: Encoded Image
# Encoded Image Boundaries
# Encoded Image Resolution
# Clusters
resolution_2 = Panel("256")
image_location_2 = Slider(5, range=0..10)
encoded_image_v_1_2 = EncodedImageV1()  # -> output_b_channel, list_of_red_values, list_of_green_values, list_of_blue_values; disabled
encoded_image_v_2_2 = EncodedImageV2()  # -> colored_mesh, red_values, green_values, blue_values; disabled
skin_resolution_2 = Slider(35, range=0..100)  # disabled
value_list_2 = ValueList({"Red Channel": 0, "Green Channel": 1, "Blue Channel": 2}, selected="Red Channel")  # disabled
dom_2 = ConstructDomain(DomainStart="-8", DomainEnd="8")
rectangle_2 = Rectangle(Plane=move_3.Geometry, XSize=dom_2, YSize=dom_2, Radius=0)  # -> Rectangle, Length
encoded_image_v_3_3 = EncodedImageV3_2(
    max_heigth_room_z=0,
    max_width_x=0,
    r_color_domain=Domain(0, 1),
    g_color_domain=Domain(0, 1),
    b_color_domain=Domain(0, 1))  # -> encoded_image, r_channel_image, r_channel_values, g_channel_image, faces, g_channel_values, b_channel_image, b_channel_values; disabled
mesh_plane_2 = MeshPlane(Boundary=rectangle_2.Rectangle, WidthCount=resolution_2, HeightCount=resolution_2)  # -> Mesh, Area
mesh_encoded_image_2 = Mesh(mesh_plane_2.Mesh)
deconstruct_mesh_5 = DeconstructMesh(Mesh=mesh_encoded_image_2)  # -> Vertices, Faces, Colours, Normals
encoded_image_v_3_4 = EncodedImageV3_3(
    mersh_vectors=deconstruct_mesh_5.Vertices,
    dist_facade_skin=image_location_2,
    max_heigth_room_z=height,
    max_width_x=number_slider,
    facade_window_srf=cull_pattern_6,
    r_color_domain="255 to 30",
    skin_typology_srf=cluster.lg,
    g_color_domain="70 to 255",
    back_room_wall_srf=move_5.Geometry,
    b_color_domain="255 to 30")  # -> encoded_image, r_channel_image, r_channel_values, g_channel_image, faces, g_channel_values, b_channel_image, b_channel_values

cull_pattern_7 = CullPattern(List=vizquick_4, CullPattern=invert(deconstruct_vector.XComponent))
cull_pattern_8 = CullPattern(List=vizquick_4, CullPattern=equality_4.Equality)

concatenate_7 = Concatenate(
    Fragment_A=encoded_image_v_3_4.r_channel_values,
    Fragment_B="0",
    A=encoded_image_v_3_4.b_channel_values,
    JoinSeparator=",")
construct_mesh_4 = ConstructMesh(Vertices=deconstruct_mesh_5.Vertices, Faces=deconstruct_mesh_5.Faces, Colours=concatenate_7)
rotate = Rotate(Geometry=construct_mesh_4, Angle=1.570796327, Plane=PlaneXY(0, 0, 0))  # -> Geometry, Transform

concatenate_8 = Concatenate(Fragment_A="0", Fragment_B=encoded_image_v_3_4.g_channel_values, A="0", JoinSeparator=",")
construct_mesh_5 = ConstructMesh(Vertices=deconstruct_mesh_5.Vertices, Faces=deconstruct_mesh_5.Faces, Colours=concatenate_8)
rotate_2 = Rotate(Geometry=construct_mesh_5, Angle=1.570796327, Plane=PlaneXY(0, 0, 0))  # -> Geometry, Transform

construct_mesh_6 = ConstructMesh(Vertices=deconstruct_mesh_5.Vertices, Faces=deconstruct_mesh_5.Faces, Colours=encoded_image_v_3_4.encoded_image)
rotate_3 = Rotate(Geometry=construct_mesh_6, Angle=1.570796327, Plane=PlaneXY(0, 0, 0))  # -> Geometry, Transform

# ----
# Encoded Image
# Inputs: Encoded Image
# Encoded Image Boundaries
# Encoded Image Resolution
# Clusters
image_location_3 = Slider(5, range=0..10)
resolution_3 = Panel("256")
encoded_image_v_1_3 = EncodedImageV1()  # -> output_b_channel, list_of_red_values, list_of_green_values, list_of_blue_values; disabled
encoded_image_v_2_3 = EncodedImageV2()  # -> colored_mesh, red_values, green_values, blue_values; disabled
skin_resolution_3 = Slider(35, range=0..100)  # disabled
value_list_3 = ValueList({"Red Channel": 0, "Green Channel": 1, "Blue Channel": 2}, selected="Red Channel")  # disabled
dom_3 = ConstructDomain(DomainStart="-8", DomainEnd="8")
rectangle_3 = Rectangle(Plane=move_4.Geometry, XSize=dom_3, YSize=dom_3, Radius=0)  # -> Rectangle, Length
encoded_image_v_3_5 = EncodedImageV3_2(
    max_heigth_room_z=0,
    max_width_x=0,
    r_color_domain=Domain(0, 1),
    g_color_domain=Domain(0, 1),
    b_color_domain=Domain(0, 1))  # -> encoded_image, r_channel_image, r_channel_values, g_channel_image, faces, g_channel_values, b_channel_image, b_channel_values; disabled
mesh_plane_3 = MeshPlane(Boundary=rectangle_3.Rectangle, WidthCount=resolution_3, HeightCount=resolution_3)  # -> Mesh, Area
mesh_encoded_image_3 = Mesh(mesh_plane_3.Mesh)
deconstruct_mesh_6 = DeconstructMesh(Mesh=mesh_encoded_image_3)  # -> Vertices, Faces, Colours, Normals
encoded_image_v_3_6 = EncodedImageV3(
    mersh_vectors=deconstruct_mesh_6.Vertices,
    dist_facade_skin=image_location_3,
    max_heigth_room_z=height,
    max_width_x=number_slider,
    facade_window_srf=cull_pattern_8,
    r_color_domain="255 to 30",
    g_color_domain="70 to 255",
    back_room_wall_srf=move_2.Geometry,
    b_color_domain="255 to 30")  # -> encoded_image, r_channel_image, r_channel_values, g_channel_image, faces, g_channel_values, b_channel_image, b_channel_values
construct_mesh_7 = ConstructMesh(Vertices=deconstruct_mesh_6.Vertices, Faces=deconstruct_mesh_6.Faces, Colours=encoded_image_v_3_6.encoded_image)

# ----
# Model
model = HBModel(rooms=flatten(aperturesbyratio.hb_objs), shades=flatten(shade.shades), apertures=flatten(aperture.apertures))  # -> out, model; plug-in component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
vizall = HBVisualizeAll(hb_objs=flatten(model.model))  # -> geo; plug-in component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
vizwiref = HBVisualizeWireframe(hb_objs=flatten(model.model))  # -> geo; plug-in component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

hb_face_attributes = HBFaceAttributes({"Display Name": "display_name", "Simulation Name (Identifier)": "identifier", "Boundary Condition": "boundary_condition", "Has Parent": "has_parent", "Parent": "parent", "Azimuth": "azimuth", "Altitude": "altitude", "Area": "area", "Perimeter": "perimeter", "Face Type": "type", "Aperture Is Operable": "is_operable", "Door Is Glass": "is_glass"}, selected="Boundary Condition")
# Faces labels
lablefaces = HBLabelFaces(hb_objs=flatten(model.model), attribute=hb_face_attributes)  # -> label_text, base_pts, labels, wire_frame; plug-in component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

# ----
# Visualize
vizbytype = HBVisualizeByType(hb_objs=model.model)  # -> walls, interior_walls, roofs, ceilings, exterior_floors, interior_floors, air_walls, apertures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; plug-in component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
data_4 = Data(vizbytype.outdoor_shades)
mesh_edges = MeshEdges(Mesh=data_4)  # -> NakedEdges, InteriorEdges, NonManifoldEdges
data_5 = Data(mesh_edges.NakedEdges)
mesh_2 = Mesh(data_4)

concatenate_9 = Concatenate(
    Fragment_A=encoded_image_v_3_6.r_channel_values,
    Fragment_B="0",
    A=encoded_image_v_3_6.b_channel_values,
    JoinSeparator=",")
construct_mesh_8 = ConstructMesh(Vertices=deconstruct_mesh_6.Vertices, Faces=deconstruct_mesh_6.Faces, Colours=concatenate_9)

concatenate_10 = Concatenate(Fragment_A="0", Fragment_B=encoded_image_v_3_6.g_channel_values, A="0", JoinSeparator=",")
construct_mesh_9 = ConstructMesh(Vertices=deconstruct_mesh_6.Vertices, Faces=deconstruct_mesh_6.Faces, Colours=concatenate_10)

# ----
# Encoded Image
# Inputs: Encoded Image
# Encoded Image Boundaries
# Encoded Image Resolution
# Clusters
resolution_4 = Panel("256")
image_location_4 = Slider(5, range=0..10)
encoded_image_v_1_4 = EncodedImageV1()  # -> output_b_channel, list_of_red_values, list_of_green_values, list_of_blue_values; disabled
encoded_image_v_2_4 = EncodedImageV2()  # -> colored_mesh, red_values, green_values, blue_values; disabled
skin_resolution_4 = Slider(35, range=0..100)  # disabled
value_list_4 = ValueList({"Red Channel": 0, "Green Channel": 1, "Blue Channel": 2}, selected="Red Channel")  # disabled
dom_4 = ConstructDomain(DomainStart="-8", DomainEnd="8")
rectangle_4 = Rectangle(Plane=move_5.Geometry, XSize=dom_4, YSize=dom_4, Radius=0)  # -> Rectangle, Length
encoded_image_v_3_7 = EncodedImageV3_2(
    max_heigth_room_z=0,
    max_width_x=0,
    r_color_domain=Domain(0, 1),
    g_color_domain=Domain(0, 1),
    b_color_domain=Domain(0, 1))  # -> encoded_image, r_channel_image, r_channel_values, g_channel_image, faces, g_channel_values, b_channel_image, b_channel_values; disabled
mesh_plane_4 = MeshPlane(Boundary=rectangle_4.Rectangle, WidthCount=resolution_4, HeightCount=resolution_4)  # -> Mesh, Area
mesh_encoded_image_4 = Mesh(mesh_plane_4.Mesh)
deconstruct_mesh_7 = DeconstructMesh(Mesh=mesh_encoded_image_4)  # -> Vertices, Faces, Colours, Normals
encoded_image_v_3_8 = EncodedImageV3_3(
    mersh_vectors=deconstruct_mesh_7.Vertices,
    dist_facade_skin=image_location_4,
    max_heigth_room_z=height,
    max_width_x=number_slider,
    facade_window_srf=cull_pattern_7,
    r_color_domain="255 to 30",
    skin_typology_srf=cluster_2.lg,
    g_color_domain="70 to 255",
    back_room_wall_srf=move_3.Geometry,
    b_color_domain="255 to 30")  # -> encoded_image, r_channel_image, r_channel_values, g_channel_image, faces, g_channel_values, b_channel_image, b_channel_values

concatenate_11 = Concatenate(Fragment_A="0", Fragment_B=encoded_image_v_3_8.g_channel_values, A="0", JoinSeparator=",")
construct_mesh_10 = ConstructMesh(Vertices=deconstruct_mesh_7.Vertices, Faces=deconstruct_mesh_7.Faces, Colours=concatenate_11)
rotate_4 = Rotate(Geometry=construct_mesh_10, Angle=1.570796327, Plane=PlaneXY(0, 0, 0))  # -> Geometry, Transform

concatenate_12 = Concatenate(
    Fragment_A=encoded_image_v_3_8.r_channel_values,
    Fragment_B="0",
    A=encoded_image_v_3_8.b_channel_values,
    JoinSeparator=",")
construct_mesh_11 = ConstructMesh(Vertices=deconstruct_mesh_7.Vertices, Faces=deconstruct_mesh_7.Faces, Colours=concatenate_12)
rotate_5 = Rotate(Geometry=construct_mesh_11, Angle=1.570796327, Plane=PlaneXY(0, 0, 0))  # -> Geometry, Transform

construct_mesh_12 = ConstructMesh(Vertices=deconstruct_mesh_7.Vertices, Faces=deconstruct_mesh_7.Faces, Colours=encoded_image_v_3_8.encoded_image)
rotate_6 = Rotate(Geometry=construct_mesh_12, Angle=1.570796327, Plane=PlaneXY(0, 0, 0))  # -> Geometry, Transform

# ----
# For Getting the R0B image
panel_6 = Panel("-4")
xz_plane = XZPlane(Origin=Point(0, 0, 0))
dom_5 = ConstructDomain(DomainStart=panel_6, DomainEnd="4")
number_slider_16 = Slider(4, range=0..10)
rectangle_5 = Rectangle(Plane=xz_plane, XSize=dom_5, YSize=dom_5, Radius=0)  # -> Rectangle, Length
surface = Surface(rectangle_5.Rectangle)
mesh_plane_5 = MeshPlane(Boundary=rectangle_5.Rectangle, WidthCount="256", HeightCount="256")  # -> Mesh, Area
number_slider_17 = Slider(0.3, range=0..1)
divide_surface = DivideSurface(Surface=surface, UCount=number_slider_16, VCount=number_slider_16)  # -> flatten(Points), Normals, Parameters
number_slider_18 = Slider(0.25, range=0..1)
area_2 = Area(Geometry=construct_mesh_2)  # -> Area, Centroid
scale = Scale(Geometry=construct_mesh_2, Center=area_2.Centroid, Factor=number_slider_18)  # -> Geometry, Transform
list_item_5 = ListItem(List=divide_surface.Points, Index=Slider(8, range=0..10), Wrap=True)
list_item_6 = ListItem(List=divide_surface.Points, Index=Slider(18, range=0..100), Wrap=True)
list_item_7 = ListItem(List=divide_surface.Points, Index=Slider(16, range=0..100), Wrap=True)
list_item_8 = ListItem(List=divide_surface.Points, Index=Slider(6, range=0..10), Wrap=True)
point = Point(list_item_6)
point_2 = Point(list_item_8)
point_3 = Point(list_item_5)
move_to_point = MoveToPoint(Geometry=scale.Geometry, PointA=area_2.Centroid, PointB=point_3)  # -> Moved, Vector, Transform
point_4 = Point(list_item_7)
area_3 = Area(Geometry=rotate.Geometry)  # -> Area, Centroid
scale_2 = Scale(Geometry=rotate.Geometry, Center=area_3.Centroid, Factor=number_slider_18)  # -> Geometry, Transform
move_to_point_2 = MoveToPoint(Geometry=scale_2.Geometry, PointA=area_3.Centroid, PointB=point)  # -> Moved, Vector, Transform
area_4 = Area(Geometry=construct_mesh_8)  # -> Area, Centroid
scale_3 = Scale(Geometry=construct_mesh_8, Center=area_4.Centroid, Factor=number_slider_18)  # -> Geometry, Transform
move_to_point_3 = MoveToPoint(Geometry=scale_3.Geometry, PointA=area_4.Centroid, PointB=point_2)  # -> Moved, Vector, Transform
area_5 = Area(Geometry=rotate_5.Geometry)  # -> Area, Centroid
scale_4 = Scale(Geometry=rotate_5.Geometry, Center=area_5.Centroid, Factor=number_slider_18)  # -> Geometry, Transform
move_to_point_4 = MoveToPoint(Geometry=scale_4.Geometry, PointA=area_5.Centroid, PointB=point_4)  # -> Moved, Vector, Transform
xz_plane_2 = XZPlane(Origin=Point(0, 0, 0))
dom_6 = ConstructDomain(DomainStart="-4", DomainEnd="4")
rectangle_6 = Rectangle(Plane=xz_plane_2, XSize=dom_6, YSize=dom_6, Radius=0)  # -> Rectangle, Length
unit_x_3 = UnitX(Factor="8")
move_6 = Move(Geometry=rectangle_6.Rectangle, Motion=unit_x_3)  # -> Geometry, Transform
area_6 = Area(Geometry=move_6.Geometry)  # -> Area, Centroid
merge_2 = Merge(Data1=move_to_point.Moved, Data2=move_to_point_2.Moved, Data3=move_to_point_3.Moved, Data4=move_to_point_4.Moved)
mesh_join_4 = MeshJoin(Meshes=merge_2)  # -> flatten(Mesh)
mesh_3 = Mesh([move_to_point_4.Moved, move_to_point_3.Moved, move_to_point_2.Moved, move_to_point.Moved])

# ----
# For Getting the RGB image
panel_7 = Panel("-4")
xz_plane_3 = XZPlane(Origin=Point(0, 0, 0))
dom_7 = ConstructDomain(DomainStart=panel_7, DomainEnd="4")
number_slider_19 = Slider(4, range=0..10)
rectangle_7 = Rectangle(Plane=xz_plane_3, XSize=dom_7, YSize=dom_7, Radius=0)  # -> Rectangle, Length
surface_2 = Surface(rectangle_7.Rectangle)
mesh_plane_6 = MeshPlane(Boundary=rectangle_7.Rectangle, WidthCount="256", HeightCount="256")  # -> Mesh, Area
number_slider_20 = Slider(0.3, range=0..1)
divide_surface_2 = DivideSurface(Surface=surface_2, UCount=number_slider_19, VCount=number_slider_19)  # -> flatten(Points), Normals, Parameters
number_slider_21 = Slider(0.25, range=0..1)
area_7 = Area(Geometry=construct_mesh)  # -> Area, Centroid
scale_5 = Scale(Geometry=construct_mesh, Center=area_7.Centroid, Factor=number_slider_21)  # -> Geometry, Transform
list_item_9 = ListItem(List=divide_surface_2.Points, Index=Slider(8, range=0..10), Wrap=True)
list_item_10 = ListItem(List=divide_surface_2.Points, Index=Slider(18, range=0..100), Wrap=True)
list_item_11 = ListItem(List=divide_surface_2.Points, Index=Slider(16, range=0..100), Wrap=True)
list_item_12 = ListItem(List=divide_surface_2.Points, Index=Slider(6, range=0..10), Wrap=True)
area_8 = Area(Geometry=rotate_3.Geometry)  # -> Area, Centroid
scale_6 = Scale(Geometry=rotate_3.Geometry, Center=area_8.Centroid, Factor=number_slider_21)  # -> Geometry, Transform
area_9 = Area(Geometry=construct_mesh_7)  # -> Area, Centroid
scale_7 = Scale(Geometry=construct_mesh_7, Center=area_9.Centroid, Factor=number_slider_21)  # -> Geometry, Transform
area_10 = Area(Geometry=rotate_6.Geometry)  # -> Area, Centroid
scale_8 = Scale(Geometry=rotate_6.Geometry, Center=area_10.Centroid, Factor=number_slider_21)  # -> Geometry, Transform
xz_plane_4 = XZPlane(Origin=Point(0, 0, 0))
dom_8 = ConstructDomain(DomainStart="-4", DomainEnd="4")
rectangle_8 = Rectangle(Plane=xz_plane_4, XSize=dom_8, YSize=dom_8, Radius=0)  # -> Rectangle, Length
unit_x_4 = UnitX(Factor="8")
move_7 = Move(Geometry=rectangle_8.Rectangle, Motion=unit_x_4)  # -> Geometry, Transform
area_11 = Area(Geometry=move_7.Geometry)  # -> Area, Centroid

# ---- group: 2nd
point_5 = Point(list_item_10)

# ---- group: 3rd
point_6 = Point(list_item_12)

# ---- group: 1st
point_7 = Point(list_item_9)

# ---- group: 4th
point_8 = Point(list_item_11)

# ----
# For Getting the 0G0 image
xz_plane_5 = XZPlane(Origin=Point(0, 0, 0))
dom_9 = ConstructDomain(DomainStart="-4", DomainEnd="4")
number_slider_22 = Slider(4, range=0..10)
rectangle_9 = Rectangle(Plane=xz_plane_5, XSize=dom_9, YSize=dom_9, Radius=0)  # -> Rectangle, Length
surface_3 = Surface(rectangle_9.Rectangle)
mesh_plane_7 = MeshPlane(Boundary=rectangle_9.Rectangle, WidthCount="256", HeightCount="256")  # -> Mesh, Area
number_slider_23 = Slider(0.3, range=0..1)
divide_surface_3 = DivideSurface(Surface=surface_3, UCount=number_slider_22, VCount=number_slider_22)  # -> flatten(Points), Normals, Parameters
number_slider_24 = Slider(0.25, range=0..1)
area_12 = Area(Geometry=construct_mesh_3)  # -> Area, Centroid
scale_9 = Scale(Geometry=construct_mesh_3, Center=area_12.Centroid, Factor=number_slider_24)  # -> Geometry, Transform
list_item_13 = ListItem(List=divide_surface_3.Points, Index=Slider(8, range=0..10), Wrap=True)
list_item_14 = ListItem(List=divide_surface_3.Points, Index=Slider(18, range=0..100), Wrap=True)
list_item_15 = ListItem(List=divide_surface_3.Points, Index=Slider(16, range=0..100), Wrap=True)
list_item_16 = ListItem(List=divide_surface_3.Points, Index=Slider(6, range=0..10), Wrap=True)
point_9 = Point(list_item_14)
point_10 = Point(list_item_16)
point_11 = Point(list_item_13)
move_to_point_5 = MoveToPoint(Geometry=scale_9.Geometry, PointA=area_12.Centroid, PointB=point_11)  # -> Moved, Vector, Transform
point_12 = Point(list_item_15)
area_13 = Area(Geometry=rotate_2.Geometry)  # -> Area, Centroid
scale_10 = Scale(Geometry=rotate_2.Geometry, Center=area_13.Centroid, Factor=number_slider_24)  # -> Geometry, Transform
move_to_point_6 = MoveToPoint(Geometry=scale_10.Geometry, PointA=area_13.Centroid, PointB=point_9)  # -> Moved, Vector, Transform
area_14 = Area(Geometry=construct_mesh_9)  # -> Area, Centroid
scale_11 = Scale(Geometry=construct_mesh_9, Center=area_14.Centroid, Factor=number_slider_24)  # -> Geometry, Transform
move_to_point_7 = MoveToPoint(Geometry=scale_11.Geometry, PointA=area_14.Centroid, PointB=point_10)  # -> Moved, Vector, Transform
area_15 = Area(Geometry=rotate_4.Geometry)  # -> Area, Centroid
scale_12 = Scale(Geometry=rotate_4.Geometry, Center=area_15.Centroid, Factor=number_slider_24)  # -> Geometry, Transform
move_to_point_8 = MoveToPoint(Geometry=scale_12.Geometry, PointA=area_15.Centroid, PointB=point_12)  # -> Moved, Vector, Transform
xz_plane_6 = XZPlane(Origin=Point(0, 0, 0))
dom_10 = ConstructDomain(DomainStart="-4", DomainEnd="4")
rectangle_10 = Rectangle(Plane=xz_plane_6, XSize=dom_10, YSize=dom_10, Radius=0)  # -> Rectangle, Length
unit_x_5 = UnitX(Factor="8")
move_8 = Move(Geometry=rectangle_10.Rectangle, Motion=unit_x_5)  # -> Geometry, Transform
area_16 = Area(Geometry=move_8.Geometry)  # -> Area, Centroid
merge_3 = Merge(Data1=move_to_point_5.Moved, Data2=move_to_point_6.Moved, Data3=move_to_point_7.Moved, Data4=move_to_point_8.Moved)
mesh_join_5 = MeshJoin(Meshes=merge_3)  # -> flatten(Mesh)
mesh_4 = Mesh([move_to_point_8.Moved, move_to_point_7.Moved, move_to_point_6.Moved, move_to_point_5.Moved])

move_to_point_9 = MoveToPoint(Geometry=scale_5.Geometry, PointA=area_7.Centroid, PointB=point_7)  # -> Moved, Vector, Transform
move_to_point_10 = MoveToPoint(Geometry=scale_6.Geometry, PointA=area_8.Centroid, PointB=point_5)  # -> Moved, Vector, Transform
move_to_point_11 = MoveToPoint(Geometry=scale_7.Geometry, PointA=area_9.Centroid, PointB=point_6)  # -> Moved, Vector, Transform
move_to_point_12 = MoveToPoint(Geometry=scale_8.Geometry, PointA=area_10.Centroid, PointB=point_8)  # -> Moved, Vector, Transform
merge_4 = Merge(Data1=move_to_point_9.Moved, Data2=move_to_point_10.Moved, Data3=move_to_point_11.Moved, Data4=move_to_point_12.Moved)
mesh_join_6 = MeshJoin(Meshes=merge_4)  # -> flatten(Mesh)

# ---- group: 4 MESH
mesh_5 = Mesh([move_to_point_12.Moved, move_to_point_11.Moved, move_to_point_10.Moved, move_to_point_9.Moved])

# ----
# Save File to Folder
mesh_explode = MeshExplode(Mesh=mesh_join_6, Interpolate=False)  # disabled
deconstruct_mesh_8 = DeconstructMesh(Mesh=mesh_explode)  # -> Vertices, Faces, Colours, Normals; disabled
average = Average(Input=deconstruct_mesh_8.Colours)  # -> flatten(ArithmeticMean); disabled
build_bitmap_2 = BuildBitmap(Width=number_slider_13, Height=number_slider_13, Colors=average)  # disabled

panel_8 = Panel("\\.psf\Home\Library\CloudStorage\GoogleDrive-georgios.grigoriadis@students.iaac.net\.shortcut-targets-by-id\1HMKmUbvymzdqYQePkG28Gkn-BSdMqvnw\AIA Studio Group 4\RGB encoding\Dataset_Encoded_Hoz_Skin")  # disabled
panel_9 = Panel("x")  # disabled
panel_10 = Panel("px")  # disabled
panel_11 = Panel("_")  # disabled
concatenate_13 = Concatenate(A=panel_11, Fragment_B=panel_9, C=panel_11, D=resolution, E=panel_10)  # disabled
null_item = NullItem(Item=build_bitmap_2)  # -> NullFlags, InvalidFlags, Description; disabled
save_bitmap = SaveBitmap(
    ImageBitmap=build_bitmap_2,
    FolderPath=panel_8,
    FileName=concatenate_13,
    Extension=0,
    Save=invert(null_item.InvalidFlags))
panel_12 = Panel(save_bitmap)  # disabled
prev_image = PrevImage(SmartBitmap=build_bitmap_2)  # disabled

# ----
# Sensor Grid
number_slider_25 = Slider(0.5, range=0..10)
genpts = LBGeneratePointGrid(geometry=move.Geometry, grid_size=number_slider_25)  # -> points, vectors, face_areas, mesh; plug-in component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
points = Data(genpts.points)

rebuild_mesh = RebuildMesh(
    Mesh=genpts.mesh,
    RebuildNormals=False,
    CullUnused=False,
    UnifyNormals=False,
    FlipNormals=True,
    IdenticalCombine=False,
    WeldVertices=0)

sensorgrid = HBSensorGrid(positions=points, mesh=rebuild_mesh)  # -> grid; plug-in component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
assigngridsviews = HBAssignGridsAndViews(model=model.model, grids=flatten(sensorgrid))  # -> model; plug-in component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

# ----
# Analysis parameters:
# 
# HB room - Indoor analysis:
# Apreture testing location : South
# period: Annual
# Wind speed: 0.2
# human body parameters: Seated - facing side way to the window
adaptivemap = HBAdaptiveComfortMap(
    model=assigngridsviews,
    epw=downloadepw.epw_file,
    ddy=downloadepw.ddy_file,
    run_period=analysisperiod.period,
    air_speed=number_slider_8,
    comfort_par=adaptpar,
    solar_body_par=solarbodypar,
    run=toggle)  # -> out, env_conds, op_temp, condition, deg_neut, TCP, HSP, CSP; plug-in component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

heatmap = LBSpatialHeatmap(values=adaptivemap.CSP, mesh=rebuild_mesh)  # -> mesh, legend, title, colors, legend_par, vis_set; plug-in component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
heatmap_2 = LBSpatialHeatmap(values=adaptivemap.HSP, mesh=rebuild_mesh)  # -> mesh, legend, title, colors, legend_par, vis_set; plug-in component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
heatmap_3 = LBSpatialHeatmap(values=adaptivemap.TCP, mesh=rebuild_mesh)  # -> mesh, legend, title, colors, legend_par, vis_set; plug-in component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

envmtx = HBReadEnvironmentMatrix(env_conds=adaptivemap.env_conds, load=Toggle(True))  # -> comf_mtx; plug-in component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
thermalmtx_2 = HBReadThermalMatrix(comf_result=adaptivemap.condition, load=Toggle(True))  # -> comf_mtx; plug-in component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
vizthermalmap_2 = HBVisualizeThermalMap(comf_mtx=envmtx, mesh=flatten(rebuild_mesh), legend_par=legendpar)  # -> out, mesh, legend, title, colors, values; plug-in component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
average_2 = Average(Input=adaptivemap.HSP)
average_3 = Average(Input=adaptivemap.TCP)
average_4 = Average(Input=vizthermalmap_2.values)

round_to_decimal_place_2 = RoundToDecimalPlace(NumberX=average_4, DecimalPlace=Slider(1, range=0..10), RoundType=0)  # -> Rounded, Difference
tag_2 = TextTag3D(
    Location=points,
    Text=round_to_decimal_place_2.Rounded,
    Size=Slider(0.1, range=0..0.1),
    Colour=ColourSwatch(SwatchColor=RGB(0, 0, 0)),
    Justification=7)

wallacei_x = WallaceiX(
    Genes=[number_slider, number_slider_3, number_slider_15],
    Objectives=[average_4, average_3, average_2],
    Phenotype=[vizthermalmap_2.mesh, mesh_join_6, mesh_join_4, mesh_join_5, brep_join.Breps],
    allFitness="33.881658|42.157796|51.472281;28.634816|72.300818|22.340669;30.078228|60.514777|33.503112;32.628865|56.468779|43.484795;30.868814|55.805754|38.222382;29.782049|62.877017|31.792097;29.409468|67.523367|27.812128;35.324565|33.895125|56.319186;31.173629|65.39279|34.574512;30.042593|57.494982|35.798065;29.368862|66.327378|28.512775;34.043081|34.586728|65.412977;32.800403|57.291298|42.650572;32.061606|52.172433|41.337427;29.42928|66.20764|29.420131;29.646777|67.801621|27.522301;32.978487|45.287519|49.697426;33.820245|39.003897|54.925257;33.18528|47.213182|45.745882;32.827103|42.030641|57.966702",
    allFrontIdx="0|0;0|1;0|2;0|4;0|5;0|6;0|7;0|9;0|10;0|11;0|13;0|14;0|15;0|16;0|17;0|18;0|19",
    allGenomes="6|4|0.7_12|8|0.65_7|10|0.15_11|3|0.37_7|10|1.02_11|5|0.92_11|8|1.42_4|4|0.57_13|4|1.19_7|9|1.33_10|8|1.05_3|10|1.21_13|3|0.77_9|5|1.49_11|6|0.65_11|8|0.71_6|5|0.79_5|5|1.04_8|4|1.42_4|10|0.73",
    curFrontIdx="0|0;0|1;0|2;0|4;0|5;0|6;0|7;0|9;0|10;0|11;0|13;0|14;0|15;0|16;0|17;0|18;0|19",
    curFrontIdxSave="0|0;0|1;0|2;0|4;0|5;0|6;0|7;0|9;0|10;0|11;0|13;0|14;0|15;0|16;0|17;0|18;0|19",
    popGen="20,1",
    total="1599563",
    wlcDone=True)  # -> WallaceiGenomes, FitnessValues, Data, Phenotypes
number_slider_26 = Slider(20, range=0..100)
distribute_to_grid = DistributeToGrid(
    FitnessValues=wallacei_x.FitnessValues,
    WallaceiPhenotypes=wallacei_x.Phenotypes,
    SizeOfTheGridInTheXDirection=number_slider_26,
    SizeOfTheGridInTheYDirection=number_slider_26,
    OutputOptions=0)  # -> DistributedFitnessValues, DistributedData, DistributedGeometries, DistributedMeshes, DistributedNumbers, GridLocations
tag_3 = TextTag3D(
    Text=distribute_to_grid.DistributedFitnessValues,
    Size=Slider(0.1, range=0..0.1),
    Colour=ColourSwatch(SwatchColor=RGB(0, 0, 0)),
    Justification=7)

decode_phenotype = DecodePhenotype(WallaceiPhenotype=wallacei_x.Phenotypes)  # -> GeometriesList, MeshesList, NumbersList, TextList
data_6 = Data(decode_phenotype.MeshesList)
list_item_17 = ListItem(List=data_6, Index=0, Wrap=True)
list_item_18 = ListItem(List=data_6, Index="1", Wrap=True)
list_item_19 = ListItem(List=data_6, Index="2", Wrap=True)
list_item_20 = ListItem(List=data_6, Index="3", Wrap=True)
mesh_edges_2 = MeshEdges(Mesh=list_item_18)  # -> NakedEdges, InteriorEdges, NonManifoldEdges
data_7 = Data(mesh_edges_2.NakedEdges)
list_item_21 = ListItem(List=flatten(decode_phenotype.GeometriesList), Index=Slider(0, range=0..20), Wrap=True)
list_item_22 = ListItem(List=flatten(list_item_17), Index=number_slider_12, Wrap=True)
list_item_23 = ListItem(List=flatten(list_item_19), Index=number_slider_12, Wrap=True)
list_item_24 = ListItem(List=flatten(list_item_20), Index=number_slider_12, Wrap=True)
list_item_25 = ListItem(List=flatten(list_item_18), Index=number_slider_12, Wrap=True)
center_4 = Center(Geometry=list_item_21)  # -> Center, Dimension
move_to_point_13 = MoveToPoint(Geometry=list_item_21, PointA=center_4.Center, PointB=area_16.Centroid)  # -> Moved, Vector, Transform
center_5 = Center(Geometry=list_item_22)  # -> Center, Dimension
move_9 = Move(Geometry=data_7, Motion=unit_x)  # -> Geometry, Transform
custom_preview_lineweights = CustomPreviewLineweights(Geometry=[move_8.Geometry, move_9.Geometry], Shader=ColourSwatch(SwatchColor=RGB(255, 255, 255)), Absolute=False)
rotate_axis = RotateAxis(Geometry=move_to_point_13.Moved, Angle=1.570796327, Axis=Line((0, 0, 0), (10, 0, 0)))  # -> Geometry, Transform

move_to_point_14 = MoveToPoint(Geometry=vizthermalmap_2.mesh, PointB=area_6.Centroid)  # -> Moved, Vector, Transform
mesh_6 = Mesh(flatten([mesh_3, move_to_point_14.Moved]))

move_to_point_15 = MoveToPoint(Geometry=vizthermalmap_2.mesh, PointB=area_11.Centroid)  # -> Moved, Vector, Transform

move_10 = Move(Geometry=list_item_23, Motion=unit_x)  # -> Geometry, Transform
mesh_7 = Mesh(flatten(rotate_axis.Geometry))
move_to_point_16 = MoveToPoint(Geometry=list_item_22, PointA=center_5.Center, PointB=area_16.Centroid)  # -> Moved, Vector, Transform
scale_13 = Scale(Geometry=mesh_7, Center=area_11.Centroid, Factor=0.5)  # -> Geometry, Transform
rotate_axis_2 = RotateAxis(Geometry=move_to_point_16.Moved, Angle=1.570796327, Axis=Line((0, 0, 0), (10, 0, 0)))  # -> Geometry, Transform
mesh_8 = Mesh(flatten(rotate_axis_2.Geometry))
mesh_9 = Mesh(flatten(move_10.Geometry))

# ---- group: FINAL MESH
mesh_10 = Mesh(flatten([mesh_5, move_to_point_15.Moved]))

# ----
# Visualize
scale_14 = Scale(Geometry=mesh_8, Center=area_11.Centroid, Factor=0.5)  # -> Geometry, Transform

data_8 = Data(flatten(Tree({0}: ["C:\Users\Aly Mahmoud\simulation\unnamed\adaptive_comfort_map\initial_results/conditions", "C:\Users\Aly Mahmoud\simulation\unnamed\adaptive_comfort_map\results/temperature", "C:\Users\Aly Mahmoud\simulation\unnamed\adaptive_comfort_map\results/condition", "C:\Users\Aly Mahmoud\simulation\unnamed\adaptive_comfort_map\results/condition_intensity"], {0;0}: [47.58208955, 47.88059701, 47.97014925, 47.91044776, 47.73134328, 47.82089552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])))  # disabled
list_item_26 = ListItem(List=data_8, Index=0, Wrap=True)  # -> Item, Item1, Item2, Item3, Item4, Item5, Item6, Item7; disabled
boolean_toggle_4 = BooleanToggle(True)  # disabled
mesh_11 = Mesh(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)  # disabled
thermalmtx_3 = HBReadThermalMatrix(comf_result=list_item_26.Item2, load=boolean_toggle_4)  # -> comf_mtx; disabled; plug-in component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
face_normals_2 = FaceNormals(Mesh=mesh_11)  # -> Centers, Normals; disabled
number_slider_27 = Slider(2, range=0..10)  # disabled
number_slider_28 = Slider(0.1, range=0..0.1)  # disabled
swatch_2 = ColourSwatch(SwatchColor=RGB(0, 0, 0))  # disabled

envmtx_2 = HBReadEnvironmentMatrix(env_conds=list_item_26.Item, load=boolean_toggle_3)  # -> comf_mtx; disabled; plug-in component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

vizthermalmap_3 = HBVisualizeThermalMap(comf_mtx=envmtx_2, mesh=flatten(mesh_11))  # -> out, mesh, legend, title, colors, values; disabled; plug-in component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
round_to_decimal_place_3 = RoundToDecimalPlace(NumberX=vizthermalmap_3.values, DecimalPlace=number_slider_27, RoundType=0)  # -> Rounded, Difference; disabled
tag_4 = TextTag3D(
    Location=face_normals_2.Centers,
    Text=round_to_decimal_place_3.Rounded,
    Size=number_slider_28,
    Colour=swatch_2,
    Justification=7)  # disabled

move_to_point_17 = MoveToPoint(Geometry=list_item_22, PointA=center_5.Center, PointB=area_16.Centroid)  # -> Moved, Vector, Transform

rotate_axis_3 = RotateAxis(Geometry=move_to_point_17.Moved, Angle=1.570796327, Axis=Line((0, 0, 0), (10, 0, 0)))  # -> Geometry, Transform

mesh_12 = Mesh(flatten(rotate_axis_3.Geometry))

# ==== cluster EncodedImageV1
back_surface_of_room = ClusterInput()
mjoin = MeshJoin(Meshes=back_surface_of_room)
mesh = ClusterInput()
mesh_2 = Mesh(back_surface_of_room)
mesh_3 = Mesh(mesh)
center = Center(Geometry=mjoin, forall=False)  # -> Center, Dimension
center_2 = Center(Geometry=mesh, forall=False)  # -> Center, Dimension
deconstruct_mesh = DeconstructMesh(Mesh=mesh)  # -> Vertices, Faces, Colours, Normals

# ----
# Vector for Projection
vector_2pt = Vector2Pt(PointA=center_2.Center, PointB=center.Center, Unitize=False)  # -> Vector, Length

# ----
# Points
project_point = ProjectPoint(Point=deconstruct_mesh.Vertices, Direction=vector_2pt.Vector, Geometry=back_surface_of_room)  # -> Point, Index
deconstruct = Deconstruct(Point=project_point.Point)  # -> XComponent, YComponent, ZComponent

vdis = VectorDisplay(Anchor=center_2.Center, Vector=vector_2pt.Vector)
absolute = Absolute(Value=deconstruct.YComponent)
control_wire_display = ControlWireDisplay(WireDisplay="1")

# ----
# Point domain in Y
bounds = Bounds(Numbers=absolute)
deconstruct_domain = DeconstructDomain(Domain=bounds)  # -> Start, End

channel = ClusterInput()

# ----
# Checks if flat
subtraction = Subtraction(A=deconstruct_domain.Start, B=deconstruct_domain.End)
equality_within_tolerance = EqualityWithinTolerance(FirstNumber=subtraction, SecondNumber="0,00", Tolerance=0.01)  # -> Equality, Inequality

# ----
# Condition:
# Geometry of Surface
condition_flat = Panel("0")
condition_not_flat = Data(deconstruct_domain.End)
stream_filter = StreamFilter(Gate=equality_within_tolerance.Equality, Stream0=condition_not_flat, Stream1=condition_flat)

construct_domain = ConstructDomain(DomainStart=deconstruct_domain.Start, DomainEnd=stream_filter)

# ----
# Red Channel
panel = Panel("0")
equality = Equality(FirstNumber=channel, SecondNumber=panel)  # -> Equality, Inequality
stream_filter_2 = StreamFilter(Gate=equality.Equality, Stream0="0 to 0", Stream1="255 to 30")
remap_numbers = RemapNumbers(Value=absolute, Source=construct_domain, Target=stream_filter_2)  # -> Mapped, Clipped

# ----
# Blue Channel
panel_2 = Panel("2")
equality_2 = Equality(FirstNumber=channel, SecondNumber=panel_2)  # -> Equality, Inequality
stream_filter_3 = StreamFilter(Gate=equality_2.Equality, Stream0="0 to 0", Stream1="255 to 30")
remap_numbers_2 = RemapNumbers(Value=absolute, Source=construct_domain, Target=stream_filter_3)  # -> Mapped, Clipped

# ----
# Green Channel
panel_3 = Panel("1")
equality_3 = Equality(FirstNumber=channel, SecondNumber=panel_3)  # -> Equality, Inequality
stream_filter_4 = StreamFilter(Gate=equality_3.Equality, Stream0="0 to 0", Stream1="60 to 255")
remap_numbers_3 = RemapNumbers(Value=absolute, Source=construct_domain, Target=stream_filter_4)  # -> Mapped, Clipped

colour_rgb = ColourRGB(Alpha=255, Red=remap_numbers.Mapped, Green=remap_numbers_3.Mapped, Blue=remap_numbers_2.Mapped)

# ----
# Replace <null> cells
# with 0,0,1 (black)
null_item = NullItem(Item=colour_rgb)  # -> NullFlags, InvalidFlags, Description
list_length = ListLength(List=colour_rgb)
series = Series(Start=0, Step=1, Count=list_length)
cull_pattern = CullPattern(List=series, CullPattern=null_item.InvalidFlags)

replace_items = ReplaceItems(List=remap_numbers_2.Mapped, Item="1", Indices=cull_pattern, Wrap=False)
replace_items_2 = ReplaceItems(List=remap_numbers.Mapped, Item="1", Indices=cull_pattern, Wrap=False)
replace_items_3 = ReplaceItems(List=remap_numbers_3.Mapped, Item="1", Indices=cull_pattern, Wrap=False)
list_of_red_values = ClusterOutput(replace_items_2)
list_of_blue_values = ClusterOutput(replace_items)
list_of_green_values = ClusterOutput(replace_items_3)
b_channel = Panel("0,0,1")
r_channel = Panel("1,0,0")
g_channel = Panel("0,1,0")
stream_filter_5 = StreamFilter(Gate=channel, Stream0=r_channel, Stream1=g_channel, Stream2=b_channel)

# ----
# Create List colors
replace_items_4 = ReplaceItems(List=colour_rgb, Item=stream_filter_5, Indices=cull_pattern, Wrap=False)

panel_4 = Panel(replace_items_4)

# ----
# Output Gradient
construct_mesh = ConstructMesh(Vertices=deconstruct_mesh.Vertices, Faces=deconstruct_mesh.Faces, Colours=replace_items_4)

output_b_channel = ClusterOutput(construct_mesh)

# ==== cluster EncodedImageV2
mesh_image = ClusterInput()
geomtery_to_encode = ClusterInput()
skin_typology_resolution = ClusterInput()
channel = ClusterInput()
direction_projection = ClusterInput()
control_wire_display = ControlWireDisplay(WireDisplay="1")
number_slider = Slider(9, range=0..10)
mesh_surface = MeshSurface(
    Surface=geomtery_to_encode,
    UCount=Slider(256, range=0..256),
    VCount=skin_typology_resolution,
    Overhang=True,
    Equalize=False)
deconstruct_mesh = DeconstructMesh(Mesh=mesh_image)  # -> Vertices, Faces, Colours, Normals
mesh_join = MeshJoin(Meshes=mesh_surface)

deconstruct_mesh_2 = DeconstructMesh(Mesh=mesh_join)  # -> Vertices, Faces, Colours, Normals
deconstruct = Deconstruct(Point=deconstruct_mesh_2.Vertices)  # -> XComponent, YComponent, ZComponent
construct_point = ConstructPoint(XCoordinate=deconstruct.XComponent, YCoordinate="-5", ZCoordinate=deconstruct.ZComponent)

# ----
# Points
mesh_ray = MeshRay(Mesh=mesh_join, Point=deconstruct_mesh.Vertices, Direction=expr("-x", direction_projection))  # -> Point, Hit; disabled

list_length = ListLength(List=deconstruct_mesh.Vertices)
create_rtree = CreateRTree(InputGeometry=flatten(deconstruct_mesh.Vertices))
series = Series(Start=0, Step="0", Count=list_length)
rtree_closest_point = RTreeClosestPoint(SearchPoints=flatten(construct_point), RTree=create_rtree)  # -> ClosestPoint, ClosestIndex
replace_items = ReplaceItems(List=series, Item=deconstruct.YComponent, Indices=rtree_closest_point.ClosestIndex, Wrap=False)

absolute = Absolute(Value=replace_items)
create_set = CreateSet(List=absolute)  # -> Set, Map
equality = Equality(FirstNumber=absolute, SecondNumber=Slider(0, range=0..100))  # -> Equality, Inequality
cull_pattern = CullPattern(List=absolute, CullPattern=equality.Inequality)
# Point domain in Y
bounds = Bounds(Numbers=cull_pattern)
deconstruct_domain = DeconstructDomain(Domain=bounds)  # -> Start, End
# Checks if flat
subtraction = Subtraction(A=deconstruct_domain.Start, B=deconstruct_domain.End)
# Red Channel
panel = Panel("0")
condition_flat = Panel("0")
# Condition:
# Geometry of Surface
condition_not_flat = Data(deconstruct_domain.End)
# Blue Channel
panel_2 = Panel("2")
# Green Channel
panel_3 = Panel("1")
equality_within_tolerance = EqualityWithinTolerance(FirstNumber=subtraction, SecondNumber="0,00", Tolerance=0.01)  # -> Equality, Inequality
equality_2 = Equality(FirstNumber=channel, SecondNumber=panel_3)  # -> Equality, Inequality
equality_3 = Equality(FirstNumber=channel, SecondNumber=panel)  # -> Equality, Inequality
equality_4 = Equality(FirstNumber=channel, SecondNumber=panel_2)  # -> Equality, Inequality
stream_filter = StreamFilter(Gate=equality_within_tolerance.Equality, Stream0=condition_not_flat, Stream1=condition_flat)
construct_domain = ConstructDomain(DomainStart=deconstruct_domain.Start, DomainEnd=stream_filter)
stream_filter_2 = StreamFilter(Gate=equality_2.Equality, Stream0="0 to 0", Stream1="1 to 255")
stream_filter_3 = StreamFilter(Gate=equality_4.Equality, Stream0="0 to 0", Stream1="255 to 30")
stream_filter_4 = StreamFilter(Gate=equality_3.Equality, Stream0="0 to 0", Stream1="255 to 30")
remap_numbers = RemapNumbers(Value=absolute, Source=construct_domain, Target=stream_filter_4)  # -> Mapped, Clipped
remap_numbers_2 = RemapNumbers(Value=absolute, Source=construct_domain, Target=stream_filter_3)  # -> Mapped, Clipped
remap_numbers_3 = RemapNumbers(Value=absolute, Source=construct_domain, Target=stream_filter_2)  # -> Mapped, Clipped
colour_rgb = ColourRGB(Alpha=255, Red=remap_numbers.Mapped, Green=remap_numbers_3.Mapped, Blue=remap_numbers_2.Mapped)
null_item = NullItem(Item=colour_rgb)  # -> NullFlags, InvalidFlags, Description
# Replace <null> cells
# with 0,0,1 (black)
list_length_2 = ListLength(List=colour_rgb)
series_2 = Series(Start=0, Step=1, Count=list_length_2)
cull_pattern_2 = CullPattern(List=series_2, CullPattern=null_item.InvalidFlags)
replace_items_2 = ReplaceItems(List=remap_numbers_2.Mapped, Item="1", Indices=cull_pattern_2, Wrap=False)
replace_items_3 = ReplaceItems(List=remap_numbers_3.Mapped, Item="1", Indices=cull_pattern_2, Wrap=False)
replace_items_4 = ReplaceItems(List=remap_numbers.Mapped, Item="1", Indices=cull_pattern_2, Wrap=False)
blue_values = ClusterOutput(replace_items_2)
red_values = ClusterOutput(replace_items_4)
green_values = ClusterOutput(replace_items_3)
b_channel = Panel("0,0,1")
r_channel = Panel("1,0,0")
g_channel = Panel("0,1,0")
stream_filter_5 = StreamFilter(Gate=channel, Stream0=r_channel, Stream1=g_channel, Stream2=b_channel)
# Create List colors
replace_items_5 = ReplaceItems(List=colour_rgb, Item=stream_filter_5, Indices=cull_pattern_2, Wrap=False)
# Output Gradient
construct_mesh = ConstructMesh(Vertices=deconstruct_mesh.Vertices, Faces=deconstruct_mesh.Faces, Colours=replace_items_5)
panel_4 = Panel(replace_items_5)
colored_mesh = ClusterOutput(construct_mesh)

# ==== cluster EncodedImageV3
mersh_vectors = ClusterInput()
dist_facade_skin = ClusterInput()
max_heigth_room_z = ClusterInput()
max_width_x = ClusterInput()

# ----
# Filter Points
deconstruct = Deconstruct(Point=mersh_vectors)  # -> XComponent, YComponent, ZComponent
smaller_than = SmallerThan(FirstNumber=deconstruct.XComponent, SecondNumber=max_width_x)  # -> SmallerThan, OrEqualTo
larger_than = LargerThan(FirstNumber=deconstruct.ZComponent, SecondNumber="0")  # -> LargerThan, OrEqualTo
smaller_than_2 = SmallerThan(FirstNumber=deconstruct.ZComponent, SecondNumber=max_heigth_room_z)  # -> SmallerThan, OrEqualTo
larger_than_2 = LargerThan(FirstNumber=deconstruct.XComponent, SecondNumber="0")  # -> LargerThan, OrEqualTo
gate_and = GateAnd(A=larger_than.OrEqualTo, B=smaller_than_2.OrEqualTo, C=larger_than_2.OrEqualTo, D=smaller_than.OrEqualTo)
cull_pattern = CullPattern(List=mersh_vectors, CullPattern=gate_and)

facade_window_srf = ClusterInput()
r_color_domain = ClusterInput()
skin_typology_srf = ClusterInput()
g_color_domain = ClusterInput()
back_room_wall_srf = ClusterInput()
b_color_domain = ClusterInput()

deconstruct_2 = Deconstruct(Point=cull_pattern)  # -> XComponent, YComponent, ZComponent
equality = Equality(FirstNumber=deconstruct_2.ZComponent, SecondNumber="0")  # -> Equality, Inequality
cull_pattern_2 = CullPattern(List=cull_pattern, CullPattern=equality.Equality)
list_length = ListLength(List=cull_pattern_2)

deconstruct_3 = Deconstruct(Point=cull_pattern)  # -> XComponent, YComponent, ZComponent
equality_2 = Equality(FirstNumber=deconstruct_3.XComponent, SecondNumber="0")  # -> Equality, Inequality
cull_pattern_3 = CullPattern(List=cull_pattern, CullPattern=equality_2.Equality)
list_length_2 = ListLength(List=cull_pattern_3)

data = Data(dist_facade_skin)

mesh_surface = MeshSurface(Surface=back_room_wall_srf, UCount=list_length, VCount=list_length_2, Overhang=True, Equalize=False)
mesh_join = MeshJoin(Meshes=mesh_surface)
deconstruct_mesh = DeconstructMesh(Mesh=mesh_join)  # -> Vertices, Faces, Colours, Normals
deconstruct_4 = Deconstruct(Point=deconstruct_mesh.Vertices)  # -> XComponent, YComponent, ZComponent
round = Round(Number=deconstruct_4.YComponent)  # -> Nearest, Floor, Ceiling
construct_point = ConstructPoint(XCoordinate=deconstruct_4.XComponent, YCoordinate=data, ZCoordinate=deconstruct_4.ZComponent)
bounds = Bounds(Numbers=round.Nearest)

mesh_surface_2 = MeshSurface(Surface=facade_window_srf, UCount=list_length, VCount=list_length_2, Overhang=True, Equalize=False)
mesh_join_2 = MeshJoin(Meshes=mesh_surface_2)
deconstruct_mesh_2 = DeconstructMesh(Mesh=mesh_join_2)  # -> Vertices, Faces, Colours, Normals
deconstruct_5 = Deconstruct(Point=deconstruct_mesh_2.Vertices)  # -> XComponent, YComponent, ZComponent
round_2 = Round(Number=deconstruct_5.YComponent)  # -> Nearest, Floor, Ceiling
construct_point_2 = ConstructPoint(XCoordinate=deconstruct_5.XComponent, YCoordinate=data, ZCoordinate=deconstruct_5.ZComponent)
bounds_2 = Bounds(Numbers=round_2.Nearest)

# ----
# List Generation
list_length_3 = ListLength(List=mersh_vectors)
duplicate_data = DuplicateData(Data="0,0,0", Number=list_length_3, Order=True)
duplicate_data_2 = DuplicateData(Data="0", Number=list_length_3, Order=True)

deconstruct_6 = Deconstruct(Point=deconstruct_mesh_2.Vertices)  # -> XComponent, YComponent, ZComponent
construct_point_3 = ConstructPoint(XCoordinate=0, YCoordinate=0, ZCoordinate=0)
control_wire_display = ControlWireDisplay(WireDisplay="1")

mesh_surface_3 = MeshSurface(Surface=flatten(skin_typology_srf), UCount=list_length, VCount=list_length_2, Overhang=True, Equalize=False)
mesh_join_3 = MeshJoin(Meshes=mesh_surface_3)
deconstruct_mesh_3 = DeconstructMesh(Mesh=mesh_join_3)  # -> Vertices, Faces, Colours, Normals

deconstruct_7 = Deconstruct(Point=deconstruct_mesh_3.Vertices)  # -> XComponent, YComponent, ZComponent

round_3 = Round(Number=deconstruct_7.YComponent)  # -> Nearest, Floor, Ceiling
bounds_3 = Bounds(Numbers=deconstruct_7.YComponent)

panel = Panel(deconstruct_7.YComponent)
construct_point_4 = ConstructPoint(XCoordinate=deconstruct_7.XComponent, YCoordinate=data, ZCoordinate=deconstruct_7.ZComponent)
panel_2 = Panel(round_3.Nearest)
faces = ClusterOutput(deconstruct_mesh_3.Faces)

remap_numbers = RemapNumbers(Value=deconstruct_4.YComponent, Source=bounds, Target=b_color_domain)  # -> Mapped, Clipped
create_rtree = CreateRTree(InputGeometry=flatten(mersh_vectors))
rtree_closest_point = RTreeClosestPoint(SearchPoints=flatten(construct_point), RTree=create_rtree)  # -> ClosestPoint, ClosestIndex

round_4 = Round(Number=remap_numbers.Mapped)  # -> Nearest, Floor, Ceiling

concatenate = Concatenate(FragmentB="0,0", FragmentA=round_4.Nearest, JoinSeparator=",")

# ----
# B channel Image
replace_items = ReplaceItems(List=duplicate_data, Item=concatenate, Indices=rtree_closest_point.ClosestIndex, Wrap=False)

# ----
# Only B values
replace_items_2 = ReplaceItems(List=duplicate_data_2, Item=round_4.Nearest, Indices=rtree_closest_point.ClosestIndex, Wrap=False)

# ----
# Blue Channel
b_channel_values = ClusterOutput(replace_items_2)
b_channel_image = ClusterOutput(replace_items)

remap_numbers_2 = RemapNumbers(Value=deconstruct_5.YComponent, Source=bounds_2, Target=r_color_domain)  # -> Mapped, Clipped
create_rtree_2 = CreateRTree(InputGeometry=flatten(mersh_vectors))
rtree_closest_point_2 = RTreeClosestPoint(SearchPoints=flatten(construct_point_2), RTree=create_rtree_2)  # -> ClosestPoint, ClosestIndex

round_5 = Round(Number=remap_numbers_2.Mapped)  # -> Nearest, Floor, Ceiling

concatenate_2 = Concatenate(FragmentB=round_5.Nearest, FragmentA="0,0", JoinSeparator=",")

# ----
# R channel Image
replace_items_3 = ReplaceItems(List=duplicate_data, Item=concatenate_2, Indices=rtree_closest_point_2.ClosestIndex, Wrap=False)

# ----
# Only R values
replace_items_4 = ReplaceItems(List=duplicate_data_2, Item=round_5.Nearest, Indices=rtree_closest_point_2.ClosestIndex, Wrap=False)

# ----
# Red Channel
r_channel_values = ClusterOutput(replace_items_4)
r_channel_image = ClusterOutput(replace_items_3)

remap_numbers_3 = RemapNumbers(Value=deconstruct_7.YComponent, Source=bounds_3, Target=g_color_domain)  # -> Mapped, Clipped
create_rtree_3 = CreateRTree(InputGeometry=flatten(mersh_vectors))
rtree_closest_point_3 = RTreeClosestPoint(SearchPoints=flatten(construct_point_4), RTree=create_rtree_3)  # -> ClosestPoint, ClosestIndex

round_6 = Round(Number=remap_numbers_3.Mapped)  # -> Nearest, Floor, Ceiling

concatenate_3 = Concatenate(Fragment_B="0", A=round_6.Nearest, B="0", JoinSeparator=",")

# ----
# G channel Image
replace_items_5 = ReplaceItems(List=duplicate_data, Item=concatenate_3, Indices=rtree_closest_point_3.ClosestIndex, Wrap=False)

# ----
# Only G values
replace_items_6 = ReplaceItems(List=duplicate_data_2, Item=round_6.Nearest, Indices=rtree_closest_point_3.ClosestIndex, Wrap=False)

# ----
# Green Channel
g_channel_image = ClusterOutput(replace_items_5)
g_channel_values = ClusterOutput(replace_items_6)

concatenate_4 = Concatenate(R=replace_items_4, G=replace_items_6, B=replace_items_2, JoinSeparator=",")
encoded_image = ClusterOutput(concatenate_4)

# ==== cluster EncodedImageV3_2
mersh_vectors = ClusterInput()
dist_facade_skin = ClusterInput()
max_heigth_room_z = ClusterInput()
max_width_x = ClusterInput()

# ----
# Filter Points
deconstruct = Deconstruct(Point=mersh_vectors)  # -> XComponent, YComponent, ZComponent
smaller_than = SmallerThan(FirstNumber=deconstruct.YComponent, SecondNumber=max_width_x)  # -> SmallerThan, OrEqualTo
larger_than = LargerThan(FirstNumber=deconstruct.ZComponent, SecondNumber="0")  # -> LargerThan, OrEqualTo
smaller_than_2 = SmallerThan(FirstNumber=deconstruct.ZComponent, SecondNumber=max_heigth_room_z)  # -> SmallerThan, OrEqualTo
larger_than_2 = LargerThan(FirstNumber=deconstruct.YComponent, SecondNumber="0")  # -> LargerThan, OrEqualTo
gate_and = GateAnd(A=larger_than.OrEqualTo, B=smaller_than_2.OrEqualTo, C=larger_than_2.OrEqualTo, D=smaller_than.OrEqualTo)
cull_pattern = CullPattern(List=mersh_vectors, CullPattern=gate_and)

facade_window_srf = ClusterInput()
r_color_domain = ClusterInput()
skin_typology_srf = ClusterInput()
g_color_domain = ClusterInput()
back_room_wall_srf = ClusterInput()
b_color_domain = ClusterInput()

deconstruct_2 = Deconstruct(Point=cull_pattern)  # -> XComponent, YComponent, ZComponent
equality = Equality(FirstNumber=deconstruct_2.ZComponent, SecondNumber="0")  # -> Equality, Inequality
cull_pattern_2 = CullPattern(List=cull_pattern, CullPattern=equality.Equality)
list_length = ListLength(List=cull_pattern_2)

deconstruct_3 = Deconstruct(Point=cull_pattern)  # -> XComponent, YComponent, ZComponent
equality_2 = Equality(FirstNumber=deconstruct_3.YComponent, SecondNumber="0")  # -> Equality, Inequality
cull_pattern_3 = CullPattern(List=cull_pattern, CullPattern=equality_2.Equality)
list_length_2 = ListLength(List=cull_pattern_3)

data = Data(dist_facade_skin)

mesh_surface = MeshSurface(Surface=back_room_wall_srf, UCount=list_length, VCount=list_length_2, Overhang=True, Equalize=False)
mesh_join = MeshJoin(Meshes=mesh_surface)
deconstruct_mesh = DeconstructMesh(Mesh=mesh_join)  # -> Vertices, Faces, Colours, Normals
deconstruct_4 = Deconstruct(Point=deconstruct_mesh.Vertices)  # -> XComponent, YComponent, ZComponent
round = Round(Number=deconstruct_4.YComponent)  # -> Nearest, Floor, Ceiling
construct_point = ConstructPoint(XCoordinate=deconstruct_4.XComponent, YCoordinate=data, ZCoordinate=deconstruct_4.ZComponent)
bounds = Bounds(Numbers=round.Nearest)

# ----
# List Generation
list_length_3 = ListLength(List=mersh_vectors)
duplicate_data = DuplicateData(Data="0,0,0", Number=list_length_3, Order=True)
duplicate_data_2 = DuplicateData(Data="0", Number=list_length_3, Order=True)

control_wire_display = ControlWireDisplay(WireDisplay="1")

mesh_surface_2 = MeshSurface(Surface=flatten(skin_typology_srf), UCount=list_length_2, VCount=list_length, Overhang=True, Equalize=False)
mesh_join_2 = MeshJoin(Meshes=mesh_surface_2)
deconstruct_mesh_2 = DeconstructMesh(Mesh=mesh_join_2)  # -> Vertices, Faces, Colours, Normals

deconstruct_5 = Deconstruct(Point=deconstruct_mesh_2.Vertices)  # -> XComponent, YComponent, ZComponent

round_2 = Round(Number=deconstruct_5.XComponent)  # -> Nearest, Floor, Ceiling
bounds_2 = Bounds(Numbers=deconstruct_5.XComponent)

panel = Panel(deconstruct_5.XComponent)
construct_point_2 = ConstructPoint(XCoordinate=data, YCoordinate=deconstruct_5.YComponent, ZCoordinate=deconstruct_5.ZComponent)
panel_2 = Panel(round_2.Nearest)
faces = ClusterOutput(deconstruct_mesh_2.Faces)

mesh_surface_3 = MeshSurface(Surface=facade_window_srf, UCount=list_length, VCount=list_length_2, Overhang=True, Equalize=False)
mesh_join_3 = MeshJoin(Meshes=mesh_surface_3)
deconstruct_mesh_3 = DeconstructMesh(Mesh=mesh_join_3)  # -> Vertices, Faces, Colours, Normals
deconstruct_6 = Deconstruct(Point=deconstruct_mesh_3.Vertices)  # -> XComponent, YComponent, ZComponent
construct_point_3 = ConstructPoint(XCoordinate=0, YCoordinate=0, ZCoordinate=0)

deconstruct_7 = Deconstruct(Point=deconstruct_mesh_3.Vertices)  # -> XComponent, YComponent, ZComponent

round_3 = Round(Number=deconstruct_7.XComponent)  # -> Nearest, Floor, Ceiling
bounds_3 = Bounds(Numbers=round_3.Nearest)

construct_point_4 = ConstructPoint(XCoordinate=data, YCoordinate=deconstruct_7.YComponent, ZCoordinate=deconstruct_7.ZComponent)

remap_numbers = RemapNumbers(Value=deconstruct_4.YComponent, Source=bounds, Target=b_color_domain)  # -> Mapped, Clipped
create_rtree = CreateRTree(InputGeometry=flatten(mersh_vectors))
rtree_closest_point = RTreeClosestPoint(SearchPoints=flatten(construct_point), RTree=create_rtree)  # -> ClosestPoint, ClosestIndex

round_4 = Round(Number=remap_numbers.Mapped)  # -> Nearest, Floor, Ceiling

concatenate = Concatenate(FragmentB="0,0", FragmentA=round_4.Nearest, JoinSeparator=",")

# ----
# B channel Image
replace_items = ReplaceItems(List=duplicate_data, Item=concatenate, Indices=rtree_closest_point.ClosestIndex, Wrap=False)

# ----
# Only B values
replace_items_2 = ReplaceItems(List=duplicate_data_2, Item=round_4.Nearest, Indices=rtree_closest_point.ClosestIndex, Wrap=False)

# ----
# Blue Channel
b_channel_values = ClusterOutput(replace_items_2)
b_channel_image = ClusterOutput(replace_items)

remap_numbers_2 = RemapNumbers(Value=deconstruct_7.XComponent, Source=bounds_3, Target=r_color_domain)  # -> Mapped, Clipped
create_rtree_2 = CreateRTree(InputGeometry=flatten(mersh_vectors))
rtree_closest_point_2 = RTreeClosestPoint(SearchPoints=flatten(construct_point_4), RTree=create_rtree_2)  # -> ClosestPoint, ClosestIndex

round_5 = Round(Number=remap_numbers_2.Mapped)  # -> Nearest, Floor, Ceiling

concatenate_2 = Concatenate(FragmentB=round_5.Nearest, FragmentA="0,0", JoinSeparator=",")

# ----
# R channel Image
replace_items_3 = ReplaceItems(List=duplicate_data, Item=concatenate_2, Indices=rtree_closest_point_2.ClosestIndex, Wrap=False)

# ----
# Only R values
replace_items_4 = ReplaceItems(List=duplicate_data_2, Item=round_5.Nearest, Indices=rtree_closest_point_2.ClosestIndex, Wrap=False)

# ----
# Red Channel
r_channel_values = ClusterOutput(replace_items_4)
r_channel_image = ClusterOutput(replace_items_3)

remap_numbers_3 = RemapNumbers(Value=deconstruct_5.XComponent, Source=bounds_2, Target=g_color_domain)  # -> Mapped, Clipped
create_rtree_3 = CreateRTree(InputGeometry=flatten(mersh_vectors))
rtree_closest_point_3 = RTreeClosestPoint(SearchPoints=flatten(construct_point_2), RTree=create_rtree_3)  # -> ClosestPoint, ClosestIndex

round_6 = Round(Number=remap_numbers_3.Mapped)  # -> Nearest, Floor, Ceiling

concatenate_3 = Concatenate(Fragment_B="0", A=round_6.Nearest, B="0", JoinSeparator=",")

# ----
# G channel Image
replace_items_5 = ReplaceItems(List=duplicate_data, Item=concatenate_3, Indices=rtree_closest_point_3.ClosestIndex, Wrap=False)

# ----
# Only G values
replace_items_6 = ReplaceItems(List=duplicate_data_2, Item=round_6.Nearest, Indices=rtree_closest_point_3.ClosestIndex, Wrap=False)

# ----
# Green Channel
g_channel_image = ClusterOutput(replace_items_5)
g_channel_values = ClusterOutput(replace_items_6)

concatenate_4 = Concatenate(R=replace_items_4, G=replace_items_6, B=replace_items_2, JoinSeparator=",")
encoded_image = ClusterOutput(concatenate_4)

# ==== cluster EncodedImageV3_3
mersh_vectors = ClusterInput()
dist_facade_skin = ClusterInput()
max_heigth_room_z = ClusterInput()
max_width_x = ClusterInput()

# ----
# Filter Points
deconstruct = Deconstruct(Point=mersh_vectors)  # -> XComponent, YComponent, ZComponent
smaller_than = SmallerThan(FirstNumber=deconstruct.YComponent, SecondNumber=max_width_x)  # -> SmallerThan, OrEqualTo
larger_than = LargerThan(FirstNumber=deconstruct.ZComponent, SecondNumber="0")  # -> LargerThan, OrEqualTo
smaller_than_2 = SmallerThan(FirstNumber=deconstruct.ZComponent, SecondNumber=max_heigth_room_z)  # -> SmallerThan, OrEqualTo
larger_than_2 = LargerThan(FirstNumber=deconstruct.YComponent, SecondNumber="0")  # -> LargerThan, OrEqualTo
gate_and = GateAnd(A=larger_than.OrEqualTo, B=smaller_than_2.OrEqualTo, C=larger_than_2.OrEqualTo, D=smaller_than.OrEqualTo)
cull_pattern = CullPattern(List=mersh_vectors, CullPattern=gate_and)

facade_window_srf = ClusterInput()
r_color_domain = ClusterInput()
skin_typology_srf = ClusterInput()
g_color_domain = ClusterInput()
back_room_wall_srf = ClusterInput()
b_color_domain = ClusterInput()

deconstruct_2 = Deconstruct(Point=cull_pattern)  # -> XComponent, YComponent, ZComponent
equality = Equality(FirstNumber=deconstruct_2.ZComponent, SecondNumber="0")  # -> Equality, Inequality
cull_pattern_2 = CullPattern(List=cull_pattern, CullPattern=equality.Equality)
list_length = ListLength(List=cull_pattern_2)

deconstruct_3 = Deconstruct(Point=cull_pattern)  # -> XComponent, YComponent, ZComponent
equality_2 = Equality(FirstNumber=deconstruct_3.YComponent, SecondNumber="0")  # -> Equality, Inequality
cull_pattern_3 = CullPattern(List=cull_pattern, CullPattern=equality_2.Equality)
list_length_2 = ListLength(List=cull_pattern_3)

data = Data(dist_facade_skin)

# ----
# List Generation
list_length_3 = ListLength(List=mersh_vectors)
duplicate_data = DuplicateData(Data="0,0,0", Number=list_length_3, Order=True)
duplicate_data_2 = DuplicateData(Data="0", Number=list_length_3, Order=True)

control_wire_display = ControlWireDisplay(WireDisplay="1")

mesh_surface = MeshSurface(Surface=flatten(skin_typology_srf), UCount=list_length, VCount=list_length_2, Overhang=True, Equalize=False)
mesh_join = MeshJoin(Meshes=mesh_surface)
deconstruct_mesh = DeconstructMesh(Mesh=mesh_join)  # -> Vertices, Faces, Colours, Normals

deconstruct_4 = Deconstruct(Point=deconstruct_mesh.Vertices)  # -> XComponent, YComponent, ZComponent

round = Round(Number=deconstruct_4.XComponent)  # -> Nearest, Floor, Ceiling
bounds = Bounds(Numbers=deconstruct_4.XComponent)

panel = Panel(deconstruct_4.XComponent)
construct_point = ConstructPoint(XCoordinate=data, YCoordinate=deconstruct_4.YComponent, ZCoordinate=deconstruct_4.ZComponent)
panel_2 = Panel(round.Nearest)
faces = ClusterOutput(deconstruct_mesh.Faces)

mesh_surface_2 = MeshSurface(Surface=back_room_wall_srf, UCount=list_length, VCount=list_length_2, Overhang=True, Equalize=False)
mesh_join_2 = MeshJoin(Meshes=mesh_surface_2)
deconstruct_mesh_2 = DeconstructMesh(Mesh=mesh_join_2)  # -> Vertices, Faces, Colours, Normals
deconstruct_5 = Deconstruct(Point=deconstruct_mesh_2.Vertices)  # -> XComponent, YComponent, ZComponent
construct_point_2 = ConstructPoint(XCoordinate=0, YCoordinate=0, ZCoordinate=0)

deconstruct_6 = Deconstruct(Point=deconstruct_mesh_2.Vertices)  # -> XComponent, YComponent, ZComponent

round_2 = Round(Number=deconstruct_6.XComponent)  # -> Nearest, Floor, Ceiling
bounds_2 = Bounds(Numbers=round_2.Nearest)

construct_point_3 = ConstructPoint(XCoordinate=data, YCoordinate=deconstruct_6.YComponent, ZCoordinate=deconstruct_6.ZComponent)

mesh_surface_3 = MeshSurface(Surface=facade_window_srf, UCount=list_length, VCount=list_length_2, Overhang=True, Equalize=False)
mesh_join_3 = MeshJoin(Meshes=mesh_surface_3)
deconstruct_mesh_3 = DeconstructMesh(Mesh=mesh_join_3)  # -> Vertices, Faces, Colours, Normals
deconstruct_7 = Deconstruct(Point=deconstruct_mesh_3.Vertices)  # -> XComponent, YComponent, ZComponent
construct_point_4 = ConstructPoint(XCoordinate=0, YCoordinate=0, ZCoordinate=0)

deconstruct_8 = Deconstruct(Point=deconstruct_mesh_3.Vertices)  # -> XComponent, YComponent, ZComponent

round_3 = Round(Number=deconstruct_8.XComponent)  # -> Nearest, Floor, Ceiling
bounds_3 = Bounds(Numbers=round_3.Nearest)

construct_point_5 = ConstructPoint(XCoordinate=data, YCoordinate=deconstruct_8.YComponent, ZCoordinate=deconstruct_8.ZComponent)

remap_numbers = RemapNumbers(Value=deconstruct_6.XComponent, Source=bounds_2, Target=b_color_domain)  # -> Mapped, Clipped
create_rtree = CreateRTree(InputGeometry=flatten(mersh_vectors))
rtree_closest_point = RTreeClosestPoint(SearchPoints=flatten(construct_point_3), RTree=create_rtree)  # -> ClosestPoint, ClosestIndex

round_4 = Round(Number=remap_numbers.Mapped)  # -> Nearest, Floor, Ceiling

concatenate = Concatenate(FragmentB="0,0", FragmentA=round_4.Nearest, JoinSeparator=",")

# ----
# B channel Image
replace_items = ReplaceItems(List=duplicate_data, Item=concatenate, Indices=rtree_closest_point.ClosestIndex, Wrap=False)

# ----
# Only B values
replace_items_2 = ReplaceItems(List=duplicate_data_2, Item=round_4.Nearest, Indices=rtree_closest_point.ClosestIndex, Wrap=False)

# ----
# Blue Channel
b_channel_values = ClusterOutput(replace_items_2)
b_channel_image = ClusterOutput(replace_items)

remap_numbers_2 = RemapNumbers(Value=deconstruct_8.XComponent, Source=bounds_3, Target=r_color_domain)  # -> Mapped, Clipped
create_rtree_2 = CreateRTree(InputGeometry=flatten(mersh_vectors))
rtree_closest_point_2 = RTreeClosestPoint(SearchPoints=flatten(construct_point_5), RTree=create_rtree_2)  # -> ClosestPoint, ClosestIndex

round_5 = Round(Number=remap_numbers_2.Mapped)  # -> Nearest, Floor, Ceiling

concatenate_2 = Concatenate(FragmentB=round_5.Nearest, FragmentA="0,0", JoinSeparator=",")

# ----
# R channel Image
replace_items_3 = ReplaceItems(List=duplicate_data, Item=concatenate_2, Indices=rtree_closest_point_2.ClosestIndex, Wrap=False)

# ----
# Only R values
replace_items_4 = ReplaceItems(List=duplicate_data_2, Item=round_5.Nearest, Indices=rtree_closest_point_2.ClosestIndex, Wrap=False)

# ----
# Red Channel
r_channel_values = ClusterOutput(replace_items_4)
r_channel_image = ClusterOutput(replace_items_3)

remap_numbers_3 = RemapNumbers(Value=deconstruct_4.XComponent, Source=bounds, Target=g_color_domain)  # -> Mapped, Clipped
create_rtree_3 = CreateRTree(InputGeometry=flatten(mersh_vectors))
rtree_closest_point_3 = RTreeClosestPoint(SearchPoints=flatten(construct_point), RTree=create_rtree_3)  # -> ClosestPoint, ClosestIndex

round_6 = Round(Number=remap_numbers_3.Mapped)  # -> Nearest, Floor, Ceiling

concatenate_3 = Concatenate(Fragment_B="0", A=round_6.Nearest, B="0", JoinSeparator=",")

# ----
# G channel Image
replace_items_5 = ReplaceItems(List=duplicate_data, Item=concatenate_3, Indices=rtree_closest_point_3.ClosestIndex, Wrap=False)

# ----
# Only G values
replace_items_6 = ReplaceItems(List=duplicate_data_2, Item=round_6.Nearest, Indices=rtree_closest_point_3.ClosestIndex, Wrap=False)

# ----
# Green Channel
g_channel_image = ClusterOutput(replace_items_5)
g_channel_values = ClusterOutput(replace_items_6)

concatenate_4 = Concatenate(R=replace_items_4, G=replace_items_6, B=replace_items_2, JoinSeparator=",")
encoded_image = ClusterOutput(concatenate_4)

# ==== cluster Cluster
S = ClusterInput()
U = ClusterInput()
V = ClusterInput()
sframes = SurfaceFrames(Surface=S, UCount=U, VCount=V)  # -> Frames, Parameters
B = ClusterInput()
panel = Panel("""0
-1""")
division = Division(A=2.8, B=B)
cull_i = CullIndex(List=sframes.Frames, Indices=panel, Wrap=True)
cull_i_2 = CullIndex(List=flatten(cull_i), Indices=panel, Wrap=True)  # -> flatten(List)
panel_2 = Panel("""0
1""")
cull = CullPattern(List=cull_i_2, CullPattern=panel_2)
S_2 = ClusterInput()
cir = Circle(Plane=cull, Radius=division)
srfsplit = SurfaceSplit(Surface=S_2, Curves=cir)
# Skin
srf_sl = SrfSmallLarge(srf_list=srfsplit)  # -> smallest, largest
sm = ClusterOutput(srf_sl.smallest)
lg = ClusterOutput(srf_sl.largest)

# ==== cluster SrfSmallLarge
srf_list = ClusterInput()
edges = BrepEdges(Brep=srf_list)  # -> Naked, Interior, NonManifold
len = Length(Curve=edges.Naked)
ma = MassAddition(Input=len)  # -> Result, PartialResults
pshift = ShiftPaths(Data=ma.Result, Offset=-1)
sort = SortList(Keys=pshift, ValuesA=srf_list)  # -> Keys, ValuesA
item = ListItem(List=reverse(sort.ValuesA), Index=0, Wrap=True)
cull_index = CullIndex(List=sort.ValuesA, Indices="-1", Wrap=True)
largest = ClusterOutput(item)
smallest = ClusterOutput(cull_index)
