# Grasshopper definition Encoding images Dataset_1.gh (Grasshopper 1.0.7)
# Copyright: 2017
# plug-ins: LunchBoxML, MetaHopper, Wallacei

# ----
# List Generation
# Red Channel
# R channel Image
# Only R values
# Filter Points
# G channel Image
# Green Channel
# Only G values
# Blue Channel
# B channel Image
# Only B values
mersh_vectors = MershVectors()
dist_facade_skin = DistFacadeSkin()
max_heigth_room_z = MaxHeigthRoomZ()
max_width_x = MaxWidthX()
facade_window_srf = FacadeWindowSrf()
r_color_domain = RColorDomain()
skin_typology_srf = SkinTypologySrf()
g_color_domain = GColorDomain()
back_room_wall_srf = BackRoomWallSrf()
b_color_domain = BColorDomain()
deconstruct = Deconstruct(Point=mersh_vectors)  # -> XComponent, YComponent, ZComponent
smaller_than = SmallerThan(FirstNumber=deconstruct.XComponent, SecondNumber=max_width_x)  # -> SmallerThan, OrEqualTo
larger_than = LargerThan(FirstNumber=deconstruct.ZComponent, SecondNumber="0")  # -> LargerThan, OrEqualTo
smaller_than_2 = SmallerThan(FirstNumber=deconstruct.ZComponent, SecondNumber=max_heigth_room_z)  # -> SmallerThan, OrEqualTo
larger_than_2 = LargerThan(FirstNumber=deconstruct.XComponent, SecondNumber="0")  # -> LargerThan, OrEqualTo
gate_and = GateAnd(A=larger_than.OrEqualTo, B=smaller_than_2.OrEqualTo, C=larger_than_2.OrEqualTo, D=smaller_than.OrEqualTo)
cull_pattern = CullPattern(List=mersh_vectors, CullPattern=gate_and)
deconstruct_2 = Deconstruct(Point=cull_pattern)  # -> XComponent, YComponent, ZComponent
deconstruct_3 = Deconstruct(Point=cull_pattern)  # -> XComponent, YComponent, ZComponent
equality = Equality(FirstNumber=deconstruct_2.ZComponent, SecondNumber="0")  # -> Equality, Inequality
equality_2 = Equality(FirstNumber=deconstruct_3.XComponent, SecondNumber="0")  # -> Equality, Inequality
cull_pattern_2 = CullPattern(List=cull_pattern, CullPattern=equality.Equality)
cull_pattern_3 = CullPattern(List=cull_pattern, CullPattern=equality_2.Equality)
list_length = ListLength(List=cull_pattern_2)
list_length_2 = ListLength(List=cull_pattern_3)
data = Data(dist_facade_skin)
mesh_surface = MeshSurface(Surface=back_room_wall_srf, UCount=list_length, VCount=list_length_2, Overhang=True, Equalize=False)
mesh_surface_2 = MeshSurface(Surface=skin_typology_srf, UCount=list_length, VCount=list_length_2, Overhang=True, Equalize=False)
mesh_surface_3 = MeshSurface(Surface=facade_window_srf, UCount=list_length, VCount=list_length_2, Overhang=True, Equalize=False)
list_length_3 = ListLength(List=mersh_vectors)
mesh_join = MeshJoin(Meshes=mesh_surface_2)
mesh_join_2 = MeshJoin(Meshes=mesh_surface)
mesh_join_3 = MeshJoin(Meshes=mesh_surface_3)
deconstruct_mesh = DeconstructMesh(Mesh=mesh_join)  # -> Vertices, Faces, Colours, Normals
deconstruct_mesh_2 = DeconstructMesh(Mesh=mesh_join_2)  # -> Vertices, Faces, Colours, Normals
deconstruct_mesh_3 = DeconstructMesh(Mesh=mesh_join_3)  # -> Vertices, Faces, Colours, Normals
deconstruct_4 = Deconstruct(Point=deconstruct_mesh.Vertices)  # -> XComponent, YComponent, ZComponent
deconstruct_5 = Deconstruct(Point=deconstruct_mesh_2.Vertices)  # -> XComponent, YComponent, ZComponent
duplicate_data = DuplicateData(Data="0,0,0", Number=list_length_3, Order=True)
duplicate_data_2 = DuplicateData(Data="0", Number=list_length_3, Order=True)
deconstruct_6 = Deconstruct(Point=deconstruct_mesh_3.Vertices)  # -> XComponent, YComponent, ZComponent
round = Round(Number=deconstruct_4.YComponent)  # -> Nearest, Floor, Ceiling
round_2 = Round(Number=deconstruct_5.YComponent)  # -> Nearest, Floor, Ceiling
round_3 = Round(Number=deconstruct_6.YComponent)  # -> Nearest, Floor, Ceiling
bounds = Bounds(Numbers=round.Nearest)
construct_point = ConstructPoint(XCoordinate=deconstruct_4.XComponent, YCoordinate=data, ZCoordinate=deconstruct_4.ZComponent)
construct_point_2 = ConstructPoint(XCoordinate=deconstruct_6.XComponent, YCoordinate=data, ZCoordinate=deconstruct_6.ZComponent)
construct_point_3 = ConstructPoint(XCoordinate=deconstruct_5.XComponent, YCoordinate=data, ZCoordinate=deconstruct_5.ZComponent)
bounds_2 = Bounds(Numbers=round_2.Nearest)
bounds_3 = Bounds(Numbers=round_3.Nearest)
control_wire_display = ControlWireDisplay(WireDisplay="1")
remap_numbers = RemapNumbers(Value=deconstruct_4.YComponent, Source=bounds, Target=g_color_domain)  # -> Mapped, Clipped
remap_numbers_2 = RemapNumbers(Value=deconstruct_5.YComponent, Source=bounds_2, Target=b_color_domain)  # -> Mapped, Clipped
remap_numbers_3 = RemapNumbers(Value=deconstruct_6.YComponent, Source=bounds_3, Target=r_color_domain)  # -> Mapped, Clipped
round_4 = Round(Number=remap_numbers.Mapped)  # -> Nearest, Floor, Ceiling
round_5 = Round(Number=remap_numbers_3.Mapped)  # -> Nearest, Floor, Ceiling
round_6 = Round(Number=remap_numbers_2.Mapped)  # -> Nearest, Floor, Ceiling
create_rtree = CreateRTree(InputGeometry=flatten(mersh_vectors))
create_rtree_2 = CreateRTree(InputGeometry=flatten(mersh_vectors))
concatenate = Concatenate(Fragment_B="0", A=round_4.Nearest, B="0", JoinSeparator=",")
create_rtree_3 = CreateRTree(InputGeometry=flatten(mersh_vectors))
concatenate_2 = Concatenate(FragmentB=round_5.Nearest, FragmentA="0,0", JoinSeparator=",")
concatenate_3 = Concatenate(FragmentB="0,0", FragmentA=round_6.Nearest, JoinSeparator=",")
rtree_closest_point = RTreeClosestPoint(SearchPoints=flatten(construct_point_2), RTree=create_rtree)  # -> ClosestPoint, ClosestIndex
rtree_closest_point_2 = RTreeClosestPoint(SearchPoints=flatten(construct_point), RTree=create_rtree_2)  # -> ClosestPoint, ClosestIndex
rtree_closest_point_3 = RTreeClosestPoint(SearchPoints=flatten(construct_point_3), RTree=create_rtree_3)  # -> ClosestPoint, ClosestIndex
replace_items = ReplaceItems(List=duplicate_data, Item=concatenate_2, Indices=rtree_closest_point.ClosestIndex, Wrap=False)
replace_items_2 = ReplaceItems(List=duplicate_data_2, Item=round_5.Nearest, Indices=rtree_closest_point.ClosestIndex, Wrap=False)
replace_items_3 = ReplaceItems(List=duplicate_data, Item=concatenate, Indices=rtree_closest_point_2.ClosestIndex, Wrap=False)
replace_items_4 = ReplaceItems(List=duplicate_data_2, Item=round_4.Nearest, Indices=rtree_closest_point_2.ClosestIndex, Wrap=False)
replace_items_5 = ReplaceItems(List=duplicate_data, Item=concatenate_3, Indices=rtree_closest_point_3.ClosestIndex, Wrap=False)
replace_items_6 = ReplaceItems(List=duplicate_data_2, Item=remap_numbers_2.Mapped, Indices=rtree_closest_point_3.ClosestIndex, Wrap=False)
g_channel_values = GChannelValues(replace_items_4)
r_channel_values = RChannelValues(replace_items_2)
g_channel_image = GChannelImage(replace_items_3)
r_channel_image = RChannelImage(replace_items)
b_channel_values = BChannelValues(replace_items_6)
b_channel_image = BChannelImage(replace_items_5)
concatenate_4 = Concatenate(R=replace_items_2, G=replace_items_4, B=replace_items_6, JoinSeparator=",")
encoded_image = EncodedImage(concatenate_4)

ratio_to_the_elevation = Slider(0.8, range=0.1..1.1)
window_height = Slider(0.9, range=0.5..2)
horizontal_spacing_between = Slider(0.5, range=0..2)
sill_height = Slider(1.3, range=0.5..2)

# ----
# Room
# Inputs: Room
number_slider = Slider(6, range=3..8)
number_slider_2 = Slider(6, range=3..8)
number_slider_3 = Slider(7, range=3..8)

skin_location = Slider(0.2, range=0..2)

skin_typology = ValueList({"Skin Typology 1": 0, "Skin Typology 2": 1, "Skin Typology 3": 2}, selected="Skin Typology 2")

# ----
# Clusters
encoded_image_v_1 = EncodedImageV1()  # -> output_b_channel, list_of_red_values, list_of_green_values, list_of_blue_values; disabled
encoded_image_v_2 = EncodedImageV2()  # -> colored_mesh, red_values, green_values, blue_values; disabled
encoded_image_v_3 = EncodedImageV3(
    max_heigth_room_z=0,
    max_width_x=0,
    r_color_domain=Domain(0, 1),
    g_color_domain=Domain(0, 1),
    b_color_domain=Domain(0, 1))  # -> encoded_image, r_channel_image, r_channel_values, g_channel_image, g_channel_values, b_channel_image, b_channel_values; disabled

skin_resolution = Slider(35, range=0..100)
value_list = ValueList({"Red Channel": 0, "Green Channel": 1, "Blue Channel": 2}, selected="Red Channel")

# ----
# Room
hb_building_programs = HBBuildingPrograms({"LargeOffice", "MediumOffice", "SmallOffice", "MidriseApartment", "HighriseApartment", "Retail", "StripMall", "PrimarySchool", "SecondarySchool", "SmallHotel", "LargeHotel", "Hospital", "Outpatient", "Laboratory", "Warehouse", "SuperMarket", "FullServiceRestaurant", "QuickServiceRestaurant", "Courthouse", "LargeDataCenterHighITE", "LargeDataCenterLowITE", "SmallDataCenterHighITE", "SmallDataCenterLowITE"}, selected="LargeOffice")
domain_box = DomainBox(Base=PlaneXY(0, 0, 0), X=number_slider, Y=number_slider_2, Z=number_slider_3)
deconstruct_brep = DeconstructBrep(Brep=domain_box)  # -> Faces, Edges, Vertices
roomsolid = HBRoomFromSolid(geo=flatten(domain_box), program=hb_building_programs, conditioned=True)  # -> out, rooms; plug-in component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

# ----
# Opening Parameters
vertical_spacing_between = Slider(0, range=0..10)

# ----
# Windows
facparam = HBFacadeParameters(north=0, east=0, south=ratio_to_the_elevation, west=0)  # -> fac_par; plug-in component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
aperturesbyratio = HBAperturesByRatio(
    hb_objs=flatten(roomsolid.rooms),
    ratio=facparam,
    subdivide=Slider(3, range=0..10),
    win_height=window_height,
    sill_height=sill_height,
    horiz_separ=horizontal_spacing_between,
    vert_separ=vertical_spacing_between)  # -> out, hb_objs; plug-in component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

# ----
# Parameters
step = Slider(37, range=3..100)  # disabled
horizontal_depth_max = Slider(0.5, range=0.5..2)  # disabled
panel_depth = Slider(0.095, range=0..1)  # disabled
number_slider_4 = Slider(3, range=0..10)  # disabled

# ----
# Facade as a shader
number_slider_5 = Slider(0, range=0..5)
list_item = ListItem(List=deconstruct_brep.Faces, Index=number_slider_5, Wrap=True)

front_face_of_room = Geometry(list_item)

# ----
# Normal Vector
unit_y = UnitY(Factor=expr("-x", 1))
# ROOM
area = Area(Geometry=front_face_of_room)  # -> Area, Centroid
plane_normal = PlaneNormal(Origin=Point(0, 0, 0), ZAxis=unit_y)
deconstruct_plane = DeconstructPlane(Plane=plane_normal)  # -> Origin, XAxis, YAxis, ZAxis

# ----
# Push Skin from Facade
amplitude = Amplitude(Vector=deconstruct_plane.ZAxis, Amplitude=skin_location)
move = Move(Geometry=front_face_of_room, Motion=amplitude)  # -> Geometry, Transform

# ----
# Skins Typologies
# Inputs: Skins
location_of_skin = Geometry(move.Geometry)
normal_direction_of_facade = Vector(amplitude)

# ----
# Skin Typology 3: Horizontal
no_of_panels = Slider(12, range=1..20)  # disabled
horizontal_depth_min = Slider(0.248, range=0..1)  # disabled
cluster = Cluster(
    facade=location_of_skin,
    no_of_panels=no_of_panels,
    steps=step,
    hoz_depth_min=horizontal_depth_min,
    hoz_depth_max=horizontal_depth_max,
    panel_depth=panel_depth,
    normal_direction=normal_direction_of_facade,
    choose_face=number_slider_4)  # disabled

# ----
# Parameters
number_slider_6 = Slider(20, range=2..22)

# ----
# Parameters
number_slider_7 = Slider(3, range=0..10)

# ----
# Skin Typology 2: Vertical
number_slider_8 = Slider(20, range=6..50)
depth_min = Slider(1.458, range=0.6..2)
thickness_of_panels = Slider(0.08, range=0..1)
depth_max = Slider(0.106, range=0..1)
vertical_skin = VerticalSkin(
    facade=location_of_skin,
    u_count=number_slider_8,
    v_count=Slider(14, range=0..100),
    depth_min=depth_min,
    depth_max=depth_max,
    thickness_of_panels=thickness_of_panels,
    choose_face=number_slider_7)

# ----
# Skin Typology 1: Perforated
perforared_skin = PerforaredSkin(facade=location_of_skin, hole_counts=number_slider_6, z_axis=normal_direction_of_facade)  # -> sm, lg

decnstrobj = HBDeconstructObject(hb_obj=aperturesbyratio.hb_objs)  # -> faces, apertures, doors, shades; plug-in component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
list_item_2 = ListItem(List=decnstrobj.faces, Index=Slider(2, range=0..5), Wrap=True)
list_item_3 = ListItem(List=decnstrobj.faces, Index=Slider(0, range=0..5), Wrap=True)
vizquick = HBVisualizeQuick(hb_objs=flatten(list_item_2))  # -> geo; plug-in component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
vizquick_2 = HBVisualizeQuick(hb_objs=flatten(list_item_3))  # -> geo; plug-in component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

back_face_of_room = Geometry(vizquick)
facade_windows = Geometry(vizquick_2)
entwine = Entwine(Branch00=perforared_skin.lg, Branch01=vertical_skin, Branch02=cluster, FlattenInputs=True)  # -> simplify(Result)
cluster_2 = Cluster_3(tree=entwine, index_typology=skin_typology)
selected_skin = Data(cluster_2)
number_slider_9 = Slider(20, range=0..100)

# ----
# CONSIDERED MAX ROOM SIZE 8MX8MX8M
# Encoded Image Boundaries
panel = Panel("-4")
construct_domain = ConstructDomain(DomainStart=panel, DomainEnd="4")

# ----
# Inputs: Encoded Image
resolution = Panel("256")
# Encoded Image
image_location = Slider(5, range=0..5)

# ----
# Push Image from Facade
amplitude_2 = Amplitude(Vector=deconstruct_plane.ZAxis, Amplitude=image_location)
move_2 = Move(Geometry=front_face_of_room, Motion=amplitude_2)  # -> Geometry, Transform

rectangle = Rectangle(Plane=move_2.Geometry, XSize=construct_domain, YSize=construct_domain, Radius=0)  # -> Rectangle, Length

# ----
# Encoded Image Resolution
mesh_plane = MeshPlane(Boundary=rectangle.Rectangle, WidthCount=resolution, HeightCount=resolution)  # -> Mesh, Area

mesh_encoded_image = Mesh(mesh_plane.Mesh)

deconstruct_mesh_4 = DeconstructMesh(Mesh=mesh_encoded_image)  # -> Vertices, Faces, Colours, Normals
encoded_image_v_3_2 = EncodedImageV3(
    mersh_vectors=deconstruct_mesh_4.Vertices,
    dist_facade_skin=image_location,
    max_heigth_room_z=number_slider_3,
    max_width_x=number_slider,
    facade_window_srf=facade_windows,
    r_color_domain="255 to 30",
    skin_typology_srf=selected_skin,
    g_color_domain="70 to 255",
    back_room_wall_srf=back_face_of_room,
    b_color_domain="255 to 30")  # -> encoded_image, r_channel_image, r_channel_values, g_channel_image, g_channel_values, b_channel_image, b_channel_values
construct_mesh = ConstructMesh(Vertices=deconstruct_mesh_4.Vertices, Faces=deconstruct_mesh_4.Faces, Colours=encoded_image_v_3_2.encoded_image)
wallacei_x = WallaceiX(
    Genes=[depth_min, number_slider_3, skin_location, ratio_to_the_elevation, window_height, sill_height, horizontal_spacing_between],
    Objectives=[number_slider_8, number_slider_2, number_slider],
    Data=number_slider_6,
    Phenotype=construct_mesh,
    allFitness="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",
    allFrontIdx="0|0;0|1;0|2;0|3;0|4;0|5;0|6;0|7;0|8;0|9;0|10;0|11;0|12;0|13;0|14;0|15;0|16;0|17;0|18;0|19;0|20;0|21;0|22;0|23;0|24;0|25;0|26;0|27;0|28;0|29;0|30;0|31;0|32;0|33;0|34;0|35;0|36;0|37;0|38;0|39;0|40;0|41;0|42;0|43;0|44;0|45;0|46;0|47;0|48;0|49;0|50;0|51;0|52;0|53;0|54;0|55;0|56;0|57;0|58;0|59;0|60;0|61;0|62;0|63;0|64;0|65;0|66;0|67;0|68;0|69;0|70;0|71;0|72;0|73;0|74;0|75;0|76;0|77;0|78;0|79;0|80;0|81;0|82;0|83;0|84;0|85;0|86;0|87;0|88;0|89",
    allGenomes="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",
    curFrontIdx="0|0;0|1;0|2;0|3;0|4;0|5;0|6;0|7;0|8;0|9;0|10;0|11;0|12;0|13;0|14;0|15;0|16;0|17;0|18;0|19;0|20;0|21;0|22;0|23;0|24;0|25;0|26;0|27;0|28;0|29;0|30;0|31;0|32;0|33;0|34;0|35;0|36;0|37;0|38;0|39;0|40;0|41;0|42;0|43;0|44;0|45;0|46;0|47;0|48;0|49;0|50;0|51;0|52;0|53;0|54;0|55;0|56;0|57;0|58;0|59;0|60;0|61;0|62;0|63;0|64;0|65;0|66;0|67;0|68;0|69;0|70;0|71;0|72;0|73;0|74;0|75;0|76;0|77;0|78;0|79;0|80;0|81;0|82;0|83;0|84;0|85;0|86;0|87;0|88;0|89",
    curFrontIdxSave="0|0;0|1;0|2;0|3;0|4;0|5;0|6;0|7;0|8;0|9;0|10;0|11;0|12;0|13;0|14;0|15;0|16;0|17;0|18;0|19;0|20;0|21;0|22;0|23;0|24;0|25;0|26;0|27;0|28;0|29;0|30;0|31;0|32;0|33;0|34;0|35;0|36;0|37;0|38;0|39;0|40;0|41;0|42;0|43;0|44;0|45;0|46;0|47;0|48;0|49;0|50;0|51;0|52;0|53;0|54;0|55;0|56;0|57;0|58;0|59;0|60;0|61;0|62;0|63;0|64;0|65;0|66;0|67;0|68;0|69;0|70;0|71;0|72;0|73;0|74;0|75;0|76;0|77;0|78;0|79;0|80;0|81;0|82;0|83;0|84;0|85;0|86;0|87;0|88;0|89",
    popGen="90,1",
    total="1235546",
    wlcDone=True)  # -> WallaceiGenomes, FitnessValues, Data, Phenotypes
data_2 = Data(wallacei_x.Data)
# Visualize
distribute_to_grid = DistributeToGrid(
    FitnessValues=wallacei_x.FitnessValues,
    Data=wallacei_x.Data,
    WallaceiPhenotypes=wallacei_x.Phenotypes,
    SizeOfTheGridInTheXDirection=number_slider_9,
    SizeOfTheGridInTheYDirection=number_slider_9,
    OutputOptions=0)  # -> DistributedFitnessValues, DistributedData, DistributedGeometries, DistributedMeshes, DistributedNumbers, GridLocations

# ==== cluster PerforaredSkin
facade = ClusterInput()
hole_counts = ClusterInput()
z_axis = ClusterInput()
surface_frames = SurfaceFrames(Surface=facade, UCount=hole_counts, VCount=hole_counts)  # -> Frames, Parameters
panel = Panel("""0
-1""")
cull_i = CullIndex(List=surface_frames.Frames, Indices=panel, Wrap=True)
flip = FlipMatrix(Data=cull_i)
cull_i_2 = CullIndex(List=flip, Indices=panel, Wrap=True)  # -> flatten(List)
panel_2 = Panel("""0
1""")
cull = CullPattern(List=cull_i_2, CullPattern=panel_2)
plane_normal = PlaneNormal(Origin=cull, ZAxis=z_axis)
division = Division(A="2", B=hole_counts)
cir = Circle(Plane=plane_normal, Radius=division)
srfsplit = SurfaceSplit(Surface=facade, Curves=cir)
srf_sl = SrfSmallLarge(srf_list=srfsplit)  # -> smallest, largest
sm = ClusterOutput(srf_sl.smallest)
lg = ClusterOutput(srf_sl.largest)

# ==== cluster VerticalSkin
facade = ClusterInput()
u_count = ClusterInput()
v_count = ClusterInput()
depth_min = ClusterInput()
depth_max = ClusterInput()
thickness_of_panels = ClusterInput()
choose_face = ClusterInput()

# ---- group: Attractor Points
pt = Point([Point(1.204088415, -2.498187981, 2.951122658), Point(3.560976659, 0.2601758001, 17.86178769), Point(11.00378164, -0.8219923242, 3.199216157), Point(18.19849312, -0.8996962654, 16.5091201), Point(26.57164873, 0.02883612935, 8.409179645)])

# ----
# VERTICAL SKIN
sdivide = DivideSurface(Surface=facade, UCount=u_count, VCount=v_count)  # -> Points, Normals, Parameters
flatten = FlattenTree(Tree=sdivide.Points, Path="{0}")
dist = Distance(PointA=graft(flatten), PointB=pt)
bnd = Bounds(Numbers=flatten(dist))
remap = RemapNumbers(Value=dist, Source=bnd, Target=Domain(0, 1))  # -> Mapped, Clipped
genes = GenePool(Decimals=3, Maximum=10, Minimum=0, Value=[0.042, 2.11, 6.728, 1.912, 0])
graph = GraphMapper(remap.Mapped, x0=0, x1=1, y0=0, y1=1, container_name="Bezier", cpx=[0, 0.4592220187, 0, 1], cpy=[1, 0.5075471401, 0, 0])
multiplication = Multiplication(A=graph, B=genes)
ma = MassAddition(Input=multiplication)  # -> flatten(Result), PartialResults
bnd_2 = Bounds(Numbers=ma.Result)
remap_2 = RemapNumbers(Value=ma.Result, Source=bnd_2, Target=Domain(0, 1))  # -> Mapped, Clipped
graph_2 = GraphMapper(
    remap_2.Mapped,
    x0=0,
    x1=1,
    y0=0,
    y1=1,
    container_name="Sine",
    Equation_px=[0, 0.1356530935],
    Equation_py=[0, 0.9846509695])
multiplication_2 = Multiplication(A=graph_2, B=depth_min)
addition = Addition(A=multiplication_2, B=depth_max)
amp = Amplitude(Vector=flatten(sdivide.Normals), Amplitude=addition)
move = Move(Geometry=flatten, Motion=amp)  # -> Geometry, Transform
unflatten = UnflattenTree(Tree=move.Geometry, Guide=sdivide.Points)
intcrv = Interpolate(Vertices=unflatten, Degree=3, Periodic=False, KnotStyle=1)  # -> Curve, Length, Domain
intcrv_2 = Interpolate(Vertices=sdivide.Points, Degree=3, Periodic=False, KnotStyle=1)  # -> Curve, Length, Domain
flip = FlipCurve(Curve=intcrv_2.Curve)  # -> Curve, Flag
expression = Expression(x=thickness_of_panels, Expression="x/2")
merge = Merge(Data1=intcrv.Curve, Data2=flip.Curve)
neg = Negative(Value=expression)
connect = ConnectCurves(Curves=merge, Continuity="0", Close=True, Bulge=1)
X = UnitX(Factor=neg)
X_2 = UnitX(Factor=thickness_of_panels)
boundary = BoundarySurfaces(Edges=connect)
move_2 = Move(Geometry=boundary, Motion=X)  # -> Geometry, Transform
extr = Extrude(Base=move_2.Geometry, Direction=X_2)

debrep = DeconstructBrep(Brep=extr)  # -> Faces, Edges, Vertices
item = ListItem(List=debrep.Faces, Index=choose_face, Wrap=invert(True))

vertical_pattern = ClusterOutput(item)

# ==== cluster Cluster
hoz_depth_max = ClusterInput()
hoz_depth_min = ClusterInput()
panel_depth = ClusterInput()
normal_direction = ClusterInput()
no_of_panels = ClusterInput()
steps = ClusterInput()
# Hoz Facade System
facade = ClusterInput()
choose_face = ClusterInput()

divide = DivideDomain²(Domain=facade, UCount="1", VCount=no_of_panels)
subsrf = Isotrim(Surface=facade, Domain=divide)
debrep = DeconstructBrep(Brep=subsrf)  # -> Faces, simplify(Edges), flatten(Vertices)

range = Range(Domain=Domain(0, 1), Steps=expr("x-1", steps))
graph = GraphMapper(
    range,
    x0=0,
    x1=1,
    y0=0,
    y1=1,
    container_name="Sinc",
    Equation_X0=0.7256833315,
    Equation_X1=0.1845636368,
    Equation_Y0=0.03992664814,
    Equation_Y1=0.5902863741)
bnd = Bounds(Numbers=graph)
dom = ConstructDomain(DomainStart=hoz_depth_min, DomainEnd=hoz_depth_max)
remap = RemapNumbers(Value=graph, Source=bnd, Target=dom)  # -> Mapped, Clipped

end_points = EndPoints(Curve=debrep.Edges)  # -> Start, End
vector_2pt = Vector2Pt(PointA=end_points.Start, PointB=end_points.End, Unitize=False)  # -> flatten(Vector), Length
deconstruct_vector = DeconstructVector(Vector=vector_2pt.Vector)  # -> XComponent, YComponent, ZComponent
equality = Equality(FirstNumber=deconstruct_vector.ZComponent, SecondNumber="0")  # -> Equality, Inequality
cull_pattern = CullPattern(List=debrep.Edges, CullPattern=equality.Equality)  # -> flatten(List)
removeduplicatelines = RemoveDuplicateLines(Lines=cull_pattern, Tolerance=0.01)
list_item = ListItem(List=removeduplicatelines, Index=0, Wrap=True)
flip_curve = FlipCurve(Curve=removeduplicatelines, Guide=list_item)  # -> Curve, Flag

amplitude = Amplitude(Vector=normal_direction, Amplitude=remap.Mapped)
divide_2 = DivideCurve(Curve=flip_curve.Curve, Count=steps, Kinks=False)  # -> Points, Tangents, Parameters
move = Move(Geometry=divide_2.Points, Motion=amplitude)  # -> Geometry, Transform

intcrv_t = InterpolateT(Vertices=move.Geometry, TangentStart=Vector(0, 0, 0), TangentEnd=Vector(0, 0, 0), KnotStyle=1)  # -> Curve, Length, Domain
project = Project(Geometry=intcrv_t.Curve, Plane=facade)  # -> Geometry, Transform
loft = Loft(
    Curves=[project.Geometry, intcrv_t.Curve],
    Options={Adjust=False, Closed=False, LoftEnds=0, LoftSimp=0, LoftType=3, Rebuild=10, Refit=0.01})  # -> flatten(Loft)
offsrf = OffsetSurface(Surface=loft, Distance=panel_depth, BothSides=0, CreateSolid=True)  # -> flatten(Offset)
debrep_2 = DeconstructBrep(Brep=offsrf)  # -> Faces, Edges, Vertices

item = ListItem(List=debrep_2.Faces, Index=choose_face, Wrap=invert(True))
hoz_shaders = ClusterOutput(item)

# ==== cluster Cluster_3
index_typology = ClusterInput()
tree = ClusterInput()
cluster = Cluster_2(fragment_b=index_typology)
tree_branch = TreeBranch(Tree=tree, Path=cluster, MaintainPaths=True)
result = ClusterOutput(tree_branch)

# ==== cluster EncodedImageV1
back_surface_of_room = ClusterInput()
mjoin = MeshJoin(Meshes=back_surface_of_room)
mesh = ClusterInput()
mesh_2 = Mesh(back_surface_of_room)
mesh_3 = Mesh(mesh)
center = Center(Geometry=mjoin, forall=False)  # -> Center, Dimension
center_2 = Center(Geometry=mesh, forall=False)  # -> Center, Dimension
deconstruct_mesh = DeconstructMesh(Mesh=mesh)  # -> Vertices, Faces, Colours, Normals

# ----
# Vector for Projection
vector_2pt = Vector2Pt(PointA=center_2.Center, PointB=center.Center, Unitize=False)  # -> Vector, Length

# ----
# Points
project_point = ProjectPoint(Point=deconstruct_mesh.Vertices, Direction=vector_2pt.Vector, Geometry=back_surface_of_room)  # -> Point, Index
deconstruct = Deconstruct(Point=project_point.Point)  # -> XComponent, YComponent, ZComponent

vdis = VectorDisplay(Anchor=center_2.Center, Vector=vector_2pt.Vector)
absolute = Absolute(Value=deconstruct.YComponent)
control_wire_display = ControlWireDisplay(WireDisplay="1")

# ----
# Point domain in Y
bounds = Bounds(Numbers=absolute)
deconstruct_domain = DeconstructDomain(Domain=bounds)  # -> Start, End

channel = ClusterInput()

# ----
# Checks if flat
subtraction = Subtraction(A=deconstruct_domain.Start, B=deconstruct_domain.End)
equality_within_tolerance = EqualityWithinTolerance(FirstNumber=subtraction, SecondNumber="0,00", Tolerance=0.01)  # -> Equality, Inequality

# ----
# Condition:
# Geometry of Surface
condition_flat = Panel("0")
condition_not_flat = Data(deconstruct_domain.End)
stream_filter = StreamFilter(Gate=equality_within_tolerance.Equality, Stream0=condition_not_flat, Stream1=condition_flat)

construct_domain = ConstructDomain(DomainStart=deconstruct_domain.Start, DomainEnd=stream_filter)

# ----
# Red Channel
panel = Panel("0")
equality = Equality(FirstNumber=channel, SecondNumber=panel)  # -> Equality, Inequality
stream_filter_2 = StreamFilter(Gate=equality.Equality, Stream0="0 to 0", Stream1="255 to 30")
remap_numbers = RemapNumbers(Value=absolute, Source=construct_domain, Target=stream_filter_2)  # -> Mapped, Clipped

# ----
# Blue Channel
panel_2 = Panel("2")
equality_2 = Equality(FirstNumber=channel, SecondNumber=panel_2)  # -> Equality, Inequality
stream_filter_3 = StreamFilter(Gate=equality_2.Equality, Stream0="0 to 0", Stream1="255 to 30")
remap_numbers_2 = RemapNumbers(Value=absolute, Source=construct_domain, Target=stream_filter_3)  # -> Mapped, Clipped

# ----
# Green Channel
panel_3 = Panel("1")
equality_3 = Equality(FirstNumber=channel, SecondNumber=panel_3)  # -> Equality, Inequality
stream_filter_4 = StreamFilter(Gate=equality_3.Equality, Stream0="0 to 0", Stream1="60 to 255")
remap_numbers_3 = RemapNumbers(Value=absolute, Source=construct_domain, Target=stream_filter_4)  # -> Mapped, Clipped

colour_rgb = ColourRGB(Alpha=255, Red=remap_numbers.Mapped, Green=remap_numbers_3.Mapped, Blue=remap_numbers_2.Mapped)

# ----
# Replace <null> cells
# with 0,0,1 (black)
null_item = NullItem(Item=colour_rgb)  # -> NullFlags, InvalidFlags, Description
list_length = ListLength(List=colour_rgb)
series = Series(Start=0, Step=1, Count=list_length)
cull_pattern = CullPattern(List=series, CullPattern=null_item.InvalidFlags)

replace_items = ReplaceItems(List=remap_numbers_2.Mapped, Item="1", Indices=cull_pattern, Wrap=False)
replace_items_2 = ReplaceItems(List=remap_numbers.Mapped, Item="1", Indices=cull_pattern, Wrap=False)
replace_items_3 = ReplaceItems(List=remap_numbers_3.Mapped, Item="1", Indices=cull_pattern, Wrap=False)
list_of_red_values = ClusterOutput(replace_items_2)
list_of_blue_values = ClusterOutput(replace_items)
list_of_green_values = ClusterOutput(replace_items_3)
b_channel = Panel("0,0,1")
r_channel = Panel("1,0,0")
g_channel = Panel("0,1,0")
stream_filter_5 = StreamFilter(Gate=channel, Stream0=r_channel, Stream1=g_channel, Stream2=b_channel)

# ----
# Create List colors
replace_items_4 = ReplaceItems(List=colour_rgb, Item=stream_filter_5, Indices=cull_pattern, Wrap=False)

panel_4 = Panel(replace_items_4)

# ----
# Output Gradient
construct_mesh = ConstructMesh(Vertices=deconstruct_mesh.Vertices, Faces=deconstruct_mesh.Faces, Colours=replace_items_4)

output_b_channel = ClusterOutput(construct_mesh)

# ==== cluster EncodedImageV2
mesh_image = ClusterInput()
geomtery_to_encode = ClusterInput()
skin_typology_resolution = ClusterInput()
channel = ClusterInput()
direction_projection = ClusterInput()
control_wire_display = ControlWireDisplay(WireDisplay="1")
number_slider = Slider(9, range=0..10)
mesh_surface = MeshSurface(
    Surface=geomtery_to_encode,
    UCount=Slider(256, range=0..256),
    VCount=skin_typology_resolution,
    Overhang=True,
    Equalize=False)
deconstruct_mesh = DeconstructMesh(Mesh=mesh_image)  # -> Vertices, Faces, Colours, Normals
mesh_join = MeshJoin(Meshes=mesh_surface)

deconstruct_mesh_2 = DeconstructMesh(Mesh=mesh_join)  # -> Vertices, Faces, Colours, Normals
deconstruct = Deconstruct(Point=deconstruct_mesh_2.Vertices)  # -> XComponent, YComponent, ZComponent
construct_point = ConstructPoint(XCoordinate=deconstruct.XComponent, YCoordinate="-5", ZCoordinate=deconstruct.ZComponent)

# ----
# Points
mesh_ray = MeshRay(Mesh=mesh_join, Point=deconstruct_mesh.Vertices, Direction=expr("-x", direction_projection))  # -> Point, Hit; disabled

list_length = ListLength(List=deconstruct_mesh.Vertices)
create_rtree = CreateRTree(InputGeometry=flatten(deconstruct_mesh.Vertices))
series = Series(Start=0, Step="0", Count=list_length)
rtree_closest_point = RTreeClosestPoint(SearchPoints=flatten(construct_point), RTree=create_rtree)  # -> ClosestPoint, ClosestIndex
replace_items = ReplaceItems(List=series, Item=deconstruct.YComponent, Indices=rtree_closest_point.ClosestIndex, Wrap=False)

absolute = Absolute(Value=replace_items)
create_set = CreateSet(List=absolute)  # -> Set, Map
equality = Equality(FirstNumber=absolute, SecondNumber=Slider(0, range=0..100))  # -> Equality, Inequality
cull_pattern = CullPattern(List=absolute, CullPattern=equality.Inequality)
# Point domain in Y
bounds = Bounds(Numbers=cull_pattern)
deconstruct_domain = DeconstructDomain(Domain=bounds)  # -> Start, End
# Checks if flat
subtraction = Subtraction(A=deconstruct_domain.Start, B=deconstruct_domain.End)
# Red Channel
panel = Panel("0")
condition_flat = Panel("0")
# Condition:
# Geometry of Surface
condition_not_flat = Data(deconstruct_domain.End)
# Blue Channel
panel_2 = Panel("2")
# Green Channel
panel_3 = Panel("1")
equality_within_tolerance = EqualityWithinTolerance(FirstNumber=subtraction, SecondNumber="0,00", Tolerance=0.01)  # -> Equality, Inequality
equality_2 = Equality(FirstNumber=channel, SecondNumber=panel_3)  # -> Equality, Inequality
equality_3 = Equality(FirstNumber=channel, SecondNumber=panel)  # -> Equality, Inequality
equality_4 = Equality(FirstNumber=channel, SecondNumber=panel_2)  # -> Equality, Inequality
stream_filter = StreamFilter(Gate=equality_within_tolerance.Equality, Stream0=condition_not_flat, Stream1=condition_flat)
construct_domain = ConstructDomain(DomainStart=deconstruct_domain.Start, DomainEnd=stream_filter)
stream_filter_2 = StreamFilter(Gate=equality_2.Equality, Stream0="0 to 0", Stream1="1 to 255")
stream_filter_3 = StreamFilter(Gate=equality_4.Equality, Stream0="0 to 0", Stream1="255 to 30")
stream_filter_4 = StreamFilter(Gate=equality_3.Equality, Stream0="0 to 0", Stream1="255 to 30")
remap_numbers = RemapNumbers(Value=absolute, Source=construct_domain, Target=stream_filter_4)  # -> Mapped, Clipped
remap_numbers_2 = RemapNumbers(Value=absolute, Source=construct_domain, Target=stream_filter_3)  # -> Mapped, Clipped
remap_numbers_3 = RemapNumbers(Value=absolute, Source=construct_domain, Target=stream_filter_2)  # -> Mapped, Clipped
colour_rgb = ColourRGB(Alpha=255, Red=remap_numbers.Mapped, Green=remap_numbers_3.Mapped, Blue=remap_numbers_2.Mapped)
null_item = NullItem(Item=colour_rgb)  # -> NullFlags, InvalidFlags, Description
# Replace <null> cells
# with 0,0,1 (black)
list_length_2 = ListLength(List=colour_rgb)
series_2 = Series(Start=0, Step=1, Count=list_length_2)
cull_pattern_2 = CullPattern(List=series_2, CullPattern=null_item.InvalidFlags)
replace_items_2 = ReplaceItems(List=remap_numbers_2.Mapped, Item="1", Indices=cull_pattern_2, Wrap=False)
replace_items_3 = ReplaceItems(List=remap_numbers_3.Mapped, Item="1", Indices=cull_pattern_2, Wrap=False)
replace_items_4 = ReplaceItems(List=remap_numbers.Mapped, Item="1", Indices=cull_pattern_2, Wrap=False)
blue_values = ClusterOutput(replace_items_2)
red_values = ClusterOutput(replace_items_4)
green_values = ClusterOutput(replace_items_3)
b_channel = Panel("0,0,1")
r_channel = Panel("1,0,0")
g_channel = Panel("0,1,0")
stream_filter_5 = StreamFilter(Gate=channel, Stream0=r_channel, Stream1=g_channel, Stream2=b_channel)
# Create List colors
replace_items_5 = ReplaceItems(List=colour_rgb, Item=stream_filter_5, Indices=cull_pattern_2, Wrap=False)
# Output Gradient
construct_mesh = ConstructMesh(Vertices=deconstruct_mesh.Vertices, Faces=deconstruct_mesh.Faces, Colours=replace_items_5)
panel_4 = Panel(replace_items_5)
colored_mesh = ClusterOutput(construct_mesh)

# ==== cluster EncodedImageV3
mersh_vectors = ClusterInput()
dist_facade_skin = ClusterInput()
max_heigth_room_z = ClusterInput()
max_width_x = ClusterInput()

# ----
# Filter Points
deconstruct = Deconstruct(Point=mersh_vectors)  # -> XComponent, YComponent, ZComponent
smaller_than = SmallerThan(FirstNumber=deconstruct.XComponent, SecondNumber=max_width_x)  # -> SmallerThan, OrEqualTo
larger_than = LargerThan(FirstNumber=deconstruct.ZComponent, SecondNumber="0")  # -> LargerThan, OrEqualTo
smaller_than_2 = SmallerThan(FirstNumber=deconstruct.ZComponent, SecondNumber=max_heigth_room_z)  # -> SmallerThan, OrEqualTo
larger_than_2 = LargerThan(FirstNumber=deconstruct.XComponent, SecondNumber="0")  # -> LargerThan, OrEqualTo
gate_and = GateAnd(A=larger_than.OrEqualTo, B=smaller_than_2.OrEqualTo, C=larger_than_2.OrEqualTo, D=smaller_than.OrEqualTo)
cull_pattern = CullPattern(List=mersh_vectors, CullPattern=gate_and)

facade_window_srf = ClusterInput()
r_color_domain = ClusterInput()
skin_typology_srf = ClusterInput()
g_color_domain = ClusterInput()
back_room_wall_srf = ClusterInput()
b_color_domain = ClusterInput()

deconstruct_2 = Deconstruct(Point=cull_pattern)  # -> XComponent, YComponent, ZComponent
equality = Equality(FirstNumber=deconstruct_2.XComponent, SecondNumber="0")  # -> Equality, Inequality
cull_pattern_2 = CullPattern(List=cull_pattern, CullPattern=equality.Equality)
list_length = ListLength(List=cull_pattern_2)

deconstruct_3 = Deconstruct(Point=cull_pattern)  # -> XComponent, YComponent, ZComponent
equality_2 = Equality(FirstNumber=deconstruct_3.ZComponent, SecondNumber="0")  # -> Equality, Inequality
cull_pattern_3 = CullPattern(List=cull_pattern, CullPattern=equality_2.Equality)
list_length_2 = ListLength(List=cull_pattern_3)

data = Data(dist_facade_skin)

mesh_surface = MeshSurface(Surface=skin_typology_srf, UCount=list_length, VCount=list_length_2, Overhang=True, Equalize=False)
mesh_join = MeshJoin(Meshes=mesh_surface)
deconstruct_mesh = DeconstructMesh(Mesh=mesh_join)  # -> Vertices, Faces, Colours, Normals
deconstruct_4 = Deconstruct(Point=deconstruct_mesh.Vertices)  # -> XComponent, YComponent, ZComponent
bounds = Bounds(Numbers=deconstruct_4.YComponent)
construct_point = ConstructPoint(XCoordinate=deconstruct_4.XComponent, YCoordinate=data, ZCoordinate=deconstruct_4.ZComponent)

mesh_surface_2 = MeshSurface(Surface=back_room_wall_srf, UCount=list_length_2, VCount=list_length, Overhang=True, Equalize=False)
mesh_join_2 = MeshJoin(Meshes=mesh_surface_2)
deconstruct_mesh_2 = DeconstructMesh(Mesh=mesh_join_2)  # -> Vertices, Faces, Colours, Normals
deconstruct_5 = Deconstruct(Point=deconstruct_mesh_2.Vertices)  # -> XComponent, YComponent, ZComponent
round = Round(Number=deconstruct_5.YComponent)  # -> Nearest, Floor, Ceiling
construct_point_2 = ConstructPoint(XCoordinate=deconstruct_5.XComponent, YCoordinate=data, ZCoordinate=deconstruct_5.ZComponent)
bounds_2 = Bounds(Numbers=round.Nearest)

mesh_surface_3 = MeshSurface(Surface=facade_window_srf, UCount=list_length_2, VCount=list_length, Overhang=True, Equalize=False)
mesh_join_3 = MeshJoin(Meshes=mesh_surface_3)
deconstruct_mesh_3 = DeconstructMesh(Mesh=mesh_join_3)  # -> Vertices, Faces, Colours, Normals
deconstruct_6 = Deconstruct(Point=deconstruct_mesh_3.Vertices)  # -> XComponent, YComponent, ZComponent
round_2 = Round(Number=deconstruct_6.YComponent)  # -> Nearest, Floor, Ceiling
construct_point_3 = ConstructPoint(XCoordinate=deconstruct_6.XComponent, YCoordinate=data, ZCoordinate=deconstruct_6.ZComponent)
bounds_3 = Bounds(Numbers=round_2.Nearest)

# ----
# List Generation
list_length_3 = ListLength(List=mersh_vectors)
duplicate_data = DuplicateData(Data="0,0,0", Number=list_length_3, Order=True)
duplicate_data_2 = DuplicateData(Data="0", Number=list_length_3, Order=True)

control_wire_display = ControlWireDisplay(WireDisplay="1")

remap_numbers = RemapNumbers(Value=deconstruct_5.YComponent, Source=bounds_2, Target=b_color_domain)  # -> Mapped, Clipped
create_rtree = CreateRTree(InputGeometry=flatten(mersh_vectors))
rtree_closest_point = RTreeClosestPoint(SearchPoints=flatten(construct_point_2), RTree=create_rtree)  # -> ClosestPoint, ClosestIndex

round_3 = Round(Number=remap_numbers.Mapped)  # -> Nearest, Floor, Ceiling

concatenate = Concatenate(FragmentB="0,0", FragmentA=round_3.Nearest, JoinSeparator=",")

# ----
# B channel Image
replace_items = ReplaceItems(List=duplicate_data, Item=concatenate, Indices=rtree_closest_point.ClosestIndex, Wrap=False)

# ----
# Only B values
replace_items_2 = ReplaceItems(List=duplicate_data_2, Item=round_3.Nearest, Indices=rtree_closest_point.ClosestIndex, Wrap=False)

# ----
# Blue Channel
b_channel_values = ClusterOutput(replace_items_2)
b_channel_image = ClusterOutput(replace_items)

remap_numbers_2 = RemapNumbers(Value=deconstruct_6.YComponent, Source=bounds_3, Target=r_color_domain)  # -> Mapped, Clipped
create_rtree_2 = CreateRTree(InputGeometry=flatten(mersh_vectors))
rtree_closest_point_2 = RTreeClosestPoint(SearchPoints=flatten(construct_point_3), RTree=create_rtree_2)  # -> ClosestPoint, ClosestIndex

round_4 = Round(Number=remap_numbers_2.Mapped)  # -> Nearest, Floor, Ceiling

concatenate_2 = Concatenate(FragmentB=round_4.Nearest, FragmentA="0,0", JoinSeparator=",")

# ----
# R channel Image
replace_items_3 = ReplaceItems(List=duplicate_data, Item=concatenate_2, Indices=rtree_closest_point_2.ClosestIndex, Wrap=False)

# ----
# Only R values
replace_items_4 = ReplaceItems(List=duplicate_data_2, Item=round_4.Nearest, Indices=rtree_closest_point_2.ClosestIndex, Wrap=False)

# ----
# Red Channel
r_channel_values = ClusterOutput(replace_items_4)
r_channel_image = ClusterOutput(replace_items_3)

remap_numbers_3 = RemapNumbers(Value=deconstruct_4.YComponent, Source=bounds, Target=g_color_domain)  # -> Mapped, Clipped
create_rtree_3 = CreateRTree(InputGeometry=flatten(mersh_vectors))
rtree_closest_point_3 = RTreeClosestPoint(SearchPoints=flatten(construct_point), RTree=create_rtree_3)  # -> ClosestPoint, ClosestIndex

round_5 = Round(Number=remap_numbers_3.Mapped)  # -> Nearest, Floor, Ceiling

concatenate_3 = Concatenate(Fragment_B="0", A=round_5.Nearest, B="0", JoinSeparator=",")

# ----
# G channel Image
replace_items_5 = ReplaceItems(List=duplicate_data, Item=concatenate_3, Indices=rtree_closest_point_3.ClosestIndex, Wrap=False)

# ----
# Only G values
replace_items_6 = ReplaceItems(List=duplicate_data_2, Item=round_5.Nearest, Indices=rtree_closest_point_3.ClosestIndex, Wrap=False)

# ----
# Green Channel
g_channel_values = ClusterOutput(replace_items_6)
g_channel_image = ClusterOutput(replace_items_5)

concatenate_4 = Concatenate(R=replace_items_4, G=replace_items_6, B=replace_items_2, JoinSeparator=",")
encoded_image = ClusterOutput(concatenate_4)

# ==== cluster SrfSmallLarge
srf_list = ClusterInput()
edges = BrepEdges(Brep=srf_list)  # -> Naked, Interior, NonManifold
len = Length(Curve=edges.Naked)
ma = MassAddition(Input=len)  # -> Result, PartialResults
pshift = ShiftPaths(Data=ma.Result, Offset=-1)
sort = SortList(Keys=pshift, ValuesA=srf_list)  # -> Keys, ValuesA
item = ListItem(List=reverse(sort.ValuesA), Index=0, Wrap=True)
cull_index = CullIndex(List=sort.ValuesA, Indices="-1", Wrap=True)
largest = ClusterOutput(item)
smallest = ClusterOutput(cull_index)

# ==== cluster Cluster_2
fragment_b = ClusterInput()
concatenate = Concatenate(Fragment_A="{", Fragment_B=fragment_b, A="}")
result = ClusterOutput(concatenate)
