# Grasshopper definition G encoding script.gh (Grasshopper 1.0.7)
# plug-ins: eleFront, AviaryMacawGH, AviaryHoopoeGH, AviaryWindGH, LINK_Dashboards, Stripper, Tundra, Pufferfish, LunchBox, Heteroptera

project = Project(Plane=PlaneXY(0, 0, 0))  # -> Geometry, Transform
remesh = QuadRemesh()
mesh = Mesh()
gradient = Gradient(LowerLimit=0, UpperLimit=1, stops=[0.0166: RGB(255, 0, 0), 1: RGB(50, 0, 0)])
mcol = MeshColours(
    Mesh=mesh,
    Colours=[RGB(127, 255, 0), RGB(0, 100, 0), RGB(34, 139, 34), RGB(124, 252, 0), RGB(154, 205, 50), RGB(173, 255, 47), RGB(50, 205, 50), RGB(152, 251, 152)])
mesh_edges = GetMeshEdges()  # -> MeshEdges, BoundaryEdges, UnweldedEdges, InnerEdges
facade = Surface(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)
window = Surface(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)
window_2 = Surface(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)
window_3 = Surface(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)
facade_2 = Surface(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)
mesh_2 = Mesh(window_2)
debrep = DeconstructBrep(Brep=window_2)  # -> Faces, Edges, Vertices
debrep_2 = DeconstructBrep(Brep=facade_2)  # -> Faces, Edges, Vertices
crv = Curve(debrep.Edges)
quads = QuadPanels(Surface=window_2, UDivisions=Slider(100, range=0..1000), VDivisions=Slider(100, range=0..1000))
item = ListItem(Index=0, Wrap=True)
crv_2 = Curve(debrep_2.Edges)
join = JoinCurves(Curves=crv, Preserve=False)
quads_2 = QuadPanels(Surface=facade_2, UDivisions=Slider(100, range=0..1000), VDivisions=Slider(100, range=0..1000))
join_2 = JoinCurves(Curves=crv_2, Preserve=False)
srf = Surface(quads)
area = Area(Geometry=join)  # -> Area, Centroid
mesh_uv = MeshSurface(Surface=quads, UCount=5, VCount=5, Overhang=True, Equalize=False)
srf_2 = Surface(quads_2)
area_2 = Area(Geometry=join_2)  # -> Area, Centroid
center = Center(Geometric=srf)  # -> Center, Dimension
extremums = MinMax(Number=area.Area)  # -> Minimum, Maximum
wall = Mesh(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)
center_2 = Center(Geometric=srf_2)  # -> Center, Dimension
panel = Panel(area.Area)
extremums_2 = MinMax(Number=area_2.Area)  # -> Minimum, Maximum
panel_2 = Panel(area_2.Area)
smaller = SmallerThan(FirstNumber=area.Area, SecondNumber=extremums.Maximum)  # -> SmallerThan, OrEqualTo
subdivide_custom = SubdivideMeshCustom(Level=1, Smooth=False, Tolerance=0.01, BlendCreases=False)
panel_3 = Panel("0")
smaller_2 = SmallerThan(FirstNumber=area_2.Area, SecondNumber=extremums_2.Maximum)  # -> SmallerThan, OrEqualTo
cull = CullPattern(List=join, CullPattern=smaller.SmallerThan)
incurves = PointInCurves(Point=center.Center, Curves=cull)  # -> Relationship, Index, Point
sub_parts = MeshSubdivisionPartitions(Mesh=wall, Level=Slider(2, range=0..10))
equals = Equality(FirstNumber=incurves.Relationship, SecondNumber="0")  # -> Equality, Inequality
equals_2 = Equality(FirstNumber=incurves.Relationship, SecondNumber="1")  # -> Equality, Inequality
cull_2 = CullPattern(List=join_2, CullPattern=smaller_2.SmallerThan)
incurves_2 = PointInCurves(Point=center_2.Center, Curves=cull_2)  # -> Relationship, Index, Point
face_count = MeshFaceCount(Mesh=wall)
equals_3 = Equality(FirstNumber=incurves.Relationship, SecondNumber="2")  # -> Equality, Inequality
equals_4 = Equality(FirstNumber=incurves_2.Relationship, SecondNumber="0")  # -> Equality, Inequality
equals_5 = Equality(FirstNumber=incurves_2.Relationship, SecondNumber="1")  # -> Equality, Inequality
gradient_2 = Gradient()
equals_6 = Equality(FirstNumber=incurves_2.Relationship, SecondNumber="2")  # -> Equality, Inequality
gradient_3 = Gradient(LowerLimit=0, UpperLimit=1, stops=[0.0166: RGB(255, 0, 0), 1: RGB(50, 0, 0)])
cull_3 = CullPattern(List=quads, CullPattern=equals_2.Equality)
stroke = Stroke(StrokeColor=ColourSwatch(SwatchColor=RGB(247, 0, 255)), Weight=Slider(0.07, range=0..0.1))
cull_4 = CullPattern(List=quads, CullPattern=equals_3.Equality)
cull_5 = CullPattern(List=quads, CullPattern=equals.Equality)
solid = SolidFill(FillColor=RGB(0, 0, 0))
cull_6 = CullPattern(List=quads_2, CullPattern=equals_5.Equality)
cull_7 = CullPattern(List=quads_2, CullPattern=equals_6.Equality)
cull_8 = CullPattern(List=quads_2, CullPattern=equals_4.Equality)
xz = XZPlane(Origin=Point(0, 0, 0))
window_4 = Mesh([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])
number_slider = Slider(0.463, range=0..1)
number_slider_2 = Slider(0.49, range=0..1)
properties = ImageProperties()  # -> Width, Height, DPIX, DPIY
number_slider_3 = Slider(100, range=0..100)
mcol_2 = MeshColours(Mesh=cull_5, Colours=ColourSwatch(SwatchColor=RGB(255, 0, 0)))
meshshp = MeshToShape(Mesh=window_4, Graphic=stroke)
mcol_3 = MeshColours(Mesh=[cull_4, cull_3], Colours=ColourSwatch(SwatchColor=RGB(90, 0, 0)))
mcol_4 = MeshColours(Mesh=cull_8, Colours=ColourSwatch(SwatchColor=RGB(0, 255, 0)))
brec = BoundingRectangle(Geometry=window_4, Plane=xz, Axis=0, Slide=0, Union=True)  # -> Bounding, DimensionX, DimensionY
mcol_5 = MeshColours(Mesh=[cull_7, cull_6], Colours=ColourSwatch(SwatchColor=RGB(0, 90, 0)))
mjoin = MeshJoin(Meshes=[mcol_3, mcol_2])
drawing = ComposeDrawing(
    Shapes=meshshp,
    Boundary=brec.Bounding,
    Width=number_slider_3,
    Height=number_slider_3,
    Backround=ColourSwatch(SwatchColor=RGB(255, 255, 255)))
mjoin_2 = MeshJoin(Meshes=[mcol_5, mcol_4])
draw = ViewDrawing(Drawing=drawing)
demesh = DeconstructMesh(Mesh=mjoin)  # -> Vertices, Faces, Colours, Normals
draw_to_bitmap = DrawingToBitmap(Drawing=drawing, PPI=96)
cset = CreateSet(List=demesh.Colours)  # -> Set, Map
panel_5 = Panel(cset.Set)
number_slider_4 = Slider(900, range=0..1000)
facade_3 = Surface(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)
stroke_2 = Stroke(StrokeColor=RGB(0, 0, 0), Weight=1)
window_5 = Surface(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)
image = ImageViewer(Image=draw_to_bitmap)
number_slider_5 = Slider(100, range=0..1000)
number_slider_6 = Slider(100, range=0..1000)
build = BuildImage(Width=Slider(30, range=0..100), Height=Slider(30, range=0..100), Colors=gradient_3)
parameters = QuadRemeshParameters(
    TargetQuadCount=Slider(256, range=0..1000),
    UseAdaptiveQuads=True,
    AdaptiveQuadSize=50,
    DetectHardEdges=True,
    PreserveMeshArrayHardEdges=0,
    SymmetryAxis=0,
    GuideCurveInfluence=0,
    TargetEdgeLength=0)
window_6 = Surface(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)
radial = RadialGradientFill(
    GradientColors=[RGB(0, 0, 0), RGB(255, 255, 255)],
    Parameters=[0, 1],
    Center=Point(0.5, 0.5, 0),
    Focus=Point(0.5, 0.5, 0),
    Radius=1)
colour = ColourPicker(PickedColour=RGB(0, 47, 0))
wheel = ColourWheel(
    ColourGrips_Style=31,
    ColourGrips_Grip=[0, 2.094395102, 4.188790205, 3.141592654],
    ColourGrips_Lum=[0.1, 0.5],
    ColourGrips_Range=[0.2617993878, 0.2617993878, 0.2617993878, 0.2617993878],
    ColourGrips_Sat=[0.2, 1])
image_2 = ImageViewer(Image=build)
mesh_3 = Mesh(window_6)
properties_2 = ImageProperties()  # -> Width, Height, DPIX, DPIY
debrep_3 = DeconstructBrep(Brep=window_6)  # -> Faces, Edges, Vertices
build_2 = BuildImage(Width=100, Height=100)
values = ImageValues(Image=build, Modes=0)
value_at = ImageValueAt(Modes=0, Unitize=False)
quads_3 = QuadPanels(Surface=window_6, UDivisions=Slider(20, range=0..100), VDivisions=Slider(20, range=0..100))
values_2 = ImageValues(Modes=0)
panel_6 = Panel(colour)
crv_3 = Curve(debrep_3.Edges)
layer = AddLayer(BlendMode=0, Opacity=1)
modify = ModifyLayer(Mode=0, Value=0, Color=RGB(0, 0, 0))
extract = ExtractChannel(Mode=0)  # -> Image, Filter
centers_normals = GetFaceCentersNormals()  # -> FaceCenters, FaceNormals
vertices_normals = GetVerticesNormals()  # -> Vertices, Normals
item_2 = ListItem(Index=0, Wrap=True)
join_3 = JoinCurves(Curves=crv_3, Preserve=False)
resize = ResizeImage(Mode=0, Width=100, Height=100)  # -> Image, Filter
remesh_2 = QuadRemesh(MeshOrBrep=window_6, QuadRemeshParameters=parameters)
color = DefineColor(Source="object")
clear_colors = ClearMeshColors()
color_by_palette = ColorMeshesWithSwatchPalette(Samples=5)  # -> MeshesColored, SampleColors
attatt = AttachAttributes()
mesh_uv_2 = MeshSurface(Surface=window_6, UCount=5, VCount=5, Overhang=True, Equalize=False)
area_3 = Area(Geometry=join_3)  # -> Area, Centroid
color_meshes = ColorMeshesRandomly(Rs=5, Re=250, Gs=5, Ge=250, Bs=5, Be=250)
undivide = UndivideSubdividedMesh()
sub_parts_2 = MeshSubdivisionPartitions(Level=1)
center_3 = Center()  # -> Center, Dimension
cellular = Cellular(Seed=1, Width=100, Height=100, Depth=1, Mode=0, Interpolation=0, Jitter=0.5, Frequency=0.25, Interval=Domain(0, 1))  # -> Image, Noise
noise = Noise(Seed=1, Width=100, Height=100, Depth=1, Mode=0, Interpolation=0, Frequency=0.25)  # -> Image, Noise
extremums_3 = MinMax(Number=area_3.Area)  # -> Minimum, Maximum
panel_7 = Panel(area_3.Area)
mesh_faces = GetMeshFaces()
subdivide = SubdivideMesh(Level=1, Type=0)
shapes = BitmapShapes()  # -> Circles, Triangles, Quadrilaterals
smaller_3 = SmallerThan(FirstNumber=area_3.Area, SecondNumber=extremums_3.Maximum)  # -> SmallerThan, OrEqualTo
neighbor_faces = GetNeighboringFaces(FaceIndex=0, ToggleExtractionMode=True)  # -> Mesh, ExtractedFaceIndex
color_vertices = ColorMeshVerticesRandomly(Rs=5, Re=250, Gs=5, Ge=250, Bs=5, Be=250)
image_3 = ImageSampler(Filter="Colour", Interpolate=False, Umax=1, Umin=0, Vmax=1, Vmin=0, Wrap=1)
scale = ScaleImage(Mode=0, Scale=1)  # -> Image, Filter
cull_9 = CullPattern(List=join_3, CullPattern=smaller_3.SmallerThan)
incurves_3 = PointInCurves(Point=center_3.Center, Curves=cull_9)  # -> Relationship, Index, Point
linkdashboard_3dtext = LINKDashboard3dText(FontSize=-1, Color=RGB(0, 0, 0))
equals_7 = Equality(FirstNumber=incurves_3.Relationship, SecondNumber="0")  # -> Equality, Inequality
equals_8 = Equality(FirstNumber=incurves_3.Relationship, SecondNumber="1")  # -> Equality, Inequality
color_faces = ColorMeshFacesRandomly(Rs=5, Re=250, Gs=5, Ge=250, Bs=5, Be=250)
equals_9 = Equality(FirstNumber=incurves_3.Relationship, SecondNumber="2")  # -> Equality, Inequality
panel_10 = Panel("2")
corners = BitmapCorners(Mode=0, Threshold=1, Value=1)
gradient_4 = Gradient(LowerLimit=0, UpperLimit=1, Parameter=incurves_3.Relationship, stops=[0: RGB(84, 0, 0), 1: RGB(220, 0, 40)])
blob = FilterBlob(Width=Domain(1, 100), Height=Domain(1, 100), Unique=False, Blobs=False, Coupled=False)  # -> Image, Filter
cull_10 = CullPattern(List=mesh_uv_2, CullPattern=equals_8.Equality)
linkdashboard_export = LINKDashboardExport()
cull_11 = CullPattern(List=mesh_uv_2, CullPattern=equals_9.Equality)
cull_12 = CullPattern(List=mesh_uv_2, CullPattern=equals_7.Equality)
linkdashboard_piechart = LINKDashboardPiechart()
polar = PolarImage(Angle=0, Pinch=0, To=True)  # -> Image, Filter
mcol_6 = MeshColours(Mesh=cull_12, Colours=ColourSwatch(SwatchColor=RGB(255, 0, 0)))
mcol_7 = MeshColours(Mesh=[cull_11, cull_10], Colours=ColourSwatch(SwatchColor=RGB(90, 0, 0)))
mcol_8 = MeshColours(Mesh=graft(mesh_uv_2), Colours=gradient_4)
mjoin_3 = MeshJoin(Meshes=[mcol_7, mcol_6])
