# Grasshopper definition rgb encoding.gh (Grasshopper 1.0.7)
# Copyright: 2017
# plug-ins: Heteroptera, MetaHopper, Pufferfish, Wallacei, LunchBox, Kangaroo2 Components, MeshEdit Components, eleFront

# ----
# EPW FILE
# General input
epw_file_path_barcelona = Panel("https://climate.onebuilding.org/WMO_Region_1_Africa/EGY_Egypt/QH_Al_Qahirah_Cairo/EGY_QH_Cairo.Intl.AP.623660_TMYx.zip")
epw_filepath = Data(epw_file_path_barcelona)

hb_building_programs = HBBuildingPrograms({"LargeOffice", "MediumOffice", "SmallOffice", "MidriseApartment", "HighriseApartment", "Retail", "StripMall", "PrimarySchool", "SecondarySchool", "SmallHotel", "LargeHotel", "Hospital", "Outpatient", "Laboratory", "Warehouse", "SuperMarket", "FullServiceRestaurant", "QuickServiceRestaurant", "Courthouse", "LargeDataCenterHighITE", "LargeDataCenterLowITE", "SmallDataCenterHighITE", "SmallDataCenterLowITE"}, selected="LargeOffice")

# ----
# Set Up ROOM or ZONE
number_slider = Slider(6, range=0..10)
domain_box = DomainBox(Base=PlaneXY(0, 0, 0), X=Slider(6.8, range=0..10), Y=number_slider, Z=Slider(3, range=0..10))
volume = Volume(Geometry=domain_box)  # -> Volume, Centroid
panel = Panel(volume.Volume)
# Room Related
roomsolid = HBRoomFromSolid(geo=flatten(domain_box), program=hb_building_programs, conditioned=True)  # -> out, rooms; plug-in component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

vt = Slider(0.8, range=0..1)
# Material Set up
panel_2 = Panel("glazing")
windowmat = HBWindowMaterial(name=panel_2, u_factor=Slider(5.7, range=0.8..5.7), shgc=Slider(0.2, range=0..1), t_vis=vt)  # -> mat; plug-in component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
windowconstr = HBWindowConstruction(name=panel_2, materials=windowmat)  # -> constr; plug-in component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

opaquemat = HBOpaqueMaterial(name="interior_Walls_MT")  # -> mat; plug-in component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
opaqueconstr = HBOpaqueConstruction(name="interior_Walls_MT", materials=opaquemat)  # -> constr; plug-in component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

opaquemat_2 = HBOpaqueMaterial(name="roof_MT")  # -> mat; plug-in component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
opaqueconstr_2 = HBOpaqueConstruction(name="roof_MT", materials=opaquemat_2)  # -> constr; plug-in component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

opaquemat_3 = HBOpaqueMaterial(name="floor_MT")  # -> mat; plug-in component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
opaqueconstr_3 = HBOpaqueConstruction(name="floor_MT", materials=opaquemat_3)  # -> constr; plug-in component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

opaquemat_4 = HBOpaqueMaterial(name="Exterior_Walls_MT")  # -> mat; plug-in component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
opaqueconstr_4 = HBOpaqueConstruction(name="Exterior_Walls_MT", materials=opaquemat_4)  # -> constr; plug-in component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

set_group_properties = SetGroupProperties(
    Group=["Grasshopper.Kernel.Types.GH_ObjectWrapper", "Grasshopper.Kernel.Types.GH_ObjectWrapper", "Grasshopper.Kernel.Types.GH_ObjectWrapper", "Grasshopper.Kernel.Types.GH_ObjectWrapper", "Grasshopper.Kernel.Types.GH_ObjectWrapper", "Grasshopper.Kernel.Types.GH_ObjectWrapper", "Grasshopper.Kernel.Types.GH_ObjectWrapper", "Grasshopper.Kernel.Types.GH_ObjectWrapper", "Grasshopper.Kernel.Types.GH_ObjectWrapper", "Grasshopper.Kernel.Types.GH_ObjectWrapper", "Grasshopper.Kernel.Types.GH_ObjectWrapper", "Grasshopper.Kernel.Types.GH_ObjectWrapper", "Grasshopper.Kernel.Types.GH_ObjectWrapper"],
    Color=ColourSwatch(SwatchColor=RGBA(120, 120, 120, 88)))

# ----
# Weather file
epw_filepath_2 = Data(epw_filepath)
downloadepw = LBDownloadWeather(weather_URL=epw_filepath_2)  # -> epw_file, stat_file, ddy_file; plug-in component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

pt = Point(Point(-2.722291582, 0.2658342869, 0))
northarrow = Ladybug_North(centerPt=pt, scale=Slider(0.1, range=0..0.1))  # -> northSign; plug-in component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

aperture = HBAperture()  # -> out, apertures; plug-in component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
face = HBFace()  # -> out, faces; plug-in component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

# ----
# plane to analyze
deconstruct_brep = DeconstructBrep(Brep=domain_box)  # -> Faces, Edges, Vertices
center = Center(Geometry=deconstruct_brep.Faces)  # -> Center, Dimension
deconstruct = Deconstruct(Point=center.Center)  # -> XComponent, YComponent, ZComponent
smaller_than = SmallerThan(FirstNumber=deconstruct.ZComponent, SecondNumber=Slider(0.02, range=0..0.1))  # -> SmallerThan, OrEqualTo
cull_pattern = CullPattern(List=deconstruct_brep.Faces, CullPattern=smaller_than.SmallerThan)

number_slider_2 = Slider(0, range=0..5)
hb_construction_types = HBConstructionTypes({"SteelFramed", "WoodFramed", "Mass", "Metal Building"}, selected="SteelFramed")
srf = Surface(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)

# ----
# Comfort param
adaptpar = LBAdaptiveComfortParameters()  # -> adapt_par; plug-in component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
solarbodypar = LBSolarBodyParameters()  # -> sol_body_par; plug-in component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

number_slider_3 = Slider(13, range=0..23)
number_slider_4 = Slider(1, range=1..31)
number_slider_5 = Slider(12, range=0..23)
analysisperiod = LBAnalysisPeriod(
    start_month=Slider(6, range=1..12),
    start_day=number_slider_4,
    start_hour=number_slider_5,
    end_month=Slider(12, range=1..12),
    end_day=number_slider_4,
    end_hour=number_slider_5)  # -> period, hoys, dates; plug-in component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
data_dam = DataDam(BufferDelay=10000000, BufferMode=0)  # -> DataDataA, DataA, DataB, DataC, DataD, DataE

control_wire_display = ControlWireDisplay(
    WireDisplay=2,
    AllObjects_Object=[adaptivemap, pmvmap, vizthermalmap_2, toggle_7, xmatrix_3, item_8, number_slider_16, hourlyplot_3, pt_4, item_9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])

# ---- group: ARE YOU SURE ?
toggle = BooleanToggle(True)
toggle_2 = BooleanToggle(False)  # disabled
toggle_3 = BooleanToggle(False)  # disabled

# ----
srf_2 = Surface(<surface referenced from the Rhino model>)
brep = Brep(<brep referenced from the Rhino model>)
list_item = ListItem(List=brep, Index=Slider(1, range=0..5), Wrap=True)
number_slider_6 = Slider(30, range=0..100)
number_slider_7 = Slider(30, range=0..100)
datadt = LBDataDateTimes()  # -> hoys; plug-in component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
quads = QuadPanels(Surface=brep, UDivisions=number_slider_6, VDivisions=number_slider_7)
legendpar = LBLegendParameters(min="28", max="30")  # -> leg_par; plug-in component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
center_2 = Center(Geometry=quads)  # -> Center, Dimension
deconstruct_2 = Deconstruct(Point=center_2.Center)  # -> XComponent, YComponent, ZComponent
dom = ConstructDomain(DomainStart="10", DomainEnd="255")
bnd = Bounds(Numbers=deconstruct_2.YComponent)
remap = RemapNumbers(Value=deconstruct_2.YComponent, Source=bnd, Target=dom)  # -> Mapped, Clipped
int = Integer(remap.Mapped)
concat = Concatenate(FragmentA="0", FragmentB=",", FragmentC="0", FragmentD=",", FragmentE=int)
mesh_colours = MeshColours(Colours=[RGB(127, 255, 0), RGB(0, 100, 0), RGB(34, 139, 34), RGB(124, 252, 0), RGB(154, 205, 50), RGB(173, 255, 47), RGB(50, 205, 50), RGB(152, 251, 152)])
color = DefineColor(Color=concat, Source="object")
number_slider_8 = Slider(3.076, range=0..10)
multiplication = Multiplication(A=number_slider_8, B=Slider(2.716, range=0..10))
multiplication_2 = Multiplication(A=multiplication, B=1.5)
unit_y = UnitY(Factor=multiplication_2)
negative = Negative(Value=unit_y)
unit_y_2 = UnitY(Factor=number_slider_8)
unit_y_3 = UnitY(Factor=multiplication)
negative_2 = Negative(Value=unit_y_2)
negative_3 = Negative(Value=unit_y_3)

# ----
# Opening Parameters
ratio_to_the_elevation = Slider(0.46, range=0..1)
horizontal_spacing_between = Slider(2, range=0..10)
window_height = Slider(2, range=0..10)
sill_height = Slider(0.5, range=-0.5..2)
vertical_spacing_between = Slider(0, range=0..10)

# ----
# Windows
facparam = HBFacadeParameters(north=0, east=0, south=ratio_to_the_elevation, west=0)  # -> fac_par; plug-in component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
aperturesbyratio = HBAperturesByRatio(
    hb_objs=flatten(roomsolid.rooms),
    ratio=facparam,
    subdivide=Slider(3, range=0..10),
    win_height=window_height,
    sill_height=sill_height,
    horiz_separ=horizontal_spacing_between,
    vert_separ=vertical_spacing_between)  # -> out, hb_objs; plug-in component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

# ----
# Skylight
ratio_to_the_elevation_2 = Slider(0.21, range=0..1)
skylightsbyratio = HBSkylightsByRatio(hb_objs=flatten(aperturesbyratio.hb_objs), ratio=ratio_to_the_elevation_2)  # -> out, hb_objs; plug-in component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
vizwiref = HBVisualizeWireframe(hb_objs=flatten(skylightsbyratio.hb_objs))  # -> geo; plug-in component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

number_slider_9 = Slider(16, range=2..16)
panel_3 = Panel("""0
-1""")
division = Division(A=2.4, B=number_slider_9)
panel_4 = Panel("""0
1""")

# ----
# Facade as a shader
number_slider_10 = Slider(0, range=0..5)
viznorm = HBVisualizeNormals(hb_objs=roomsolid.rooms)  # -> points, vectors; plug-in component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
list_item_2 = ListItem(List=deconstruct_brep.Faces, Index=number_slider_10, Wrap=True)
list_item_3 = ListItem(List=viznorm.vectors, Index=number_slider_10, Wrap=True)
amplitude = Amplitude(Vector=list_item_3, Amplitude=Slider(1.68, range=0..2))
move = Move(Geometry=list_item_2, Motion=amplitude)  # -> Geometry, Transform
center_3 = Center(Geometry=list_item_2)  # -> Center, Dimension
center_4 = Center(Geometry=move.Geometry)  # -> Center, Dimension
distance = Distance(PointA=center_3.Center, PointB=center_4.Center)

srf_3 = Surface(move.Geometry)
quads_2 = QuadPanels(Surface=srf_3, UDivisions=number_slider_6, VDivisions=number_slider_7)
mesh_colours_2 = MeshColours(Mesh=quads_2, Colours=color)
move_2 = Move(Geometry=mesh_colours_2, Motion=negative_2)  # -> Geometry, Transform
demesh = DeconstructMesh(Mesh=move_2.Geometry)  # -> Vertices, Faces, Colours, Normals
panel_5 = Panel(demesh.Colours)
split = TextSplit(Text=demesh.Colours, Separators=",")
panel_6 = Panel(split)
item = ListItem(List=split, Index="2", Wrap=True)

sframes = SurfaceFrames(Surface=move.Geometry, UCount=number_slider_9, VCount=number_slider_9)  # -> Frames, Parameters
cull_i = CullIndex(List=sframes.Frames, Indices=panel_3, Wrap=True)
flip = FlipMatrix(Data=cull_i)
cull_i_2 = CullIndex(List=flip, Indices=panel_3, Wrap=True)  # -> flatten(List)
cull = CullPattern(List=cull_i_2, CullPattern=panel_4)
cir = Circle(Plane=cull, Radius=division)
# Skin
srfsplit = SurfaceSplit(Surface=move.Geometry, Curves=cir)
srf_sl = SrfSmallLarge(srf_list=srfsplit)  # -> smallest, largest
srf_4 = Surface(srf_sl.smallest)
area = Area(Geometry=srf_4)  # -> Area, Centroid
mass_addition = MassAddition(Input=area.Area)  # -> Result, PartialResults

srf_5 = Surface(srf_sl.largest)
shade = HBShade(geo=srf_5)  # -> out, shades; plug-in component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

decnstrobj = HBDeconstructObject(hb_obj=aperturesbyratio.hb_objs)  # -> faces, apertures, doors, shades; plug-in component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
vizquick = HBVisualizeQuick(hb_objs=flatten(decnstrobj.apertures))  # -> geo; plug-in component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
aperture_2 = HBAperture(geo=vizquick)  # -> out, apertures; plug-in component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

geometry = Geometry(vizquick)
center_5 = Center(Geometry=geometry)  # -> Center, Dimension
list_item_4 = ListItem(List=center_5.Center, Index=0, Wrap=True)  # -> Item, Item1, Item2
distance_2 = Distance(PointA=list_item_4.Item, PointB=area.Centroid)
distance_3 = Distance(PointA=list_item_4.Item1, PointB=area.Centroid)
distance_4 = Distance(PointA=list_item_4.Item2, PointB=area.Centroid)

list_item_5 = ListItem(List=decnstrobj.faces, Index=number_slider_2, Wrap=True)
cull_index = CullIndex(List=decnstrobj.faces, Indices=number_slider_2, Wrap=True)
vizquick_2 = HBVisualizeQuick(hb_objs=flatten(list_item_5))  # -> geo; plug-in component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

vizquick_3 = HBVisualizeQuick(hb_objs=flatten(cull_index))  # -> geo; plug-in component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
face_2 = HBFace(geo=vizquick_2)  # -> out, faces; plug-in component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

face_3 = HBFace(geo=vizquick_3, bc="adiabatic")  # -> out, faces; plug-in component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

# ----
# Model
model = HBModel(faces=flatten([face_2.faces, face_3.faces]), shades=flatten(shade.shades), apertures=flatten(aperture_2.apertures))  # -> out, model; plug-in component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

dam = DataDam(DataA=model.model, BufferDelay=10000000, BufferMode=0)

# ----
# Sensor Grid
number_slider_11 = Slider(0.5, range=0..10)
genpts = LBGeneratePointGrid(geometry=cull_pattern, grid_size=number_slider_11)  # -> points, vectors, face_areas, mesh; plug-in component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
points = Data(genpts.points)
sensorgrid = HBSensorGrid(positions=points)  # -> grid; plug-in component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
assigngridsviews = HBAssignGridsAndViews(model=dam, grids=flatten(sensorgrid))  # -> model; plug-in component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

vizall = HBVisualizeAll(hb_objs=flatten(dam))  # -> geo; plug-in component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
vizwiref_2 = HBVisualizeWireframe(hb_objs=flatten(dam))  # -> geo; plug-in component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

# ----
# Faces labels
hb_face_attributes = HBFaceAttributes({"Display Name": "display_name", "Simulation Name (Identifier)": "identifier", "Boundary Condition": "boundary_condition", "Has Parent": "has_parent", "Parent": "parent", "Azimuth": "azimuth", "Altitude": "altitude", "Area": "area", "Perimeter": "perimeter", "Face Type": "type", "Aperture Is Operable": "is_operable", "Door Is Glass": "is_glass"}, selected="Boundary Condition")
lablefaces = HBLabelFaces(hb_objs=flatten(dam), attribute=hb_face_attributes)  # -> label_text, base_pts, labels, wire_frame; plug-in component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

# ----
# Visualize
vizbytype = HBVisualizeByType(hb_objs=dam)  # -> walls, interior_walls, roofs, ceilings, exterior_floors, interior_floors, air_walls, apertures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; plug-in component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
vizwiref_3 = HBVisualizeWireframe(hb_objs=flatten(dam))  # -> geo; plug-in component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

data_dam_2 = DataDam(
    DataDataA=assigngridsviews,
    DataA=downloadepw.epw_file,
    DataB=downloadepw.ddy_file,
    DataC=analysisperiod.period,
    DataD=adaptpar,
    DataE=toggle_2,
    BufferDelay=10000000,
    BufferMode=0)  # -> DataDataA, DataA, DataB, DataC, DataD, DataE; disabled
# PMV
pmvmap = HBPMVComfortMap(
    model=data_dam_2.DataDataA,
    epw=data_dam_2.DataA,
    ddy=data_dam_2.DataB,
    run_period=data_dam_2.DataC,
    comfort_par=data_dam_2.DataD,
    run=data_dam_2.DataE)  # -> out, env_conds, temperature, condition, pmv, TCP, HSP, CSP; disabled; plug-in component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
toggle_4 = BooleanToggle(True)  # disabled
thermalmtx = HBReadThermalMatrix(comf_result=pmvmap.pmv, load=toggle_4)  # -> comf_mtx; disabled; plug-in component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

window = Surface(vizquick_2)
srf_6 = Surface(window)
srf_7 = Surface(vizquick)
join = BrepJoin(Breps=[srf_6, srf_7])  # -> Breps, Closed
debrep = DeconstructBrep(Brep=window)  # -> Faces, Edges, Vertices
crv = Curve(debrep.Edges)
join_2 = JoinCurves(Curves=crv, Preserve=False)
mesh_uv = MeshSurface(Surface=join.Breps, UCount=Slider(92, range=0..100), VCount=Slider(88, range=0..100), Overhang=True, Equalize=False)
area_2 = Area(Geometry=join_2)  # -> Area, Centroid
explode = MeshExplode(Mesh=mesh_uv, Interpolate=False)
extremums = MinMax(Number=area_2.Area)  # -> Minimum, Maximum
panel_7 = Panel(area_2.Area)
smaller = SmallerThan(FirstNumber=area_2.Area, SecondNumber=extremums.Maximum)  # -> SmallerThan, OrEqualTo
cull_2 = CullPattern(List=join_2, CullPattern=smaller.SmallerThan)
center_6 = Center(Geometric=explode)  # -> Center, Dimension
incurves = PointInCurves(Point=center_6.Center, Curves=cull_2)  # -> Relationship, Index, Point
equals = Equality(FirstNumber=incurves.Relationship, SecondNumber="2")  # -> Equality, Inequality
equals_2 = Equality(FirstNumber=incurves.Relationship, SecondNumber="0")  # -> Equality, Inequality
equals_3 = Equality(FirstNumber=incurves.Relationship, SecondNumber="1")  # -> Equality, Inequality
cull_3 = CullPattern(List=explode, CullPattern=equals_3.Equality)
cull_4 = CullPattern(List=explode, CullPattern=equals.Equality)
cull_5 = CullPattern(List=explode, CullPattern=equals_2.Equality)
mcol = MeshColours(Mesh=[cull_4, cull_3], Colours=ColourSwatch(SwatchColor=RGB(90, 0, 0)))
mcol_2 = MeshColours(Mesh=cull_5, Colours=ColourSwatch(SwatchColor=RGB(255, 0, 0)))
mjoin = MeshJoin(Meshes=[mcol, mcol_2])

window_2 = Surface(srf_5)
srf_8 = Surface(window)
srf_9 = Surface(vizquick)
join_3 = BrepJoin(Breps=[srf_8, srf_9])  # -> Breps, Closed
debrep_2 = DeconstructBrep(Brep=window_2)  # -> Faces, Edges, Vertices
crv_2 = Curve(debrep_2.Edges)
join_4 = JoinCurves(Curves=crv_2, Preserve=False)
mesh_uv_2 = MeshSurface(Surface=join_3.Breps, UCount=Slider(92, range=0..100), VCount=Slider(88, range=0..100), Overhang=True, Equalize=False)
area_3 = Area(Geometry=join_4)  # -> Area, Centroid
explode_2 = MeshExplode(Mesh=mesh_uv_2, Interpolate=False)
extremums_2 = MinMax(Number=area_3.Area)  # -> Minimum, Maximum
panel_8 = Panel(area_3.Area)
smaller_2 = SmallerThan(FirstNumber=area_3.Area, SecondNumber=extremums_2.Maximum)  # -> SmallerThan, OrEqualTo
cull_6 = CullPattern(List=join_4, CullPattern=smaller_2.SmallerThan)
center_7 = Center(Geometric=explode_2)  # -> Center, Dimension
incurves_2 = PointInCurves(Point=center_7.Center, Curves=cull_6)  # -> Relationship, Index, Point
equals_4 = Equality(FirstNumber=incurves_2.Relationship, SecondNumber="2")  # -> Equality, Inequality
equals_5 = Equality(FirstNumber=incurves_2.Relationship, SecondNumber="0")  # -> Equality, Inequality
equals_6 = Equality(FirstNumber=incurves_2.Relationship, SecondNumber="1")  # -> Equality, Inequality
cull_7 = CullPattern(List=explode_2, CullPattern=equals_6.Equality)
cull_8 = CullPattern(List=explode_2, CullPattern=equals_4.Equality)
cull_9 = CullPattern(List=explode_2, CullPattern=equals_5.Equality)
mcol_3 = MeshColours(Mesh=cull_9, Colours=ColourSwatch(SwatchColor=RGB(0, 255, 0)))
mcol_4 = MeshColours(Mesh=[cull_8, cull_7], Colours=ColourSwatch(SwatchColor=RGB(0, 90, 0)))
mjoin_2 = MeshJoin(Meshes=[mcol_4, mcol_3])

move_3 = Move(Geometry=mjoin, Motion=negative_3)  # -> Geometry, Transform
move_4 = Move(Geometry=mjoin_2, Motion=negative)  # -> Geometry, Transform
demesh_2 = DeconstructMesh(Mesh=move_3.Geometry)  # -> Vertices, Faces, Colours, Normals
demesh_3 = DeconstructMesh(Mesh=move_4.Geometry)  # -> Vertices, Faces, Colours, Normals
panel_9 = Panel(demesh_2.Colours)
panel_10 = Panel(demesh_3.Colours)
split_2 = TextSplit(Text=demesh_3.Colours, Separators=",")
split_3 = TextSplit(Text=demesh_2.Colours, Separators=",")
panel_11 = Panel(split_3)
panel_12 = Panel(split_2)
item_2 = ListItem(List=split_3, Index="0", Wrap=True)
item_3 = ListItem(List=split_2, Index="1", Wrap=True)
concat_2 = Concatenate(FragmentA=item_2, FragmentB=",", FragmentC=item_3, FragmentD=",", FragmentE=item)
panel_13 = Panel(concat_2)
conmesh = ConstructMesh(Vertices=demesh_3.Vertices, Faces=demesh_2.Faces, Colours=flatten(concat_2))

srf_10 = Surface(srf_sl.largest)
importloc = LBImportLocation(epw_file=downloadepw.epw_file)  # -> location; plug-in component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
sunpath = LBSunPath(location=importloc, hoys=analysisperiod.hoys, scale=1)  # -> out, vectors, altitudes, azimuths, hoys, sun_pts, analemma, daily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; plug-in component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
grid_sensor_points = Point(genpts.points)
sun_points = Point(sunpath.sun_pts)
removeduplicatepts = RemoveDuplicatePts(Points=sun_points, Tolerance=Slider(1, range=0..1))
line = Line(StartPoint=removeduplicatepts, EndPoint=grid_sensor_points)

# ----
# Entering the room through the window
surface_line = SurfaceLine(Surface=graft(geometry), Line=line, LimitToFirst=False)  # -> Curves, Points, UVPoints, Normal

# ----
# Points Blocked by the skin
surface_line_2 = SurfaceLine(Surface=graft(srf_10), Line=line, LimitToFirst=False)  # -> Curves, Points, UVPoints, Normal

list_length = ListLength(List=flatten(surface_line.Points))
list_length_2 = ListLength(List=flatten(surface_line_2.Points))

area_4 = Area(Geometry=srf_5)  # -> Area, Centroid

mass_addition_2 = MassAddition(Input=flatten([area.Area, area_4.Area]))  # -> Result, PartialResults

division_2 = Division(A=mass_addition.Result, B=mass_addition_2.Result)
multiplication_3 = Multiplication(A=division_2, B=100)

division_3 = Division(A=area_4.Area, B=mass_addition_2.Result)
multiplication_4 = Multiplication(A=division_3, B=100)

# ----
# Objectives
perforations_percentage = Data(multiplication_3)
solid_percentage = Data(multiplication_4)
points_entering_the_room = Data(list_length)
proints_blocked = Data(list_length_2)

# ----
# UTCI
utcimap = HBUTCIComfortMap(
    model=assigngridsviews,
    epw=downloadepw.epw_file,
    ddy=downloadepw.ddy_file,
    run_period=analysisperiod.period,
    comfort_par=adaptpar,
    run=toggle)  # -> report, env_conds, utci, condition, category, TCP, HSP, CSP; plug-in component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
thermalmtx_2 = HBReadThermalMatrix(comf_result=utcimap.utci, load=Toggle(True))  # -> comf_mtx; plug-in component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
xmatrix = LBDeconstructMatrix(matrix=flatten(thermalmtx_2))  # -> values; plug-in component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
number_slider_12 = Slider(157, range=0..1000)
xdata = LBDeconstructData(data=xmatrix)  # -> header, values; plug-in component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
points_2 = Data(points)
item_4 = ListItem(List=xmatrix, Index=number_slider_12, Wrap=True)
item_5 = ListItem(List=points_2, Index=number_slider_12, Wrap=True)
avr = Average(Input=xdata.values)  # -> flatten(ArithmeticMean)
pt_2 = Point(Point(93.14477679, -19.53288665, 0))
meshselector = LBMeshThresholdSelector(values=avr, mesh=genpts.mesh)  # -> report, total_value, total_area, sub_mesh, outline; plug-in component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
hourlyplot = LBHourlyPlot(data=item_4, base_pt=pt_2, y_dim=Slider(2, range=0..100))  # -> report, mesh, legend, borders, labels, title, vis_set; plug-in component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

# ----
# Adpative thermal comfort
# Visualization
data_dam_3 = DataDam(
    DataDataA=assigngridsviews,
    DataA=downloadepw.epw_file,
    DataB=downloadepw.ddy_file,
    DataC=analysisperiod.period,
    DataD=adaptpar,
    DataE=toggle_3,
    BufferDelay=10000000,
    BufferMode=0)  # -> DataDataA, DataA, DataB, DataC, DataD, DataE; disabled
adaptivemap = HBAdaptiveComfortMap(
    model=data_dam_3.DataDataA,
    epw=data_dam_3.DataA,
    ddy=data_dam_3.DataB,
    run_period=data_dam_3.DataC,
    comfort_par=data_dam_3.DataD,
    run=data_dam_3.DataE)  # -> out, env_conds, op_temp, condition, deg_neut, TCP, HSP, CSP; disabled; plug-in component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
toggle_5 = BooleanToggle(True)  # disabled
thermalmtx_3 = HBReadThermalMatrix(comf_result=adaptivemap.TCP, load=toggle_5)  # -> comf_mtx; disabled; plug-in component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
xmatrix_2 = LBDeconstructMatrix(matrix=flatten(thermalmtx_3))  # -> values; disabled; plug-in component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
number_slider_13 = Slider(157, range=0..1000)  # disabled
xdata_2 = LBDeconstructData(data=xmatrix_2)  # -> header, values; disabled; plug-in component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
points_3 = Data(points)  # disabled
number_slider_14 = Slider(2, range=0..100)  # disabled
item_6 = ListItem(List=xmatrix_2, Index=number_slider_13, Wrap=True)  # disabled
item_7 = ListItem(List=points_3, Index=number_slider_13, Wrap=True)  # disabled
avr_2 = Average(Input=xdata_2.values)  # -> flatten(ArithmeticMean); disabled
panel_14 = Panel("2")  # disabled
pt_3 = Point(Point(93.14477679, -19.53288665, 0))  # disabled
round_to_decimal_place = RoundToDecimalPlace(NumberX=avr_2, DecimalPlace=panel_14, RoundType=0)  # -> Rounded, Difference; disabled
number_slider_15 = Slider(0.1, range=0..0.1)  # disabled
vizthermalmap = HBVisualizeThermalMap(comf_mtx=thermalmtx_2, mesh=flatten(genpts.mesh))  # -> report, mesh, legend, title, colors, values; disabled; plug-in component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
meshselector_2 = LBMeshThresholdSelector(values=avr_2, mesh=genpts.mesh)  # -> report, total_value, total_area, sub_mesh, outline; disabled; plug-in component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
hourlyplot_2 = LBHourlyPlot(data=item_6, base_pt=pt_3, y_dim=number_slider_14)  # -> report, mesh, legend, borders, labels, title, vis_set; disabled; plug-in component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
swatch = ColourSwatch(SwatchColor=RGB(0, 0, 0))  # disabled
toggle_6 = GroupToggle(ToggleActive=True, ToggleVisible=False)  # disabled
tag = TextTag3D(Location=points_3, Text=round_to_decimal_place.Rounded, Size=number_slider_15, Colour=swatch, Justification=7)  # disabled

# ----
# Visualization
xmatrix_3 = LBDeconstructMatrix(matrix=flatten(thermalmtx))  # -> values; disabled; plug-in component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
number_slider_16 = Slider(157, range=0..1000)  # disabled
xdata_3 = LBDeconstructData(data=xmatrix_3)  # -> header, values; disabled; plug-in component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
points_4 = Data(points)  # disabled
number_slider_17 = Slider(2, range=0..100)  # disabled
item_8 = ListItem(List=xmatrix_3, Index=number_slider_16, Wrap=True)  # disabled
item_9 = ListItem(List=points_4, Index=number_slider_16, Wrap=True)  # disabled
avr_3 = Average(Input=xdata_3.values)  # -> flatten(ArithmeticMean); disabled
panel_15 = Panel("2")  # disabled
pt_4 = Point(Point(93.14477679, -19.53288665, 0))  # disabled
round_to_decimal_place_2 = RoundToDecimalPlace(NumberX=avr_3, DecimalPlace=panel_15, RoundType=0)  # -> Rounded, Difference; disabled
number_slider_18 = Slider(0.1, range=0..0.1)  # disabled
vizthermalmap_2 = HBVisualizeThermalMap(comf_mtx=thermalmtx_2, mesh=flatten(genpts.mesh))  # -> report, mesh, legend, title, colors, values; disabled; plug-in component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
meshselector_3 = LBMeshThresholdSelector(values=avr_3, mesh=genpts.mesh)  # -> report, total_value, total_area, sub_mesh, outline; disabled; plug-in component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
hourlyplot_3 = LBHourlyPlot(data=item_8, base_pt=pt_4, y_dim=number_slider_17)  # -> report, mesh, legend, borders, labels, title, vis_set; disabled; plug-in component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
swatch_2 = ColourSwatch(SwatchColor=RGB(0, 0, 0))  # disabled
toggle_7 = GroupToggle(ToggleActive=True, ToggleVisible=False)  # disabled
tag_2 = TextTag3D(Location=points_4, Text=round_to_decimal_place_2.Rounded, Size=number_slider_18, Colour=swatch_2, Justification=7)  # disabled

round_to_decimal_place_3 = RoundToDecimalPlace(NumberX=avr, DecimalPlace="2", RoundType=0)  # -> Rounded, Difference

# ---- group: Main preview
vizthermalmap_3 = HBVisualizeThermalMap(comf_mtx=thermalmtx_2, mesh=flatten(genpts.mesh))  # -> report, mesh, legend, title, colors, values; plug-in component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
toggle_8 = GroupToggle(ToggleActive=True, ToggleVisible=False)  # disabled

# ----
tag_3 = TextTag3D(
    Location=points_2,
    Text=round_to_decimal_place_3.Rounded,
    Size=Slider(0.1, range=0..0.1),
    Colour=ColourSwatch(SwatchColor=RGB(0, 0, 0)),
    Justification=7)

utci_per_grid_cell = Data(round_to_decimal_place_3.Rounded)

data = Data(vizthermalmap_3.mesh)

# ----
# Iterative parameters or Different set of geometries
# Import your current geometry here !
wallacei_x = WallaceiX(
    Genes=number_slider_9,
    Objectives=[round_to_decimal_place_3.Rounded, multiplication_3],
    Phenotype=[vizwiref_2, vizthermalmap_3.mesh],
    allFitness="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",
    allFrontIdx="0|0;0|1;0|2;0|5;0|7;0|9",
    allGenomes="7_4_11_17_15_11_9_4_15_3",
    curFrontIdx="0|0;0|1;0|2;0|5;0|7;0|9",
    curFrontIdxSave="0|0;0|1;0|2;0|5;0|7;0|9",
    popGen="10,1",
    total="384953",
    wlcDone=True)  # -> WallaceiGenomes, FitnessValues, Data, Phenotypes
number_slider_19 = Slider(20, range=0..100)
# WALLACEI
distribute_to_grid = DistributeToGrid(
    FitnessValues=wallacei_x.FitnessValues,
    WallaceiPhenotypes=wallacei_x.Phenotypes,
    SizeOfTheGridInTheXDirection=number_slider_19,
    SizeOfTheGridInTheYDirection=number_slider_19,
    OutputOptions=0)  # -> DistributedFitnessValues, DistributedData, DistributedGeometries, DistributedMeshes, DistributedNumbers, GridLocations
data_2 = Data(distribute_to_grid.DistributedMeshes)
face_normals = FaceNormals(Mesh=data_2)  # -> Centers, Normals
tag_4 = TextTag3D(
    Location=face_normals.Centers,
    Text=round_to_decimal_place_3.Rounded,
    Size=Slider(0.1, range=0..0.1),
    Colour=ColourSwatch(SwatchColor=RGB(0, 0, 0)),
    Justification=7)

# ----
# Set a file path on your computer
number_slider_20 = Slider(10, range=0..100)  # disabled
panel_16 = Panel("Generation ")  # disabled
series = Series(Start=0, Step=1, Count=number_slider_20)  # disabled
panel_17 = Panel("UTCI SKIN TRIAL 01")  # disabled
concatenate = Concatenate(FragmentA=panel_16, FragmentB=series)  # disabled
# Export CSV
boolean_toggle = BooleanToggle(True)  # disabled
file_path = FilePath("D:\IAAC\Third semester\Studio\Studio_G04\Dataset 01 - Sheet1.csv")  # disabled
boolean_toggle_2 = BooleanToggle(False)  # disabled
excel_write = ExcelWrite(
    WriteExcelData=boolean_toggle,
    WorkbookPath=file_path,
    WorksheetName=panel_17,
    ColumnHeadings=concatenate,
    Data=wallacei_x.FitnessValues,
    ClearSheet=boolean_toggle_2)  # disabled

# ==== cluster SrfSmallLarge
srf_list = ClusterInput()
edges = BrepEdges(Brep=srf_list)  # -> Naked, Interior, NonManifold
len = Length(Curve=edges.Naked)
ma = MassAddition(Input=len)  # -> Result, PartialResults
pshift = ShiftPaths(Data=ma.Result, Offset=-1)
sort = SortList(Keys=pshift, ValuesA=srf_list)  # -> Keys, ValuesA
item = ListItem(List=reverse(sort.ValuesA), Index=0, Wrap=True)
cull_index = CullIndex(List=sort.ValuesA, Indices="-1", Wrap=True)
largest = ClusterOutput(item)
smallest = ClusterOutput(cull_index)
